# Grasshopper definition assembled_revit_Paulatest.gh (Grasshopper 1.0.7)
# plug-ins: eleFront, Speckle 2, Rhino.Inside for Autodesk Revit, Nautilus, Human

# ---- group: BIMSC-PROJECT
# Send a message to James M. to add
# new materials. This list will be updated
# for all groups to have a common material
# library and common material names.
panel = Panel("ELEMENTAL MARS")
bimsc_project = Text(panel)

# ---- group: RECEIVE MATERIALS
# RECIEVE
# MATERIALS
panel_2 = Panel("https://macad.speckle.xyz/projects/4975f9f0a8/models/d59a568f9e")
receive = Receive(
    Stream=panel_2,
    AutoReceive=False,
    CurrentComponentState="expired",
    ExpandOutput=True,
    LastInfoMessage="James McBennett @ 03/02/2024 01:57:29: Materials 01-03-2024 (id:6ecf38526e)",
    ReceiveOnOpen=False,
    ReceivedCommitId="6ecf38526e",
    StreamWrapper="https://macad.speckle.xyz/projects/4975f9f0a8/models/d59a568f9e",
    selectedKitName="Objects")  # -> Info, Materials
dso = DeconstructSpeckleObject(SpeckleObject=receive.Materials, selectedKitName="Objects")  # -> Inflatable, Regolith, Soil, Steel

# ---- group: FLOOR_LEVELS
# Set your 'Project' name, your 'Group'
# number, your 'Volume' Location that
# connect wirelessly.
series = Series(Start=0, Step=1, Count="5")
expression = Expression(x=series, Expression="Format(\"{0:00}\", x)")
concat = Concatenate(FragmentA="L", FragmentB=expression)  # -> simplify(graft(Result))
floor_levels = Text(concat)

# ----
# filter terrain
# add actual units
panel_3 = Panel("TopoBrep")  # disabled
panel_4 = Panel("Contours")  # disabled
panel_5 = Panel("TopoMesh")  # disabled
panel_6 = Panel("BakedStudioMarsTopoMain")  # disabled
list = ValueList({"AngularDimension", "Arc", "Block", "Brep", "Circle", "Curve", "Dimension", "Ellipse", "Extrusion", "Hatch", "Leader", "Line", "LinearDimension", "Mesh", "Point", "Polyline", "Polysurface", "RadialDimension", "Surface", "Text", "TextDot"}, selected="Mesh")  # disabled
reflay = ReferenceByLayer(LayerName=panel_4, lightweight=False)  # disabled
reflay_2 = ReferenceByLayer(LayerName=panel_3, lightweight=False)  # disabled
reflay_3 = ReferenceByLayer(LayerName=panel_5, lightweight=False)  # disabled
reflay_4 = ReferenceByLayer(LayerName=panel_6, lightweight=False)  # disabled
mesh = MeshBrep(
    Brep=reflay_2,
    Settings={GridMaxCount=0, GridMinCount=16, JaggedSeams=False, MaxEdgeLength=0, MinEdgeLength=0.0001, MinTolerance=0, Refine=True, RefineAngle=0, RelativeTolerance=0.65, SimplePlanes=True, Tolerance=0})  # disabled
filtertype = FilterByType(ObjectType=list, Geometry=reflay_4, invertFilter=False, returnNulls=False)  # -> ExcludedGeometry, IncludedGeometry; disabled
brep = Brep(reflay_2)  # disabled
mesh_2 = Mesh(reflay_3)  # disabled
faceb = FaceBoundaries(Mesh=mesh_2)  # disabled
mesh_3 = Mesh(filtertype.IncludedGeometry)  # disabled
faceb_2 = FaceBoundaries(Mesh=mesh_3)  # disabled
boundary = BoundarySurfaces(Edges=faceb)  # disabled
boundary_2 = BoundarySurfaces(Edges=faceb_2)  # disabled
join = BrepJoin(Breps=boundary)  # -> Breps, Closed; disabled
join_2 = BrepJoin(Breps=boundary_2)  # -> Breps, Closed; disabled

# ----
# ASSEMBLY PHASES
number_slider = Slider(8, range=1..8)
series_2 = Series(Start=1, Step=1, Count=number_slider)
item = ListItem(List=series_2, Index=0, Wrap=True)  # -> Item, Item1, Item2, Item3, Item4, Item5, Item6, Item7

# ---- group: BIMSC-ORIGINATOR
bimsc_originator = Text("G06")

# ---- group: WorksForBrepsAndMeshes
list_2 = ValueList({"Srf/Brep": 0, "Mesh": 1}, selected="Mesh")

# ---- group: BIMSC-VOLUME
bimsc_volume = Text("A4")

# ---- group: PHASE 1
num = Number(item.Item)

# ---- group: PHASE 2
num_2 = Number(item.Item1)

# ---- group: PHASE 3
num_3 = Number(item.Item2)

# ---- group: PHASE 4
num_4 = Number(item.Item3)

# ---- group: PHASE 5
num_5 = Number(item.Item4)

# ---- group: PHASE 6
num_6 = Number(item.Item5)

# ---- group: PHASE 7
num_7 = Number(item.Item6)

# ---- group: PHASE 8
num_8 = Number(item.Item7)

# ----
# UNITS
panel_7 = Panel("UnitsRawVolumes")
reflay_5 = ReferenceByLayer(LayerName=panel_7, lightweight=False)
volume = Volume(Geometry=reflay_5)  # -> Volume, Centroid
int = Integer(volume.Volume)
cset = CreateSet(List=int)  # -> Set, Map
cset_2 = CreateSet(List=cset.Map)  # -> Set, Map
mindex = MemberIndex(Set=cset.Map, Member=cset_2.Set)  # -> Index, Count
item_2 = ListItem(List=reflay_5, Index=mindex.Index, Wrap=True)  # -> simplify(Item)
bang = ExplodeTree(Data=item_2)  # -> Branch0, Branch1

# ----
# PHASE 2 (50P) - HUMANS / MACHINE COLLABORATION
panel_8 = Panel("")
# PHASE 1 (50p)- NO HUMANS
panel_9 = Panel("")

# ---- group: All Blocks for Pods
# UNITS BLOCKS
panel_10 = Panel("Default")
reflay_6 = ReferenceByLayer(LayerName=panel_10, lightweight=False)  # -> simplify(graft(Geometry))
block_info = GetBlockInfo(Block=reflay_6)  # -> Name, simplify(Plane), Transform, BlockType, FilePath, Active
pt = Point(block_info.Plane)

# ----
area = Area(Geometry=bang.Branch1)  # -> Area, Centroid
prox = Proximity3D(Points=area.Centroid, Group="2", MaxRadius="5")  # -> simplify(Links), Topology
clean = CleanTree(RemoveNulls=True, RemoveInvalid=True, RemoveEmpty=True, Tree=prox.Links)
tstat = TreeStatistics(Tree=clean)  # -> Paths, Length, Count
duplines = RemoveDuplicateLines(Lines=flatten(clean), Tolerance=0.01)  # -> graft(Lines)
split = SplitTree(Data=simplify(graft(bang.Branch1)), Masks=flatten(tstat.Paths))  # -> graft(Positive), flatten(Negative)

panel_11 = Panel(reflay_6)

# ---- group: All Blocks for Pods / Units Planes
bang_2 = ExplodeTree(Data=pt)  # -> Branch0, Branch1, Branch2

# ----
# ADD UNITS FLOOR
panel_12 = Panel("Floors")
reflay_7 = ReferenceByLayer(LayerName=panel_12, lightweight=False, DisableAutoUpdate=False)
mesh_4 = MeshBrep(
    Brep=reflay_7,
    Settings={GridMaxCount=0, GridMinCount=16, JaggedSeams=False, MaxEdgeLength=0, MinEdgeLength=0.0001, MinTolerance=0, Refine=True, RefineAngle=0, RelativeTolerance=0.65, SimplePlanes=True, Tolerance=0})
mjoin = MeshJoin(Meshes=mesh_4)
weld = WeldMesh(Mesh=mjoin, Angle=3.141592654)
brep_2 = Brep(reflay_7)
phase = Panel(num_2)
filter = StreamFilter(Gate=list_2, Stream0=brep_2, Stream1=weld)
name = ExtendSpeckleObject(
    SpeckleObject=filter,
    BIMSCPROJECT=bimsc_project,
    BIMSCORIGINATOR=bimsc_originator,
    BIMSCVOLUME=bimsc_volume,
    BIMSCTYPE="FLOORS",
    BIMSCMATERIAL="Regolith",
    RenderMaterial=dso.Regolith,
    BIMSCPHASE=phase,
    selectedKitName="Objects")  # -> flatten(ExtendedSpeckleObject)

# ----
# ADD COURTYARD PODS
panel_13 = Panel("Pods")
reflay_8 = ReferenceByLayer(LayerName=panel_13, lightweight=False, DisableAutoUpdate=False)
mesh_5 = MeshBrep(
    Brep=reflay_8,
    Settings={GridMaxCount=0, GridMinCount=16, JaggedSeams=False, MaxEdgeLength=0, MinEdgeLength=0.0001, MinTolerance=0, Refine=True, RefineAngle=0, RelativeTolerance=0.65, SimplePlanes=True, Tolerance=0})
brep_3 = Brep(reflay_8)
mjoin_2 = MeshJoin(Meshes=mesh_5)
weld_2 = WeldMesh(Mesh=mjoin_2, Angle=3.141592654)
filter_2 = StreamFilter(Gate=list_2, Stream0=brep_3, Stream1=weld_2)
phase_2 = Panel(num_3)
name_2 = ExtendSpeckleObject(
    SpeckleObject=filter_2,
    BIMSCPROJECT=bimsc_project,
    BIMSCORIGINATOR=bimsc_originator,
    BIMSCVOLUME=bimsc_volume,
    BIMSCTYPE="PODS",
    BIMSCMATERIAL="Regolith",
    RenderMaterial=dso.Regolith,
    BIMSCPHASE=phase_2,
    selectedKitName="Objects")  # -> flatten(ExtendedSpeckleObject)

# ----
# ADD WALLS
panel_14 = Panel("Wall")
reflay_9 = ReferenceByLayer(LayerName=panel_14, lightweight=False, DisableAutoUpdate=False)
mesh_6 = MeshBrep(
    Brep=reflay_9,
    Settings={GridMaxCount=0, GridMinCount=16, JaggedSeams=False, MaxEdgeLength=0, MinEdgeLength=0.0001, MinTolerance=0, Refine=True, RefineAngle=0, RelativeTolerance=0.65, SimplePlanes=True, Tolerance=0})
brep_4 = Brep(reflay_9)
mjoin_3 = MeshJoin(Meshes=mesh_6)
weld_3 = WeldMesh(Mesh=mjoin_3, Angle=3.141592654)
phase_3 = Panel(num_7)
filter_3 = StreamFilter(Gate=list_2, Stream0=brep_4, Stream1=weld_3)  # -> reverse(simplify(graft(Stream)))
name_3 = ExtendSpeckleObject(
    SpeckleObject=filter_3,
    BIMSCPROJECT=bimsc_project,
    BIMSCORIGINATOR=bimsc_originator,
    BIMSCVOLUME=bimsc_volume,
    BIMSCTYPE="WALLS",
    BIMSCMATERIAL="Regolith",
    RenderMaterial=dso.Regolith,
    BIMSCPHASE=phase_3,
    selectedKitName="Objects")

# ----
# ADD ROOF
panel_15 = Panel("Roof")
reflay_10 = ReferenceByLayer(LayerName=panel_15, lightweight=False, DisableAutoUpdate=False)
mesh_7 = Mesh(reflay_10)
faceb_3 = FaceBoundaries(Mesh=mesh_7)
boundary_3 = BoundarySurfaces(Edges=faceb_3)
join_3 = BrepJoin(Breps=boundary_3)  # -> Breps, Closed
mesh_8 = Mesh(reflay_10)
phase_4 = Panel(num_8)
filter_4 = StreamFilter(Gate=list_2, Stream0=join_3.Breps, Stream1=mesh_8)  # -> reverse(simplify(graft(Stream)))
name_4 = ExtendSpeckleObject(
    SpeckleObject=filter_4,
    BIMSCPROJECT=bimsc_project,
    BIMSCORIGINATOR=bimsc_originator,
    BIMSCVOLUME=bimsc_volume,
    BIMSCTYPE="ROOF",
    BIMSCMATERIAL="Inflatable",
    RenderMaterial=dso.Inflatable,
    BIMSCPHASE=phase_4,
    selectedKitName="Objects")

# ----
# SORTING UNITS BY VOLUME
end = EndPoints(Curve=simplify(duplines))  # -> Start, End
pdecon = Deconstruct(Point=[end.Start, end.End])  # -> XComponent, YComponent, ZComponent
int_2 = Integer(pdecon.ZComponent)
bnd = Bounds(Numbers=int_2)
dedomain = DeconstructDomain(Domain=bnd)  # -> Start, End
equals = Equality(FirstNumber=int_2, SecondNumber=dedomain.Start)  # -> Equality, Inequality
volume_2 = Volume(Geometry=split.Positive)  # -> Volume, simplify(flatten(Centroid))
cull = CullPattern(List=[end.Start, end.End], CullPattern=equals.Equality)
cp = ClosestPoint(Point=cull, Cloud=volume_2.Centroid)  # -> ClosestPoint, CPIndex, Distance
item_3 = ListItem(List=flatten(split.Positive), Index=cp.CPIndex, Wrap=True)
debrep = DeconstructBrep(Brep=item_3)  # -> Faces, Edges, Vertices
area_2 = Area(Geometry=debrep.Faces)  # -> Area, Centroid
pdecon_2 = Deconstruct(Point=area_2.Centroid)  # -> XComponent, YComponent, ZComponent
int_3 = Integer(pdecon_2.ZComponent)
bnd_2 = Bounds(Numbers=int_3)
dedomain_2 = DeconstructDomain(Domain=bnd_2)  # -> Start, End
equals_2 = Equality(FirstNumber=int_3, SecondNumber=dedomain_2.Start)  # -> Equality, Inequality
cull_2 = CullPattern(List=debrep.Faces, CullPattern=equals_2.Equality)  # -> simplify(List)
subtraction = Subtraction(A=dedomain.Start, B=dedomain.End)
wires = BrepWireframe(Brep=cull_2, Density=-1)
division = Division(A=subtraction, B="2")
abs = Absolute(Value=subtraction)
Z = UnitZ(Factor=division)
move = Move(Geometry=cull, Motion=Z)  # -> Geometry, Transform
project = Project(Geometry=wires, Plane=move.Geometry)  # -> simplify(Geometry), Transform

# ---- group: Units_Buffer
brep_5 = Brep(Tree({0}: [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], {1}: [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]))

# ---- group: Units_Habi
brep_6 = Brep(Tree({0}: [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], {1}: [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]))

# ---- group: Units_Support
brep_7 = Brep(Tree({0}: [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], {1}: [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]))

# ----
phase_5 = Panel(num_5)
phase_6 = Panel(num_4)
phase_7 = Panel(num_6)
phase_8 = Panel(num)

# ----
# EDIT SITE MESH
panel_16 = Panel("https://macad.speckle.xyz/streams/4975f9f0a8/branches/site/04-community-site")
receive_2 = Receive(
    Stream=panel_16,
    AutoReceive=False,
    CurrentComponentState="expired",
    ExpandOutput=True,
    LastInfoMessage="James McBennett @ 03/01/2024 23:14:17: 2024 Mar-01 (id:9ec35295b2)",
    ReceiveOnOpen=False,
    ReceivedCommitId="9ec35295b2",
    StreamWrapper="https://macad.speckle.xyz/projects/4975f9f0a8/models/site/04-community-site",
    selectedKitName="Objects")  # -> Info, CONTOURS, SOIL
item_4 = ListItem(List=flatten(receive_2.SOIL), Index=Slider(3, range=0..17), Wrap=True)
srf = Surface(<surface referenced from the Rhino model>)
bbox = BoundingBox(Content=srf, Plane=PlaneXY(0, 0, 0))  # -> Box, Box_2
volume_3 = Volume(Geometry=bbox.Box)  # -> Volume, Centroid
msphere = MeshSphere(Base=volume_3.Centroid, Radius="80", UCount="100", VCount="100")
msplit = MeshSplit(Mesh=item_4, Splitters=msphere)
item_5 = ListItem(List=msplit, Index=Slider(0, range=0..1), Wrap=True)
name_5 = ExtendSpeckleObject(
    SpeckleObject=item_5,
    BIMSCPROJECT=bimsc_project,
    BIMSCORIGINATOR=bimsc_originator,
    BIMSCVOLUME=bimsc_volume,
    BIMSCTYPE="SITE",
    BIMSCMATERIAL="soil",
    RenderMaterial=dso.Soil,
    BIMSCPHASE=phase_8,
    selectedKitName="Objects")  # -> flatten(ExtendedSpeckleObject)

# ----
# ADD SITE TERRAIN
panel_17 = Panel("TopoMesh")
reflay_11 = ReferenceByLayer(LayerName="TopoBrep", lightweight=False, DisableAutoUpdate=False)
reflay_12 = ReferenceByLayer(LayerName=panel_17, lightweight=False, DisableAutoUpdate=False)
filter_5 = StreamFilter(Gate=list_2, Stream0=reflay_11, Stream1=reflay_12)
msplit_2 = MeshSplit(Mesh=filter_5, Splitters=msphere)
item_6 = ListItem(List=msplit_2, Index=Slider(1, range=0..1), Wrap=True)
name_6 = ExtendSpeckleObject(
    SpeckleObject=item_6,
    BIMSCPROJECT=bimsc_project,
    BIMSCORIGINATOR=bimsc_originator,
    BIMSCVOLUME=bimsc_volume,
    BIMSCTYPE="TERRAIN",
    BIMSCMATERIAL="soil",
    RenderMaterial=dso.Soil,
    BIMSCPHASE=phase_8,
    selectedKitName="Objects")  # -> flatten(ExtendedSpeckleObject)

end_2 = EndPoints(Curve=project.Geometry)  # -> Start, End
multiplication = Multiplication(A=abs, B="2")
cullpt = CullDuplicates(Points=[end_2.Start, end_2.End], Tolerance=0.1, CullMode=3)  # -> Points, Indices, Valence
pline = PolyLine(Vertices=cullpt.Points, Closed=True)  # -> simplify(Polyline)
Z_2 = UnitZ(Factor=multiplication)
extr = Extrude(Base=pline, Direction=Z_2)
cap = CapHoles(Brep=extr)

# ----
# 01 //Create Revit Materials from Rhino M Properties
trigger = Trigger(Interval=-1000, TimerInterval=1000, Target=[material, graphics])

# ----
# 02// Create New Unit Revit Family
trigger_2 = Trigger(Interval=-1000, TimerInterval=1000, Target=[new, famform_8, materials, active, subcat])  # disabled

# ----
# SEND TO REVIT MODEL
# The figures in the circles from the trigger component
# for the revit families to work have to be from left to right:
# a triangle (play), a pointer (mouse), and a key.
# //Send Topo Meshes to Revit
trigger_3 = Trigger(Interval=-1000, TimerInterval=1000, Target=topography)

# ---- group: All Units (internalised)
srf_2 = Surface([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])

# ----
trigger_4 = Trigger(Interval=-1000, TimerInterval=1000, Target=[material_3, graphics_3, new_3])
trigger_5 = Trigger(Interval=-1000, TimerInterval=1000, Target=[material_2, graphics_2, new_2])

# ----
# 03//Add Units to Revit
trigger_6 = Trigger(Interval=-1000, TimerInterval=1000, Target=[types, l_component, l_component_2, l_component_3])

# ---- group: All Other Units
srf_3 = Surface([<surface referenced from the Rhino model> x56])

# ---- group: Support Units
srf_4 = Surface([<surface referenced from the Rhino model> x9])

# ---- group: Units_Buffer
# UNITS PLANES
debrep_2 = DeconstructBrep(Brep=bang.Branch0)  # -> Faces, Edges, Vertices
area_3 = Area(Geometry=debrep_2.Faces)  # -> Area, Centroid
pdecon_3 = Deconstruct(Point=area_3.Centroid)  # -> XComponent, YComponent, ZComponent
int_4 = Integer(pdecon_3.ZComponent)
bnd_3 = Bounds(Numbers=int_4)
dedomain_3 = DeconstructDomain(Domain=bnd_3)  # -> Start, End
equals_3 = Equality(FirstNumber=int_4, SecondNumber=dedomain_3.Start)  # -> Equality, Inequality
cull_3 = CullPattern(List=area_3.Centroid, CullPattern=equals_3.Equality)  # -> simplify(List)
pln = Plane(flatten(cull_3))

pln_2 = Plane(flatten(cull_3))

# ----
# BUFFER UNITS
bang_3 = ExplodeTree(Data=brep_5)  # -> Branch0, Branch1
sso = BlockDefinition(
    Name="Inflatable",
    Geometry=bang_3.Branch0,
    BasePoint=bang_2.Branch0,
    SelectedConstructorName="Objects.Other.BlockDefinition.ctor(System.String,System.Collections.Generic.List`1[Speckle.Core.Models.Base],Objects.Geometry.Point)",
    SelectedTypeName="Objects.Other.BlockDefinition",
    UseSchemaTag=False,
    UserSetSchemaTag=False,
    seed="e98ffe5e9bfe795355b2")
sso_2 = BlockDefinition(
    Name="Steel",
    Geometry=bang_3.Branch1,
    BasePoint=bang_2.Branch0,
    SelectedConstructorName="Objects.Other.BlockDefinition.ctor(System.String,System.Collections.Generic.List`1[Speckle.Core.Models.Base],Objects.Geometry.Point)",
    SelectedTypeName="Objects.Other.BlockDefinition",
    UseSchemaTag=False,
    UserSetSchemaTag=False,
    seed="19cce9d17a2992b002e5")
orient = Orient(Geometry=bang_2.Branch0, Source=bang_2.Branch0, Target=pln_2)  # -> Geometry, Transform
sso_3 = BlockInstance(
    BlockDefinition=sso,
    Transform=orient.Transform,
    SelectedConstructorName="Objects.Other.BlockInstance.ctor(Objects.Other.BlockDefinition,Objects.Other.Transform)",
    SelectedTypeName="Objects.Other.BlockInstance",
    UseSchemaTag=False,
    UserSetSchemaTag=False,
    seed="6ac40892a254094ba5bf")
sso_4 = BlockInstance(
    BlockDefinition=sso_2,
    Transform=orient.Transform,
    SelectedConstructorName="Objects.Other.BlockInstance.ctor(Objects.Other.BlockDefinition,Objects.Other.Transform)",
    SelectedTypeName="Objects.Other.BlockInstance",
    UseSchemaTag=False,
    UserSetSchemaTag=False,
    seed="56e02fcb1ef79a18a3fe")
name_7 = ExtendSpeckleObject(
    SpeckleObject=sso_3,
    BIMSCPROJECT=bimsc_project,
    BIMSCORIGINATOR=bimsc_originator,
    BIMSCVOLUME=bimsc_volume,
    BIMSCTYPE="INFLATABLES",
    BIMSCMATERIAL="Inflatable",
    RenderMaterial=dso.Inflatable,
    BIMSCPHASE=phase_7,
    selectedKitName="Objects")
name_8 = ExtendSpeckleObject(
    SpeckleObject=sso_4,
    BIMSCPROJECT=bimsc_project,
    BIMSCORIGINATOR=bimsc_originator,
    BIMSCVOLUME=bimsc_volume,
    BIMSCTYPE="STRUCTURE",
    BIMSCMATERIAL="Steel",
    RenderMaterial=dso.Steel,
    BIMSCPHASE=phase_7,
    selectedKitName="Objects")
in = CreateSpeckleObject(Inflatables=name_7, Structure=name_8, selectedKitName="Objects")

# ---- group: Units_Support
debrep_3 = DeconstructBrep(Brep=cap)  # -> Faces, Edges, Vertices
area_4 = Area(Geometry=debrep_3.Faces)  # -> Area, Centroid
pdecon_4 = Deconstruct(Point=area_4.Centroid)  # -> XComponent, YComponent, ZComponent
int_5 = Integer(pdecon_4.ZComponent)
bnd_4 = Bounds(Numbers=int_5)
dedomain_4 = DeconstructDomain(Domain=bnd_4)  # -> Start, End
equals_4 = Equality(FirstNumber=int_5, SecondNumber=dedomain_4.Start)  # -> Equality, Inequality
cull_4 = CullPattern(List=area_4.Centroid, CullPattern=equals_4.Equality)  # -> simplify(List)
pln_3 = Plane(flatten(cull_4))

pln_4 = Plane(flatten(cull_4))

# ----
pt_2 = Point(pln_4)

# ----
# SUPPORT UNITS
bang_4 = ExplodeTree(Data=brep_7)  # -> Branch0, Branch1
sso_5 = BlockDefinition(
    Name="Inflatable",
    Geometry=bang_4.Branch0,
    BasePoint=bang_2.Branch0,
    SelectedConstructorName="Objects.Other.BlockDefinition.ctor(System.String,System.Collections.Generic.List`1[Speckle.Core.Models.Base],Objects.Geometry.Point)",
    SelectedTypeName="Objects.Other.BlockDefinition",
    UseSchemaTag=False,
    UserSetSchemaTag=False,
    seed="e943e21153ec278cf34c")
sso_6 = BlockDefinition(
    Name="Steel",
    Geometry=bang_4.Branch1,
    BasePoint=bang_2.Branch0,
    SelectedConstructorName="Objects.Other.BlockDefinition.ctor(System.String,System.Collections.Generic.List`1[Speckle.Core.Models.Base],Objects.Geometry.Point)",
    SelectedTypeName="Objects.Other.BlockDefinition",
    UseSchemaTag=False,
    UserSetSchemaTag=False,
    seed="3ec79391879efae79a6e")
orient_2 = Orient(Geometry=bang_2.Branch0, Source=bang_2.Branch0, Target=pt_2)  # -> Geometry, Transform
sso_7 = BlockInstance(
    BlockDefinition=sso_5,
    Transform=orient_2.Transform,
    SelectedConstructorName="Objects.Other.BlockInstance.ctor(Objects.Other.BlockDefinition,Objects.Other.Transform)",
    SelectedTypeName="Objects.Other.BlockInstance",
    UseSchemaTag=False,
    UserSetSchemaTag=False,
    seed="45b434c764ae94fc6baa")
sso_8 = BlockInstance(
    BlockDefinition=sso_6,
    Transform=orient_2.Transform,
    SelectedConstructorName="Objects.Other.BlockInstance.ctor(Objects.Other.BlockDefinition,Objects.Other.Transform)",
    SelectedTypeName="Objects.Other.BlockInstance",
    UseSchemaTag=False,
    UserSetSchemaTag=False,
    seed="bc2b41bba78f8d3e6aa2")
name_9 = ExtendSpeckleObject(
    SpeckleObject=sso_7,
    BIMSCPROJECT=bimsc_project,
    BIMSCORIGINATOR=bimsc_originator,
    BIMSCVOLUME=bimsc_volume,
    BIMSCTYPE="INFLATABLES",
    BIMSCMATERIAL="Inflatable",
    RenderMaterial=dso.Inflatable,
    BIMSCPHASE=phase_6,
    selectedKitName="Objects")
name_10 = ExtendSpeckleObject(
    SpeckleObject=sso_8,
    BIMSCPROJECT=bimsc_project,
    BIMSCORIGINATOR=bimsc_originator,
    BIMSCVOLUME=bimsc_volume,
    BIMSCTYPE="STRUCTURE",
    BIMSCMATERIAL="Steel",
    RenderMaterial=dso.Steel,
    BIMSCPHASE=phase_6,
    selectedKitName="Objects")
in_2 = CreateSpeckleObject(Inflatables=name_9, Structure=name_10, selectedKitName="Objects")

# ---- group: Units_Habi
debrep_4 = DeconstructBrep(Brep=split.Negative)  # -> Faces, Edges, Vertices
area_5 = Area(Geometry=debrep_4.Faces)  # -> Area, Centroid
pdecon_5 = Deconstruct(Point=area_5.Centroid)  # -> XComponent, YComponent, ZComponent
int_6 = Integer(pdecon_5.ZComponent)
bnd_5 = Bounds(Numbers=int_6)
dedomain_5 = DeconstructDomain(Domain=bnd_5)  # -> Start, End
equals_5 = Equality(FirstNumber=int_6, SecondNumber=dedomain_5.Start)  # -> Equality, Inequality
cull_5 = CullPattern(List=area_5.Centroid, CullPattern=equals_5.Equality)  # -> simplify(List)
# //Temporarily
# disconnected
# to correct
# orientation
pln_5 = Plane(flatten(cull_5))

pln_6 = Plane(flatten(cull_5))

# ----
# HABITAD UNITS
bang_5 = ExplodeTree(Data=brep_6)  # -> Branch0, Branch1
sso_9 = BlockDefinition(
    Name="Inflatable",
    Geometry=bang_5.Branch0,
    BasePoint=bang_2.Branch0,
    SelectedConstructorName="Objects.Other.BlockDefinition.ctor(System.String,System.Collections.Generic.List`1[Speckle.Core.Models.Base],Objects.Geometry.Point)",
    SelectedTypeName="Objects.Other.BlockDefinition",
    UseSchemaTag=False,
    UserSetSchemaTag=False,
    seed="74c7ac9f915255a3e209")
sso_10 = BlockDefinition(
    Name="Steel",
    Geometry=bang_5.Branch1,
    BasePoint=bang_2.Branch0,
    SelectedConstructorName="Objects.Other.BlockDefinition.ctor(System.String,System.Collections.Generic.List`1[Speckle.Core.Models.Base],Objects.Geometry.Point)",
    SelectedTypeName="Objects.Other.BlockDefinition",
    UseSchemaTag=False,
    UserSetSchemaTag=False,
    seed="6d6048d8a75f62682faf")
orient_3 = Orient(Geometry=bang_2.Branch0, Source=bang_2.Branch0, Target=pln_6)  # -> Geometry, Transform
sso_11 = BlockInstance(
    BlockDefinition=sso_9,
    Transform=orient_3.Transform,
    SelectedConstructorName="Objects.Other.BlockInstance.ctor(Objects.Other.BlockDefinition,Objects.Other.Transform)",
    SelectedTypeName="Objects.Other.BlockInstance",
    UseSchemaTag=False,
    UserSetSchemaTag=False,
    seed="5ef6fa26b8afc923a02a")
sso_12 = BlockInstance(
    BlockDefinition=sso_10,
    Transform=orient_3.Transform,
    SelectedConstructorName="Objects.Other.BlockInstance.ctor(Objects.Other.BlockDefinition,Objects.Other.Transform)",
    SelectedTypeName="Objects.Other.BlockInstance",
    UseSchemaTag=False,
    UserSetSchemaTag=False,
    seed="2b6654ad513ddd9dd323")
name_11 = ExtendSpeckleObject(
    SpeckleObject=sso_11,
    BIMSCPROJECT=bimsc_project,
    BIMSCORIGINATOR=bimsc_originator,
    BIMSCVOLUME=bimsc_volume,
    BIMSCTYPE="INFLATABLES",
    BIMSCMATERIAL="Inflatable",
    RenderMaterial=dso.Inflatable,
    BIMSCPHASE=phase_5,
    selectedKitName="Objects")
name_12 = ExtendSpeckleObject(
    SpeckleObject=sso_12,
    BIMSCPROJECT=bimsc_project,
    BIMSCORIGINATOR=bimsc_originator,
    BIMSCVOLUME=bimsc_volume,
    BIMSCTYPE="STRUCTURE",
    BIMSCMATERIAL="Steel",
    RenderMaterial=dso.Steel,
    BIMSCPHASE=phase_5,
    selectedKitName="Objects")
in_3 = CreateSpeckleObject(Inflatables=name_11, Structure=name_12, selectedKitName="Objects")

# ----
# MERGED UNITS
in_4 = CreateSpeckleObject(Units_Buffer=in, Units_Habi=in_3, Units_Support=in_2, selectedKitName="Objects")

panel_18 = Panel(in_4)

# ----
# //Units Planes for positioning in model
area_6 = Area(Geometry=srf_3)  # -> Area, Centroid
area_7 = Area(Geometry=srf_4)  # -> Area, Centroid
pl_origin = PlaneOrigin(Base=srf_4, Origin=area_7.Centroid)
pl_origin_2 = PlaneOrigin(Base=srf_3, Origin=area_6.Centroid)
smaller = SmallerThan(FirstNumber=area_6.Area, SecondNumber="20")  # -> SmallerThan, OrEqualTo
dispatch = Dispatch(List=pl_origin_2, DispatchPattern=smaller.OrEqualTo)  # -> ListA, ListB
entwine = Entwine(Branch00=pl_origin, Branch01=dispatch.ListB, Branch02=dispatch.ListA, FlattenInputs=True)

# ----
# G06 wip branch
# https://macad.speckle.xyz/projects/4975f9f0a8/models/0c407c0907
panel_19 = Panel("G06_WIPdModel_V10")

# ----
# G06 shared branch
# https://macad.speckle.xyz/streams/4975f9f0a8/branches/shared%2Fg06
panel_20 = Panel("G06_AssembledModel_V4")

# ----
# G06_test_Unreal
# https://macad.speckle.xyz/streams/5e4e4e4563
panel_21 = Panel("G06_UnrealdModel_V1")

# ----
# G6_STUDIO_MAIN_MODEL
# https://macad.speckle.xyz/projects/4975f9f0a8/models/37a2354197
panel_22 = Panel("G06_AssembledModel_V4")

# ----
# SEND TO SPLECKLE STREAMS
cso = CreateSpeckleObject(
    ROOF=name_4,
    WALL=name_3,
    FLOORS=name,
    PODS=name_2,
    UNITS=in_4,
    TERRAIN=name_6,
    SITE_A4=name_5,
    selectedKitName="Objects")

# ----
# //Send block instances to Revit
block_info_2 = GetBlockInfo(Block=reflay_6)  # -> Name, Plane, Transform, BlockType, FilePath, Active
orient_4 = Orient(Geometry=reflay_6, Source=block_info_2.Plane, Target=PlaneXY(0, 0, 0))  # -> Geometry, Transform
expblock = ExplodeBlock(Block=orient_4.Geometry, recursive=False)  # -> Name, Transform, Geometry

# ----
# //Send topo meshes to Revit
number_slider_2 = Slider(9, range=0..10)
mesh_9 = Mesh(reflay_12)
unweld = UnweldMesh(Mesh=mesh_9, Angle=degrees(number_slider_2))
topography = AddTopographyMesh(Mesh=unweld, TrackingMode=2)

panel_23 = Panel(block_info_2.Name)

# ----
# Always Leave Send Component Unplugged
# in the stream input before closing and
# saving this gh file
send = Send(
    Message=panel_19,
    D=cso,
    AutoSend=False,
    BaseId="61a5c0449fc9d2c6089ab465ac4f1933",
    CurrentComponentState="up_to_date",
    KitName="Objects",
    OutputWrappers="https://macad.speckle.xyz\t4975f9f0a8\t5050d2ac9e",
    UseDefaultCache=True,
    selectedKitName="Objects")
rec = DataRecorder(send, DataLimit=-10, RecordData=True)
panel_24 = Panel(rec)

bang_6 = ExplodeTree(Data=simplify(expblock.Name))  # -> Branch0, Branch1, Branch2
active = ActiveDocument()

# ----
# 03//Add components to RH Planes
bang_7 = ExplodeTree(Data=simplify(entwine))  # -> Branch0, Branch1, Branch2
types = QueryTypes(Document=active, Kind=3, FamilyName=expblock.Name)
bang_8 = ExplodeTree(Data=types)  # -> Branch0, Branch1, Branch2
l_component = AddComponentLocation(Document=active, Location=simplify(bang_7.Branch1), Type=simplify(bang_8.Branch0), TrackingMode=2)
l_component_2 = AddComponentLocation(Document=active, Location=simplify(bang_7.Branch0), Type=simplify(bang_8.Branch1), TrackingMode=2)
l_component_3 = AddComponentLocation(Document=active, Location=simplify(bang_7.Branch2), Type=simplify(bang_8.Branch2), TrackingMode=2)

panel_25 = Panel(types)

categories = BuiltInCategories("autodesk.revit.category.family:genericModel-1.0.0", SearchPattern="Generic")

# ----
# //Query materials' names using Elefront
layertable = LayerTable(Update=True, AutoUpdate=False)  # -> Layers, FullLayerPaths, LayerColors, Linetypes, MaterialNames, Visible, PrintWidth, PrintColor
geo = Geometry(expblock.Geometry)
ef_att = EleFrontAttributes(Attributes=geo)
ef_layer = EleFrontLayer(Layer=ef_att)
bang_9 = ExplodeTree(Data=simplify(geo))  # -> Branch0, Branch1, Branch2

split_2 = TextSplit(Text=ef_layer, Separators="::")
item_7 = ListItem(List=split_2, Index=-1, Wrap=True)
concat_2 = Concatenate(FragmentA="M-", FragmentB=item_7)  # -> simplify(Result)
pshift = ShiftPaths(Data=concat_2, Offset=-1)

pshift_2 = ShiftPaths(Data=item_7, Offset=-1)
cset_3 = CreateSet(List=pshift_2)  # -> Set, Map
txt = Text(cset_3.Set)
subcat = AddSubCategory(Parent=categories, Name=txt, TrackingMode=2)
bang_10 = ExplodeTree(Data=simplify(subcat))  # -> simplify(graft(Branch0)), simplify(graft(Branch1)), simplify(graft(Branch2))

bang_11 = ExplodeTree(Data=simplify(pshift))  # -> Branch0, Branch1, Branch2

cset_4 = CreateSet(List=bang_11.Branch2)  # -> Set, Map
cset_5 = CreateSet(List=cset_4.Map)  # -> Set, Map
panel_26 = Panel(bang_6.Branch2)
mindex_2 = MemberIndex(Set=cset_4.Map, Member=cset_5.Set)  # -> Index, Count
item_8 = ListItem(List=bang_11.Branch2, Index=mindex_2.Index, Wrap=True)  # -> simplify(Item)
item_9 = ListItem(List=bang_9.Branch2, Index=mindex_2.Index, Wrap=True)  # -> simplify(Item)
item_10 = ListItem(List=item_8, Index=0, Wrap=True)
bang_12 = ExplodeTree(Data=bang_10.Branch2)  # -> Branch0, Branch1, Branch2, Branch3, Branch4, Branch5
bang_13 = ExplodeTree(Data=item_9)  # -> Branch0, Branch1, Branch2, Branch3, Branch4, Branch5
bang_14 = ExplodeTree(Data=item_10)  # -> Branch0, Branch1, Branch2, Branch3, Branch4, Branch5

cset_6 = CreateSet(List=bang_11.Branch0)  # -> Set, Map
cset_7 = CreateSet(List=cset_6.Map)  # -> Set, Map
panel_27 = Panel(bang_6.Branch0)
mindex_3 = MemberIndex(Set=cset_6.Map, Member=cset_7.Set)  # -> Index, Count
item_11 = ListItem(List=bang_11.Branch0, Index=mindex_3.Index, Wrap=True)  # -> simplify(Item)
item_12 = ListItem(List=bang_9.Branch0, Index=mindex_3.Index, Wrap=True)  # -> simplify(Item)
item_13 = ListItem(List=item_11, Index=0, Wrap=True)
bang_15 = ExplodeTree(Data=bang_10.Branch0)  # -> Branch0, Branch1, Branch2, Branch3, Branch4, Branch5, Branch6, Branch7, Branch8
bang_16 = ExplodeTree(Data=item_12)  # -> Branch0, Branch1, Branch2, Branch3, Branch4, Branch5, Branch6, Branch7, Branch8
bang_17 = ExplodeTree(Data=item_13)  # -> Branch0, Branch1, Branch2, Branch3, Branch4, Branch5, Branch6, Branch7, Branch8

cset_8 = CreateSet(List=bang_11.Branch1)  # -> Set, Map
cset_9 = CreateSet(List=cset_8.Map)  # -> Set, Map
panel_28 = Panel(bang_6.Branch1)
mindex_4 = MemberIndex(Set=cset_8.Map, Member=cset_9.Set)  # -> Index, Count
item_14 = ListItem(List=bang_11.Branch1, Index=mindex_4.Index, Wrap=True)  # -> simplify(Item)
item_15 = ListItem(List=bang_9.Branch1, Index=mindex_4.Index, Wrap=True)  # -> simplify(Item)
item_16 = ListItem(List=item_14, Index=0, Wrap=True)
bang_18 = ExplodeTree(Data=bang_10.Branch1)  # -> Branch0, Branch1, Branch2, Branch3, Branch4, Branch5, Branch6, Branch7, Branch8
bang_19 = ExplodeTree(Data=item_15)  # -> Branch0, Branch1, Branch2, Branch3, Branch4, Branch5, Branch6, Branch7, Branch8
bang_20 = ExplodeTree(Data=item_16)  # -> Branch0, Branch1, Branch2, Branch3, Branch4, Branch5, Branch6, Branch7, Branch8

# ----
# 01 //Create Revit materials from Rhino M Properties
panel_29 = Panel("::")
txt_2 = Text(bang_6.Branch0)
concat_3 = Concatenate(FragmentA=txt_2, FragmentB=panel_29)
expression_2 = Expression(x=layertable.FullLayerPaths, y=concat_3, Expression="Contains(x,y)")
cull_6 = CullPattern(List=layertable.FullLayerPaths, CullPattern=expression_2)
cull_7 = CullPattern(List=layertable.LayerColors, CullPattern=expression_2)
split_3 = TextSplit(Text=cull_6, Separators=panel_29)
split_4 = TextSplit(Text=cull_7, Separators=" ()")
item_17 = ListItem(List=split_3, Index=-1, Wrap=True)
item_18 = ListItem(List=simplify(split_4), Index=0, Wrap=True)  # -> Item, Item1, Item2, Item3
concat_4 = Concatenate(FragmentA="M-", FragmentB=item_17)  # -> flatten(Result)
material = AddMaterial(Name=concat_4, TrackingMode=2)
graphics = MaterialGraphics(Material=material, Color=item_18.Item)  # -> Material, UseRenderAppearance, Color, Transparency, SurfacePatternsForegroundPattern, SurfacePatternsForegroundColor, CutPatternsForegroundPattern, CutPatternsForegroundColor

# ----
# 01 //Create Revit materials from Rhino M Properties
panel_30 = Panel("::")
txt_3 = Text(bang_6.Branch1)
concat_5 = Concatenate(FragmentA=txt_3, FragmentB=panel_30)
expression_3 = Expression(x=layertable.FullLayerPaths, y=concat_5, Expression="Contains(x,y)")
cull_8 = CullPattern(List=layertable.FullLayerPaths, CullPattern=expression_3)
cull_9 = CullPattern(List=layertable.LayerColors, CullPattern=expression_3)
split_5 = TextSplit(Text=cull_8, Separators=panel_30)
split_6 = TextSplit(Text=cull_9, Separators=" ()")
item_19 = ListItem(List=split_5, Index=-1, Wrap=True)
item_20 = ListItem(List=simplify(split_6), Index=0, Wrap=True)  # -> Item, Item1, Item2, Item3
concat_6 = Concatenate(FragmentA="M-", FragmentB=item_19)  # -> flatten(Result)
material_2 = AddMaterial(Name=concat_6, TrackingMode=2)
graphics_2 = MaterialGraphics(Material=material_2, Color=item_20.Item)  # -> Material, UseRenderAppearance, Color, Transparency, SurfacePatternsForegroundPattern, SurfacePatternsForegroundColor, CutPatternsForegroundPattern, CutPatternsForegroundColor

# ----
# 01 //Create Revit materials from Rhino M Properties
panel_31 = Panel("::")
txt_4 = Text(bang_6.Branch2)
concat_7 = Concatenate(FragmentA=txt_4, FragmentB=panel_31)
expression_4 = Expression(x=layertable.FullLayerPaths, y=concat_7, Expression="Contains(x,y)")
cull_10 = CullPattern(List=layertable.FullLayerPaths, CullPattern=expression_4)
cull_11 = CullPattern(List=layertable.LayerColors, CullPattern=expression_4)
split_7 = TextSplit(Text=cull_10, Separators=panel_31)
split_8 = TextSplit(Text=cull_11, Separators=" ()")
item_21 = ListItem(List=split_7, Index=-1, Wrap=True)
item_22 = ListItem(List=simplify(split_8), Index=0, Wrap=True)  # -> Item, Item1, Item2, Item3
concat_8 = Concatenate(FragmentA="M-", FragmentB=item_21)  # -> flatten(Result)
material_3 = AddMaterial(Name=concat_8, TrackingMode=2)
graphics_3 = MaterialGraphics(Material=material_3, Color=item_22.Item)  # -> Material, UseRenderAppearance, Color, Transparency, SurfacePatternsForegroundPattern, SurfacePatternsForegroundColor, CutPatternsForegroundPattern, CutPatternsForegroundColor

# ----
# 02// Create new component family
# Add Link to Revit Family in from your laptop. [Final / Documentation]: C:\Users\ARoncal\OneDrive - Thornton Tomasetti, Inc\__License Resources\Desktop\G06_studio_2024\Final\documentation\FTemplate_GEN_WorkPlane1.rft
add_link_to_revit_family_in_from_your_la = Panel("D:\FAD\MaCAD\Studio 2\GitHub\G06_studio_2024\Final\documentation\FTemplate_GEN_WorkPlane1.rft")  # "Add Link to Revit Family in from your laptop. [Final / Documentation]"
add_link_to_revit_family_in_from_your_la_2 = Panel("C:\Users\paude\Desktop\FTemplate_GEN_WorkPlane.rft")  # "Add Link to Revit Family in from your laptop. [Final / Documentation]"
materials = QueryMaterials(Document=active, Name=bang_17.Branch0)
materials_2 = QueryMaterials(Document=active, Name=bang_17.Branch4)
materials_3 = QueryMaterials(Document=active, Name=bang_17.Branch5)
materials_4 = QueryMaterials(Document=active, Name=bang_17.Branch6)
materials_5 = QueryMaterials(Document=active, Name=bang_17.Branch3)
materials_6 = QueryMaterials(Document=active, Name=bang_17.Branch1)
materials_7 = QueryMaterials(Document=active, Name=bang_17.Branch2)
materials_8 = QueryMaterials(Document=active, Name=bang_17.Branch7)
materials_9 = QueryMaterials(Document=active, Name=bang_17.Branch8)
famform = ComponentFamilyForm(Brep=bang_16.Branch4, Subcategory=bang_15.Branch4, Material=materials_2)  # -> simplify(Brep)
famform_2 = ComponentFamilyForm(Brep=bang_16.Branch5, Subcategory=bang_15.Branch5, Material=materials_3)  # -> simplify(Brep)
famform_3 = ComponentFamilyForm(Brep=bang_16.Branch6, Subcategory=bang_15.Branch6, Material=materials_4)  # -> simplify(Brep)
famform_4 = ComponentFamilyForm(Brep=bang_16.Branch3, Subcategory=bang_15.Branch3, Material=materials_5)  # -> simplify(Brep)
famform_5 = ComponentFamilyForm(Brep=bang_16.Branch1, Subcategory=bang_15.Branch1, Material=materials_6)  # -> simplify(Brep)
famform_6 = ComponentFamilyForm(Brep=bang_16.Branch2, Subcategory=bang_15.Branch2, Material=materials_7)  # -> simplify(Brep)
famform_7 = ComponentFamilyForm(Brep=bang_16.Branch7, Subcategory=bang_15.Branch7, Material=materials_8)  # -> simplify(Brep)
famform_8 = ComponentFamilyForm(Brep=bang_16.Branch0, Subcategory=bang_15.Branch0, Material=materials)  # -> simplify(Brep)
famform_9 = ComponentFamilyForm(Brep=bang_16.Branch8, Subcategory=bang_15.Branch8, Material=materials_9)  # -> simplify(Brep)
merge = Merge(
    Data1=famform_8,
    Data2=famform_5,
    Data3=famform_6,
    Data4=famform_4,
    Data5=famform,
    Data6=famform_2,
    Data7=famform_3,
    Data8=famform_7,
    Data9=famform_9)  # -> flatten(Result)
new = NewComponentFamily(
    Document=active,
    Template=add_link_to_revit_family_in_from_your_la,
    Overwrite=Toggle(True),
    Name=simplify(bang_6.Branch0),
    Geometry=simplify(merge))

# ----
# 02// Create new component family
# Add Link to Revit Family in from your laptop. [Final / Documentation]: C:\Users\ARoncal\OneDrive - Thornton Tomasetti, Inc\__License Resources\Desktop\G06_studio_2024\Final\documentation\FTemplate_GEN_WorkPlane2.rft
add_link_to_revit_family_in_from_your_la_3 = Panel("D:\FAD\MaCAD\Studio 2\GitHub\G06_studio_2024\Final\documentation\FTemplate_GEN_WorkPlane2.rft")  # "Add Link to Revit Family in from your laptop. [Final / Documentation]"
materials_10 = QueryMaterials(Document=active, Name=bang_20.Branch4)
materials_11 = QueryMaterials(Document=active, Name=bang_20.Branch5)
materials_12 = QueryMaterials(Document=active, Name=bang_20.Branch6)
materials_13 = QueryMaterials(Document=active, Name=bang_20.Branch3)
materials_14 = QueryMaterials(Document=active, Name=bang_20.Branch1)
materials_15 = QueryMaterials(Document=active, Name=bang_20.Branch2)
materials_16 = QueryMaterials(Document=active, Name=bang_20.Branch7)
materials_17 = QueryMaterials(Document=active, Name=bang_20.Branch8)
materials_18 = QueryMaterials(Document=active, Name=bang_20.Branch0)
famform_10 = ComponentFamilyForm(Brep=bang_19.Branch4, Subcategory=bang_18.Branch4, Material=materials_10)  # -> simplify(Brep)
famform_11 = ComponentFamilyForm(Brep=bang_19.Branch5, Subcategory=bang_18.Branch5, Material=materials_11)  # -> simplify(Brep)
famform_12 = ComponentFamilyForm(Brep=bang_19.Branch6, Subcategory=bang_18.Branch6, Material=materials_12)  # -> simplify(Brep)
famform_13 = ComponentFamilyForm(Brep=bang_19.Branch3, Subcategory=bang_18.Branch3, Material=materials_13)  # -> simplify(Brep)
famform_14 = ComponentFamilyForm(Brep=bang_19.Branch1, Subcategory=bang_18.Branch1, Material=materials_14)  # -> simplify(Brep)
famform_15 = ComponentFamilyForm(Brep=bang_19.Branch2, Subcategory=bang_18.Branch2, Material=materials_15)  # -> simplify(Brep)
famform_16 = ComponentFamilyForm(Brep=bang_19.Branch7, Subcategory=bang_18.Branch7, Material=materials_16)  # -> simplify(Brep)
famform_17 = ComponentFamilyForm(Brep=bang_19.Branch0, Subcategory=bang_18.Branch0, Material=materials_18)  # -> simplify(Brep)
famform_18 = ComponentFamilyForm(Brep=bang_19.Branch8, Subcategory=bang_18.Branch8, Material=materials_17)  # -> simplify(Brep)
merge_2 = Merge(
    Data1=famform_17,
    Data2=famform_14,
    Data3=famform_15,
    Data4=famform_13,
    Data5=famform_10,
    Data6=famform_11,
    Data7=famform_12,
    Data8=famform_16,
    Data9=famform_18)  # -> flatten(Result)
new_2 = NewComponentFamily(
    Document=active,
    Template=add_link_to_revit_family_in_from_your_la_3,
    Overwrite=Toggle(True),
    Name=simplify(bang_6.Branch1),
    Geometry=simplify(merge_2))

# ----
# 02// Create new component family
# Add Link to Revit Family in from your laptop. [Final / Documentation]: C:\Users\ARoncal\OneDrive - Thornton Tomasetti, Inc\__License Resources\Desktop\G06_studio_2024\Final\documentation\FTemplate_GEN_WorkPlane3).rft
add_link_to_revit_family_in_from_your_la_5 = Panel("D:\FAD\MaCAD\Studio 2\GitHub\G06_studio_2024\Final\documentation\FTemplate_GEN_WorkPlane3).rft")  # "Add Link to Revit Family in from your laptop. [Final / Documentation]"
materials_19 = QueryMaterials(Document=active, Name=bang_14.Branch4)
materials_20 = QueryMaterials(Document=active, Name=bang_14.Branch5)
materials_21 = QueryMaterials(Document=active, Name=bang_14.Branch3)
materials_22 = QueryMaterials(Document=active, Name=bang_14.Branch1)
materials_23 = QueryMaterials(Document=active, Name=bang_14.Branch2)
materials_24 = QueryMaterials(Document=active, Name=bang_14.Branch0)
famform_19 = ComponentFamilyForm(Brep=bang_13.Branch4, Subcategory=bang_12.Branch4, Material=materials_19)  # -> simplify(Brep)
famform_20 = ComponentFamilyForm(Brep=bang_13.Branch5, Subcategory=bang_12.Branch5, Material=materials_20)  # -> simplify(Brep)
famform_21 = ComponentFamilyForm(Brep=bang_13.Branch3, Subcategory=bang_12.Branch3, Material=materials_21)  # -> simplify(Brep)
famform_22 = ComponentFamilyForm(Brep=bang_13.Branch1, Subcategory=bang_12.Branch1, Material=materials_22)  # -> simplify(Brep)
famform_23 = ComponentFamilyForm(Brep=bang_13.Branch2, Subcategory=bang_12.Branch2, Material=materials_23)  # -> simplify(Brep)
famform_24 = ComponentFamilyForm(Brep=bang_13.Branch0, Subcategory=bang_12.Branch0, Material=materials_24)  # -> simplify(Brep)
merge_3 = Merge(Data1=famform_24, Data2=famform_22, Data3=famform_23, Data4=famform_21, Data5=famform_19, Data6=famform_20)  # -> flatten(Result)
new_3 = NewComponentFamily(
    Document=active,
    Template=add_link_to_revit_family_in_from_your_la_5,
    Overwrite=Toggle(True),
    Name=simplify(bang_6.Branch2),
    Geometry=simplify(merge_3))
