# Grasshopper definition assembled_speckle.gh (Grasshopper 1.0.7)
# plug-ins: eleFront, Speckle 2, Rhino.Inside for Autodesk Revit, treesloth01, Nautilus

# ---- group: All Other Units
srf = Surface([<surface referenced from the Rhino model> x56])

# ---- group: Support Units
srf_2 = Surface([<surface referenced from the Rhino model> x9])

# ----
# //Units Planes for positioning in model
area = Area(Geometry=srf)  # -> Area, Centroid
area_2 = Area(Geometry=srf_2)  # -> Area, Centroid
pl_origin = PlaneOrigin(Base=srf_2, Origin=area_2.Centroid)
pl_origin_2 = PlaneOrigin(Base=srf, Origin=area.Centroid)
smaller = SmallerThan(FirstNumber=area.Area, SecondNumber="20")  # -> SmallerThan, OrEqualTo
dispatch = Dispatch(List=pl_origin_2, DispatchPattern=smaller.OrEqualTo)  # -> ListA, ListB
entwine = Entwine(Branch00=pl_origin, Branch01=dispatch.ListB, Branch02=dispatch.ListA, FlattenInputs=True)

# ---- group: BIMSC-PROJECT
# Send a message to James M. to add
# new materials. This list will be updated
# for all groups to have a common material
# library and common material names.
panel = Panel("ELEMENTAL MARS")
bimsc_project = Text(panel)

# ---- group: RECEIVE MATERIALS
# RECIEVE
# MATERIALS
panel_2 = Panel("https://macad.speckle.xyz/projects/4975f9f0a8/models/d59a568f9e")
receive = Receive(
    Stream=panel_2,
    AutoReceive=False,
    CurrentComponentState="expired",
    ExpandOutput=True,
    LastInfoMessage="James McBennett @ 03/02/2024 01:57:29: Materials 01-03-2024 (id:6ecf38526e)",
    ReceiveOnOpen=False,
    ReceivedCommitId="6ecf38526e",
    StreamWrapper="https://macad.speckle.xyz/projects/4975f9f0a8/models/d59a568f9e",
    selectedKitName="Objects")  # -> Info, Materials
dso = DeconstructSpeckleObject(SpeckleObject=receive.Materials, selectedKitName="Objects")  # -> Glass, Inflatable, Regolith, Site, Soil, Steel

# ---- group: FLOOR_LEVELS
# Set your 'Project' name, your 'Group'
# number, your 'Volume' Location that
# connect wirelessly.
series = Series(Start=0, Step=1, Count="5")
expression = Expression(x=series, Expression="Format(\"{0:00}\", x)")
concat = Concatenate(FragmentA="L", FragmentB=expression)  # -> simplify(graft(Result))
floor_levels = Text(concat)

# ----
# PHASES FOR HUMAN DEPLOYMENT
number_slider = Slider(2, range=1..8)
series_2 = Series(Start=1, Step=1, Count=number_slider)
item = ListItem(List=series_2, Index=0, Wrap=True)  # -> Item, Item1, Item2, Item3, Item4, Item5, Item6, Item7

# ----
# ASSEMBLY PHASES
number_slider_2 = Slider(8, range=1..8)
series_3 = Series(Start=1, Step=1, Count=number_slider_2)
item_2 = ListItem(List=series_3, Index=0, Wrap=True)  # -> Item, Item1, Item2, Item3, Item4, Item5, Item6, Item7

# ---- group: All Blocks for Pods
# UNITS BLOCKS
panel_3 = Panel("Default")
reflay = ReferenceByLayer(LayerName=panel_3, lightweight=False)  # -> simplify(graft(Geometry))
panel_4 = Panel(reflay)
block_info = GetBlockInfo(Block=reflay)  # -> Name, simplify(Plane), Transform, BlockType, FilePath, Active
pt = Point(block_info.Plane)
bang = ExplodeTree(Data=reflay)  # -> Branch0, Branch1, Branch2

# ---- group: BIMSC-ORIGINATOR
bimsc_originator = Text("G06")

# ---- group: WorksForBrepsAndMeshes
list = ValueList({"Srf/Brep": 0, "Mesh": 1}, selected="Mesh")

# ----
bang_2 = ExplodeTree(Data=simplify(entwine))  # -> Branch0, Branch1, Branch2

# ---- group: BIMSC-VOLUME
bimsc_volume = Text("A4")

# ----
panel_5 = Panel(bang_2.Branch0)

# ---- group: Buffer
support = Plane(bang_2.Branch0)

# ---- group: Habit
support_2 = Plane(bang_2.Branch1)

# ----
support_3 = Plane(bang_2.Branch2)

# ---- group: PHASE 1
num = Number(item.Item)

# ---- group: PHASE 2
num_2 = Number(item.Item1)

# ---- group: PHASE 3
num_3 = Number(item.Item2)  # disabled

# ---- group: PHASE 4
num_4 = Number(item.Item3)  # disabled

# ---- group: PHASE 5
num_5 = Number(item.Item4)  # disabled

# ---- group: PHASE 6
num_6 = Number(item.Item5)  # disabled

# ---- group: PHASE 8
num_7 = Number(item.Item7)  # disabled

# ---- group: PHASE 1
num_8 = Number(item_2.Item)

# ---- group: PHASE 2
num_9 = Number(item_2.Item1)

# ---- group: PHASE 3
num_10 = Number(item_2.Item2)

# ---- group: PHASE 4
num_11 = Number(item_2.Item3)

# ---- group: PHASE 5
num_12 = Number(item_2.Item4)

# ---- group: PHASE 6
num_13 = Number(item_2.Item5)

# ---- group: PHASE 8
num_14 = Number(item_2.Item7)

# ---- group: PHASE 7
num_15 = Number(item.Item6)  # disabled

num_16 = Number(item_2.Item6)

# ---- group: All Blocks for Pods / Units Planes
bang_3 = ExplodeTree(Data=pt)  # -> Branch0, Branch1, Branch2

# ----
# UNITS
panel_6 = Panel("UnitsRawVolumes")
reflay_2 = ReferenceByLayer(LayerName=panel_6, lightweight=False)
volume = Volume(Geometry=reflay_2)  # -> Volume, Centroid
int = Integer(volume.Volume)
cset = CreateSet(List=int)  # -> Set, Map
cset_2 = CreateSet(List=cset.Map)  # -> Set, Map
mindex = MemberIndex(Set=cset.Map, Member=cset_2.Set)  # -> Index, Count
item_3 = ListItem(List=reflay_2, Index=mindex.Index, Wrap=True)  # -> simplify(Item)
bang_4 = ExplodeTree(Data=item_3)  # -> Branch0, Branch1

# ----
# PHASE 1 (50p)- NO HUMANS
panel_7 = Panel("")
p_phase = Panel(num)
# PHASE 2 (50P) - HUMANS / MACHINE COLLABORATION
panel_8 = Panel("")
p_phase_2 = Panel(num_2)

area_3 = Area(Geometry=bang_4.Branch1)  # -> Area, Centroid
prox = Proximity3D(Points=area_3.Centroid, Group="2", MaxRadius="5")  # -> simplify(Links), Topology
clean = CleanTree(RemoveNulls=True, RemoveInvalid=True, RemoveEmpty=True, Tree=prox.Links)
tstat = TreeStatistics(Tree=clean)  # -> Paths, Length, Count
duplines = RemoveDuplicateLines(Lines=flatten(clean), Tolerance=0.01)  # -> graft(Lines)
split = SplitTree(Data=simplify(graft(bang_4.Branch1)), Masks=flatten(tstat.Paths))  # -> graft(Positive), flatten(Negative)

# ---- group: Units_Support
pln = Plane(flatten(support_2))

# ----
# HABIT UNITS
# ASSEMBLY PHASE 5
expblock = ExplodeBlock(Block=bang.Branch0, recursive=False)  # -> Name, Transform, Geometry
detatt = DetachAttributes(Geometry=expblock.Geometry)  # -> Geometry, Attributes
ef_att = EleFrontAttributes(Attributes=detatt.Attributes)
ef_layer = EleFrontLayer(Layer=ef_att)
cset_3 = CreateSet(List=ef_layer)  # -> Set, Map
cset_4 = CreateSet(List=cset_3.Map)  # -> Set, Map
mindex_2 = MemberIndex(Set=cset_3.Map, Member=cset_4.Set)  # -> Index, Count
item_4 = ListItem(List=detatt.Geometry, Index=mindex_2.Index, Wrap=True)  # -> simplify(Item)
aphase = Panel(num_13)
bang_5 = ExplodeTree(Data=item_4)  # -> Branch0, Branch1, Branch2, Branch3, Branch4, Branch5, Branch6, Branch7, Branch8
orient = Orient(Geometry=bang.Branch0, Source=bang_3.Branch0, Target=pln)  # -> Geometry, Transform
sso = BlockDefinition(
    Name="InflatableOuter",
    Geometry=bang_5.Branch0,
    BasePoint=bang_3.Branch0,
    SelectedConstructorName="Objects.Other.BlockDefinition.ctor(System.String,System.Collections.Generic.List`1[Speckle.Core.Models.Base],Objects.Geometry.Point)",
    SelectedTypeName="Objects.Other.BlockDefinition",
    UseSchemaTag=False,
    UserSetSchemaTag=False,
    seed="0c0bfbf44b6fc9593242")
sso_2 = BlockDefinition(
    Name="InflatableMiddle",
    Geometry=bang_5.Branch2,
    BasePoint=bang_3.Branch0,
    SelectedConstructorName="Objects.Other.BlockDefinition.ctor(System.String,System.Collections.Generic.List`1[Speckle.Core.Models.Base],Objects.Geometry.Point)",
    SelectedTypeName="Objects.Other.BlockDefinition",
    UseSchemaTag=False,
    UserSetSchemaTag=False,
    seed="f2dae493b5f49fd56f56")
sso_3 = BlockDefinition(
    Name="InflatableInner",
    Geometry=bang_5.Branch3,
    BasePoint=bang_3.Branch0,
    SelectedConstructorName="Objects.Other.BlockDefinition.ctor(System.String,System.Collections.Generic.List`1[Speckle.Core.Models.Base],Objects.Geometry.Point)",
    SelectedTypeName="Objects.Other.BlockDefinition",
    UseSchemaTag=False,
    UserSetSchemaTag=False,
    seed="311221a5fa03667bba1f")
sso_4 = BlockDefinition(
    Name="WindowFrames",
    Geometry=bang_5.Branch1,
    BasePoint=bang_3.Branch0,
    SelectedConstructorName="Objects.Other.BlockDefinition.ctor(System.String,System.Collections.Generic.List`1[Speckle.Core.Models.Base],Objects.Geometry.Point)",
    SelectedTypeName="Objects.Other.BlockDefinition",
    UseSchemaTag=False,
    UserSetSchemaTag=False,
    seed="ec49600ebf22b9682b16")
sso_5 = BlockDefinition(
    Name="Window",
    Geometry=bang_5.Branch4,
    BasePoint=bang_3.Branch0,
    SelectedConstructorName="Objects.Other.BlockDefinition.ctor(System.String,System.Collections.Generic.List`1[Speckle.Core.Models.Base],Objects.Geometry.Point)",
    SelectedTypeName="Objects.Other.BlockDefinition",
    UseSchemaTag=False,
    UserSetSchemaTag=False,
    seed="5524b12c270b464f9945")
sso_6 = BlockDefinition(
    Name="Framing",
    Geometry=bang_5.Branch5,
    BasePoint=bang_3.Branch0,
    SelectedConstructorName="Objects.Other.BlockDefinition.ctor(System.String,System.Collections.Generic.List`1[Speckle.Core.Models.Base],Objects.Geometry.Point)",
    SelectedTypeName="Objects.Other.BlockDefinition",
    UseSchemaTag=False,
    UserSetSchemaTag=False,
    seed="e8622a4f2ae231dbeaaa")
sso_7 = BlockDefinition(
    Name="Roof",
    Geometry=bang_5.Branch6,
    BasePoint=bang_3.Branch0,
    SelectedConstructorName="Objects.Other.BlockDefinition.ctor(System.String,System.Collections.Generic.List`1[Speckle.Core.Models.Base],Objects.Geometry.Point)",
    SelectedTypeName="Objects.Other.BlockDefinition",
    UseSchemaTag=False,
    UserSetSchemaTag=False,
    seed="eea9f2379bd8f6b26e29")
sso_8 = BlockDefinition(
    Name="CeilingStructure",
    Geometry=bang_5.Branch7,
    BasePoint=bang_3.Branch0,
    SelectedConstructorName="Objects.Other.BlockDefinition.ctor(System.String,System.Collections.Generic.List`1[Speckle.Core.Models.Base],Objects.Geometry.Point)",
    SelectedTypeName="Objects.Other.BlockDefinition",
    UseSchemaTag=False,
    UserSetSchemaTag=False,
    seed="c352b8107c4569902c77")
sso_9 = BlockDefinition(
    Name="Floors",
    Geometry=bang_5.Branch7,
    BasePoint=bang_3.Branch0,
    SelectedConstructorName="Objects.Other.BlockDefinition.ctor(System.String,System.Collections.Generic.List`1[Speckle.Core.Models.Base],Objects.Geometry.Point)",
    SelectedTypeName="Objects.Other.BlockDefinition",
    UseSchemaTag=False,
    UserSetSchemaTag=False,
    seed="f4a3b66187280424dcb3")
sso_10 = BlockInstance(
    BlockDefinition=sso,
    Transform=orient.Transform,
    SelectedConstructorName="Objects.Other.BlockInstance.ctor(Objects.Other.BlockDefinition,Objects.Other.Transform)",
    SelectedTypeName="Objects.Other.BlockInstance",
    UseSchemaTag=False,
    UserSetSchemaTag=False,
    seed="635c2e14caeec1251298")
sso_11 = BlockInstance(
    BlockDefinition=sso_2,
    Transform=orient.Transform,
    SelectedConstructorName="Objects.Other.BlockInstance.ctor(Objects.Other.BlockDefinition,Objects.Other.Transform)",
    SelectedTypeName="Objects.Other.BlockInstance",
    UseSchemaTag=False,
    UserSetSchemaTag=False,
    seed="2d8e482bc030067d1a3f")
sso_12 = BlockInstance(
    BlockDefinition=sso_3,
    Transform=orient.Transform,
    SelectedConstructorName="Objects.Other.BlockInstance.ctor(Objects.Other.BlockDefinition,Objects.Other.Transform)",
    SelectedTypeName="Objects.Other.BlockInstance",
    UseSchemaTag=False,
    UserSetSchemaTag=False,
    seed="335354b84b22f36c7ccd")
sso_13 = BlockInstance(
    BlockDefinition=sso_4,
    Transform=orient.Transform,
    SelectedConstructorName="Objects.Other.BlockInstance.ctor(Objects.Other.BlockDefinition,Objects.Other.Transform)",
    SelectedTypeName="Objects.Other.BlockInstance",
    UseSchemaTag=False,
    UserSetSchemaTag=False,
    seed="609e05eb7f9cf0fff7b9")
sso_14 = BlockInstance(
    BlockDefinition=sso_5,
    Transform=orient.Transform,
    SelectedConstructorName="Objects.Other.BlockInstance.ctor(Objects.Other.BlockDefinition,Objects.Other.Transform)",
    SelectedTypeName="Objects.Other.BlockInstance",
    UseSchemaTag=False,
    UserSetSchemaTag=False,
    seed="e68279f743a035b31d0f")
sso_15 = BlockInstance(
    BlockDefinition=sso_6,
    Transform=orient.Transform,
    SelectedConstructorName="Objects.Other.BlockInstance.ctor(Objects.Other.BlockDefinition,Objects.Other.Transform)",
    SelectedTypeName="Objects.Other.BlockInstance",
    UseSchemaTag=False,
    UserSetSchemaTag=False,
    seed="215f1a9b5c3e45f580da")
sso_16 = BlockInstance(
    BlockDefinition=sso_7,
    Transform=orient.Transform,
    SelectedConstructorName="Objects.Other.BlockInstance.ctor(Objects.Other.BlockDefinition,Objects.Other.Transform)",
    SelectedTypeName="Objects.Other.BlockInstance",
    UseSchemaTag=False,
    UserSetSchemaTag=False,
    seed="15db98691e75a563107b")
sso_17 = BlockInstance(
    BlockDefinition=sso_8,
    Transform=orient.Transform,
    SelectedConstructorName="Objects.Other.BlockInstance.ctor(Objects.Other.BlockDefinition,Objects.Other.Transform)",
    SelectedTypeName="Objects.Other.BlockInstance",
    UseSchemaTag=False,
    UserSetSchemaTag=False,
    seed="27f8526bea910862bf2d")
sso_18 = BlockInstance(
    BlockDefinition=sso_9,
    Transform=orient.Transform,
    SelectedConstructorName="Objects.Other.BlockInstance.ctor(Objects.Other.BlockDefinition,Objects.Other.Transform)",
    SelectedTypeName="Objects.Other.BlockInstance",
    UseSchemaTag=False,
    UserSetSchemaTag=False,
    seed="6620a7c4d71e0e11c226")
name = ExtendSpeckleObject(
    SpeckleObject=sso_10,
    BIMSCPROJECT=bimsc_project,
    BIMSCORIGINATOR=bimsc_originator,
    BIMSCVOLUME=bimsc_volume,
    BIMSCTYPE="Inflatable",
    BIMSCMATERIAL="Inflatable",
    RenderMaterial=dso.Inflatable,
    BIMSCASSEMBLY=aphase,
    BIMSCPHASE=p_phase_2,
    selectedKitName="Objects")
name_2 = ExtendSpeckleObject(
    SpeckleObject=sso_11,
    BIMSCPROJECT=bimsc_project,
    BIMSCORIGINATOR=bimsc_originator,
    BIMSCVOLUME=bimsc_volume,
    BIMSCTYPE="Inflatable",
    BIMSCMATERIAL="Inflatable",
    RenderMaterial=dso.Inflatable,
    BIMSCASSEMBLY=aphase,
    BIMSCPHASE=p_phase_2,
    selectedKitName="Objects")
name_3 = ExtendSpeckleObject(
    SpeckleObject=sso_12,
    BIMSCPROJECT=bimsc_project,
    BIMSCORIGINATOR=bimsc_originator,
    BIMSCVOLUME=bimsc_volume,
    BIMSCTYPE="Inflatable",
    BIMSCMATERIAL="Inflatable",
    RenderMaterial=dso.Inflatable,
    BIMSCASSEMBLY=aphase,
    BIMSCPHASE=p_phase_2,
    selectedKitName="Objects")
name_4 = ExtendSpeckleObject(
    SpeckleObject=sso_13,
    BIMSCPROJECT=bimsc_project,
    BIMSCORIGINATOR=bimsc_originator,
    BIMSCVOLUME=bimsc_volume,
    BIMSCTYPE="STRUCTURE",
    BIMSCMATERIAL="Steel",
    RenderMaterial=dso.Steel,
    BIMSCASSEMBLY=aphase,
    BIMSCPHASE=p_phase_2,
    selectedKitName="Objects")
name_5 = ExtendSpeckleObject(
    SpeckleObject=sso_14,
    BIMSCPROJECT=bimsc_project,
    BIMSCORIGINATOR=bimsc_originator,
    BIMSCVOLUME=bimsc_volume,
    BIMSCTYPE="GLASS",
    BIMSCMATERIAL="Glass",
    RenderMaterial=dso.Glass,
    BIMSCASSEMBLY=aphase,
    BIMSCPHASE=p_phase_2,
    selectedKitName="Objects")
name_6 = ExtendSpeckleObject(
    SpeckleObject=sso_15,
    BIMSCPROJECT=bimsc_project,
    BIMSCORIGINATOR=bimsc_originator,
    BIMSCVOLUME=bimsc_volume,
    BIMSCTYPE="STRUCTURE",
    BIMSCMATERIAL="Steel",
    RenderMaterial=dso.Steel,
    BIMSCASSEMBLY=aphase,
    BIMSCPHASE=p_phase_2,
    selectedKitName="Objects")
name_7 = ExtendSpeckleObject(
    SpeckleObject=sso_16,
    BIMSCPROJECT=bimsc_project,
    BIMSCORIGINATOR=bimsc_originator,
    BIMSCVOLUME=bimsc_volume,
    BIMSCTYPE="STRUCTURE",
    BIMSCMATERIAL="Steel",
    RenderMaterial=dso.Steel,
    BIMSCASSEMBLY=aphase,
    BIMSCPHASE=p_phase_2,
    selectedKitName="Objects")
name_8 = ExtendSpeckleObject(
    SpeckleObject=sso_17,
    BIMSCPROJECT=bimsc_project,
    BIMSCORIGINATOR=bimsc_originator,
    BIMSCVOLUME=bimsc_volume,
    BIMSCTYPE="STRUCTURE",
    BIMSCMATERIAL="Steel",
    RenderMaterial=dso.Steel,
    BIMSCASSEMBLY=aphase,
    BIMSCPHASE=p_phase_2,
    selectedKitName="Objects")
name_9 = ExtendSpeckleObject(
    SpeckleObject=sso_18,
    BIMSCPROJECT=bimsc_project,
    BIMSCORIGINATOR=bimsc_originator,
    BIMSCVOLUME=bimsc_volume,
    BIMSCTYPE="STRUCTURE",
    BIMSCMATERIAL="Steel",
    RenderMaterial=dso.Steel,
    BIMSCASSEMBLY=aphase,
    BIMSCPHASE=p_phase_2,
    selectedKitName="Objects")
in = CreateSpeckleObject(
    InflatableOuter=name,
    InflatableMiddle=name_2,
    InflatableInner=name_3,
    WindowFrames=name_4,
    Window=name_5,
    Framing=name_6,
    Roof=name_7,
    CeilingStructure=name_8,
    Floors=name_9,
    selectedKitName="Objects")

# ----
# ADD UNITS FLOOR
# ASSEMBLY PHASE 2
panel_9 = Panel("Floors")
reflay_3 = ReferenceByLayer(LayerName=panel_9, lightweight=False, DisableAutoUpdate=False)
mesh = MeshBrep(
    Brep=reflay_3,
    Settings={GridMaxCount=0, GridMinCount=16, JaggedSeams=False, MaxEdgeLength=0, MinEdgeLength=0.0001, MinTolerance=0, Refine=True, RefineAngle=0, RelativeTolerance=0.65, SimplePlanes=True, Tolerance=0})
mjoin = MeshJoin(Meshes=mesh)
weld = WeldMesh(Mesh=mjoin, Angle=3.141592654)
brep = Brep(reflay_3)
filter = StreamFilter(Gate=list, Stream0=brep, Stream1=weld)
aphase_2 = Panel(num_9)
name_10 = ExtendSpeckleObject(
    SpeckleObject=filter,
    BIMSCPROJECT=bimsc_project,
    BIMSCORIGINATOR=bimsc_originator,
    BIMSCVOLUME=bimsc_volume,
    BIMSCTYPE="FLOORS",
    BIMSCMATERIAL="Regolith",
    RenderMaterial=dso.Regolith,
    BIMSCASSEMBLY=aphase_2,
    BIMSCPHASE=p_phase,
    selectedKitName="Objects")  # -> flatten(ExtendedSpeckleObject)

# ----
# ADD COURTYARD PODS
# ASSEMBLY PHASE 3
panel_10 = Panel("Pods")
reflay_4 = ReferenceByLayer(LayerName=panel_10, lightweight=False, DisableAutoUpdate=False)
mesh_2 = MeshBrep(
    Brep=reflay_4,
    Settings={GridMaxCount=0, GridMinCount=16, JaggedSeams=False, MaxEdgeLength=0, MinEdgeLength=0.0001, MinTolerance=0, Refine=True, RefineAngle=0, RelativeTolerance=0.65, SimplePlanes=True, Tolerance=0})
brep_2 = Brep(reflay_4)
mjoin_2 = MeshJoin(Meshes=mesh_2)
weld_2 = WeldMesh(Mesh=mjoin_2, Angle=3.141592654)
filter_2 = StreamFilter(Gate=list, Stream0=brep_2, Stream1=weld_2)
aphase_3 = Panel(num_10)
name_11 = ExtendSpeckleObject(
    SpeckleObject=filter_2,
    BIMSCPROJECT=bimsc_project,
    BIMSCORIGINATOR=bimsc_originator,
    BIMSCVOLUME=bimsc_volume,
    BIMSCTYPE="PODS",
    BIMSCMATERIAL="Regolith",
    RenderMaterial=dso.Regolith,
    BIMSCASSEMBLY=aphase_3,
    BIMSCPHASE=p_phase,
    selectedKitName="Objects")  # -> flatten(ExtendedSpeckleObject)

# ----
# ADD WALLS
# ASSEMBLY PHASE 4
panel_11 = Panel("Wall")
reflay_5 = ReferenceByLayer(LayerName=panel_11, lightweight=False, DisableAutoUpdate=False)
mesh_3 = MeshBrep(
    Brep=reflay_5,
    Settings={GridMaxCount=0, GridMinCount=16, JaggedSeams=False, MaxEdgeLength=0, MinEdgeLength=0.0001, MinTolerance=0, Refine=True, RefineAngle=0, RelativeTolerance=0.65, SimplePlanes=True, Tolerance=0})
brep_3 = Brep(reflay_5)
mjoin_3 = MeshJoin(Meshes=mesh_3)
weld_3 = WeldMesh(Mesh=mjoin_3, Angle=3.141592654)
filter_3 = StreamFilter(Gate=list, Stream0=brep_3, Stream1=weld_3)  # -> reverse(simplify(graft(Stream)))
aphase_4 = Panel(num_11)
name_12 = ExtendSpeckleObject(
    SpeckleObject=filter_3,
    BIMSCPROJECT=bimsc_project,
    BIMSCORIGINATOR=bimsc_originator,
    BIMSCVOLUME=bimsc_volume,
    BIMSCTYPE="WALLS",
    BIMSCMATERIAL="Regolith",
    RenderMaterial=dso.Regolith,
    BIMSCASSEMBLY=aphase_4,
    BIMSCPHASE=p_phase_2,
    selectedKitName="Objects")

# ---- group: Units_Support
pln_2 = Plane(flatten(support_3))

# ----
# SUPPORT UNITS
# ASSEMBLY PHASE 5
expblock_2 = ExplodeBlock(Block=bang.Branch2, recursive=False)  # -> Name, Transform, Geometry
detatt_2 = DetachAttributes(Geometry=expblock_2.Geometry)  # -> Geometry, Attributes
ef_att_2 = EleFrontAttributes(Attributes=detatt_2.Attributes)
ef_layer_2 = EleFrontLayer(Layer=ef_att_2)
cset_5 = CreateSet(List=ef_layer_2)  # -> Set, Map
cset_6 = CreateSet(List=cset_5.Map)  # -> Set, Map
mindex_3 = MemberIndex(Set=cset_5.Map, Member=cset_6.Set)  # -> Index, Count
item_5 = ListItem(List=detatt_2.Geometry, Index=mindex_3.Index, Wrap=True)  # -> simplify(Item)
bang_6 = ExplodeTree(Data=item_5)  # -> Branch0, Branch1, Branch2, Branch3, Branch4, Branch5, Branch6, Branch7, Branch8; disabled
bang_7 = ExplodeTree(Data=item_5)  # -> Branch0, Branch1, Branch2, Branch3, Branch4, Branch5
orient_2 = Orient(Geometry=bang.Branch2, Source=bang_3.Branch2, Target=pln_2)  # -> Geometry, Transform
aphase_5 = Panel(num_16)
brep_4 = Brep(bang_7.Branch1)
brep_5 = Brep(bang_7.Branch2)
brep_6 = Brep(bang_7.Branch3)
brep_7 = Brep(bang_7.Branch5)
brep_8 = Brep(bang_7.Branch0)
brep_9 = Brep(bang_7.Branch4)
sso_19 = BlockDefinition(
    Name="InflatableOuter",
    Geometry=brep_8,
    BasePoint=bang_3.Branch2,
    SelectedConstructorName="Objects.Other.BlockDefinition.ctor(System.String,System.Collections.Generic.List`1[Speckle.Core.Models.Base],Objects.Geometry.Point)",
    SelectedTypeName="Objects.Other.BlockDefinition",
    UseSchemaTag=False,
    UserSetSchemaTag=False,
    seed="8c08fb87d31f234ca101")
sso_20 = BlockDefinition(
    Name="WindowFrames",
    Geometry=brep_4,
    BasePoint=bang_3.Branch2,
    SelectedConstructorName="Objects.Other.BlockDefinition.ctor(System.String,System.Collections.Generic.List`1[Speckle.Core.Models.Base],Objects.Geometry.Point)",
    SelectedTypeName="Objects.Other.BlockDefinition",
    UseSchemaTag=False,
    UserSetSchemaTag=False,
    seed="7d5962f81b569b0ad592")
sso_21 = BlockDefinition(
    Name="InflatableInner",
    Geometry=brep_7,
    BasePoint=bang_3.Branch2,
    SelectedConstructorName="Objects.Other.BlockDefinition.ctor(System.String,System.Collections.Generic.List`1[Speckle.Core.Models.Base],Objects.Geometry.Point)",
    SelectedTypeName="Objects.Other.BlockDefinition",
    UseSchemaTag=False,
    UserSetSchemaTag=False,
    seed="54283d71154866975d4f")
sso_22 = BlockDefinition(
    Name="ConnectorOuter",
    Geometry=brep_5,
    BasePoint=bang_3.Branch2,
    SelectedConstructorName="Objects.Other.BlockDefinition.ctor(System.String,System.Collections.Generic.List`1[Speckle.Core.Models.Base],Objects.Geometry.Point)",
    SelectedTypeName="Objects.Other.BlockDefinition",
    UseSchemaTag=False,
    UserSetSchemaTag=False,
    seed="ea6803804c0a54a18905")
sso_23 = BlockDefinition(
    Name="ConnectorInner",
    Geometry=brep_6,
    BasePoint=bang_3.Branch2,
    SelectedConstructorName="Objects.Other.BlockDefinition.ctor(System.String,System.Collections.Generic.List`1[Speckle.Core.Models.Base],Objects.Geometry.Point)",
    SelectedTypeName="Objects.Other.BlockDefinition",
    UseSchemaTag=False,
    UserSetSchemaTag=False,
    seed="d610489023093f5430a1")
sso_24 = BlockDefinition(
    Name="InnerShell",
    Geometry=brep_9,
    BasePoint=bang_3.Branch2,
    SelectedConstructorName="Objects.Other.BlockDefinition.ctor(System.String,System.Collections.Generic.List`1[Speckle.Core.Models.Base],Objects.Geometry.Point)",
    SelectedTypeName="Objects.Other.BlockDefinition",
    UseSchemaTag=False,
    UserSetSchemaTag=False,
    seed="1411c20d6517185d3dd5")
sso_25 = BlockInstance(
    BlockDefinition=sso_19,
    Transform=orient_2.Transform,
    SelectedConstructorName="Objects.Other.BlockInstance.ctor(Objects.Other.BlockDefinition,Objects.Other.Transform)",
    SelectedTypeName="Objects.Other.BlockInstance",
    UseSchemaTag=False,
    UserSetSchemaTag=False,
    seed="2a86e01dd8e5625a8286")
sso_26 = BlockInstance(
    BlockDefinition=sso_20,
    Transform=orient_2.Transform,
    SelectedConstructorName="Objects.Other.BlockInstance.ctor(Objects.Other.BlockDefinition,Objects.Other.Transform)",
    SelectedTypeName="Objects.Other.BlockInstance",
    UseSchemaTag=False,
    UserSetSchemaTag=False,
    seed="5e672a94bd38cf687d14")
sso_27 = BlockInstance(
    BlockDefinition=sso_21,
    Transform=orient_2.Transform,
    SelectedConstructorName="Objects.Other.BlockInstance.ctor(Objects.Other.BlockDefinition,Objects.Other.Transform)",
    SelectedTypeName="Objects.Other.BlockInstance",
    UseSchemaTag=False,
    UserSetSchemaTag=False,
    seed="e9d3362dd511b1fd6c3f")
sso_28 = BlockInstance(
    BlockDefinition=sso_22,
    Transform=orient_2.Transform,
    SelectedConstructorName="Objects.Other.BlockInstance.ctor(Objects.Other.BlockDefinition,Objects.Other.Transform)",
    SelectedTypeName="Objects.Other.BlockInstance",
    UseSchemaTag=False,
    UserSetSchemaTag=False,
    seed="d0ceec8a9d66951b1cc6")
sso_29 = BlockInstance(
    BlockDefinition=sso_23,
    Transform=orient_2.Transform,
    SelectedConstructorName="Objects.Other.BlockInstance.ctor(Objects.Other.BlockDefinition,Objects.Other.Transform)",
    SelectedTypeName="Objects.Other.BlockInstance",
    UseSchemaTag=False,
    UserSetSchemaTag=False,
    seed="97c94131e245df46d377")
sso_30 = BlockInstance(
    BlockDefinition=sso_24,
    Transform=orient_2.Transform,
    SelectedConstructorName="Objects.Other.BlockInstance.ctor(Objects.Other.BlockDefinition,Objects.Other.Transform)",
    SelectedTypeName="Objects.Other.BlockInstance",
    UseSchemaTag=False,
    UserSetSchemaTag=False,
    seed="c3ff12edffa77049ad6e")
name_13 = ExtendSpeckleObject(
    SpeckleObject=sso_25,
    BIMSCPROJECT=bimsc_project,
    BIMSCORIGINATOR=bimsc_originator,
    BIMSCVOLUME=bimsc_volume,
    BIMSCTYPE="INFLATABLE",
    BIMSCMATERIAL="Inflatable",
    RenderMaterial=dso.Steel,
    BIMSCASSEMBLY=aphase_5,
    BIMSCPHASE=p_phase_2,
    selectedKitName="Objects")
name_14 = ExtendSpeckleObject(
    SpeckleObject=sso_26,
    BIMSCPROJECT=bimsc_project,
    BIMSCORIGINATOR=bimsc_originator,
    BIMSCVOLUME=bimsc_volume,
    BIMSCTYPE="STRUCTURE",
    BIMSCMATERIAL="Steel",
    RenderMaterial=dso.Steel,
    BIMSCASSEMBLY=aphase_5,
    BIMSCPHASE=p_phase_2,
    selectedKitName="Objects")
name_15 = ExtendSpeckleObject(
    SpeckleObject=sso_27,
    BIMSCPROJECT=bimsc_project,
    BIMSCORIGINATOR=bimsc_originator,
    BIMSCVOLUME=bimsc_volume,
    BIMSCTYPE="INFLATABLE",
    BIMSCMATERIAL="Inflatable",
    RenderMaterial=dso.Steel,
    BIMSCASSEMBLY=aphase_5,
    BIMSCPHASE=p_phase_2,
    selectedKitName="Objects")
name_16 = ExtendSpeckleObject(
    SpeckleObject=sso_28,
    BIMSCPROJECT=bimsc_project,
    BIMSCORIGINATOR=bimsc_originator,
    BIMSCVOLUME=bimsc_volume,
    BIMSCTYPE="INFLATABLE",
    BIMSCMATERIAL="Inflatable",
    RenderMaterial=dso.Steel,
    BIMSCASSEMBLY=aphase_5,
    BIMSCPHASE=p_phase_2,
    selectedKitName="Objects")
name_17 = ExtendSpeckleObject(
    SpeckleObject=sso_29,
    BIMSCPROJECT=bimsc_project,
    BIMSCORIGINATOR=bimsc_originator,
    BIMSCVOLUME=bimsc_volume,
    BIMSCTYPE="INFLATABLE",
    BIMSCMATERIAL="Inflatable",
    RenderMaterial=dso.Steel,
    BIMSCASSEMBLY=aphase_5,
    BIMSCPHASE=p_phase_2,
    selectedKitName="Objects")
name_18 = ExtendSpeckleObject(
    SpeckleObject=sso_30,
    BIMSCPROJECT=bimsc_project,
    BIMSCORIGINATOR=bimsc_originator,
    BIMSCVOLUME=bimsc_volume,
    BIMSCTYPE="STRUCTURE",
    BIMSCMATERIAL="Steel",
    RenderMaterial=dso.Steel,
    BIMSCASSEMBLY=aphase_5,
    BIMSCPHASE=p_phase_2,
    selectedKitName="Objects")
cso = CreateSpeckleObject(
    InflatableOuter=name_13,
    WindowFrames=name_14,
    InflatableInner=name_15,
    ConnectorOuter=name_16,
    ConnectorInner=name_17,
    InnerShell=name_18,
    selectedKitName="Objects")

# ---- group: Units_Support
pln_3 = Plane(flatten(support))

# ----
# BUFFER UNITS
# ASSEMBLY PHASE 5
expblock_3 = ExplodeBlock(Block=bang.Branch1, recursive=False)  # -> Name, Transform, Geometry
detatt_3 = DetachAttributes(Geometry=expblock_3.Geometry)  # -> Geometry, Attributes
ef_att_3 = EleFrontAttributes(Attributes=detatt_3.Attributes)
ef_layer_3 = EleFrontLayer(Layer=ef_att_3)
cset_7 = CreateSet(List=ef_layer_3)  # -> Set, Map
cset_8 = CreateSet(List=cset_7.Map)  # -> Set, Map
mindex_4 = MemberIndex(Set=cset_7.Map, Member=cset_8.Set)  # -> Index, Count
item_6 = ListItem(List=detatt_3.Geometry, Index=mindex_4.Index, Wrap=True)  # -> simplify(Item)
bang_8 = ExplodeTree(Data=item_6)  # -> Branch0, Branch1, Branch2, Branch3, Branch4, Branch5, Branch6, Branch7, Branch8
orient_3 = Orient(Geometry=bang.Branch1, Source=bang_3.Branch1, Target=pln_3)  # -> Geometry, Transform
aphase_6 = Panel(num_12)
sso_31 = BlockDefinition(
    Name="InflatableOuter",
    Geometry=bang_8.Branch0,
    BasePoint=bang_3.Branch1,
    SelectedConstructorName="Objects.Other.BlockDefinition.ctor(System.String,System.Collections.Generic.List`1[Speckle.Core.Models.Base],Objects.Geometry.Point)",
    SelectedTypeName="Objects.Other.BlockDefinition",
    UseSchemaTag=False,
    UserSetSchemaTag=False,
    seed="ebddc3f8063087270148")
sso_32 = BlockDefinition(
    Name="InflatableMiddle",
    Geometry=bang_8.Branch2,
    BasePoint=bang_3.Branch1,
    SelectedConstructorName="Objects.Other.BlockDefinition.ctor(System.String,System.Collections.Generic.List`1[Speckle.Core.Models.Base],Objects.Geometry.Point)",
    SelectedTypeName="Objects.Other.BlockDefinition",
    UseSchemaTag=False,
    UserSetSchemaTag=False,
    seed="bfa6b5e3eddf2eaa6ee4")
sso_33 = BlockDefinition(
    Name="InflatableInner",
    Geometry=bang_8.Branch3,
    BasePoint=bang_3.Branch1,
    SelectedConstructorName="Objects.Other.BlockDefinition.ctor(System.String,System.Collections.Generic.List`1[Speckle.Core.Models.Base],Objects.Geometry.Point)",
    SelectedTypeName="Objects.Other.BlockDefinition",
    UseSchemaTag=False,
    UserSetSchemaTag=False,
    seed="73ade2175767d3b7bbc7")
sso_34 = BlockDefinition(
    Name="WindowFrames",
    Geometry=bang_8.Branch1,
    BasePoint=bang_3.Branch1,
    SelectedConstructorName="Objects.Other.BlockDefinition.ctor(System.String,System.Collections.Generic.List`1[Speckle.Core.Models.Base],Objects.Geometry.Point)",
    SelectedTypeName="Objects.Other.BlockDefinition",
    UseSchemaTag=False,
    UserSetSchemaTag=False,
    seed="1b1d80a4eee3176ca6c3")
sso_35 = BlockDefinition(
    Name="Window",
    Geometry=bang_8.Branch4,
    BasePoint=bang_3.Branch1,
    SelectedConstructorName="Objects.Other.BlockDefinition.ctor(System.String,System.Collections.Generic.List`1[Speckle.Core.Models.Base],Objects.Geometry.Point)",
    SelectedTypeName="Objects.Other.BlockDefinition",
    UseSchemaTag=False,
    UserSetSchemaTag=False,
    seed="24688f9d86b2807a3ef7")
sso_36 = BlockDefinition(
    Name="Framing",
    Geometry=bang_8.Branch5,
    BasePoint=bang_3.Branch1,
    SelectedConstructorName="Objects.Other.BlockDefinition.ctor(System.String,System.Collections.Generic.List`1[Speckle.Core.Models.Base],Objects.Geometry.Point)",
    SelectedTypeName="Objects.Other.BlockDefinition",
    UseSchemaTag=False,
    UserSetSchemaTag=False,
    seed="7b69c7c1659cf41b13b2")
sso_37 = BlockDefinition(
    Name="Roof",
    Geometry=bang_8.Branch6,
    BasePoint=bang_3.Branch1,
    SelectedConstructorName="Objects.Other.BlockDefinition.ctor(System.String,System.Collections.Generic.List`1[Speckle.Core.Models.Base],Objects.Geometry.Point)",
    SelectedTypeName="Objects.Other.BlockDefinition",
    UseSchemaTag=False,
    UserSetSchemaTag=False,
    seed="8320e9394c29bdbf5e56")
sso_38 = BlockDefinition(
    Name="CeilingStructure",
    Geometry=bang_8.Branch7,
    BasePoint=bang_3.Branch1,
    SelectedConstructorName="Objects.Other.BlockDefinition.ctor(System.String,System.Collections.Generic.List`1[Speckle.Core.Models.Base],Objects.Geometry.Point)",
    SelectedTypeName="Objects.Other.BlockDefinition",
    UseSchemaTag=False,
    UserSetSchemaTag=False,
    seed="a0fe2e1947377c7832cd")
sso_39 = BlockDefinition(
    Name="Floors",
    Geometry=bang_8.Branch7,
    BasePoint=bang_3.Branch1,
    SelectedConstructorName="Objects.Other.BlockDefinition.ctor(System.String,System.Collections.Generic.List`1[Speckle.Core.Models.Base],Objects.Geometry.Point)",
    SelectedTypeName="Objects.Other.BlockDefinition",
    UseSchemaTag=False,
    UserSetSchemaTag=False,
    seed="cd8c0c70134f2ff0082b")
sso_40 = BlockInstance(
    BlockDefinition=sso_31,
    Transform=orient_3.Transform,
    SelectedConstructorName="Objects.Other.BlockInstance.ctor(Objects.Other.BlockDefinition,Objects.Other.Transform)",
    SelectedTypeName="Objects.Other.BlockInstance",
    UseSchemaTag=False,
    UserSetSchemaTag=False,
    seed="4b1574076bd92df2fdb6")
sso_41 = BlockInstance(
    BlockDefinition=sso_32,
    Transform=orient_3.Transform,
    SelectedConstructorName="Objects.Other.BlockInstance.ctor(Objects.Other.BlockDefinition,Objects.Other.Transform)",
    SelectedTypeName="Objects.Other.BlockInstance",
    UseSchemaTag=False,
    UserSetSchemaTag=False,
    seed="a373a42837050946c3d7")
sso_42 = BlockInstance(
    BlockDefinition=sso_33,
    Transform=orient_3.Transform,
    SelectedConstructorName="Objects.Other.BlockInstance.ctor(Objects.Other.BlockDefinition,Objects.Other.Transform)",
    SelectedTypeName="Objects.Other.BlockInstance",
    UseSchemaTag=False,
    UserSetSchemaTag=False,
    seed="1d93392209af0fbf4d8a")
sso_43 = BlockInstance(
    BlockDefinition=sso_34,
    Transform=orient_3.Transform,
    SelectedConstructorName="Objects.Other.BlockInstance.ctor(Objects.Other.BlockDefinition,Objects.Other.Transform)",
    SelectedTypeName="Objects.Other.BlockInstance",
    UseSchemaTag=False,
    UserSetSchemaTag=False,
    seed="453350f923d137815641")
sso_44 = BlockInstance(
    BlockDefinition=sso_35,
    Transform=orient_3.Transform,
    SelectedConstructorName="Objects.Other.BlockInstance.ctor(Objects.Other.BlockDefinition,Objects.Other.Transform)",
    SelectedTypeName="Objects.Other.BlockInstance",
    UseSchemaTag=False,
    UserSetSchemaTag=False,
    seed="456041edc1203048b78e")
sso_45 = BlockInstance(
    BlockDefinition=sso_36,
    Transform=orient_3.Transform,
    SelectedConstructorName="Objects.Other.BlockInstance.ctor(Objects.Other.BlockDefinition,Objects.Other.Transform)",
    SelectedTypeName="Objects.Other.BlockInstance",
    UseSchemaTag=False,
    UserSetSchemaTag=False,
    seed="3a3267cb212978794cbe")
sso_46 = BlockInstance(
    BlockDefinition=sso_37,
    Transform=orient_3.Transform,
    SelectedConstructorName="Objects.Other.BlockInstance.ctor(Objects.Other.BlockDefinition,Objects.Other.Transform)",
    SelectedTypeName="Objects.Other.BlockInstance",
    UseSchemaTag=False,
    UserSetSchemaTag=False,
    seed="32eecf91193ad8da0957")
sso_47 = BlockInstance(
    BlockDefinition=sso_38,
    Transform=orient_3.Transform,
    SelectedConstructorName="Objects.Other.BlockInstance.ctor(Objects.Other.BlockDefinition,Objects.Other.Transform)",
    SelectedTypeName="Objects.Other.BlockInstance",
    UseSchemaTag=False,
    UserSetSchemaTag=False,
    seed="627c43d1a42e93a63a6a")
sso_48 = BlockInstance(
    BlockDefinition=sso_39,
    Transform=orient_3.Transform,
    SelectedConstructorName="Objects.Other.BlockInstance.ctor(Objects.Other.BlockDefinition,Objects.Other.Transform)",
    SelectedTypeName="Objects.Other.BlockInstance",
    UseSchemaTag=False,
    UserSetSchemaTag=False,
    seed="c2fdd04aaf9448ae4b5f")
name_19 = ExtendSpeckleObject(
    SpeckleObject=sso_40,
    BIMSCPROJECT=bimsc_project,
    BIMSCORIGINATOR=bimsc_originator,
    BIMSCVOLUME=bimsc_volume,
    BIMSCTYPE="Inflatable",
    BIMSCMATERIAL="Inflatable",
    RenderMaterial=dso.Inflatable,
    BIMSCASSEMBLY=aphase_6,
    BIMSCPHASE=p_phase_2,
    selectedKitName="Objects")
name_20 = ExtendSpeckleObject(
    SpeckleObject=sso_41,
    BIMSCPROJECT=bimsc_project,
    BIMSCORIGINATOR=bimsc_originator,
    BIMSCVOLUME=bimsc_volume,
    BIMSCTYPE="Inflatable",
    BIMSCMATERIAL="Inflatable",
    RenderMaterial=dso.Inflatable,
    BIMSCASSEMBLY=aphase_6,
    BIMSCPHASE=p_phase_2,
    selectedKitName="Objects")
name_21 = ExtendSpeckleObject(
    SpeckleObject=sso_42,
    BIMSCPROJECT=bimsc_project,
    BIMSCORIGINATOR=bimsc_originator,
    BIMSCVOLUME=bimsc_volume,
    BIMSCTYPE="Inflatable",
    BIMSCMATERIAL="Inflatable",
    RenderMaterial=dso.Inflatable,
    BIMSCASSEMBLY=aphase_6,
    BIMSCPHASE=p_phase_2,
    selectedKitName="Objects")
name_22 = ExtendSpeckleObject(
    SpeckleObject=sso_43,
    BIMSCPROJECT=bimsc_project,
    BIMSCORIGINATOR=bimsc_originator,
    BIMSCVOLUME=bimsc_volume,
    BIMSCTYPE="STRUCTURE",
    BIMSCMATERIAL="Steel",
    RenderMaterial=dso.Steel,
    BIMSCASSEMBLY=aphase_6,
    BIMSCPHASE=p_phase_2,
    selectedKitName="Objects")
name_23 = ExtendSpeckleObject(
    SpeckleObject=sso_44,
    BIMSCPROJECT=bimsc_project,
    BIMSCORIGINATOR=bimsc_originator,
    BIMSCVOLUME=bimsc_volume,
    BIMSCTYPE="GLASS",
    BIMSCMATERIAL="Glass",
    RenderMaterial=dso.Glass,
    BIMSCASSEMBLY=aphase_6,
    BIMSCPHASE=p_phase_2,
    selectedKitName="Objects")
name_24 = ExtendSpeckleObject(
    SpeckleObject=sso_45,
    BIMSCPROJECT=bimsc_project,
    BIMSCORIGINATOR=bimsc_originator,
    BIMSCVOLUME=bimsc_volume,
    BIMSCTYPE="STRUCTURE",
    BIMSCMATERIAL="Steel",
    RenderMaterial=dso.Steel,
    BIMSCASSEMBLY=aphase_6,
    BIMSCPHASE=p_phase_2,
    selectedKitName="Objects")
name_25 = ExtendSpeckleObject(
    SpeckleObject=sso_47,
    BIMSCPROJECT=bimsc_project,
    BIMSCORIGINATOR=bimsc_originator,
    BIMSCVOLUME=bimsc_volume,
    BIMSCTYPE="STRUCTURE",
    BIMSCMATERIAL="Steel",
    RenderMaterial=dso.Steel,
    BIMSCASSEMBLY=aphase_6,
    BIMSCPHASE=p_phase_2,
    selectedKitName="Objects")
name_26 = ExtendSpeckleObject(
    SpeckleObject=sso_48,
    BIMSCPROJECT=bimsc_project,
    BIMSCORIGINATOR=bimsc_originator,
    BIMSCVOLUME=bimsc_volume,
    BIMSCTYPE="STRUCTURE",
    BIMSCMATERIAL="Steel",
    RenderMaterial=dso.Steel,
    BIMSCASSEMBLY=aphase_6,
    BIMSCPHASE=p_phase_2,
    selectedKitName="Objects")
name_27 = ExtendSpeckleObject(
    SpeckleObject=sso_46,
    BIMSCPROJECT=bimsc_project,
    BIMSCORIGINATOR=bimsc_originator,
    BIMSCVOLUME=bimsc_volume,
    BIMSCTYPE="STRUCTURE",
    BIMSCMATERIAL="Steel",
    RenderMaterial=dso.Steel,
    BIMSCASSEMBLY=aphase_6,
    BIMSCPHASE=p_phase_2,
    selectedKitName="Objects")
in_2 = CreateSpeckleObject(
    InflatableOuter=name_19,
    InflatableMiddle=name_20,
    InflatableInner=name_21,
    WindowFrames=name_22,
    Window=name_23,
    Framing=name_24,
    Roof=name_27,
    CeilingStructure=name_25,
    Floors=name_26,
    selectedKitName="Objects")

# ----
# SORTING UNITS BY VOLUME
end = EndPoints(Curve=simplify(duplines))  # -> Start, End
pdecon = Deconstruct(Point=[end.Start, end.End])  # -> XComponent, YComponent, ZComponent
int_2 = Integer(pdecon.ZComponent)
bnd = Bounds(Numbers=int_2)
dedomain = DeconstructDomain(Domain=bnd)  # -> Start, End
equals = Equality(FirstNumber=int_2, SecondNumber=dedomain.Start)  # -> Equality, Inequality
volume_2 = Volume(Geometry=split.Positive)  # -> Volume, simplify(flatten(Centroid))
cull = CullPattern(List=[end.Start, end.End], CullPattern=equals.Equality)
cp = ClosestPoint(Point=cull, Cloud=volume_2.Centroid)  # -> ClosestPoint, CPIndex, Distance
item_7 = ListItem(List=flatten(split.Positive), Index=cp.CPIndex, Wrap=True)
debrep = DeconstructBrep(Brep=item_7)  # -> Faces, Edges, Vertices
area_4 = Area(Geometry=debrep.Faces)  # -> Area, Centroid
pdecon_2 = Deconstruct(Point=area_4.Centroid)  # -> XComponent, YComponent, ZComponent
int_3 = Integer(pdecon_2.ZComponent)
bnd_2 = Bounds(Numbers=int_3)
dedomain_2 = DeconstructDomain(Domain=bnd_2)  # -> Start, End
equals_2 = Equality(FirstNumber=int_3, SecondNumber=dedomain_2.Start)  # -> Equality, Inequality
cull_2 = CullPattern(List=debrep.Faces, CullPattern=equals_2.Equality)  # -> simplify(List)
subtraction = Subtraction(A=dedomain.Start, B=dedomain.End)
wires = BrepWireframe(Brep=cull_2, Density=-1)
division = Division(A=subtraction, B="2")
abs = Absolute(Value=subtraction)
Z = UnitZ(Factor=division)
move = Move(Geometry=cull, Motion=Z)  # -> Geometry, Transform
project = Project(Geometry=wires, Plane=move.Geometry)  # -> simplify(Geometry), Transform

a_phase = Panel(num_8)

# ----
# EDIT SITE MESH
# ASSEMBLY PHASE 1
panel_12 = Panel("https://macad.speckle.xyz/streams/4975f9f0a8/branches/site/04-community-site")
receive_2 = Receive(
    Stream=panel_12,
    AutoReceive=False,
    CurrentComponentState="expired",
    ExpandOutput=True,
    LastInfoMessage="James McBennett @ 03/01/2024 23:14:17: 2024 Mar-01 (id:9ec35295b2)",
    ReceiveOnOpen=False,
    ReceivedCommitId="9ec35295b2",
    StreamWrapper="https://macad.speckle.xyz/projects/4975f9f0a8/models/site/04-community-site",
    selectedKitName="Objects")  # -> Info, CONTOURS, SOIL
item_8 = ListItem(List=flatten(receive_2.SOIL), Index=Slider(3, range=0..17), Wrap=True)
srf_3 = Surface(<surface referenced from the Rhino model>)
bbox = BoundingBox(Content=srf_3, Plane=PlaneXY(0, 0, 0))  # -> Box, Box_2
volume_3 = Volume(Geometry=bbox.Box)  # -> Volume, Centroid
msphere = MeshSphere(Base=volume_3.Centroid, Radius="80", UCount="100", VCount="100")
msplit = MeshSplit(Mesh=item_8, Splitters=msphere)
item_9 = ListItem(List=msplit, Index=Slider(0, range=0..1), Wrap=True)
name_28 = ExtendSpeckleObject(
    SpeckleObject=item_9,
    BIMSCPROJECT=bimsc_project,
    BIMSCORIGINATOR=bimsc_originator,
    BIMSCVOLUME=bimsc_volume,
    BIMSCTYPE="SITE",
    BIMSCMATERIAL="soil",
    RenderMaterial=dso.Site,
    BIMSCASSEMBLY=a_phase,
    BIMSCPHASE=p_phase,
    selectedKitName="Objects")  # -> flatten(ExtendedSpeckleObject)

# ----
# ADD SITE TERRAIN
# ASSEMBLY PHASE 1
panel_13 = Panel("TopoMesh")
reflay_6 = ReferenceByLayer(LayerName="TopoBrep", lightweight=False, DisableAutoUpdate=False)
reflay_7 = ReferenceByLayer(LayerName=panel_13, lightweight=False, DisableAutoUpdate=False)
filter_4 = StreamFilter(Gate=list, Stream0=reflay_6, Stream1=reflay_7)
msplit_2 = MeshSplit(Mesh=filter_4, Splitters=msphere)
item_10 = ListItem(List=msplit_2, Index=Slider(1, range=0..1), Wrap=True)
name_29 = ExtendSpeckleObject(
    SpeckleObject=item_10,
    BIMSCPROJECT=bimsc_project,
    BIMSCORIGINATOR=bimsc_originator,
    BIMSCVOLUME=bimsc_volume,
    BIMSCTYPE="TERRAIN",
    BIMSCMATERIAL="soil",
    RenderMaterial=dso.Soil,
    BIMSCASSEMBLY=a_phase,
    BIMSCPHASE=p_phase,
    selectedKitName="Objects")  # -> flatten(ExtendedSpeckleObject)

end_2 = EndPoints(Curve=project.Geometry)  # -> Start, End
multiplication = Multiplication(A=abs, B="2")
cullpt = CullDuplicates(Points=[end_2.Start, end_2.End], Tolerance=0.1, CullMode=3)  # -> Points, Indices, Valence
pline = PolyLine(Vertices=cullpt.Points, Closed=True)  # -> simplify(Polyline)
Z_2 = UnitZ(Factor=multiplication)
extr = Extrude(Base=pline, Direction=Z_2)
cap = CapHoles(Brep=extr)

# ----
# MERGED UNITS
in_3 = CreateSpeckleObject(Units_Buffer=in_2, Units_Habi=in, Units_Support=cso, selectedKitName="Objects")

# ---- group: Units_Support
# UNITS PLANES
debrep_2 = DeconstructBrep(Brep=bang_4.Branch0)  # -> Faces, Edges, Vertices
area_5 = Area(Geometry=debrep_2.Faces)  # -> Area, Centroid
pdecon_3 = Deconstruct(Point=area_5.Centroid)  # -> XComponent, YComponent, ZComponent
int_4 = Integer(pdecon_3.ZComponent)
bnd_3 = Bounds(Numbers=int_4)
dedomain_3 = DeconstructDomain(Domain=bnd_3)  # -> Start, End
equals_3 = Equality(FirstNumber=int_4, SecondNumber=dedomain_3.Start)  # -> Equality, Inequality
cull_3 = CullPattern(List=area_5.Centroid, CullPattern=equals_3.Equality)  # -> simplify(List)
pln_4 = Plane(flatten(cull_3))

# ---- group: Units_Buffer
debrep_3 = DeconstructBrep(Brep=cap)  # -> Faces, Edges, Vertices
area_6 = Area(Geometry=debrep_3.Faces)  # -> Area, Centroid
pdecon_4 = Deconstruct(Point=area_6.Centroid)  # -> XComponent, YComponent, ZComponent
int_5 = Integer(pdecon_4.ZComponent)
bnd_4 = Bounds(Numbers=int_5)
dedomain_4 = DeconstructDomain(Domain=bnd_4)  # -> Start, End
equals_4 = Equality(FirstNumber=int_5, SecondNumber=dedomain_4.Start)  # -> Equality, Inequality
cull_4 = CullPattern(List=area_6.Centroid, CullPattern=equals_4.Equality)  # -> simplify(List)
pln_5 = Plane(flatten(cull_4))

# ---- group: Units_Habi
debrep_4 = DeconstructBrep(Brep=split.Negative)  # -> Faces, Edges, Vertices
area_7 = Area(Geometry=debrep_4.Faces)  # -> Area, Centroid
pdecon_5 = Deconstruct(Point=area_7.Centroid)  # -> XComponent, YComponent, ZComponent
int_6 = Integer(pdecon_5.ZComponent)
bnd_5 = Bounds(Numbers=int_6)
dedomain_5 = DeconstructDomain(Domain=bnd_5)  # -> Start, End
equals_5 = Equality(FirstNumber=int_6, SecondNumber=dedomain_5.Start)  # -> Equality, Inequality
cull_5 = CullPattern(List=area_7.Centroid, CullPattern=equals_5.Equality)  # -> simplify(List)
pln_6 = Plane(flatten(cull_5))

# ----
# 01 //Create Revit Materials from Rhino M Properties
trigger = Trigger(Interval=-1000, TimerInterval=1000, Target=[material, graphics])  # disabled

# ----
# 02// Create New Unit Revit Family
trigger_2 = Trigger(Interval=-1000, TimerInterval=1000, Target=[new, famform, materials, active])  # disabled

# ----
# SEND TO REVIT MODEL
# The figures in the circles from the trigger component
# for the revit families to work have to be from left to right:
# a triangle (play), a pointer (mouse), and a key.
# //Send Topo Meshes to Revit
trigger_3 = Trigger(Interval=-1000, TimerInterval=1000, Target=topography)  # disabled

# ----
# 03//Add Units to Revit
trigger_4 = Trigger(Interval=-1000, TimerInterval=1000, Target=[types, l_component, l_component_2, l_component_3])  # disabled

# ----
# G06 shared branch
panel_14 = Panel("https://macad.speckle.xyz/projects/4975f9f0a8/models/37a2354197")

# ----
# G06 wip branch
# https://macad.speckle.xyz/projects/4975f9f0a8/models/0c407c0907
panel_15 = Panel("G06_WIPdModel_V19")

# ----
# G06_test_Unreal
# https://macad.speckle.xyz/streams/5e4e4e4563
panel_16 = Panel("G06_UnrealdModel_V1")

# ----
# G6_STUDIO_MAIN_MODEL
# https://macad.speckle.xyz/projects/4975f9f0a8/models/37a2354197
panel_17 = Panel("G06_AssembledModel_V4")

# ----
# //Send topo meshes to Revit
number_slider_3 = Slider(9, range=0..10)
mesh_4 = Mesh(reflay_7)
unweld = UnweldMesh(Mesh=mesh_4, Angle=degrees(number_slider_3))
topography = AddTopographyMesh(Mesh=unweld, TrackingMode=2)  # disabled

# ----
# //Send block instances to Revit
block_info_2 = GetBlockInfo(Block=reflay)  # -> Name, Plane, Transform, BlockType, FilePath, Active
orient_4 = Orient(Geometry=reflay, Source=block_info_2.Plane, Target=PlaneXY(0, 0, 0))  # -> Geometry, Transform
expblock_4 = ExplodeBlock(Block=orient_4.Geometry, recursive=False)  # -> Name, Transform, Geometry

# ----
# //Query materials' names using Elefront
geo = Geometry(expblock_4.Geometry)
ef_att_4 = EleFrontAttributes(Attributes=geo)
ef_layer_4 = EleFrontLayer(Layer=ef_att_4)
ef_layer_5 = EleFrontLayer(Layer=ef_layer_4)

split_2 = TextSplit(Text=ef_layer_4, Separators="::")
item_11 = ListItem(List=split_2, Index=-1, Wrap=True)
concat_2 = Concatenate(FragmentA="M-", FragmentB=item_11)  # -> simplify(Result)
pshift = ShiftPaths(Data=concat_2, Offset=-1)

# ----
# 02// Create new component family
materials = QueryMaterials(Name=pshift)
add_link_to_revit_family_in_from_your_la = Panel("C:\Users\ARoncal\OneDrive - Thornton Tomasetti, Inc\__License Resources\Desktop\G06_studio_2024\Final\documentation\FTemplate_GEN_.rft")  # "Add Link to Revit Family in from your laptop. [Final / Documentation]"
famform = ComponentFamilyForm(Brep=graft(geo), Material=materials)
active = ActiveDocument()
shift = ShiftPaths(Data=famform, Offset=-1)
new = NewComponentFamily(
    Document=active,
    Template=add_link_to_revit_family_in_from_your_la,
    Overwrite=Toggle(True),
    Name=simplify(expblock_4.Name),
    Geometry=simplify(shift))

# ----
# 03//Add components to RH Planes
types = QueryTypes(Document=active, Kind=3, FamilyName=expblock_4.Name)
bang_9 = ExplodeTree()  # -> Branch0, Branch1, Branch2
l_component = AddComponentLocation(Document=active, Location=simplify(pln_4), Type=simplify(bang_9.Branch0), TrackingMode=2)
l_component_2 = AddComponentLocation(Document=active, Location=simplify(pln_6), Type=simplify(bang_9.Branch1), TrackingMode=2)
l_component_3 = AddComponentLocation(Document=active, Location=simplify(pln_5), Type=simplify(bang_9.Branch2), TrackingMode=2)

# ----
# ADD ROOF
# ASSEMBLY PHASE 8
panel_18 = Panel("Roof")
reflay_8 = ReferenceByLayer(LayerName=panel_18, lightweight=False, DisableAutoUpdate=False)
mesh_5 = Mesh(reflay_8)
faceb = FaceBoundaries(Mesh=mesh_5)
boundary = BoundarySurfaces(Edges=faceb)
join = BrepJoin(Breps=boundary)  # -> Breps, Closed
mesh_6 = Mesh(reflay_8)
aphase_7 = Panel(num_14)
filter_5 = StreamFilter(Gate=list, Stream0=join.Breps, Stream1=mesh_6)  # -> reverse(simplify(graft(Stream)))
name_30 = ExtendSpeckleObject(
    SpeckleObject=filter_5,
    BIMSCPROJECT=bimsc_project,
    BIMSCORIGINATOR=bimsc_originator,
    BIMSCVOLUME=bimsc_volume,
    BIMSCTYPE="ROOF",
    BIMSCMATERIAL="Inflatable",
    RenderMaterial=dso.Inflatable,
    BIMSCASSEMBLY=aphase_7,
    BIMSCPHASE=p_phase_2,
    selectedKitName="Objects")

# ----
# SEND TO SPLECKLE STREAMS
cso_2 = CreateSpeckleObject(
    ROOF=name_30,
    WALL=name_12,
    FLOORS=name_10,
    PODS=name_11,
    UNITS=in_3,
    TERRAIN=name_29,
    SITE_A4=name_28,
    selectedKitName="Objects")

# ----
# Always Leave Send Component Unplugged
# in the stream input before closing and
# saving this gh file
send = Send(
    Stream=panel_14,
    Message="G06_AssembledModel_V11",
    D=cso_2,
    AutoSend=False,
    BaseId="02a7ba8e94566701b40dac61cbc10317",
    CurrentComponentState="up_to_date",
    KitName="Objects",
    OutputWrappers="https://macad.speckle.xyz\t4975f9f0a8\t36d3c8927a",
    UseDefaultCache=True,
    selectedKitName="Objects")
rec = DataRecorder(send, DataLimit=-10, RecordData=True)
panel_19 = Panel(rec)

item_12 = ListItem(List=rec, Index="-1", Wrap=True)
panel_20 = Panel(item_12)

# ---- group: Units_Habi
pln_7 = Plane(flatten(cull_5))

# ---- group: Units_Buffer
pln_8 = Plane(flatten(cull_3))

# ----
aphase_8 = Panel(num_13)

# ----
# HABITAD UNITS
# ASSEMBLY PHASE 6
expblock_5 = ExplodeBlock(Block=bang.Branch1, recursive=False)  # -> Name, Transform, Geometry
detatt_4 = DetachAttributes(Geometry=expblock_5.Geometry)  # -> Geometry, Attributes
volume_4 = Volume(Geometry=detatt_4.Geometry)  # -> Volume, Centroid
cset_9 = CreateSet(List=volume_4.Volume)  # -> Set, Map
cset_10 = CreateSet(List=cset_9.Map)  # -> Set, Map
mindex_5 = MemberIndex(Set=cset_9.Map, Member=cset_10.Set)  # -> Index, Count
item_13 = ListItem(List=detatt_4.Geometry, Index=mindex_5.Index, Wrap=True)  # -> simplify(Item)
bang_10 = ExplodeTree(Data=item_13)  # -> Branch0, Branch1, Branch2
sso_49 = BlockDefinition(
    Name="Glass",
    Geometry=bang_10.Branch2,
    SelectedConstructorName="Objects.Other.BlockDefinition.ctor(System.String,System.Collections.Generic.List`1[Speckle.Core.Models.Base],Objects.Geometry.Point)",
    SelectedTypeName="Objects.Other.BlockDefinition",
    UseSchemaTag=False,
    UserSetSchemaTag=False,
    seed="ff8e895b96f4344e5bea")
sso_50 = BlockDefinition(
    Name="Inflatable",
    Geometry=bang_10.Branch1,
    BasePoint=bang_3.Branch1,
    SelectedConstructorName="Objects.Other.BlockDefinition.ctor(System.String,System.Collections.Generic.List`1[Speckle.Core.Models.Base],Objects.Geometry.Point)",
    SelectedTypeName="Objects.Other.BlockDefinition",
    UseSchemaTag=False,
    UserSetSchemaTag=False,
    seed="74c7ac9f915255a3e209")
sso_51 = BlockDefinition(
    Name="Steel",
    Geometry=bang_10.Branch0,
    BasePoint=bang_3.Branch1,
    SelectedConstructorName="Objects.Other.BlockDefinition.ctor(System.String,System.Collections.Generic.List`1[Speckle.Core.Models.Base],Objects.Geometry.Point)",
    SelectedTypeName="Objects.Other.BlockDefinition",
    UseSchemaTag=False,
    UserSetSchemaTag=False,
    seed="6d6048d8a75f62682faf")
orient_5 = Orient(Geometry=bang.Branch1, Source=bang_3.Branch1, Target=pln_7)  # -> Geometry, Transform
sso_52 = BlockInstance(
    BlockDefinition=sso_49,
    Transform=orient_5.Transform,
    SelectedConstructorName="Objects.Other.BlockInstance.ctor(Objects.Other.BlockDefinition,Objects.Other.Transform)",
    SelectedTypeName="Objects.Other.BlockInstance",
    UseSchemaTag=False,
    UserSetSchemaTag=False,
    seed="741531741e3be19cb2c0")
sso_53 = BlockInstance(
    BlockDefinition=sso_50,
    Transform=orient_5.Transform,
    SelectedConstructorName="Objects.Other.BlockInstance.ctor(Objects.Other.BlockDefinition,Objects.Other.Transform)",
    SelectedTypeName="Objects.Other.BlockInstance",
    UseSchemaTag=False,
    UserSetSchemaTag=False,
    seed="5ef6fa26b8afc923a02a")
sso_54 = BlockInstance(
    BlockDefinition=sso_51,
    Transform=orient_5.Transform,
    SelectedConstructorName="Objects.Other.BlockInstance.ctor(Objects.Other.BlockDefinition,Objects.Other.Transform)",
    SelectedTypeName="Objects.Other.BlockInstance",
    UseSchemaTag=False,
    UserSetSchemaTag=False,
    seed="2b6654ad513ddd9dd323")
name_31 = ExtendSpeckleObject(
    SpeckleObject=sso_53,
    BIMSCPROJECT=bimsc_project,
    BIMSCORIGINATOR=bimsc_originator,
    BIMSCVOLUME=bimsc_volume,
    BIMSCTYPE="INFLATABLES",
    BIMSCMATERIAL="Inflatable",
    RenderMaterial=dso.Inflatable,
    BIMSCASSEMBLY=aphase_8,
    BIMSCPHASE=p_phase_2,
    selectedKitName="Objects")
name_32 = ExtendSpeckleObject(
    SpeckleObject=sso_54,
    BIMSCPROJECT=bimsc_project,
    BIMSCORIGINATOR=bimsc_originator,
    BIMSCVOLUME=bimsc_volume,
    BIMSCTYPE="STRUCTURE",
    BIMSCMATERIAL="Steel",
    RenderMaterial=dso.Steel,
    BIMSCASSEMBLY=aphase_8,
    BIMSCPHASE=p_phase_2,
    selectedKitName="Objects")
name_33 = ExtendSpeckleObject(
    SpeckleObject=sso_52,
    BIMSCPROJECT=bimsc_project,
    BIMSCORIGINATOR=bimsc_originator,
    BIMSCVOLUME=bimsc_volume,
    BIMSCTYPE="STRUCTURE",
    BIMSCMATERIAL="Glass",
    RenderMaterial=dso.Glass,
    BIMSCASSEMBLY=aphase_8,
    BIMSCPHASE=p_phase_2,
    selectedKitName="Objects")
in_4 = CreateSpeckleObject(Inflatables=name_31, Structure=name_32, Window=name_33, selectedKitName="Objects")

# ----
# SUPPORT UNITS
# ASSEMBLY PHASE 7
expblock_6 = ExplodeBlock(recursive=False)  # -> Name, Transform, Geometry
detatt_5 = DetachAttributes(Geometry=expblock_6.Geometry)  # -> Geometry, Attributes
volume_5 = Volume(Geometry=detatt_5.Geometry)  # -> Volume, Centroid
cset_11 = CreateSet(List=volume_5.Volume)  # -> Set, Map
cset_12 = CreateSet(List=cset_11.Map)  # -> Set, Map
mindex_6 = MemberIndex(Set=cset_11.Map, Member=cset_12.Set)  # -> Index, Count
item_14 = ListItem(List=detatt_5.Geometry, Index=mindex_6.Index, Wrap=True)  # -> simplify(Item)
bang_11 = ExplodeTree(Data=item_14)  # -> Branch0, Branch1, Branch2
sso_55 = BlockDefinition(
    Name="Glass",
    Geometry=bang_11.Branch2,
    SelectedConstructorName="Objects.Other.BlockDefinition.ctor(System.String,System.Collections.Generic.List`1[Speckle.Core.Models.Base],Objects.Geometry.Point)",
    SelectedTypeName="Objects.Other.BlockDefinition",
    UseSchemaTag=False,
    UserSetSchemaTag=False,
    seed="c00390b6159f8939e4fd")
sso_56 = BlockDefinition(
    Name="Inflatable",
    Geometry=bang_11.Branch1,
    SelectedConstructorName="Objects.Other.BlockDefinition.ctor(System.String,System.Collections.Generic.List`1[Speckle.Core.Models.Base],Objects.Geometry.Point)",
    SelectedTypeName="Objects.Other.BlockDefinition",
    UseSchemaTag=False,
    UserSetSchemaTag=False,
    seed="e98ffe5e9bfe795355b2")
sso_57 = BlockDefinition(
    Name="Steel",
    Geometry=bang_11.Branch0,
    SelectedConstructorName="Objects.Other.BlockDefinition.ctor(System.String,System.Collections.Generic.List`1[Speckle.Core.Models.Base],Objects.Geometry.Point)",
    SelectedTypeName="Objects.Other.BlockDefinition",
    UseSchemaTag=False,
    UserSetSchemaTag=False,
    seed="19cce9d17a2992b002e5")
orient_6 = Orient(Source=PlaneXY(0, 0, 0), Target=pln_8)  # -> Geometry, Transform
sso_58 = BlockInstance(
    BlockDefinition=sso_55,
    Transform=orient_6.Transform,
    SelectedConstructorName="Objects.Other.BlockInstance.ctor(Objects.Other.BlockDefinition,Objects.Other.Transform)",
    SelectedTypeName="Objects.Other.BlockInstance",
    UseSchemaTag=False,
    UserSetSchemaTag=False,
    seed="95800f53cba6afedca5a")
aphase_9 = Panel(num_16)
sso_59 = BlockInstance(
    BlockDefinition=sso_56,
    Transform=orient_6.Transform,
    SelectedConstructorName="Objects.Other.BlockInstance.ctor(Objects.Other.BlockDefinition,Objects.Other.Transform)",
    SelectedTypeName="Objects.Other.BlockInstance",
    UseSchemaTag=False,
    UserSetSchemaTag=False,
    seed="6ac40892a254094ba5bf")
sso_60 = BlockInstance(
    BlockDefinition=sso_57,
    Transform=orient_6.Transform,
    SelectedConstructorName="Objects.Other.BlockInstance.ctor(Objects.Other.BlockDefinition,Objects.Other.Transform)",
    SelectedTypeName="Objects.Other.BlockInstance",
    UseSchemaTag=False,
    UserSetSchemaTag=False,
    seed="56e02fcb1ef79a18a3fe")
name_34 = ExtendSpeckleObject(
    SpeckleObject=sso_58,
    BIMSCPROJECT=bimsc_project,
    BIMSCORIGINATOR=bimsc_originator,
    BIMSCVOLUME=bimsc_volume,
    BIMSCTYPE="STRUCTURE",
    BIMSCMATERIAL="Glass",
    RenderMaterial=dso.Glass,
    BIMSCASSEMBLY=aphase_9,
    BIMSCPHASE=p_phase_2,
    selectedKitName="Objects")
name_35 = ExtendSpeckleObject(
    SpeckleObject=sso_59,
    BIMSCPROJECT=bimsc_project,
    BIMSCORIGINATOR=bimsc_originator,
    BIMSCVOLUME=bimsc_volume,
    BIMSCTYPE="INFLATABLES",
    BIMSCMATERIAL="Inflatable",
    RenderMaterial=dso.Inflatable,
    BIMSCASSEMBLY=aphase_9,
    BIMSCPHASE=p_phase_2,
    selectedKitName="Objects")
name_36 = ExtendSpeckleObject(
    SpeckleObject=sso_60,
    BIMSCPROJECT=bimsc_project,
    BIMSCORIGINATOR=bimsc_originator,
    BIMSCVOLUME=bimsc_volume,
    BIMSCTYPE="STRUCTURE",
    BIMSCMATERIAL="Steel",
    RenderMaterial=dso.Steel,
    BIMSCASSEMBLY=aphase_9,
    BIMSCPHASE=p_phase_2,
    selectedKitName="Objects")
in_5 = CreateSpeckleObject(Inflatables=name_35, Structure=name_36, Window=name_34, selectedKitName="Objects")

# ----
# 01 //Create Revit materials from Rhino M Properties
cset_13 = CreateSet(List=flatten(pshift))  # -> Set, Map
material = AddMaterial(Name=cset_13.Set, TrackingMode=2)  # disabled

# ---- group: MaterialProperties
python = GhPythonScript(Mname=cset_13.Set)  # -> out, Pvalue, Pname
# ---------- python: Python ----------
__author__ = "hesham.shawqy"
__version__ = "2024.02.25"

import rhinoscriptsyntax as rs
import Rhino.DocObjects as rd
import Rhino as rh

def get_material_properties(Mname):
    # Get the active Rhino document
    doc = rh.RhinoDoc.ActiveDoc
    
    # Search for the material by name
    material_index = doc.Materials.Find(Mname, True)
    if material_index < 0:
        print("Material not found.")
        return None
    
    # Retrieve the material object
    material = doc.Materials[material_index]
    
    # Extract material properties
    properties = {
        "DiffuseColor": material.DiffuseColor,
        "Transparency": material.Transparency,
        # Add more properties as needed
    }
    
    return properties

Pname = []
Pvalue = []
material_properties = get_material_properties(Mname)
if material_properties:
    for prop, value in material_properties.items():
        Pvalue.append(value)
        Pname.append(prop)
# ---------- end python ----------

# ----
item_15 = ListItem(List=simplify(python.Pvalue), Index=0, Wrap=True)  # -> Item, Item1
graphics = MaterialGraphics(
    Material=simplify(graft(material)),
    Color=item_15.Item,
    Transparency=item_15.Item1,
    ForegroundPatternCutPatterns=<geometry referenced from the Revit model>)  # -> Material, UseRenderAppearance, Color, Transparency, SurfacePatternsForegroundPattern, SurfacePatternsForegroundColor, CutPatternsForegroundPattern, CutPatternsForegroundColor; disabled
