# Grasshopper definition Roof Adaptive Components - Latest.gh (Grasshopper 1.0.7)
# plug-ins: Rhino.Inside for Autodesk Revit, MeshEdit Components, MetaHopper, LunchBox

mesh = Mesh(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)
mesh_2 = Mesh(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)  # disabled
mesh_3 = Mesh(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)
medges = MeshEdges(Mesh=mesh)  # -> NakedEdges, InteriorEdges, NonManifoldEdges
crv = Curve(medges.NakedEdges)
facen = FaceNormals(Mesh=mesh_3)  # -> Centers, Normals
join = JoinCurves(Curves=crv, Preserve=False)
xy = XYPlane(Origin=facen.Centers)
explode = MeshExplode(Mesh=mesh_3, Interpolate=False)
explode_2 = MeshExplode(Mesh=mesh, Interpolate=False)
project = Project(Geometry=facen.Normals, Plane=xy)  # -> Geometry, Transform
cull_i = CullIndex(List=join, Indices="4", Wrap=True)
panel = Panel("""0
1
3
2""")
vdis = VectorDisplay(Anchor=facen.Centers, Vector=facen.Normals)  # disabled
vdis_2 = VectorDisplay(Anchor=facen.Centers, Vector=project.Geometry)  # disabled
area = Area(Geometry=explode_2)  # -> Area, Centroid
angle = Angle(VectorA=facen.Normals, VectorB=project.Geometry)  # -> Angle, Reflex
item = ListItem(List=cull_i, Index=panel, Wrap=True)
deg = Degrees(Radians=angle.Angle)
rtree = CreateRTree(InputGeometry=area.Centroid)
area_2 = Area(Geometry=item)  # -> Area, Centroid
area_3 = Area(Geometry=explode)  # -> Area, Centroid
rtree_range = RTreePointsInRange(SearchPoints=area_2.Centroid, SearchDistance=Slider(13.5, range=0..50), RTree=rtree)  # -> PointsWithinRange, IndicesWithinRange
smaller = SmallerThan(FirstNumber=area_3.Area, SecondNumber=Slider(0, range=0..1))  # -> SmallerThan, OrEqualTo
smaller_2 = SmallerThan(FirstNumber=deg, SecondNumber=Slider(61.1, range=0..90))  # -> SmallerThan, OrEqualTo
rtree_cp = RTreeClosestPoint(SearchPoints=rtree_range.PointsWithinRange, RTree=rtree)  # -> ClosestPoint, ClosestIndex
dispatch = Dispatch(List=explode, DispatchPattern=smaller.OrEqualTo)  # -> ListA, ListB
dispatch_2 = Dispatch(List=area_3.Area, DispatchPattern=smaller.OrEqualTo)  # -> ListA, ListB
dispatch_3 = Dispatch(List=explode, DispatchPattern=smaller_2.OrEqualTo)  # -> ListA, ListB
item_2 = ListItem(List=explode_2, Index=rtree_cp.ClosestIndex, Wrap=True)
relay = Relay()
mesh_4 = Mesh(dispatch_3.ListB)
area_4 = Area(Geometry=item_2)  # -> Area, Centroid
dist = Distance(PointA=area_4.Centroid, PointB=graft(area_2.Centroid))
component_families = ComponentFamiliesPicker(<component families picker referenced from the Revit model>, SearchPattern="quad")
sort = SortList(Keys=dist, ValuesA=item_2)  # -> Keys, ValuesA
demesh = DeconstructMesh(Mesh=explode)  # -> simplify(Vertices), Faces, Colours, Normals
bang = ExplodeTree(Data=sort.ValuesA)  # -> _0000000, _0000001, _0000002, _0000003
viewer = ParamViewer(demesh.Vertices)
viewer_2 = ParamViewer(area_3.Area)
geo = Geometry(bang._0000000)
element_type_picker = ElementTypePicker(
    component_families,
    {"quadMeshPanel : quadMeshPanel": "45e5da70-6961-4a8e-a671-74fee38f84e8:e9fbe0a5-b638-4a2d-a8ce-f443ebd8c8b7-0004ffc3"}, selected="quadMeshPanel : quadMeshPanel")
demesh_2 = DeconstructMesh(Mesh=bang._0000000)  # -> simplify(Vertices), Faces, Colours, Normals
area_5 = Area(Geometry=bang._0000000)  # -> Area, Centroid
demesh_3 = DeconstructMesh(Mesh=bang._0000002)  # -> simplify(Vertices), Faces, Colours, Normals
area_6 = Area(Geometry=bang._0000002)  # -> Area, Centroid
demesh_4 = DeconstructMesh(Mesh=bang._0000001)  # -> simplify(Vertices), Faces, Colours, Normals
area_7 = Area(Geometry=bang._0000001)  # -> Area, Centroid
demesh_5 = DeconstructMesh(Mesh=bang._0000003)  # -> simplify(Vertices), Faces, Colours, Normals
area_8 = Area(Geometry=bang._0000003)  # -> Area, Centroid
panel_2 = Panel("Panel Area")
component_families_2 = ComponentFamiliesPicker(<component families picker referenced from the Revit model>, SearchPattern="quad")
trigger = Trigger(Interval=-1000, TimerInterval=1000, Target=g_shape)
phase = Phase(<phase referenced from the Revit model>)

mesh_5 = Mesh(<mesh referenced from the Rhino model>)
srf = Surface(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)
toggle = GroupToggle(ToggleActive=True, ToggleVisible=False)  # disabled
explode_3 = MeshExplode(Mesh=mesh_5, Interpolate=False)
demesh_6 = DeconstructMesh(Mesh=explode_3)  # -> Vertices, Faces, Colours, Normals
area_9 = Area(Geometry=explode_3)  # -> Area, Centroid
sort_2 = SortList(Keys=demesh_6.Vertices, ValuesA=demesh_6.Vertices)  # -> Keys, ValuesA
meshcp = MeshClosestPoint(Point=area_9.Centroid, Mesh=mesh_5)  # -> Point, Index, Parameter
pdecon = Deconstruct(Point=meshcp.Point)  # -> XComponent, YComponent, ZComponent
component_families_3 = ComponentFamiliesPicker(<component families picker referenced from the Revit model>, SearchPattern="generic")
multiplication = Multiplication(A=pdecon.XComponent, B=pdecon.YComponent)  # -> simplify(Result)
bnd = Bounds(Numbers=flatten(relay))
element_type_picker_2 = ElementTypePicker(component_families_3)
dedomain = DeconstructDomain(Domain=bnd)  # -> Start, End
gradient = Gradient(
    LowerLimit=dedomain.Start,
    UpperLimit=dedomain.End,
    Parameter=relay,
    stops=[0: RGB(0, 128, 0), 0.5: RGB(255, 255, 0), 1: RGB(255, 0, 0)])
active = ActiveDocument()
trigger_2 = Trigger(Interval=-1000, TimerInterval=1000, Target=a_component)
a_component = AddComponentAdaptive(Document=active, Points=demesh_6.Vertices, Type=element_type_picker_2, TrackingMode=2)  # -> simplify(Component)
cset = CreateSet(List=flatten(gradient))  # -> Set, Map
concat = Concatenate(FragmentA="colour ", FragmentB=cset.Set)
inspect = InspectElement(Element=a_component)  # -> simplify(MaterialsAndFinishesPanelMaterial)
material = AddMaterial(Name=concat, TrackingMode=2)
item_3 = ListItem(List=flatten(material), Index=cset.Map, Wrap=True)  # -> simplify(graft(Item))
param = ElementParameter(Element=a_component, Parameter=inspect)  # -> Element, Value
graphics = MaterialGraphics(Material=item_3, Color=gradient)  # -> simplify(Material), UseRenderAppearance, Color, Transparency, SurfacePatternsForegroundPattern, SurfacePatternsForegroundColor, CutPatternsForegroundPattern, CutPatternsForegroundColor
phasing = ElementPhasing(Element=param.Element, Created=phase)  # -> Element, Created, Demolished

# ---- group: TEMP
tstat = TreeStatistics(Tree=demesh_2.Vertices)  # -> Paths, Length, Count
split = SplitList(List=tstat.Paths, Index="10")  # -> ListA, ListB
split_2 = SplitList(List=area_5.Area, Index="10")  # -> ListA, ListB
split_3 = SplitTree(Data=demesh_2.Vertices, Masks=flatten(split.ListA))  # -> Positive, Negative

# ---- group: Area
parameter = Parameter(<parameter referenced from the Revit model>, SelectedBuiltInCategory="autodesk.revit.category.family:genericModel")

# ----
g_shape = AddDirectShapeGeometry(Category=<geometry referenced from the Revit model>, Geometry=dispatch.ListA, TrackingMode=2)  # disabled
tstat_2 = TreeStatistics(Tree=demesh.Vertices)  # -> Paths, Length, Count
panel_3 = Panel(parameter)
element_type_picker_3 = ElementTypePicker(
    component_families_2,
    {"Anno_Elevation_Mark_Body_Square : Detail_Number": "45e5da70-6961-4a8e-a671-74fee38f84e8:b59c8d5d-94fc-4004-be8b-c8c9a5f4950a-0002e80b", "Anno_Elevation_Mark_Body_Square : Detail_Number_and_View_Name": "45e5da70-6961-4a8e-a671-74fee38f84e8:b59c8d5d-94fc-4004-be8b-c8c9a5f4950a-0002e809", "Anno_Elevation_Mark_Body_Square : Filled_Arrow": "45e5da70-6961-4a8e-a671-74fee38f84e8:b59c8d5d-94fc-4004-be8b-c8c9a5f4950a-0002e807", "Anno_Elevation_Mark_Body_Square : Filled_Arrow_and_View_Name": "45e5da70-6961-4a8e-a671-74fee38f84e8:b59c8d5d-94fc-4004-be8b-c8c9a5f4950a-0002e80d"}, selected="Anno_Elevation_Mark_Body_Square : Detail_Number")
split_4 = SplitList(List=tstat_2.Paths, Index="10")  # -> ListA, ListB
split_5 = SplitList(List=area_3.Area, Index="10")  # -> ListA, ListB
split_6 = SplitTree(Data=demesh.Vertices, Masks=flatten(split_4.ListA))  # -> Positive, Negative
trigger_3 = Trigger(Interval=-1000, TimerInterval=1000, Target=a_component_5)

# ---- group: Angle
parameter_2 = Parameter(<parameter referenced from the Revit model>)

# ----
trigger_4 = Trigger(Interval=-1000, TimerInterval=1000, Target=a_component_2)
trigger_5 = Trigger(Interval=-1000, TimerInterval=1000, Target=a_component_3)
trigger_6 = Trigger(Interval=-1000, TimerInterval=1000, Target=a_component_4)
trigger_7 = Trigger(Interval=-1000, TimerInterval=1000, Target=a_component_6)
a_component_2 = AddComponentAdaptive(Points=demesh_5.Vertices, Type=element_type_picker, TrackingMode=2)  # -> simplify(flatten(Component)); disabled
panel_4 = Panel("Area")
panel_5 = Panel("Inclination")
panel_6 = Panel("angle")
a_component_3 = AddComponentAdaptive(Points=demesh_2.Vertices, Type=element_type_picker, TrackingMode=2)  # -> simplify(flatten(Component)); disabled
panel_7 = Panel("Panels Area")
a_component_4 = AddComponentAdaptive(Points=demesh_4.Vertices, Type=element_type_picker, TrackingMode=2)  # -> simplify(flatten(Component)); disabled
a_component_5 = AddComponentAdaptive(Points=demesh.Vertices, Type=element_type_picker_3, TrackingMode=2)  # -> simplify(flatten(Component)); disabled
a_component_6 = AddComponentAdaptive(Points=demesh_3.Vertices, Type=element_type_picker, TrackingMode=2)  # -> simplify(flatten(Component)); disabled
elements = QueryElements(Limit=100)  # -> Elements, Count
define_param = DefineParameter(Type="autodesk.spec:spec.string-2.0.0", Group="autodesk.parameter.group:data-1.0.0")
elements_2 = QueryElements(Limit=100)  # -> Elements, Count
parameters = QueryElementParameters(Element=a_component_3, Name="Panels Area")  # -> flatten(Parameters)
parameters_2 = QueryElementParameters(Element=a_component_2, Name="Panels Area")  # -> flatten(Parameters)
parameters_3 = QueryElementParameters(Element=a_component_4, Name="Panels Area")  # -> flatten(Parameters)
parameters_4 = QueryElementParameters(Element=a_component_6, Name="Panels Area")  # -> flatten(Parameters)
parameters_5 = QueryElementParameters(Element=a_component_5, Name="Panel Area")
parameters_6 = QueryElementParameters(Element=a_component_5, Name="Panel Area")  # -> flatten(Parameters)
parameters_7 = QueryElementParameters(Element=elements.Elements)
param_2 = ElementParameter(Element=a_component_3, Parameter=parameters, Value=simplify(area_5.Area))  # -> Element, Value
param_3 = ElementParameter(Element=a_component_6, Parameter=parameters_4, Value=simplify(area_6.Area))  # -> Element, Value
param_4 = ElementParameter(Element=a_component_4, Parameter=parameters_3, Value=simplify(area_7.Area))  # -> Element, Value
param_5 = ElementParameter(Element=a_component_2, Parameter=parameters_2, Value=simplify(area_8.Area))  # -> Element, Value
panel_8 = Panel(parameters_5)
phases = QueryPhases()
phases_2 = QueryPhases()
phases_3 = QueryPhases()
phases_4 = QueryPhases()
param_6 = ElementParameter(Element=a_component_5, Parameter=parameters_6, Value=simplify(area_3.Area))  # -> Element, Value
panel_9 = Panel(phases)
item_4 = ListItem(List=phases, Index=0, Wrap=True)  # -> Item, Item1, Item2, Item3, Item4
item_5 = ListItem(List=phases_4, Index=0, Wrap=True)  # -> Item, Item1, Item2, Item3, Item4, Item5
item_6 = ListItem(List=phases_3, Index=0, Wrap=True)  # -> Item, Item1, Item2, Item3
item_7 = ListItem(List=phases_2, Index=0, Wrap=True)  # -> Item, Item1, Item2, Item3, Item4
phasing_2 = ElementPhasing(Element=param_2.Element, Created=item_4.Item2)  # -> flatten(Element), Created, Demolished
phasing_3 = ElementPhasing(Element=param_4.Element, Created=item_6.Item3)  # -> flatten(Element), Created, Demolished
phasing_4 = ElementPhasing(Element=param_5.Element, Created=item_5.Item5)  # -> flatten(Element), Created, Demolished
phasing_5 = ElementPhasing(Element=param_3.Element, Created=item_7.Item4)  # -> flatten(Element), Created, Demolished
panel_10 = Panel(parameters_6)
lng = ListLength(List=phasing_2.Element)
lng_2 = ListLength(List=phasing_5.Element)
lng_3 = ListLength(List=phasing_4.Element)
lng_4 = ListLength(List=phasing_3.Element)
bnd_2 = Bounds(Numbers=panel_8)
series = Series(Start="1", Step=1, Count=lng)
series_2 = Series(Start="1", Step=1, Count=lng_2)
series_3 = Series(Start="1", Step=1, Count=lng_3)
series_4 = Series(Start="1", Step=1, Count=lng_4)
panel_11 = Panel(bnd_2)
concat_2 = Concatenate(FragmentA="Panel", FragmentB="_", FragmentC="PavA", FragmentD="_", FragmentE=series)
concat_3 = Concatenate(FragmentA="Panel", FragmentB="_", FragmentC="PavB", FragmentD="_", FragmentE=series_4)
concat_4 = Concatenate(FragmentA="Panel", FragmentB="_", FragmentC="PavC", FragmentD="_", FragmentE=series_2)
concat_5 = Concatenate(FragmentA="Panel", FragmentB="_", FragmentC="PavD", FragmentD="_", FragmentE=series_3)
param_7 = ElementParameter(Element=phasing_2.Element, Parameter="PanelID", Value=concat_2)  # -> Element, Value
param_8 = ElementParameter(Element=phasing_3.Element, Parameter="PanelID", Value=concat_3)  # -> Element, Value
param_9 = ElementParameter(Element=phasing_4.Element, Parameter="PanelID", Value=concat_5)  # -> Element, Value
param_10 = ElementParameter(Element=phasing_5.Element, Parameter="PanelID", Value=concat_4)  # -> Element, Value
