# Grasshopper definition Roof Adaptive Components.gh (Grasshopper 1.0.7)
# plug-ins: Rhino.Inside for Autodesk Revit, MetaHopper, MeshEdit Components

mesh = Mesh(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)
mesh_2 = Mesh(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)
facen = FaceNormals(Mesh=mesh_2)  # -> Centers, Normals
xy = XYPlane(Origin=facen.Centers)
mesh_3 = Mesh(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)
srf = Surface(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)  # disabled
relay = Relay()
explode = MeshExplode(Mesh=mesh_2, Interpolate=False)
project = Project(Geometry=facen.Normals, Plane=xy)  # -> Geometry, Transform
faceb = FaceBoundaries(Mesh=mesh_2)  # disabled
vdis = VectorDisplay(Anchor=facen.Centers, Vector=facen.Normals)  # disabled
vdis_2 = VectorDisplay(Anchor=facen.Centers, Vector=project.Geometry)  # disabled
angle = Angle(VectorA=facen.Normals, VectorB=project.Geometry)  # -> Angle, Reflex
explode_2 = Explode(Curve=faceb, Recursive=True)  # -> Segments, Vertices; disabled
deg = Degrees(Radians=angle.Angle)
cullpt = CullDuplicates(Points=explode_2.Vertices, Tolerance=0.1, CullMode=3)  # -> simplify(Points), Indices, Valence; disabled
relay_2 = Relay()

# ---- group: Attractor
toggle = GroupToggle(ToggleActive=True, ToggleVisible=False)  # disabled
pt = Point(Point(12783.80568, 5493.650862, 12723.70399))  # disabled
panel = Panel("1000")  # disabled
sph = Sphere(Base=pt, Radius=panel)  # disabled
panel_2 = Panel("100")  # disabled
panel_3 = Panel("800")  # disabled
dist = Distance(PointA=relay_2, PointB=pt)  # disabled
bnd = Bounds(Numbers=flatten(dist))  # disabled
dom = ConstructDomain(DomainStart=panel_3, DomainEnd=panel_2)  # disabled
remap = RemapNumbers(Value=dist, Source=bnd, Target=dom)  # -> Mapped, Clipped; disabled

# ----
area = Area(Geometry=explode)  # -> Area, Centroid
rev = ReverseList(List=cullpt.Points)  # disabled
smaller = SmallerThan(FirstNumber=area.Area, SecondNumber=Slider(0.387, range=0..1))  # -> SmallerThan, OrEqualTo
srf_cp = SurfaceClosestPoint(Point=rev, Surface=srf)  # -> Point, UVPoint, Distance; disabled
smaller_2 = SmallerThan(FirstNumber=deg, SecondNumber=Slider(55.8, range=0..90))  # -> SmallerThan, OrEqualTo
dispatch = Dispatch(List=explode, DispatchPattern=smaller.OrEqualTo)  # -> ListA, ListB
dispatch_2 = Dispatch(List=area.Area, DispatchPattern=smaller.OrEqualTo)  # -> ListA, ListB
dispatch_3 = Dispatch(List=deg, DispatchPattern=smaller_2.OrEqualTo)  # -> ListA, ListB
mesh_4 = Mesh(dispatch.ListB)
relay_3 = Relay()
demesh = DeconstructMesh(Mesh=dispatch.ListB)  # -> Vertices, Faces, Colours, Normals
viewer = ParamViewer(demesh.Vertices)
viewer_2 = ParamViewer(dispatch_2.ListB)
component_families = ComponentFamiliesPicker(<component families picker referenced from the Revit model>, SearchPattern="generic models")
trigger = Trigger(Interval=-1000, TimerInterval=1000, Target=g_shape)
element_type_picker = ElementTypePicker(
    component_families,
    {"quadMeshPanel : quadMeshPanel": "45e5da70-6961-4a8e-a671-74fee38f84e8:e9fbe0a5-b638-4a2d-a8ce-f443ebd8c8b7-0004ffc3"}, selected="quadMeshPanel : quadMeshPanel")
trigger_2 = Trigger(Interval=-1000, TimerInterval=1000, Target=g_shape_2)  # disabled
g_shape = AddDirectShapeGeometry(Category=<geometry referenced from the Revit model>, Geometry=dispatch.ListA, TrackingMode=2)  # disabled
phase = Phase(<phase referenced from the Revit model>)

mesh_5 = Mesh(<mesh referenced from the Rhino model>)  # disabled
srf_2 = Surface(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)  # disabled
toggle_2 = GroupToggle(ToggleActive=True, ToggleVisible=False)  # disabled
explode_3 = MeshExplode(Mesh=mesh_5, Interpolate=False)  # disabled
demesh_2 = DeconstructMesh(Mesh=explode_3)  # -> Vertices, Faces, Colours, Normals; disabled
area_2 = Area(Geometry=explode_3)  # -> Area, Centroid; disabled
sort = SortList(Keys=demesh_2.Vertices, ValuesA=demesh_2.Vertices)  # -> Keys, ValuesA; disabled
meshcp = MeshClosestPoint(Point=area_2.Centroid, Mesh=mesh_5)  # -> Point, Index, Parameter; disabled
pdecon = Deconstruct(Point=meshcp.Point)  # -> XComponent, YComponent, ZComponent; disabled
component_families_2 = ComponentFamiliesPicker(<component families picker referenced from the Revit model>, SearchPattern="generic")  # disabled
multiplication = Multiplication(A=pdecon.XComponent, B=pdecon.YComponent)  # -> simplify(Result); disabled
bnd_2 = Bounds(Numbers=flatten(relay_3))  # disabled
element_type_picker_2 = ElementTypePicker(component_families_2)  # disabled
dedomain = DeconstructDomain(Domain=bnd_2)  # -> Start, End; disabled
gradient = Gradient(
    LowerLimit=dedomain.Start,
    UpperLimit=dedomain.End,
    Parameter=relay_3,
    stops=[0: RGB(0, 128, 0), 0.5: RGB(255, 255, 0), 1: RGB(255, 0, 0)])  # disabled
active = ActiveDocument()  # disabled
trigger_3 = Trigger(Interval=-1000, TimerInterval=1000, Target=a_component)  # disabled
a_component = AddComponentAdaptive(Document=active, Points=demesh_2.Vertices, Type=element_type_picker_2, TrackingMode=2)  # -> simplify(Component); disabled
cset = CreateSet(List=flatten(gradient))  # -> Set, Map; disabled
panel_4 = Panel("colour ")  # disabled
concat = Concatenate(FragmentA=panel_4, FragmentB=cset.Set)  # disabled
inspect = InspectElement(Element=a_component)  # -> simplify(MaterialsAndFinishesPanelMaterial); disabled
material = AddMaterial(Name=concat, TrackingMode=2)  # disabled
item = ListItem(List=flatten(material), Index=cset.Map, Wrap=True)  # -> simplify(graft(Item)); disabled
param = ElementParameter(Element=a_component, Parameter=inspect)  # -> Element, Value; disabled
graphics = MaterialGraphics(Material=item, Color=gradient)  # -> simplify(Material), UseRenderAppearance, Color, Transparency, SurfacePatternsForegroundPattern, SurfacePatternsForegroundColor, CutPatternsForegroundPattern, CutPatternsForegroundColor; disabled
phasing = ElementPhasing(Element=param.Element, Created=phase)  # -> Element, Created, Demolished; disabled

active_2 = ActiveDocument()
g_shape_2 = AddDirectShapeGeometry(Category=<geometry referenced from the Revit model>, TrackingMode=2)
trigger_4 = Trigger(Interval=-1000, TimerInterval=1000, Target=a_component_2)

# ---- group: Angle
parameter = Parameter(<parameter referenced from the Revit model>)

# ----
a_component_2 = AddComponentAdaptive(Document=active_2, Points=demesh.Vertices, Type=element_type_picker, TrackingMode=2)  # -> simplify(Component); disabled

# ---- group: Area
parameter_2 = Parameter(<parameter referenced from the Revit model>)

# ----
panel_5 = Panel("Inclination")
panel_6 = Panel("angle")
param_2 = ElementParameter(Element=a_component_2, Parameter=parameter_2, Value=simplify(dispatch_2.ListB))  # -> Element, Value
panel_7 = Panel(param_2.Element)
elements = QueryElements(Limit=100)  # -> Elements, Count
elements_2 = QueryElements(Limit=100)  # -> Elements, Count
define_param = DefineParameter(Type="autodesk.spec:spec.string-2.0.0", Group="autodesk.parameter.group:data-1.0.0")
parameters = QueryElementParameters(Element=elements.Elements)

# ---- group: Beams
number_slider = Slider(13692, range=0..20000)  # disabled
demesh_3 = DeconstructMesh(Mesh=relay)  # -> simplify(graft(Vertices)), Faces, Colours, Normals; disabled
toggle_3 = GroupToggle(ToggleActive=True, ToggleVisible=False)  # disabled
pdecon_2 = Deconstruct(Point=demesh_3.Vertices)  # -> XComponent, YComponent, ZComponent; disabled
smaller_3 = SmallerThan(FirstNumber=pdecon_2.ZComponent, SecondNumber=number_slider)  # -> SmallerThan, OrEqualTo; disabled
dispatch_4 = Dispatch(List=demesh_3.Vertices, DispatchPattern=smaller_3.SmallerThan)  # -> ListA, ListB; disabled
pt_2 = Point(dispatch_4.ListA)  # disabled
srf_cp_2 = SurfaceClosestPoint(Point=pt_2, Surface=srf)  # -> Point, UVPoint, Distance; disabled
number_slider_2 = Slider(7688, range=0..10000)  # disabled
evalsrf = EvaluateSurface(Surface=srf, Point=srf_cp_2.UVPoint)  # -> Point, Normal, UDirection, VDirection, Frame; disabled
panel_8 = Panel("3500")  # disabled
amp = Amplitude(Vector=evalsrf.Normal, Amplitude=number_slider_2)  # disabled
amp_2 = Amplitude(Vector=evalsrf.VDirection, Amplitude=number_slider_2)  # disabled
rev_2 = Reverse(Vector=amp_2)  # disabled
move = Move(Geometry=evalsrf.Point, Motion=amp)  # -> Geometry, Transform; disabled
vdis_3 = VectorDisplay(Anchor=evalsrf.Point, Vector=amp_2)  # disabled
ln = Line(StartPoint=evalsrf.Point, EndPoint=move.Geometry)  # disabled
xy_2 = XYPlane(Origin=Point(0, 0, 0))  # disabled
pcx = CurvePlane(Curve=ln, Plane=xy_2)  # -> simplify(Points), ParamsC, ParamsP; disabled
component_families_3 = ComponentFamiliesPicker(<component families picker referenced from the Revit model>, SearchPattern="structural")  # disabled
merge = Merge(Data1=pcx.Points, Data2=move.Geometry)  # disabled
item_2 = ListItem(List=merge, Index=0, Wrap=True)  # disabled
element_type_picker_3 = ElementTypePicker(component_families_3)  # disabled
project_2 = Project(Geometry=item_2, Plane=PlaneXY(0, 0, 0))  # -> Geometry, Transform; disabled
ln_2 = Line(StartPoint=evalsrf.Point, EndPoint=project_2.Geometry)  # disabled
project_3 = Project(Geometry=ln_2, Plane=PlaneXY(0, 0, 0))  # -> Geometry, Transform; disabled
trigger_5 = Trigger(Interval=-1000, TimerInterval=1000, Target=s_beam)  # disabled
angle_2 = Angle(VectorA=rev_2, VectorB=ln_2)  # -> Angle, Reflex; disabled
angle_3 = Angle(VectorA=ln_2, VectorB=project_3.Geometry)  # -> Angle, Reflex; disabled
panel_9 = Panel("Ang0")  # disabled
panel_10 = Panel("Ang1")  # disabled

# ---- group: Beams / Upgraded : Add Beam
s_beam = AddStructuralBeam(Curve=ln_2, Type=element_type_picker_3, TrackingMode=2)  # disabled
L = Level()  # disabled

# ---- group: Beams (continued)
param_3 = ElementParameter(Element=s_beam, Parameter=panel_9, Value=angle_2.Angle)  # -> Element, Value; disabled
param_4 = ElementParameter(Element=s_beam, Parameter=panel_10, Value=angle_3.Angle)  # -> Element, Value; disabled
