# Grasshopper definition Units to RIR.gh (Grasshopper 1.0.7)
# plug-ins: Rhino.Inside for Autodesk Revit, eleFront, treesloth01, Bifocals, MetaHopper

listblockd = ListBlocksInDocument(fullName=True)

toggle = GroupToggle(ToggleActive=True, ToggleVisible=False)  # disabled
# //Send topo meshes to Revit
mesh = Mesh(<mesh referenced from the Rhino model>)  # disabled
Y = UnitY(Factor=250)  # disabled
categories = DirectShapeCategories("autodesk.revit.category.local:topography-1.0.0", SearchPattern="topo")  # disabled
number_slider = Slider(9, range=0..10)  # disabled
move = Move(Geometry=mesh, Motion=Y)  # -> Geometry, Transform; disabled
unweld = UnweldMesh(Mesh=mesh, Angle=degrees(number_slider))  # disabled
topography = AddTopographyMesh(Mesh=unweld, TrackingMode=2)  # disabled
g_shape = AddDirectShapeGeometry(Category=categories, Geometry=move.Geometry, TrackingMode=2)  # disabled

item = ListItem(List=listblockd, Index=0, Wrap=True)  # -> Item, Item1
panel = Panel(listblockd)
# //Send block instances to Revit
refblock = ReferenceBlockByName(BlockName=item.Item1, getNestedBlocks=False, lightweight=False)
# //Send block instances to Revit
refblock_2 = ReferenceBlockByName(BlockName=item.Item, getNestedBlocks=False, lightweight=False)
item_2 = ListItem(List=refblock, Index=0, Wrap=True)

srf = Surface([<surface referenced from the Rhino model> x74])
area = Area(Geometry=srf)  # -> Area, Centroid
pl_origin = PlaneOrigin(Base=srf, Origin=area.Centroid)
smaller = SmallerThan(FirstNumber=area.Area, SecondNumber="20")  # -> SmallerThan, OrEqualTo
cull = CullPattern(List=pl_origin, CullPattern=smaller.OrEqualTo)

srf_2 = Surface([<surface referenced from the Rhino model> x74])
area_2 = Area(Geometry=srf_2)  # -> Area, Centroid
pl_origin_2 = PlaneOrigin(Base=srf_2, Origin=area_2.Centroid)
smaller_2 = SmallerThan(FirstNumber=area_2.Area, SecondNumber="20")  # -> SmallerThan, OrEqualTo
cull_2 = CullPattern(List=pl_origin_2, CullPattern=invert(smaller_2.OrEqualTo))

item_3 = ListItem(List=refblock_2, Index=0, Wrap=True)
block_info = GetBlockInfo(Block=item_2)  # -> Name, Plane, Transform, BlockType, FilePath, Active
block_info_2 = GetBlockInfo(Block=item_3)  # -> Name, Plane, Transform, BlockType, FilePath, Active
orient = Orient(Geometry=item_2, Source=block_info.Plane, Target=PlaneXY(0, 0, 0))  # -> Geometry, Transform
orient_2 = Orient(Geometry=item_3, Source=block_info_2.Plane, Target=PlaneXY(0, 0, 0))  # -> Geometry, Transform
expblock = ExplodeBlock(Block=orient.Geometry, recursive=False)  # -> Name, Transform, Geometry
expblock_2 = ExplodeBlock(Block=orient_2.Geometry, recursive=False)  # -> Name, Transform, Geometry

# ----
# //Query materials' names using Elefront
geo = Geometry(expblock.Geometry)
ef_att = EleFrontAttributes(Attributes=geo)
ef_layer = EleFrontLayer(Layer=ef_att)
ef_layer_2 = EleFrontLayer(Layer=ef_layer)

# ----
# //Query materials' names using Elefront
geo_2 = Geometry(expblock_2.Geometry)
ef_att_2 = EleFrontAttributes(Attributes=geo_2)
ef_layer_3 = EleFrontLayer(Layer=ef_att_2)
ef_layer_4 = EleFrontLayer(Layer=ef_layer_3)

materials = QueryMaterials(Name=ef_layer_2)
materials_2 = QueryMaterials(Name=ef_layer_4)

# ----
# 02// Create new component family
panel_2 = Panel("D:\FAD\MaCAD\Studio 2\GitHub\G06_studio_2024\Final\documentation\FTemplate_GEN_.rft")
famform = ComponentFamilyForm(Brep=graft(geo))
shift = ShiftPaths(Data=famform, Offset=-1)
new = NewComponentFamily(Template=panel_2, Overwrite=Toggle(True), Name=expblock.Name, Geometry=shift)

# ----
# 02// Create new component family
panel_3 = Panel("D:\FAD\MaCAD\Studio 2\GitHub\G06_studio_2024\Final\documentation\FTemplate_GEN_.rft")
famform_2 = ComponentFamilyForm(Brep=graft(geo_2))
shift_2 = ShiftPaths(Data=famform_2, Offset=-1)
new_2 = NewComponentFamily(Template=panel_3, Overwrite=Toggle(True), Name=expblock_2.Name, Geometry=shift_2)

# ----
# 03//Add components to RH Planes
types = QueryTypes(Kind=3, FamilyName=expblock.Name)
block_info_3 = GetBlockInfo(Block=refblock)  # -> Name, Plane, Transform, BlockType, FilePath, Active
l_component = AddComponentLocation(Location=cull, Type=types, TrackingMode=2)

# ----
# 03//Add components to RH Planes
types_2 = QueryTypes(Kind=3, FamilyName=expblock_2.Name)
block_info_4 = GetBlockInfo(Block=refblock_2)  # -> Name, Plane, Transform, BlockType, FilePath, Active
l_component_2 = AddComponentLocation(Location=cull_2, Type=types_2, TrackingMode=2)

trigger = Trigger(Interval=-1000, TimerInterval=1000, Target=[famform, new, types, l_component, graphics, material])  # disabled
trigger_2 = Trigger(Interval=-1000, TimerInterval=1000, Target=[famform_2, new_2, types_2, l_component_2, graphics_2, material_2])  # disabled

# ----
# 01 //Create Revit materials from Rhino M Properties
cset = CreateSet(List=flatten(ef_layer_2))  # -> Set, Map
material = AddMaterial(Name=cset.Set, TrackingMode=2)

# ---- group: MaterialProperties
python = GhPythonScript(Mname=cset.Set)  # -> out, Pvalue, Pname
# ---------- python: Python ----------
__author__ = "hesham.shawqy"
__version__ = "2024.02.25"

import rhinoscriptsyntax as rs
import Rhino.DocObjects as rd
import Rhino as rh

def get_material_properties(Mname):
    # Get the active Rhino document
    doc = rh.RhinoDoc.ActiveDoc
    
    # Search for the material by name
    material_index = doc.Materials.Find(Mname, True)
    if material_index < 0:
        print("Material not found.")
        return None
    
    # Retrieve the material object
    material = doc.Materials[material_index]
    
    # Extract material properties
    properties = {
        "DiffuseColor": material.DiffuseColor,
        "Transparency": material.Transparency,
        # Add more properties as needed
    }
    
    return properties

Pname = []
Pvalue = []
material_properties = get_material_properties(Mname)
if material_properties:
    for prop, value in material_properties.items():
        Pvalue.append(value)
        Pname.append(prop)
# ---------- end python ----------

# ----
item_4 = ListItem(List=python.Pvalue, Index=0, Wrap=True)  # -> Item, Item1
graphics = MaterialGraphics(
    Material=graft(material),
    Color=item_4.Item,
    Transparency=item_4.Item1,
    ForegroundPatternCutPatterns=<geometry referenced from the Revit model>)  # -> Material, UseRenderAppearance, Color, Transparency, SurfacePatternsForegroundPattern, SurfacePatternsForegroundColor, CutPatternsForegroundPattern, CutPatternsForegroundColor

# ----
# 01 //Create Revit materials from Rhino M Properties
cset_2 = CreateSet(List=flatten(ef_layer_4))  # -> Set, Map
material_2 = AddMaterial(Name=cset_2.Set, TrackingMode=2)

# ---- group: MaterialProperties
python_2 = GhPythonScript(Mname=cset_2.Set)  # -> out, Pvalue, Pname; same code as python

# ----
item_5 = ListItem(List=python_2.Pvalue, Index=0, Wrap=True)  # -> Item, Item1
graphics_2 = MaterialGraphics(
    Material=graft(material_2),
    Color=item_5.Item,
    Transparency=item_5.Item1,
    ForegroundPatternCutPatterns=<geometry referenced from the Revit model>)  # -> Material, UseRenderAppearance, Color, Transparency, SurfacePatternsForegroundPattern, SurfacePatternsForegroundColor, CutPatternsForegroundPattern, CutPatternsForegroundColor
