# Grasshopper definition units.gh (Grasshopper 1.0.7)
# plug-ins: Speckle 2, Kangaroo2 Components, treesloth01, CORE.Toolbox.Grasshopper, Human, Pufferfish, eleFront

panel = Panel("https://macad.speckle.xyz/streams/0f1c84ad9c/commits/c4616ae012")
receive = Receive(
    Stream=panel,
    AutoReceive=False,
    CurrentComponentState="up_to_date",
    ExpandOutput=True,
    LastInfoMessage="Andres Roncal @ 02/27/2024 02:15:02: Sent 72 elements from Rhino. (id:c4616ae012)",
    ReceiveOnOpen=False,
    ReceivedCommitId="c4616ae012",
    StreamWrapper="https://macad.speckle.xyz/streams/0f1c84ad9c/commits/c4616ae012",
    selectedKitName="Objects")  # -> Info, CollectionType, Elements, Name
dso = DeconstructSpeckleObject(SpeckleObject=receive.Elements, selectedKitName="Objects")  # -> CollectionType, DisplayStyle, Elements, Name, Visible
dso_2 = DeconstructSpeckleObject(SpeckleObject=dso.Elements, selectedKitName="Objects")  # -> CollectionType, DisplayStyle, Elements, Name, Visible
dso_3 = DeconstructSpeckleObject(SpeckleObject=dso.DisplayStyle, selectedKitName="Objects")  # -> Color, Linetype, Lineweight, Name, Units

panel_2 = Panel("https://macad.speckle.xyz/streams/4975f9f0a8/commits/9ec35295b2")
receive_2 = Receive(
    Stream=panel_2,
    AutoReceive=False,
    CurrentComponentState="expired",
    ExpandOutput=True,
    LastInfoMessage="James McBennett @ 03/01/2024 23:14:17: 2024 Mar-01 (id:9ec35295b2)",
    ReceiveOnOpen=False,
    ReceivedCommitId="9ec35295b2",
    StreamWrapper="https://macad.speckle.xyz/streams/4975f9f0a8/commits/9ec35295b2",
    selectedKitName="Objects")  # -> Info, CONTOURS, SOIL
mesh = Mesh(receive_2.SOIL)  # disabled
dso_4 = DeconstructSpeckleObject(SpeckleObject=receive.Elements, selectedKitName="Objects")  # -> CollectionType, DisplayStyle, Elements, Name, Visible
panel_3 = Panel(receive_2.SOIL)
reflay = ReferenceByLayer(LayerName="UnitsRawVolumes", lightweight=False)

volume = Volume(Geometry=reflay)  # -> Volume, Centroid
int = Integer(volume.Volume)
cset = CreateSet(List=int)  # -> Set, Map
cset_2 = CreateSet(List=cset.Map)  # -> Set, Map
mindex = MemberIndex(Set=cset.Map, Member=cset_2.Set)  # -> Index, Count
item = ListItem(List=reflay, Index=mindex.Index, Wrap=True)  # -> simplify(Item)
bang = ExplodeTree(Data=item)  # -> Branch0, Branch1

area = Area(Geometry=bang.Branch1)  # -> Area, Centroid
prox = Proximity3D(Points=area.Centroid, Group="1", MaxRadius="5")  # -> simplify(Links), Topology
clean = CleanTree(RemoveNulls=True, RemoveInvalid=True, RemoveEmpty=True, Tree=prox.Links)
tstat = TreeStatistics(Tree=clean)  # -> Paths, Length, Count
split = SplitTree(Data=simplify(graft(bang.Branch1)), Masks=flatten(tstat.Paths))  # -> flatten(Positive), flatten(Negative)

renumber = RenumberPaths(Data=clean)
end = EndPoints(Curve=renumber)  # -> Start, End
pdecon = Deconstruct(Point=[end.Start, end.End])  # -> XComponent, YComponent, ZComponent
int_2 = Integer(pdecon.ZComponent)
bnd = Bounds(Numbers=int_2)
dedomain = DeconstructDomain(Domain=bnd)  # -> Start, End
equals = Equality(FirstNumber=int_2, SecondNumber=dedomain.Start)  # -> Equality, Inequality
subtraction = Subtraction(A=dedomain.Start, B=dedomain.End)
cull = CullPattern(List=[end.Start, end.End], CullPattern=equals.Equality)
division = Division(A=subtraction, B="2")
abs = Absolute(Value=subtraction)
Z = UnitZ(Factor=division)
wires = BrepWireframe(Brep=split.Positive, Density=-1)
move = Move(Geometry=cull, Motion=Z)  # -> Geometry, Transform
project = Project(Geometry=wires, Plane=move.Geometry)  # -> simplify(Geometry), Transform

end_2 = EndPoints(Curve=project.Geometry)  # -> Start, End
multiplication = Multiplication(A=abs, B="2")
dup_pts = CleanDuplicatePoints(Points=[end_2.Start, end_2.End], Tolerance=0.01)  # -> Points, Indices, Status
pline = PolyLine(Vertices=dup_pts.Points, Closed=True)  # -> simplify(Polyline)
Z_2 = UnitZ(Factor=multiplication)
extr = Extrude(Base=pline, Direction=Z_2)
cap = CapHoles(Brep=extr)

cullpt = CullDuplicates(Points=[end_2.Start, end_2.End], Tolerance=0.1, CullMode=3)  # -> Points, Indices, Valence
mp = MultiPipe(
    Curves=bang.Branch0,
    NodeSize=Slider(0.07, range=0..0.3),
    EndOffset=1,
    StrutSize=Slider(0.36, range=0..1),
    Segment=0,
    KinkAngle=0.6,
    CubeFit=0,
    Caps=0)
panel_4 = Panel("https://macad.speckle.xyz/streams/5e4e4e4563/branches/24.02.27-class")  # disabled

number_slider = Slider(1.5, range=1..2)
range = Range(Domain=Slider(1.5, range=0..6.002), Steps=number_slider)
range_2 = Range(Domain=Domain(0, 1), Steps=number_slider)
graph = GraphMapper(range_2, x0=0, x1=1, y0=0, y1=1, container_name="Bezier", cpx=[0, 0.5185281634, 1, 1], cpy=[0, 0, 0.1436586976, 1])
pt = ConstructPoint(XCoordinate=0, YCoordinate=0, ZCoordinate=range)
dom = ConstructDomain(DomainStart=Slider(2, range=1..13), DomainEnd=Slider(0.7, range=0..2.02))
bnd_2 = Bounds(Numbers=graph)
prot = RotatePlane(Plane=pt, Angle="0.5*pi")
remap = RemapNumbers(Value=graph, Source=bnd_2, Target=dom)  # -> Mapped, Clipped
cir = Circle(Plane=pt, Radius=remap.Mapped)
item_2 = ListItem(List=cir, Index=0, Wrap=True)
area_2 = Area(Geometry=item_2)  # -> Area, Centroid
number_slider_2 = Slider(0.01, range=0..1)
range_3 = Range(Domain=Domain(0, 1), Steps=Slider(4, range=0..50))
shatter = Shatter(Curve=reparameterize(graft(cir)), Parameters=range_3)
subtraction_2 = Subtraction(A="1", B=number_slider_2)
merge = Merge(Data1="0", Data2=number_slider_2, Data3=subtraction_2, Data4="1")
consec = ConsecutiveDomains(Numbers=merge, Additive=invert(True))
panel_5 = Panel(merge)
subcrv = SubCurve(BaseCurve=reparameterize(graft(shatter)), Domain=consec)
panel_6 = Panel("""0
2""")
panel_7 = Panel(consec)
cull_i = CullIndex(List=subcrv, Indices=panel_6, Wrap=True)  # -> simplify(List)
item_3 = ListItem(List=subcrv, Index=panel_6, Wrap=True)
pshift = ShiftPaths(Data=cull_i, Offset=-1)
flip = FlipMatrix(Data=pshift)
midpt = CurveMiddle(Curve=flip)
loft = Loft(Curves=cir, Options={Adjust=False, Closed=False, LoftEnds=0, LoftSimp=0, LoftType=0, Rebuild=10, Refit=0.01})
pshift_2 = ShiftPaths(Data=item_3, Offset=-1)
graph_2 = GraphMapper(range_2, x0=0, x1=1, y0=0, y1=1, container_name="Bezier", cpx=[0, 0.25, 0.75, 1], cpy=[0, 0.25, 0.75, 1])
join = JoinCurves(Curves=pshift_2, Preserve=False)
brep_cp = BrepClosestPoint(Point=midpt, Brep=loft)  # -> Point, Normal, Distance
dom_2 = ConstructDomain(DomainStart=Slider(0.1, range=0..10), DomainEnd=Slider(0.11, range=0..1))
flip_2 = FlipMatrix(Data=join)
bnd_3 = Bounds(Numbers=graph_2)
remap_2 = RemapNumbers(Value=graph_2, Source=bnd_3, Target=dom_2)  # -> Mapped, Clipped
amp = Amplitude(Vector=brep_cp.Normal, Amplitude=remap_2.Mapped)
rev = Reverse(Vector=amp)
end_3 = EndPoints(Curve=flip)  # -> Start, End
move_2 = Move(Geometry=midpt, Motion=rev)  # -> Geometry, Transform
arc = Arc3Pt(PointA=end_3.Start, PointB=move_2.Geometry, PointC=end_3.End)  # -> Arc, Plane, Radius
item_4 = ListItem(List=arc.Arc, Index=0, Wrap=True)
project_2 = Project(Geometry=item_4, Plane=PlaneXY(0, 0, 0))  # -> Geometry, Transform
loft_opt = LoftOptions(Closed=False, Adjust=False, Rebuild=0, Refit="0.01", Type=0)
replace = ReplaceItems(List=arc.Arc, Item=project_2.Geometry, Indices="0", Wrap=False)
loft_2 = Loft(Curves=flip_2, Options=loft_opt)
loft_3 = Loft(Curves=replace, Options=loft_opt)
entwine = Entwine(Branch00=loft_3, Branch01=loft_2, FlattenInputs=True)
merge_2 = Merge(Data1=ColourSwatch(SwatchColor=RGBA(107, 107, 107, 206)), Data2=ColourSwatch(SwatchColor=RGB(255, 255, 255)))  # -> simplify(graft(Result))
python = GhPythonScript(S=entwine, D=Slider(0.01, range=0..1))  # -> simplify(a); inputs S: Brep
# ---------- python: Python ----------
import rhinoscriptsyntax as rs

a = rs.OffsetSurface(S, D, None, False, True)
# ---------- end python ----------
brep = Brep(bang.Branch0)
volume_2 = Volume(Geometry=brep)  # -> Volume, Centroid
flatten = FlattenTree(Tree=python, Path="{0}")
move2pt = MoveToPoint(Geometry=flatten, PointA=area_2.Centroid, PointB=graft(volume_2.Centroid))  # -> simplify(Moved), Vector, Transform
lng = ListLength(List=move2pt.Moved)
graft = GraftTree(Tree=volume_2.Centroid, IncludeEmptyLists=True, IncludeNullItems=True)  # -> simplify(Tree)
group = Group(Objects=move2pt.Moved)
split_2 = SplitList(List=move2pt.Moved, Index=expr("x/2", lng))  # -> flatten(ListA), flatten(ListB)
mirror = Mirror(Geometry=group, Plane=graft)  # -> Geometry, Transform
ungroup = Ungroup(Group=mirror.Geometry)
entwine_2 = Entwine(Branch00=split_2.ListA, Branch01=split_2.ListB, FlattenInputs=True)  # -> simplify(Result)
split_3 = SplitList(List=ungroup, Index=expr("x/2", lng))  # -> flatten(ListA), flatten(ListB)
entwine_3 = Entwine(Branch00=split_3.ListA, Branch01=split_3.ListB, FlattenInputs=True)  # -> simplify(Result)
merge_3 = Merge(Data1=entwine_2, Data2=entwine_3)  # disabled

Z_3 = UnitZ(Factor=expr("-x", Slider(0.1, range=0..10)))
item_5 = ListItem(List=cir, Index="-1", Wrap=True)
extr_2 = Extrude(Base=item_5, Direction=Z_3)
cap_2 = CapHoles(Brep=extr_2)

number_slider_3 = Slider(1.5, range=1..2)
range_4 = Range(Domain=Slider(3.7, range=0..6.002), Steps=number_slider_3)
range_5 = Range(Domain=Domain(0, 1), Steps=number_slider_3)
graph_3 = GraphMapper(range_5, x0=0, x1=1, y0=0, y1=1, container_name="Bezier", cpx=[0, 0.5185281634, 1, 1], cpy=[0, 0, 0.1436586976, 1])
pt_2 = ConstructPoint(XCoordinate=0, YCoordinate=0, ZCoordinate=range_4)
dom_3 = ConstructDomain(DomainStart=Slider(4.2, range=1..13), DomainEnd=Slider(1.2, range=0..2.02))
bnd_4 = Bounds(Numbers=graph_3)
prot_2 = RotatePlane(Plane=pt_2, Angle="0.5*pi")
remap_3 = RemapNumbers(Value=graph_3, Source=bnd_4, Target=dom_3)  # -> Mapped, Clipped
cir_2 = Circle(Plane=prot_2, Radius=remap_3.Mapped)
item_6 = ListItem(List=cir_2, Index=0, Wrap=True)
area_3 = Area(Geometry=item_6)  # -> Area, Centroid
number_slider_4 = Slider(0.01, range=0..1)
range_6 = Range(Domain=Domain(0, 1), Steps=Slider(8, range=0..50))
shatter_2 = Shatter(Curve=reparameterize(graft(cir_2)), Parameters=range_6)
subtraction_3 = Subtraction(A="1", B=number_slider_4)
merge_4 = Merge(Data1="0", Data2=number_slider_4, Data3=subtraction_3, Data4="1")
consec_2 = ConsecutiveDomains(Numbers=merge_4, Additive=invert(True))
panel_8 = Panel(merge_4)
subcrv_2 = SubCurve(BaseCurve=reparameterize(graft(shatter_2)), Domain=consec_2)
panel_9 = Panel("""0
2""")
panel_10 = Panel(consec_2)
cull_i_2 = CullIndex(List=subcrv_2, Indices=panel_9, Wrap=True)  # -> simplify(List)
item_7 = ListItem(List=subcrv_2, Index=panel_9, Wrap=True)
pshift_3 = ShiftPaths(Data=cull_i_2, Offset=-1)
flip_3 = FlipMatrix(Data=pshift_3)
midpt_2 = CurveMiddle(Curve=flip_3)
loft_4 = Loft(Curves=cir_2, Options={Adjust=False, Closed=False, LoftEnds=0, LoftSimp=0, LoftType=0, Rebuild=10, Refit=0.01})
pshift_4 = ShiftPaths(Data=item_7, Offset=-1)
graph_4 = GraphMapper(range_5, x0=0, x1=1, y0=0, y1=1, container_name="Bezier", cpx=[0, 0.25, 0.75, 1], cpy=[0, 0.25, 0.75, 1])
join_2 = JoinCurves(Curves=pshift_4, Preserve=False)
brep_cp_2 = BrepClosestPoint(Point=midpt_2, Brep=loft_4)  # -> Point, Normal, Distance
dom_4 = ConstructDomain(DomainStart=Slider(0.1, range=0..10), DomainEnd=Slider(0.11, range=0..1))
flip_4 = FlipMatrix(Data=join_2)
bnd_5 = Bounds(Numbers=graph_4)
remap_4 = RemapNumbers(Value=graph_4, Source=bnd_5, Target=dom_4)  # -> Mapped, Clipped
amp_2 = Amplitude(Vector=brep_cp_2.Normal, Amplitude=remap_4.Mapped)
rev_2 = Reverse(Vector=amp_2)
end_4 = EndPoints(Curve=flip_3)  # -> Start, End
move_3 = Move(Geometry=midpt_2, Motion=rev_2)  # -> Geometry, Transform
arc_2 = Arc3Pt(PointA=end_4.Start, PointB=move_3.Geometry, PointC=end_4.End)  # -> Arc, Plane, Radius
item_8 = ListItem(List=arc_2.Arc, Index=0, Wrap=True)
project_3 = Project(Geometry=item_8, Plane=PlaneXY(0, 0, 0))  # -> Geometry, Transform
loft_opt_2 = LoftOptions(Closed=False, Adjust=False, Rebuild=0, Refit="0.01", Type=0)
replace_2 = ReplaceItems(List=arc_2.Arc, Item=project_3.Geometry, Indices="0", Wrap=False)
loft_5 = Loft(Curves=flip_4, Options=loft_opt_2)
loft_6 = Loft(Curves=replace_2, Options=loft_opt_2)
entwine_4 = Entwine(Branch00=loft_6, Branch01=loft_5, FlattenInputs=True)
merge_5 = Merge(Data1=ColourSwatch(SwatchColor=RGBA(107, 107, 107, 206)), Data2=ColourSwatch(SwatchColor=RGB(255, 255, 255)))  # -> simplify(graft(Result))
python_2 = GhPythonScript(S=entwine_4, D=Slider(0.01, range=0..1))  # -> simplify(a); inputs S: Brep; same code as python
brep_2 = Brep(cap)
volume_3 = Volume(Geometry=brep_2)  # -> Volume, Centroid
flatten_2 = FlattenTree(Tree=python_2, Path="{0}")
move2pt_2 = MoveToPoint(Geometry=flatten_2, PointA=area_3.Centroid, PointB=graft(volume_3.Centroid))  # -> simplify(Moved), Vector, Transform
lng_2 = ListLength(List=move2pt_2.Moved)
graft_2 = GraftTree(Tree=volume_3.Centroid, IncludeEmptyLists=True, IncludeNullItems=True)  # -> simplify(Tree)
group_2 = Group(Objects=move2pt_2.Moved)
split_4 = SplitList(List=move2pt_2.Moved, Index=expr("x/2", lng_2))  # -> flatten(ListA), flatten(ListB)
mirror_2 = Mirror(Geometry=group_2, Plane=graft_2)  # -> Geometry, Transform
ungroup_2 = Ungroup(Group=mirror_2.Geometry)
entwine_5 = Entwine(Branch00=split_4.ListA, Branch01=split_4.ListB, FlattenInputs=True)  # -> simplify(Result)
split_5 = SplitList(List=ungroup_2, Index=expr("x/2", lng_2))  # -> flatten(ListA), flatten(ListB)
entwine_6 = Entwine(Branch00=split_5.ListA, Branch01=split_5.ListB, FlattenInputs=True)  # -> simplify(Result)
merge_6 = Merge(Data1=entwine_5, Data2=entwine_6)  # disabled

Z_4 = UnitZ(Factor=expr("-x", Slider(0.1, range=0..10)))
item_9 = ListItem(List=cir_2, Index="-1", Wrap=True)
extr_3 = Extrude(Base=item_9, Direction=Z_4)
cap_3 = CapHoles(Brep=extr_3)

number_slider_5 = Slider(1.5, range=1..2)
range_7 = Range(Domain=Slider(1.5, range=0..6.002), Steps=number_slider_5)
range_8 = Range(Domain=Domain(0, 1), Steps=number_slider_5)
graph_5 = GraphMapper(range_8, x0=0, x1=1, y0=0, y1=1, container_name="Bezier", cpx=[0, 0.5185281634, 1, 1], cpy=[0, 0, 0.1436586976, 1])
pt_3 = ConstructPoint(XCoordinate=0, YCoordinate=0, ZCoordinate=range_7)
dom_5 = ConstructDomain(DomainStart=Slider(3.9, range=1..13), DomainEnd=Slider(1.2, range=0..2.02))
bnd_6 = Bounds(Numbers=graph_5)
prot_3 = RotatePlane(Plane=pt_3, Angle="0.5*pi")
remap_5 = RemapNumbers(Value=graph_5, Source=bnd_6, Target=dom_5)  # -> Mapped, Clipped
number_slider_6 = Slider(0.01, range=0..1)
cir_3 = Circle(Plane=prot_3, Radius=remap_5.Mapped)
item_10 = ListItem(List=cir_3, Index=0, Wrap=True)
area_4 = Area(Geometry=item_10)  # -> Area, Centroid
subtraction_4 = Subtraction(A="1", B=number_slider_6)
range_9 = Range(Domain=Domain(0, 1), Steps=Slider(8, range=0..50))
merge_7 = Merge(Data1="0", Data2=number_slider_6, Data3=subtraction_4, Data4="1")
shatter_3 = Shatter(Curve=reparameterize(graft(cir_3)), Parameters=range_9)
consec_3 = ConsecutiveDomains(Numbers=merge_7, Additive=invert(True))
panel_11 = Panel(merge_7)
subcrv_3 = SubCurve(BaseCurve=reparameterize(graft(shatter_3)), Domain=consec_3)
panel_12 = Panel("""0
2""")
panel_13 = Panel(consec_3)
cull_i_3 = CullIndex(List=subcrv_3, Indices=panel_12, Wrap=True)  # -> simplify(List)
item_11 = ListItem(List=subcrv_3, Index=panel_12, Wrap=True)
pshift_5 = ShiftPaths(Data=cull_i_3, Offset=-1)
flip_5 = FlipMatrix(Data=pshift_5)
midpt_3 = CurveMiddle(Curve=flip_5)
loft_7 = Loft(Curves=cir_3, Options={Adjust=False, Closed=False, LoftEnds=0, LoftSimp=0, LoftType=0, Rebuild=10, Refit=0.01})
pshift_6 = ShiftPaths(Data=item_11, Offset=-1)
graph_6 = GraphMapper(range_8, x0=0, x1=1, y0=0, y1=1, container_name="Bezier", cpx=[0, 0.25, 0.75, 1], cpy=[0, 0.25, 0.75, 1])
join_3 = JoinCurves(Curves=pshift_6, Preserve=False)
brep_cp_3 = BrepClosestPoint(Point=midpt_3, Brep=loft_7)  # -> Point, Normal, Distance
dom_6 = ConstructDomain(DomainStart=Slider(0.1, range=0..10), DomainEnd=Slider(0.11, range=0..1))
flip_6 = FlipMatrix(Data=join_3)
bnd_7 = Bounds(Numbers=graph_6)
remap_6 = RemapNumbers(Value=graph_6, Source=bnd_7, Target=dom_6)  # -> Mapped, Clipped
amp_3 = Amplitude(Vector=brep_cp_3.Normal, Amplitude=remap_6.Mapped)
rev_3 = Reverse(Vector=amp_3)
end_5 = EndPoints(Curve=flip_5)  # -> Start, End
move_4 = Move(Geometry=midpt_3, Motion=rev_3)  # -> Geometry, Transform
arc_3 = Arc3Pt(PointA=end_5.Start, PointB=move_4.Geometry, PointC=end_5.End)  # -> Arc, Plane, Radius
item_12 = ListItem(List=arc_3.Arc, Index=0, Wrap=True)
project_4 = Project(Geometry=item_12, Plane=PlaneXY(0, 0, 0))  # -> Geometry, Transform
loft_opt_3 = LoftOptions(Closed=False, Adjust=False, Rebuild=0, Refit="0.01", Type=0)
replace_3 = ReplaceItems(List=arc_3.Arc, Item=project_4.Geometry, Indices="0", Wrap=False)
loft_8 = Loft(Curves=flip_6, Options=loft_opt_3)
loft_9 = Loft(Curves=replace_3, Options=loft_opt_3)
entwine_7 = Entwine(Branch00=loft_9, Branch01=loft_8, FlattenInputs=True)
merge_8 = Merge(Data1=ColourSwatch(SwatchColor=RGBA(189, 189, 189, 206)), Data2=ColourSwatch(SwatchColor=RGB(255, 255, 255)))  # -> simplify(graft(Result))
python_3 = GhPythonScript(S=entwine_7, D=Slider(0.01, range=0..1))  # -> simplify(a); inputs S: Brep; same code as python
brep_3 = Brep(split.Negative)
volume_4 = Volume(Geometry=brep_3)  # -> Volume, Centroid
flatten_3 = FlattenTree(Tree=python_3, Path="{0}")
move2pt_3 = MoveToPoint(Geometry=flatten_3, PointA=area_4.Centroid, PointB=graft(volume_4.Centroid))  # -> simplify(Moved), Vector, Transform
lng_3 = ListLength(List=move2pt_3.Moved)
graft_3 = GraftTree(Tree=volume_4.Centroid, IncludeEmptyLists=True, IncludeNullItems=True)  # -> simplify(Tree)
group_3 = Group(Objects=move2pt_3.Moved)
split_6 = SplitList(List=move2pt_3.Moved, Index=expr("x/2", lng_3))  # -> flatten(ListA), flatten(ListB)
mirror_3 = Mirror(Geometry=group_3, Plane=graft_3)  # -> Geometry, Transform
ungroup_3 = Ungroup(Group=mirror_3.Geometry)
entwine_8 = Entwine(Branch00=split_6.ListA, Branch01=split_6.ListB, FlattenInputs=True)  # -> simplify(Result)
split_7 = SplitList(List=ungroup_3, Index=expr("x/2", lng_3))  # -> flatten(ListA), flatten(ListB)
entwine_9 = Entwine(Branch00=split_7.ListA, Branch01=split_7.ListB, FlattenInputs=True)  # -> simplify(Result)
merge_9 = Merge(Data1=entwine_8, Data2=entwine_9)
previewmat = CustomPreviewMaterials(Geometry=merge_9, DiffuseColor=merge_8)  # disabled

Z_5 = UnitZ(Factor=expr("-x", Slider(0.1, range=0..10)))
item_13 = ListItem(List=cir_3, Index="-1", Wrap=True)
extr_4 = Extrude(Base=item_13, Direction=Z_5)
cap_4 = CapHoles(Brep=extr_4)

move2pt_4 = MoveToPoint(Geometry=cap_4, PointA=area_4.Centroid, PointB=graft(volume_4.Centroid))  # -> Moved, Vector, Transform
previewmat_2 = CustomPreviewMaterials(Geometry=move2pt_4.Moved, DiffuseColor=RGB(255, 255, 255))  # disabled

move2pt_5 = MoveToPoint(Geometry=cap_2, PointA=area_2.Centroid, PointB=graft(volume_2.Centroid))  # -> Moved, Vector, Transform
previewmat_3 = CustomPreviewMaterials(Geometry=merge_3, DiffuseColor=merge_8)  # disabled
previewmat_4 = CustomPreviewMaterials(Geometry=move2pt_5.Moved, DiffuseColor=RGB(255, 255, 255))  # disabled

move2pt_6 = MoveToPoint(Geometry=cap_3, PointA=area_3.Centroid, PointB=graft(volume_3.Centroid))  # -> Moved, Vector, Transform
previewmat_5 = CustomPreviewMaterials(Geometry=merge_6, DiffuseColor=merge_8)  # disabled
previewmat_6 = CustomPreviewMaterials(Geometry=move2pt_6.Moved, DiffuseColor=RGB(255, 255, 255))  # disabled

merge_10 = Merge(Data1=move2pt_6.Moved, Data2=merge_6, Data3=move2pt_4.Moved, Data4=merge_9, Data5=move2pt_5.Moved, Data6=merge_3)  # disabled
send = Send(
    Stream=panel_4,
    Data=merge_10,
    AutoSend=False,
    BaseId="7005cf4f04ba1d7dde6e5ba4a54a8704",
    CurrentComponentState="expired",
    KitName="Objects",
    OutputWrappers="https://macad.speckle.xyz\t5e4e4e4563\t1905a1a1a6",
    UseDefaultCache=True,
    selectedKitName="Objects")  # disabled
panel_14 = Panel(send)  # disabled
