# Grasshopper definition units_detail_Paula - Copy.gh (Grasshopper 1.0.7)
# plug-ins: Speckle 2, treesloth01, Human, Pufferfish, eleFront, Bifocals

panel = Panel("https://macad.speckle.xyz/streams/0f1c84ad9c/commits/c4616ae012")
receive = Receive(
    Stream=panel,
    AutoReceive=False,
    CurrentComponentState="expired",
    ExpandOutput=True,
    ReceiveOnOpen=False,
    ReceivedCommitId="c4616ae012",
    StreamWrapper="https://macad.speckle.xyz/streams/0f1c84ad9c/commits/c4616ae012",
    selectedKitName="Objects")  # -> Info, CollectionType, Elements, Name
dso = DeconstructSpeckleObject(SpeckleObject=receive.Elements, selectedKitName="Objects")  # -> DisplayStyle, Elements
dso_2 = DeconstructSpeckleObject(SpeckleObject=dso.Elements, selectedKitName="Objects")
dso_3 = DeconstructSpeckleObject(SpeckleObject=dso.DisplayStyle, selectedKitName="Objects")

panel_2 = Panel("https://macad.speckle.xyz/streams/4975f9f0a8/commits/9ec35295b2")
receive_2 = Receive(
    Stream=panel_2,
    AutoReceive=False,
    CurrentComponentState="expired",
    ExpandOutput=True,
    ReceiveOnOpen=False,
    ReceivedCommitId="9ec35295b2",
    StreamWrapper="https://macad.speckle.xyz/streams/4975f9f0a8/commits/9ec35295b2",
    selectedKitName="Objects")  # -> Info, CONTOURS, SOIL
mesh = Mesh(receive_2.SOIL)  # disabled
dso_4 = DeconstructSpeckleObject(SpeckleObject=receive.Elements, selectedKitName="Objects")
panel_3 = Panel(receive_2.SOIL)
reflay = ReferenceByLayer(LayerName="UnitsRawVolumes", lightweight=False)

volume = Volume(Geometry=reflay)  # -> Volume, Centroid
int = Integer(volume.Volume)
cset = CreateSet(List=int)  # -> Set, Map
cset_2 = CreateSet(List=cset.Map)  # -> Set, Map
mindex = MemberIndex(Set=cset.Map, Member=cset_2.Set)  # -> Index, Count
item = ListItem(List=reflay, Index=mindex.Index, Wrap=True)  # -> simplify(Item)
bang = ExplodeTree(Data=item)  # -> Branch0, Branch1

# ----
# HABIT
number_slider = Slider(1.2, range=0..2.02)
number_slider_2 = Slider(1.5, range=1..2)
range = Range(Domain=Slider(1.5, range=0..6.002), Steps=number_slider_2)
range_2 = Range(Domain=Domain(0, 1), Steps=number_slider_2)
graph = GraphMapper(range_2, x0=0, x1=1, y0=0, y1=1, container_name="Bezier", cpx=[0, 0.5185281634, 1, 1], cpy=[0, 0, 0.1436586976, 1])
pt = ConstructPoint(XCoordinate=0, YCoordinate=0, ZCoordinate=range)
dom = ConstructDomain(DomainStart=Slider(3.9, range=1..13), DomainEnd=number_slider)
bnd = Bounds(Numbers=graph)
prot = RotatePlane(Plane=pt, Angle="0.5*pi")
remap = RemapNumbers(Value=graph, Source=bnd, Target=dom)  # -> Mapped, Clipped
number_slider_3 = Slider(0.01, range=0..1)
cir = Circle(Plane=prot, Radius=remap.Mapped)
item_2 = ListItem(List=cir, Index=0, Wrap=True)
area = Area(Geometry=item_2)  # -> Area, Centroid
range_3 = Range(Domain=Domain(0, 1), Steps=Slider(8, range=0..50))
subtraction = Subtraction(A="1", B=number_slider_3)
merge = Merge(Data1="0", Data2=number_slider_3, Data3=subtraction, Data4="1")
shatter = Shatter(Curve=reparameterize(graft(cir)), Parameters=range_3)
consec = ConsecutiveDomains(Numbers=merge, Additive=invert(True))
panel_4 = Panel(merge)
subcrv = SubCurve(BaseCurve=reparameterize(graft(shatter)), Domain=consec)
panel_5 = Panel("""0
2""")
panel_6 = Panel(consec)
cull_i = CullIndex(List=subcrv, Indices=panel_5, Wrap=True)  # -> simplify(List)
item_3 = ListItem(List=subcrv, Index=panel_5, Wrap=True)
pshift = ShiftPaths(Data=cull_i, Offset=-1)
flip = FlipMatrix(Data=pshift)
midpt = CurveMiddle(Curve=flip)
loft = Loft(Curves=cir, Options={Adjust=False, Closed=False, LoftEnds=0, LoftSimp=0, LoftType=0, Rebuild=10, Refit=0.01})
pshift_2 = ShiftPaths(Data=item_3, Offset=-1)
graph_2 = GraphMapper(range_2, x0=0, x1=1, y0=0, y1=1, container_name="Bezier", cpx=[0, 0.25, 0.75, 1], cpy=[0, 0.25, 0.75, 1])
join = JoinCurves(Curves=pshift_2, Preserve=False)
brep_cp = BrepClosestPoint(Point=midpt, Brep=loft)  # -> Point, Normal, Distance
dom_2 = ConstructDomain(DomainStart=Slider(0.1, range=0..10), DomainEnd=Slider(0.11, range=0..1))
flip_2 = FlipMatrix(Data=join)
bnd_2 = Bounds(Numbers=graph_2)
remap_2 = RemapNumbers(Value=graph_2, Source=bnd_2, Target=dom_2)  # -> Mapped, Clipped
amp = Amplitude(Vector=brep_cp.Normal, Amplitude=remap_2.Mapped)
rev = Reverse(Vector=amp)
end = EndPoints(Curve=flip)  # -> Start, End
move = Move(Geometry=midpt, Motion=rev)  # -> Geometry, Transform
arc = Arc3Pt(PointA=end.Start, PointB=move.Geometry, PointC=end.End)  # -> Arc, Plane, Radius
item_4 = ListItem(List=arc.Arc, Index=0, Wrap=True)
project = Project(Geometry=item_4, Plane=PlaneXY(0, 0, 0))  # -> Geometry, Transform
replace = ReplaceItems(List=arc.Arc, Item=project.Geometry, Indices="0", Wrap=False)
loft_opt = LoftOptions(Closed=False, Adjust=False, Rebuild=0, Refit="0.01", Type=0)

area_2 = Area(Geometry=bang.Branch1)  # -> Area, Centroid
prox = Proximity3D(Points=area_2.Centroid, Group="1", MaxRadius="5")  # -> simplify(Links), Topology
clean = CleanTree(RemoveNulls=True, RemoveInvalid=True, RemoveEmpty=True, Tree=prox.Links)
tstat = TreeStatistics(Tree=clean)  # -> Paths, Length, Count
split = SplitTree(Data=simplify(graft(bang.Branch1)), Masks=flatten(tstat.Paths))  # -> flatten(Positive), flatten(Negative)

# ----
# BUFFER
number_slider_4 = Slider(1.2, range=0..2.02)
number_slider_5 = Slider(1.5, range=1..2)
range_4 = Range(Domain=Slider(3.7, range=0..6.002), Steps=number_slider_5)
range_5 = Range(Domain=Domain(0, 1), Steps=number_slider_5)
graph_3 = GraphMapper(range_5, x0=0, x1=1, y0=0, y1=1, container_name="Bezier", cpx=[0, 0.5185281634, 1, 1], cpy=[0, 0, 0.1436586976, 1])
pt_2 = ConstructPoint(XCoordinate=0, YCoordinate=0, ZCoordinate=range_4)
dom_3 = ConstructDomain(DomainStart=Slider(4.2, range=1..13), DomainEnd=number_slider_4)
bnd_3 = Bounds(Numbers=graph_3)
prot_2 = RotatePlane(Plane=pt_2, Angle="0.5*pi")
remap_3 = RemapNumbers(Value=graph_3, Source=bnd_3, Target=dom_3)  # -> Mapped, Clipped
cir_2 = Circle(Plane=prot_2, Radius=remap_3.Mapped)
item_5 = ListItem(List=cir_2, Index=0, Wrap=True)
area_3 = Area(Geometry=item_5)  # -> Area, Centroid
number_slider_6 = Slider(0.01, range=0..1)
range_6 = Range(Domain=Domain(0, 1), Steps=Slider(8, range=0..50))
shatter_2 = Shatter(Curve=reparameterize(graft(cir_2)), Parameters=range_6)
subtraction_2 = Subtraction(A="1", B=number_slider_6)
merge_2 = Merge(Data1="0", Data2=number_slider_6, Data3=subtraction_2, Data4="1")
consec_2 = ConsecutiveDomains(Numbers=merge_2, Additive=invert(True))
panel_7 = Panel(merge_2)
subcrv_2 = SubCurve(BaseCurve=reparameterize(graft(shatter_2)), Domain=consec_2)
panel_8 = Panel("""0
2""")
panel_9 = Panel(consec_2)
cull_i_2 = CullIndex(List=subcrv_2, Indices=panel_8, Wrap=True)  # -> simplify(List)
item_6 = ListItem(List=subcrv_2, Index=panel_8, Wrap=True)
pshift_3 = ShiftPaths(Data=cull_i_2, Offset=-1)
flip_3 = FlipMatrix(Data=pshift_3)
midpt_2 = CurveMiddle(Curve=flip_3)
loft_2 = Loft(Curves=cir_2, Options={Adjust=False, Closed=False, LoftEnds=0, LoftSimp=0, LoftType=0, Rebuild=10, Refit=0.01})
pshift_4 = ShiftPaths(Data=item_6, Offset=-1)
graph_4 = GraphMapper(range_5, x0=0, x1=1, y0=0, y1=1, container_name="Bezier", cpx=[0, 0.25, 0.75, 1], cpy=[0, 0.25, 0.75, 1])
join_2 = JoinCurves(Curves=pshift_4, Preserve=False)
brep_cp_2 = BrepClosestPoint(Point=midpt_2, Brep=loft_2)  # -> Point, Normal, Distance
dom_4 = ConstructDomain(DomainStart=Slider(0.1, range=0..10), DomainEnd=Slider(0.11, range=0..1))
flip_4 = FlipMatrix(Data=join_2)
bnd_4 = Bounds(Numbers=graph_4)
remap_4 = RemapNumbers(Value=graph_4, Source=bnd_4, Target=dom_4)  # -> Mapped, Clipped
amp_2 = Amplitude(Vector=brep_cp_2.Normal, Amplitude=remap_4.Mapped)
rev_2 = Reverse(Vector=amp_2)
end_2 = EndPoints(Curve=flip_3)  # -> Start, End
move_2 = Move(Geometry=midpt_2, Motion=rev_2)  # -> Geometry, Transform
arc_2 = Arc3Pt(PointA=end_2.Start, PointB=move_2.Geometry, PointC=end_2.End)  # -> Arc, Plane, Radius
item_7 = ListItem(List=arc_2.Arc, Index=0, Wrap=True)
project_2 = Project(Geometry=item_7, Plane=PlaneXY(0, 0, 0))  # -> Geometry, Transform
loft_opt_2 = LoftOptions(Closed=False, Adjust=False, Rebuild=0, Refit="0.01", Type=0)
replace_2 = ReplaceItems(List=arc_2.Arc, Item=project_2.Geometry, Indices="0", Wrap=False)
loft_3 = Loft(Curves=flip_4, Options=loft_opt_2)
loft_4 = Loft(Curves=replace_2, Options=loft_opt_2)

item_8 = ListItem(List=bang.Branch0, Index=0, Wrap=True)
item_9 = ListItem(List=split.Negative, Index=0, Wrap=True)

renumber = RenumberPaths(Data=clean)
end_3 = EndPoints(Curve=renumber)  # -> Start, End
pdecon = Deconstruct(Point=[end_3.Start, end_3.End])  # -> XComponent, YComponent, ZComponent
int_2 = Integer(pdecon.ZComponent)
bnd_5 = Bounds(Numbers=int_2)
dedomain = DeconstructDomain(Domain=bnd_5)  # -> Start, End
equals = Equality(FirstNumber=int_2, SecondNumber=dedomain.Start)  # -> Equality, Inequality
subtraction_3 = Subtraction(A=dedomain.Start, B=dedomain.End)
cull = CullPattern(List=[end_3.Start, end_3.End], CullPattern=equals.Equality)
division = Division(A=subtraction_3, B="2")
abs = Absolute(Value=subtraction_3)
Z = UnitZ(Factor=division)
wires = BrepWireframe(Brep=split.Positive, Density=-1)
move_3 = Move(Geometry=cull, Motion=Z)  # -> Geometry, Transform
project_3 = Project(Geometry=wires, Plane=move_3.Geometry)  # -> simplify(Geometry), Transform

loft_5 = Loft(Curves=replace, Options=loft_opt)
loft_6 = Loft(Curves=flip_2, Options=loft_opt)

end_4 = EndPoints(Curve=project_3.Geometry)  # -> Start, End
multiplication = Multiplication(A=abs, B="2")
cullpt = CullDuplicates(Points=[end_4.Start, end_4.End], Tolerance=0.1, CullMode=3)  # -> Points, Indices, Valence
pline = PolyLine(Vertices=cullpt.Points, Closed=True)  # -> simplify(Polyline)
Z_2 = UnitZ(Factor=multiplication)
extr = Extrude(Base=pline, Direction=Z_2)
cap = CapHoles(Brep=extr)

item_10 = ListItem(List=end.End, Index=0, Wrap=True)  # -> flatten(Item)
item_11 = ListItem(List=cir, Index="-1", Wrap=True)
crv_cp = CurveClosestPoint(Point=item_10, Curve=item_11)  # -> flatten(Point), Parameter, Distance
avr = Average(Input=crv_cp.Point)
vec2pt = Vector2Pt(PointA=avr, PointB=crv_cp.Point, Unitize=False)  # -> Vector, Length
amp_3 = Amplitude(Vector=vec2pt.Vector, Amplitude=Slider(0.1, range=0..0.1))
move_4 = Move(Geometry=crv_cp.Point, Motion=amp_3)  # -> Geometry, Transform
ln = Line(StartPoint=crv_cp.Point, EndPoint=move_4.Geometry)

item_12 = ListItem(List=end_2.End, Index=0, Wrap=True)  # -> flatten(Item)
item_13 = ListItem(List=cir_2, Index="-1", Wrap=True)
crv_cp_2 = CurveClosestPoint(Point=item_12, Curve=item_13)  # -> flatten(Point), Parameter, Distance
avr_2 = Average(Input=crv_cp_2.Point)
vec2pt_2 = Vector2Pt(PointA=avr_2, PointB=crv_cp_2.Point, Unitize=False)  # -> Vector, Length
amp_4 = Amplitude(Vector=vec2pt_2.Vector, Amplitude=Slider(0.1, range=0..0.1))
move_5 = Move(Geometry=crv_cp_2.Point, Motion=amp_4)  # -> Geometry, Transform
ln_2 = Line(StartPoint=crv_cp_2.Point, EndPoint=move_5.Geometry)

debrep = DeconstructBrep(Brep=loft_5)  # -> Faces, Edges, Vertices
midpt_3 = CurveMiddle(Curve=debrep.Edges)
pdecon_2 = Deconstruct(Point=midpt_3)  # -> XComponent, YComponent, ZComponent
smaller = SmallerThan(FirstNumber=pdecon_2.ZComponent, SecondNumber="0.1")  # -> SmallerThan, OrEqualTo
cull_2 = CullPattern(List=midpt_3, CullPattern=smaller.SmallerThan)
flatten = FlattenTree(Tree=cull_2, Path="{0}")

debrep_2 = DeconstructBrep(Brep=loft_4)  # -> Faces, Edges, Vertices
midpt_4 = CurveMiddle(Curve=debrep_2.Edges)
pdecon_3 = Deconstruct(Point=midpt_4)  # -> XComponent, YComponent, ZComponent
smaller_2 = SmallerThan(FirstNumber=pdecon_3.ZComponent, SecondNumber="0.1")  # -> SmallerThan, OrEqualTo
cull_3 = CullPattern(List=midpt_4, CullPattern=smaller_2.SmallerThan)
flatten_2 = FlattenTree(Tree=cull_3, Path="{0}")

srf = Surface(flatten(loft_4))

# ----
# FLOOR DOWN
avr_3 = Average(Input=item_12)
neg = Negative(Value=Slider(2.5, range=0..5))
Z_3 = UnitZ(Factor=neg)
move_6 = Move(Geometry=avr_3, Motion=Z_3)  # -> Geometry, Transform
ln_3 = Line(StartPoint=move_6.Geometry, EndPoint=avr_3)
circle = CircleCNR(Center=move_6.Geometry, Normal=Vector(0, 0, 1), Radius=Slider(5, range=0..10))
boundary = BoundarySurfaces(Edges=circle)
mirror = Mirror(Geometry=srf, Plane=avr_3)  # -> Geometry, Transform
bbx = BrepBrep(BrepA=mirror.Geometry, BrepB=boundary)  # -> Curves, Points
end_5 = EndPoints(Curve=bbx.Curves)  # -> flatten(Start), End
pline_2 = PolyLine(Vertices=end_5.Start, Closed=True)
offset = OffsetCurve(Curve=pline_2, Distance="-0.1", Corners=1)
boundary_2 = BoundarySurfaces(Edges=offset)
Z_4 = UnitZ(Factor=Slider(0.05, range=0.05..0.1))
extr_2 = Extrude(Base=boundary_2, Direction=Z_4)

# ----
# CEILING
number_slider_7 = Slider(0.5, range=0..5)
neg_2 = Negative(Value=number_slider_7)
Z_5 = UnitZ(Factor=neg_2)
move_7 = Move(Geometry=avr_2, Motion=Z_5)  # -> Geometry, Transform
ln_4 = Line(StartPoint=move_7.Geometry, EndPoint=avr_2)
circle_2 = CircleCNR(Center=move_7.Geometry, Normal=Vector(0, 0, 1), Radius=Slider(5, range=0..10))
boundary_3 = BoundarySurfaces(Edges=circle_2)
bbx_2 = BrepBrep(BrepA=srf, BrepB=boundary_3)  # -> Curves, Points
number_slider_8 = Slider(0.14, range=0..0.2)
end_6 = EndPoints(Curve=bbx_2.Curves)  # -> flatten(Start), End
pline_3 = PolyLine(Vertices=end_6.Start, Closed=True)
offset_2 = OffsetCurve(Curve=pline_3, Distance="-0.1", Corners=1)
Y = UnitY(Factor=1)
boundary_4 = BoundarySurfaces(Edges=offset_2)
X = UnitX(Factor=1)
number_slider_9 = Slider(0.02, range=0..0.1)
contour = Contour(Shape=boundary_4, Point=Point(0, 0, 0), Direction=Y, Distance=number_slider_8)
contour_2 = Contour(Shape=boundary_4, Point=Point(0, 0, 0), Direction=X, Distance=number_slider_8)
Z_6 = UnitZ(Factor=number_slider_9)
neg_3 = Negative(Value=Z_6)
move_8 = Move(Geometry=contour, Motion=neg_3)  # -> Geometry, Transform
pipe = Pipe(Curve=contour_2, Radius=number_slider_9, Caps=0)
pipe_2 = Pipe(Curve=move_8.Geometry, Radius=number_slider_9, Caps=0)
merge_3 = Merge(Data1=pipe_2, Data2=pipe)

# ----
# FLOOR UP
number_slider_10 = Slider(0, range=0..5)
neg_4 = Negative(Value=number_slider_10)
Z_7 = UnitZ(Factor=neg_4)
move_9 = Move(Geometry=avr_3, Motion=Z_7)  # -> Geometry, Transform
ln_5 = Line(StartPoint=move_9.Geometry, EndPoint=avr_3)
circle_3 = CircleCNR(Center=move_9.Geometry, Normal=Vector(0, 0, 1), Radius=Slider(5, range=0..10))
boundary_5 = BoundarySurfaces(Edges=circle_3)
mirror_2 = Mirror(Geometry=srf, Plane=avr_3)  # -> Geometry, Transform
bbx_3 = BrepBrep(BrepA=mirror_2.Geometry, BrepB=boundary_5)  # -> Curves, Points
end_7 = EndPoints(Curve=bbx_3.Curves)  # -> flatten(Start), End
pline_4 = PolyLine(Vertices=end_7.Start, Closed=True)
offset_3 = OffsetCurve(Curve=pline_4, Distance="-0.1", Corners=1)
boundary_6 = BoundarySurfaces(Edges=offset_3)
Z_8 = UnitZ(Factor=Slider(0.05, range=0.05..0.1))
area_4 = Area(Geometry=boundary_6)  # -> Area, Centroid
cir_3 = Circle(Plane=area_4.Centroid, Radius=Slider(0.9, range=0..1))
rdiff = RegionDifference(CurvesA=offset_3, CurvesB=cir_3)
boundary_7 = BoundarySurfaces(Edges=rdiff)
extr_3 = Extrude(Base=boundary_7, Direction=Z_8)

avr_4 = Average(Input=flatten(flatten))

offcrv = OffsetCurve(Curve=item_11, Plane=PlaneXY(0, 0, 0), Distance=Slider(0.05, range=0..0.1), BothSides=0, Kinks=0, CapType=1)
merge_4 = Merge(Data1=offcrv, Data2=item_11)  # -> flatten(Result)
loft_7 = Loft(Curves=merge_4, Options={Adjust=False, Closed=False, LoftEnds=0, LoftSimp=0, LoftType=0, Rebuild=10, Refit=0.01})
number_slider_11 = Slider(0.2, range=0..0.2)
Z_9 = UnitZ(Factor=number_slider_11)
multiplication_2 = Multiplication(A=number_slider_11, B="-0.5")
extr_4 = Extrude(Base=loft_7, Direction=Z_9)
Z_10 = UnitZ(Factor=multiplication_2)

panel_10 = Panel("""0
3""")
item_14 = ListItem(List=flatten, Index=panel_10, Wrap=True)
ln_6 = Line(StartPoint=avr_4, EndPoint=item_14)
pframe = PerpFrame(Curve=simplify(ln_6), Parameter="0.5")  # -> graft(Frame)
ext = ExtendCurve(Curve=ln_6, Type="0", Start="0", End="1")
pipe_3 = Pipe(Curve=ext, Radius="1", Caps=0)
scale_nu = ScaleNU(Geometry=pipe_3, Plane=pframe, ScaleX=Slider(1.1, range=0..1.1), ScaleY=Slider(0.88, range=0..1), ScaleZ=1)  # -> flatten(Geometry), Transform
cap_2 = CapHoles(Brep=scale_nu.Geometry)

offcrv_2 = OffsetCurve(Curve=item_13, Plane=PlaneXY(0, 0, 0), Distance=Slider(0.05, range=0..0.1), BothSides=0, Kinks=0, CapType=1)
merge_5 = Merge(Data1=offcrv_2, Data2=item_13)  # -> flatten(Result)
loft_8 = Loft(Curves=merge_5, Options={Adjust=False, Closed=False, LoftEnds=0, LoftSimp=0, LoftType=0, Rebuild=10, Refit=0.01})
number_slider_12 = Slider(0.2, range=0..0.2)
Z_11 = UnitZ(Factor=number_slider_12)
multiplication_3 = Multiplication(A=number_slider_12, B="-0.5")
extr_5 = Extrude(Base=loft_8, Direction=Z_11)
Z_12 = UnitZ(Factor=multiplication_3)

srf_2 = Surface(flatten(loft_5))

# ----
# FLOOR
number_slider_13 = Slider(2.81, range=0..5)
neg_5 = Negative(Value=number_slider_13)
Z_13 = UnitZ(Factor=neg_5)
move_10 = Move(Geometry=avr, Motion=Z_13)  # -> Geometry, Transform
ln_7 = Line(StartPoint=move_10.Geometry, EndPoint=avr)
circle_4 = CircleCNR(Center=move_10.Geometry, Normal=Vector(0, 0, 1), Radius=Slider(5, range=0..10))
avr_5 = Average(Input=item_10)
boundary_8 = BoundarySurfaces(Edges=circle_4)
mirror_3 = Mirror(Geometry=srf_2, Plane=avr_5)  # -> Geometry, Transform
bbx_4 = BrepBrep(BrepA=mirror_3.Geometry, BrepB=boundary_8)  # -> Curves, Points
end_8 = EndPoints(Curve=bbx_4.Curves)  # -> flatten(Start), End
pline_5 = PolyLine(Vertices=end_8.Start, Closed=True)
offset_4 = OffsetCurve(Curve=pline_5, Distance="-0.1", Corners=1)
boundary_9 = BoundarySurfaces(Edges=offset_4)
Z_14 = UnitZ(Factor=Slider(0.05, range=0.05..0.1))

# ----
# CEILING
number_slider_14 = Slider(0.15, range=0..5)
neg_6 = Negative(Value=number_slider_14)
Z_15 = UnitZ(Factor=neg_6)
move_11 = Move(Geometry=avr, Motion=Z_15)  # -> Geometry, Transform
ln_8 = Line(StartPoint=move_11.Geometry, EndPoint=avr)
circle_5 = CircleCNR(Center=move_11.Geometry, Normal=Vector(0, 0, 1), Radius=Slider(5, range=0..10))
boundary_10 = BoundarySurfaces(Edges=circle_5)
bbx_5 = BrepBrep(BrepA=srf_2, BrepB=boundary_10)  # -> Curves, Points
end_9 = EndPoints(Curve=bbx_5.Curves)  # -> flatten(Start), End
number_slider_15 = Slider(0.14, range=0..0.2)
pline_6 = PolyLine(Vertices=end_9.Start, Closed=True)
offset_5 = OffsetCurve(Curve=pline_6, Distance="-0.1", Corners=1)
Y_2 = UnitY(Factor=1)
boundary_11 = BoundarySurfaces(Edges=offset_5)
X_2 = UnitX(Factor=1)
contour_3 = Contour(Shape=boundary_11, Point=Point(0, 0, 0), Direction=Y_2, Distance=number_slider_15)
contour_4 = Contour(Shape=boundary_11, Point=Point(0, 0, 0), Direction=X_2, Distance=number_slider_15)
number_slider_16 = Slider(0.02, range=0..0.1)
Z_16 = UnitZ(Factor=number_slider_16)
neg_7 = Negative(Value=Z_16)
move_12 = Move(Geometry=contour_3, Motion=neg_7)  # -> Geometry, Transform
pipe_4 = Pipe(Curve=move_12.Geometry, Radius=number_slider_16, Caps=0)
pipe_5 = Pipe(Curve=contour_4, Radius=number_slider_16, Caps=0)

avr_6 = Average(Input=flatten(flatten_2))
srf_3 = Surface(flatten(loft_4))
addition = Addition(A=neg, B="1")
Z_17 = UnitZ(Factor=addition)
neg_8 = Negative(Value=Z_17)
amp_5 = Amplitude(Vector=neg_8, Amplitude=Slider(1.3, range=1..1.5))
move_13 = Move(Geometry=avr_6, Motion=amp_5)  # -> Geometry, Transform
bbx_6 = BrepBrep(BrepA=cap_2, BrepB=srf_2)  # -> Curves, Points
mirror_4 = Mirror(Geometry=bbx_6.Curves, Plane=avr_5)  # -> Geometry, Transform

join_3 = JoinCurves(Curves=flatten([mirror_4.Geometry, bbx_6.Curves]), Preserve=False)  # -> graft(Curves)
bang_2 = ExplodeTree(Data=join_3)  # -> Branch0, Branch1
crv = Curve(bang_2.Branch0)
divide = DivideCurve(Curve=crv, Count=Slider(2, range=0..10), Kinks=False)  # -> Points, Tangents, Parameters
item_15 = ListItem(List=divide.Points, Index=0, Wrap=True)  # -> Item, Item1
Z_18 = UnitZ(Factor="5")
ln_9 = Line(StartPoint=item_15.Item, EndPoint=item_15.Item1)
move_14 = Move(Geometry=ln_9, Motion=Z_18)  # -> Geometry, Transform
midpt_5 = CurveMiddle(Curve=move_14.Geometry)
lnpt = LinePt(Line=ln_9, Point=midpt_5)
pln = Plane(lnpt)
vec = Vector(pln)
rotate = Rotate(Geometry=pln, Angle=degrees(Slider(90, range=0..100)), Plane=PlaneXY(0, 0, 0))  # -> Geometry, Transform
amp_6 = Amplitude(Vector=vec, Amplitude=Slider(3, range=0..10))
mirror_5 = Mirror(Geometry=crv, Plane=pln)  # -> Geometry, Transform
amp_7 = Amplitude(Vector=vec, Amplitude=Slider(3, range=0..10))
vec_2 = Vector(rotate.Geometry)
move_15 = Move(Geometry=mirror_5.Geometry, Motion=amp_7)  # -> Geometry, Transform
neg_9 = Negative(Value=vec_2)
loft_9 = Loft(
    Curves=flatten([move_15.Geometry, crv]),
    Options={Adjust=False, Closed=False, LoftEnds=0, LoftSimp=0, LoftType=0, Rebuild=10, Refit=0.01})
area_5 = Area(Geometry=loft_9)  # -> Area, Centroid
amp_8 = Amplitude(Vector=neg_9, Amplitude=Slider(0.41, range=0..1))
orient = Orient(Geometry=pln, Source=PlaneXY(0, 0, 0), Target=area_5.Centroid)  # -> Geometry, Transform
box = CenterBox(Base=orient.Geometry, X=Slider(1.75, range=0..10), Y=Slider(1.25, range=0..10), Z=Slider(1.25, range=0..10))
area_6 = Area(Geometry=box)  # -> Area, Centroid
orient_2 = Orient(Geometry=box, Source=area_6.Centroid, Target=area_5.Centroid)  # -> Geometry, Transform
move_16 = Move(Geometry=orient_2.Geometry, Motion=amp_8)  # -> Geometry, Transform
contour_5 = Contour(Shape=move_16.Geometry, Point=Point(0, 0, 0), Direction=pln, Distance=Slider(0.2, range=0..1))
panel_11 = Panel("""0
1""")
fillet = Fillet(Curve=contour_5, Radius=Slider(0.8, range=0..1))
pcen = PolygonCenter(Polyline=contour_5)  # -> CenterV, CenterE, CenterA
dispatch = Dispatch(List=flatten(fillet), DispatchPattern=panel_11)  # -> ListA, ListB
dispatch_2 = Dispatch(List=flatten(pcen.CenterV), DispatchPattern=panel_11)  # -> ListA, ListB
scale = Scale(Geometry=dispatch.ListA, Center=dispatch_2.ListA, Factor=Slider(0.9, range=0.5..1))  # -> Geometry, Transform
crv_2 = Curve(dispatch.ListB)
weave = Weave(Pattern=[0, 1], Stream0=crv_2, Stream1=scale.Geometry, NullGaps=False)
item_16 = ListItem(List=weave, Index=0, Wrap=True)  # -> Item1, Item
crv_3 = Curve(crv)
crv_4 = Curve(move_15.Geometry)
move_17 = Move(Motion=Vector(0, 0, 10))  # -> Geometry, Transform
merge_6 = Merge(Data1=item_16.Item, Data2=crv_3)
merge_7 = Merge(Data1=crv_4, Data2=item_16.Item1)
rebcrv = RebuildCurve(Curve=merge_6, Count="50", EndTangents=False)  # -> flatten(Rebuilt)
rebcrv_2 = RebuildCurve(Curve=merge_7, Count="50", EndTangents=False)  # -> flatten(Rebuilt)
loft_10 = Loft(Curves=rebcrv_2, Options={Adjust=False, Closed=False, LoftEnds=0, LoftSimp=0, LoftType=0, Rebuild=10, Refit=0.01})
loft_11 = Loft(Curves=weave, Options={Adjust=False, Closed=False, LoftEnds=0, LoftSimp=0, LoftType=0, Rebuild=10, Refit=0.01})
pipe_6 = Pipe(Curve=crv_4, Radius="0.05", Caps=0)
loft_12 = Loft(Curves=rebcrv, Options={Adjust=False, Closed=False, LoftEnds=0, LoftSimp=0, LoftType=0, Rebuild=10, Refit=0.01})
pipe_7 = Pipe(Curve=crv_3, Radius="0.05", Caps=0)

srf_4 = Surface(loft_3)
number_slider_17 = Slider(0.05, range=0..0.1)
mirror_6 = Mirror(Geometry=loft_3, Plane=avr_3)  # -> Geometry, Transform
pipe_8 = Pipe(Curve=ln_2, Radius=Slider(0.05, range=0..0.1), Caps=0)
move_18 = Move(Geometry=extr_5, Motion=Z_12)  # -> Geometry, Transform
brep = Brep(item_9)
# Layers
offsrf = OffsetSurface(Surface=srf_4, Distance=number_slider_17, BothSides=0, CreateSolid=True)
volume_2 = Volume(Geometry=brep)  # -> Volume, Centroid
offsrf_2 = OffsetSurface(Surface=mirror_6.Geometry, Distance=number_slider_17, BothSides=0, CreateSolid=True)

# ---- group: upper floor
brep_2 = Brep(extr_3)

# ---- group: Lower floor
brep_3 = Brep(extr_2)

# ---- group: ceiling structure
brep_4 = Brep(merge_3)

# ---- group: outer ring
brep_5 = Brep(move_18.Geometry)

# ---- group: Structure lower
brep_6 = Brep(offsrf_2)

# ---- group: structure upper
brep_7 = Brep(offsrf)

# ---- group: outer ring parts
brep_8 = Brep(pipe_8)

# ---- group: structure
entwine = Entwine(Branch00=flatten(brep_6), Branch01=flatten(brep_7), FlattenInputs=True)  # -> flatten(Result)

# ---- group: Floors
entwine_2 = Entwine(Branch00=flatten(brep_2), Branch01=flatten(brep_3), FlattenInputs=True)  # -> flatten(Result)

# ----
merge_8 = Merge(Data1=flatten(brep_5), Data2=flatten(brep_8))

# ---- group: ceiling structure
brep_9 = Brep(flatten(brep_4))

# ----
bake = BakeObjects(Bake=False, createGroups=False)  # -> Message, Ghosts

# ----
# PHASES FOR HUMAN DEPLOYMENT
number_slider_18 = Slider(2, range=1..8)
series = Series(Start=1, Step=1, Count=number_slider_18)
item_17 = ListItem(List=series, Index=0, Wrap=True)  # -> Item, Item1, Item2, Item3, Item4, Item5, Item6, Item7

# ----
# ASSEMBLY PHASES
number_slider_19 = Slider(8, range=1..8)
series_2 = Series(Start=1, Step=1, Count=number_slider_19)
item_18 = ListItem(List=series_2, Index=0, Wrap=True)  # -> Item, Item1, Item2, Item3, Item4, Item5, Item6, Item7

merge_9 = Merge(Data1=ColourSwatch(SwatchColor=RGBA(189, 189, 189, 206)), Data2=ColourSwatch(SwatchColor=RGB(255, 255, 255)))  # -> simplify(graft(Result))
panel_12 = Panel("https://macad.speckle.xyz/streams/5e4e4e4563/branches/24.02.27-class")  # disabled

# ---- group: PHASE 1
num = Number(item_17.Item)

# ---- group: PHASE 2
num_2 = Number(item_17.Item1)

# ---- group: PHASE 3
num_3 = Number(item_17.Item2)  # disabled

# ---- group: PHASE 4
num_4 = Number(item_17.Item3)  # disabled

# ---- group: PHASE 5
num_5 = Number(item_17.Item4)  # disabled

# ---- group: PHASE 6
num_6 = Number(item_17.Item5)  # disabled

# ---- group: PHASE 8
num_7 = Number(item_17.Item7)  # disabled

# ---- group: PHASE 1
num_8 = Number(item_18.Item)

# ---- group: PHASE 2
num_9 = Number(item_18.Item1)

# ---- group: PHASE 3
num_10 = Number(item_18.Item2)

# ---- group: PHASE 4
num_11 = Number(item_18.Item3)

# ---- group: PHASE 5
num_12 = Number(item_18.Item4)

# ---- group: PHASE 6
num_13 = Number(item_18.Item5)

# ---- group: PHASE 8
num_14 = Number(item_18.Item7)

# ---- group: PHASE 7
num_15 = Number(item_17.Item6)  # disabled

num_16 = Number(item_18.Item6)

# ----
p_phase = Panel(num_2)
# ASSEMBLY PHASE 5
expblock = ExplodeBlock(recursive=False)  # -> Name, Transform, Geometry
detatt = DetachAttributes(Geometry=expblock.Geometry)  # -> Geometry, Attributes
volume_3 = Volume(Geometry=detatt.Geometry)  # -> Volume, Centroid
cset_3 = CreateSet(List=volume_3.Volume)  # -> Set, Map
cset_4 = CreateSet(List=cset_3.Map)  # -> Set, Map

# ---- group: Units_Support
pln_2 = Plane()

# ----
mindex_2 = MemberIndex(Set=cset_3.Map, Member=cset_4.Set)  # -> Index, Count
item_19 = ListItem(List=detatt.Geometry, Index=mindex_2.Index, Wrap=True)  # -> simplify(Item)
bang_3 = ExplodeTree(Data=item_19)  # -> Branch0, Branch1, Branch2
aphase = Panel(num_12)

# ----
# BUFFER UNITS
# ASSEMBLY PHASE 5
expblock_2 = ExplodeBlock(recursive=False)  # -> Name, Transform, Geometry
detatt_2 = DetachAttributes(Geometry=expblock_2.Geometry)  # -> Geometry, Attributes
# HABITAD UNITS
volume_4 = Volume(Geometry=detatt_2.Geometry)  # -> Volume, Centroid
cset_5 = CreateSet(List=volume_4.Volume)  # -> Set, Map
cset_6 = CreateSet(List=cset_5.Map)  # -> Set, Map
mindex_3 = MemberIndex(Set=cset_5.Map, Member=cset_6.Set)  # -> Index, Count
item_20 = ListItem(List=detatt_2.Geometry, Index=mindex_3.Index, Wrap=True)  # -> simplify(Item)
bang_4 = ExplodeTree(Data=item_20)  # -> Branch0, Branch1, Branch2
sso = BlockDefinition(
    Name="Glass",
    Geometry=bang_4.Branch0,
    SelectedConstructorName="Objects.Other.BlockDefinition.ctor(System.String,System.Collections.Generic.List`1[Speckle.Core.Models.Base],Objects.Geometry.Point)",
    SelectedTypeName="Objects.Other.BlockDefinition",
    UseSchemaTag=False,
    UserSetSchemaTag=False,
    seed="21602eca696029062885")
sso_2 = BlockDefinition(
    Name="Inflatable",
    Geometry=bang_4.Branch1,
    SelectedConstructorName="Objects.Other.BlockDefinition.ctor(System.String,System.Collections.Generic.List`1[Speckle.Core.Models.Base],Objects.Geometry.Point)",
    SelectedTypeName="Objects.Other.BlockDefinition",
    UseSchemaTag=False,
    UserSetSchemaTag=False,
    seed="c1a866df38f102a063d9")
sso_3 = BlockDefinition(
    Name="Steel",
    Geometry=bang_4.Branch2,
    SelectedConstructorName="Objects.Other.BlockDefinition.ctor(System.String,System.Collections.Generic.List`1[Speckle.Core.Models.Base],Objects.Geometry.Point)",
    SelectedTypeName="Objects.Other.BlockDefinition",
    UseSchemaTag=False,
    UserSetSchemaTag=False,
    seed="5650f23c9f762a3b85f9")
pt_3 = Point(pln_2)
orient_3 = Orient(Source=PlaneXY(0, 0, 0), Target=pt_3)  # -> Geometry, Transform
sso_4 = BlockInstance(
    BlockDefinition=sso,
    Transform=orient_3.Transform,
    SelectedConstructorName="Objects.Other.BlockInstance.ctor(Objects.Other.BlockDefinition,Objects.Other.Transform)",
    SelectedTypeName="Objects.Other.BlockInstance",
    UseSchemaTag=False,
    UserSetSchemaTag=False,
    seed="32606f0dd716d63f93ee")
sso_5 = BlockInstance(
    BlockDefinition=sso_2,
    Transform=orient_3.Transform,
    SelectedConstructorName="Objects.Other.BlockInstance.ctor(Objects.Other.BlockDefinition,Objects.Other.Transform)",
    SelectedTypeName="Objects.Other.BlockInstance",
    UseSchemaTag=False,
    UserSetSchemaTag=False,
    seed="07c70ea8ae7b221faee6")
sso_6 = BlockInstance(
    BlockDefinition=sso_3,
    Transform=orient_3.Transform,
    SelectedConstructorName="Objects.Other.BlockInstance.ctor(Objects.Other.BlockDefinition,Objects.Other.Transform)",
    SelectedTypeName="Objects.Other.BlockInstance",
    UseSchemaTag=False,
    UserSetSchemaTag=False,
    seed="7908172b8b0c45ed91a7")
name = ExtendSpeckleObject(
    SpeckleObject=sso_4,
    BIMSCTYPE="STRUCTURE",
    BIMSCMATERIAL="Glass",
    BIMSCASSEMBLY=aphase,
    BIMSCPHASE=p_phase,
    selectedKitName="Objects")
name_2 = ExtendSpeckleObject(
    SpeckleObject=sso_5,
    BIMSCTYPE="INFLATABLES",
    BIMSCMATERIAL="Inflatable",
    BIMSCASSEMBLY=aphase,
    BIMSCPHASE=p_phase,
    selectedKitName="Objects")
name_3 = ExtendSpeckleObject(
    SpeckleObject=sso_6,
    BIMSCTYPE="STRUCTURE",
    BIMSCMATERIAL="Steel",
    BIMSCASSEMBLY=aphase,
    BIMSCPHASE=p_phase,
    selectedKitName="Objects")
in = CreateSpeckleObject(Inflatables=name_2, Structure=name_3, Window=name, selectedKitName="Objects")

# ---- group: Units_Support
pln_3 = Plane()

# ----
sso_7 = BlockDefinition(
    Name="Glass",
    Geometry=bang_3.Branch0,
    SelectedConstructorName="Objects.Other.BlockDefinition.ctor(System.String,System.Collections.Generic.List`1[Speckle.Core.Models.Base],Objects.Geometry.Point)",
    SelectedTypeName="Objects.Other.BlockDefinition",
    UseSchemaTag=False,
    UserSetSchemaTag=False,
    seed="daa2f1b88a2b775cb3dc")
sso_8 = BlockDefinition(
    Name="Inflatable",
    Geometry=bang_3.Branch1,
    SelectedConstructorName="Objects.Other.BlockDefinition.ctor(System.String,System.Collections.Generic.List`1[Speckle.Core.Models.Base],Objects.Geometry.Point)",
    SelectedTypeName="Objects.Other.BlockDefinition",
    UseSchemaTag=False,
    UserSetSchemaTag=False,
    seed="2f6c1c48011962c1cd31")
sso_9 = BlockDefinition(
    Name="Steel",
    Geometry=bang_3.Branch2,
    SelectedConstructorName="Objects.Other.BlockDefinition.ctor(System.String,System.Collections.Generic.List`1[Speckle.Core.Models.Base],Objects.Geometry.Point)",
    SelectedTypeName="Objects.Other.BlockDefinition",
    UseSchemaTag=False,
    UserSetSchemaTag=False,
    seed="ab3e5e61d0fe4005012f")
pt_4 = Point(pln_3)
orient_4 = Orient(Source=PlaneXY(0, 0, 0), Target=pt_4)  # -> Geometry, Transform
sso_10 = BlockInstance(
    BlockDefinition=sso_7,
    Transform=orient_4.Transform,
    SelectedConstructorName="Objects.Other.BlockInstance.ctor(Objects.Other.BlockDefinition,Objects.Other.Transform)",
    SelectedTypeName="Objects.Other.BlockInstance",
    UseSchemaTag=False,
    UserSetSchemaTag=False,
    seed="8ef478c2c25ec1b9e569")
sso_11 = BlockInstance(
    BlockDefinition=sso_8,
    Transform=orient_4.Transform,
    SelectedConstructorName="Objects.Other.BlockInstance.ctor(Objects.Other.BlockDefinition,Objects.Other.Transform)",
    SelectedTypeName="Objects.Other.BlockInstance",
    UseSchemaTag=False,
    UserSetSchemaTag=False,
    seed="29db92d3033d0d76b592")
sso_12 = BlockInstance(
    BlockDefinition=sso_9,
    Transform=orient_4.Transform,
    SelectedConstructorName="Objects.Other.BlockInstance.ctor(Objects.Other.BlockDefinition,Objects.Other.Transform)",
    SelectedTypeName="Objects.Other.BlockInstance",
    UseSchemaTag=False,
    UserSetSchemaTag=False,
    seed="092e66d779835865a1af")
phase = Panel("PODS")
name_4 = ExtendSpeckleObject(SpeckleObject=sso_10, BIMSCTYPE="STRUCTURE", BIMSCMATERIAL="Glass", BIMSCPHASE=phase, selectedKitName="Objects")
name_5 = ExtendSpeckleObject(SpeckleObject=sso_11, BIMSCTYPE="INFLATABLES", BIMSCMATERIAL="Inflatable", BIMSCPHASE=phase, selectedKitName="Objects")
name_6 = ExtendSpeckleObject(SpeckleObject=sso_12, BIMSCTYPE="STRUCTURE", BIMSCMATERIAL="Steel", BIMSCPHASE=phase, selectedKitName="Objects")
in_2 = CreateSpeckleObject(Inflatables=name_5, Structure=name_6, Window=name_4, selectedKitName="Objects")

# ----
# MERGED UNITS
in_3 = CreateSpeckleObject(Units_Buffer=in, selectedKitName="Objects")

in_4 = CreateSpeckleObject(Units_Buffer=in_2, selectedKitName="Objects")

# ----
# SUPPORT
number_slider_20 = Slider(2, range=1..13)
number_slider_21 = Slider(1.5, range=1..2)
range_7 = Range(Domain=Slider(1.5, range=0..6.002), Steps=number_slider_21)
range_8 = Range(Domain=Domain(0, 1), Steps=number_slider_21)
graph_5 = GraphMapper(range_8, x0=0, x1=1, y0=0, y1=1, container_name="Bezier", cpx=[0, 0.5185281634, 1, 1], cpy=[0, 0, 0.1436586976, 1])
pt_5 = ConstructPoint(XCoordinate=0, YCoordinate=0, ZCoordinate=range_7)
dom_5 = ConstructDomain(DomainStart=number_slider_20, DomainEnd=Slider(0.7, range=0..2.02))
bnd_6 = Bounds(Numbers=graph_5)
prot_3 = RotatePlane(Plane=pt_5, Angle="0.5*pi")
remap_5 = RemapNumbers(Value=graph_5, Source=bnd_6, Target=dom_5)  # -> Mapped, Clipped
cir_4 = Circle(Plane=pt_5, Radius=remap_5.Mapped)
item_21 = ListItem(List=cir_4, Index=0, Wrap=True)
area_7 = Area(Geometry=item_21)  # -> Area, Centroid
number_slider_22 = Slider(0.01, range=0..1)
range_9 = Range(Domain=Domain(0, 1), Steps=Slider(4, range=0..50))
shatter_3 = Shatter(Curve=reparameterize(graft(cir_4)), Parameters=range_9)
subtraction_4 = Subtraction(A="1", B=number_slider_22)
merge_10 = Merge(Data1="0", Data2=number_slider_22, Data3=subtraction_4, Data4="1")
consec_3 = ConsecutiveDomains(Numbers=merge_10, Additive=invert(True))
panel_13 = Panel(merge_10)
subcrv_3 = SubCurve(BaseCurve=reparameterize(graft(shatter_3)), Domain=consec_3)
panel_14 = Panel("""0
2""")
panel_15 = Panel(consec_3)
cull_i_3 = CullIndex(List=subcrv_3, Indices=panel_14, Wrap=True)  # -> simplify(List)
item_22 = ListItem(List=subcrv_3, Index=panel_14, Wrap=True)
pshift_5 = ShiftPaths(Data=cull_i_3, Offset=-1)
flip_5 = FlipMatrix(Data=pshift_5)
midpt_6 = CurveMiddle(Curve=flip_5)
loft_13 = Loft(Curves=cir_4, Options={Adjust=False, Closed=False, LoftEnds=0, LoftSimp=0, LoftType=0, Rebuild=10, Refit=0.01})
pshift_6 = ShiftPaths(Data=item_22, Offset=-1)
graph_6 = GraphMapper(range_8, x0=0, x1=1, y0=0, y1=1, container_name="Bezier", cpx=[0, 0.25, 0.75, 1], cpy=[0, 0.25, 0.75, 1])
join_4 = JoinCurves(Curves=pshift_6, Preserve=False)
brep_cp_3 = BrepClosestPoint(Point=midpt_6, Brep=loft_13)  # -> Point, Normal, Distance
dom_6 = ConstructDomain(DomainStart=Slider(0.1, range=0..10), DomainEnd=Slider(0.11, range=0..1))
flip_6 = FlipMatrix(Data=join_4)
bnd_7 = Bounds(Numbers=graph_6)
remap_6 = RemapNumbers(Value=graph_6, Source=bnd_7, Target=dom_6)  # -> Mapped, Clipped
amp_9 = Amplitude(Vector=brep_cp_3.Normal, Amplitude=remap_6.Mapped)
rev_3 = Reverse(Vector=amp_9)
end_10 = EndPoints(Curve=flip_5)  # -> Start, End
move_19 = Move(Geometry=midpt_6, Motion=rev_3)  # -> Geometry, Transform
arc_3 = Arc3Pt(PointA=end_10.Start, PointB=move_19.Geometry, PointC=end_10.End)  # -> Arc, Plane, Radius
item_23 = ListItem(List=arc_3.Arc, Index=0, Wrap=True)
project_4 = Project(Geometry=item_23, Plane=PlaneXY(0, 0, 0))  # -> Geometry, Transform
loft_opt_3 = LoftOptions(Closed=False, Adjust=False, Rebuild=0, Refit="0.01", Type=0)
replace_3 = ReplaceItems(List=arc_3.Arc, Item=project_4.Geometry, Indices="0", Wrap=False)
loft_14 = Loft(Curves=flip_6, Options=loft_opt_3)
loft_15 = Loft(Curves=replace_3, Options=loft_opt_3)
entwine_3 = Entwine(Branch00=loft_15, Branch01=loft_14, FlattenInputs=True)
brep_10 = Brep(item_8)
merge_11 = Merge(Data1=ColourSwatch(SwatchColor=RGBA(107, 107, 107, 206)), Data2=ColourSwatch(SwatchColor=RGB(255, 255, 255)))  # -> simplify(graft(Result))
python = GhPythonScript(S=entwine_3, D=Slider(0.01, range=0..1))  # -> simplify(a); inputs S: Brep
# ---------- python: Python ----------
import rhinoscriptsyntax as rs

a = rs.OffsetSurface(S, D, None, False, True)
# ---------- end python ----------
item_24 = ListItem(List=brep_10, Index=0, Wrap=True)
volume_5 = Volume(Geometry=item_24)  # -> Volume, Centroid
flatten_3 = FlattenTree(Tree=python, Path="{0}")
move2pt = MoveToPoint(Geometry=flatten_3, PointA=area_7.Centroid, PointB=graft(volume_5.Centroid))  # -> simplify(Moved), Vector, Transform
lng = ListLength(List=move2pt.Moved)
graft = GraftTree(Tree=volume_5.Centroid, IncludeEmptyLists=True, IncludeNullItems=True)  # -> simplify(Tree)
group = Group(Objects=move2pt.Moved)
split_2 = SplitList(List=move2pt.Moved, Index=expr("x/2", lng))  # -> flatten(ListA), flatten(ListB)
mirror_7 = Mirror(Geometry=group, Plane=graft)  # -> Geometry, Transform
ungroup = Ungroup(Group=mirror_7.Geometry)
entwine_4 = Entwine(Branch00=split_2.ListA, Branch01=split_2.ListB, FlattenInputs=True)  # -> simplify(Result)
split_3 = SplitList(List=ungroup, Index=expr("x/2", lng))  # -> flatten(ListA), flatten(ListB)
entwine_5 = Entwine(Branch00=split_3.ListA, Branch01=split_3.ListB, FlattenInputs=True)  # -> simplify(Result)
merge_12 = Merge(Data1=entwine_4, Data2=entwine_5)
previewmat = CustomPreviewMaterials(Geometry=merge_12, DiffuseColor=RGB(255, 255, 255))

Z_19 = UnitZ(Factor=expr("-x", Slider(0.1, range=0..10)))
item_25 = ListItem(List=cir_4, Index="-1", Wrap=True)
extr_6 = Extrude(Base=item_25, Direction=Z_19)
cap_3 = CapHoles(Brep=extr_6)

move2pt_2 = MoveToPoint(Geometry=cap_3, PointA=area_7.Centroid, PointB=graft(volume_5.Centroid))  # -> Moved, Vector, Transform
previewmat_2 = CustomPreviewMaterials(Geometry=move2pt_2.Moved, DiffuseColor=RGB(255, 255, 255))

merge_13 = Merge(Data5=move2pt_2.Moved, Data6=merge_12)  # disabled
send = Send(
    Stream=panel_12,
    Data=merge_13,
    AutoSend=False,
    BaseId="7005cf4f04ba1d7dde6e5ba4a54a8704",
    CurrentComponentState="expired",
    KitName="Objects",
    OutputWrappers="https://macad.speckle.xyz\t5e4e4e4563\t1905a1a1a6",
    UseDefaultCache=True,
    selectedKitName="Objects")  # disabled
panel_16 = Panel(send)  # disabled

mirror_8 = Mirror(Geometry=loft_4, Plane=avr_6)  # -> Geometry, Transform
debrep_3 = DeconstructBrep(Brep=mirror_8.Geometry)  # -> Faces, Edges, Vertices
midpt_7 = CurveMiddle(Curve=debrep_3.Edges)
pdecon_4 = Deconstruct(Point=midpt_7)  # -> XComponent, YComponent, ZComponent

larger = LargerThan(FirstNumber=pdecon_4.ZComponent, SecondNumber="-0.1")  # -> LargerThan, OrEqualTo

cull_4 = CullPattern(List=midpt_7, CullPattern=larger.LargerThan)
flatten_4 = FlattenTree(Tree=cull_4, Path="{0}")

avr_7 = Average(Input=flatten(flatten_4))
move_20 = Move(Geometry=avr_7, Motion=Z_17)  # -> Geometry, Transform
srf_5 = Surface(flatten(mirror_8.Geometry))

panel_17 = Panel("""1
2""")

item_26 = ListItem(List=flatten, Index=panel_17, Wrap=True)

ln_10 = Line(StartPoint=avr_4, EndPoint=item_26)
pframe_2 = PerpFrame(Curve=simplify(ln_10), Parameter="0.5")  # -> graft(Frame)
ext_2 = ExtendCurve(Curve=ln_10, Type="0", Start="0", End="1")
pipe_9 = Pipe(Curve=ext_2, Radius="1", Caps=0)
cap_4 = CapHoles(Brep=pipe_9)

merge_14 = Merge(Data1=cap_2, Data2=cap_4)  # -> flatten(Result)
splitmul = SplitBrepMultiple(Brep=srf_2, Cutters=merge_14)
bbx_7 = BrepBrep(BrepA=cap_4, BrepB=srf_2)  # -> Curves, Points
area_8 = Area(Geometry=splitmul)  # -> Area, Centroid
smaller_3 = SmallerThan(FirstNumber=flatten(area_8.Area), SecondNumber=Slider(3, range=0..10))  # -> SmallerThan, OrEqualTo

# ----
# Layers
number_slider_23 = Slider(0.05, range=0..0.1)
move_21 = Move(Geometry=extr_4, Motion=Z_10)  # -> Geometry, Transform
pipe_10 = Pipe(Curve=ln, Radius=Slider(0.05, range=0..0.1), Caps=0)
extr_7 = Extrude(Base=boundary_9, Direction=Z_14)
cull_5 = CullPattern(List=flatten(splitmul), CullPattern=smaller_3.SmallerThan)
item_27 = ListItem(List=splitmul, Index=0, Wrap=True)
boundary_12 = BoundarySurfaces(Edges=item_11)
pipe_11 = Pipe(Curve=bbx_6.Curves, Radius=Slider(0.05, range=0..0.1), Caps=0)
pipe_12 = Pipe(Curve=bbx_7.Curves, Radius=Slider(0.05, range=0..0.1), Caps=0)
merge_15 = Merge(Data1=pipe_4, Data2=pipe_5)
srf_6 = Surface(loft_6)
offsrf_3 = OffsetSurface(Surface=srf_6, Distance=number_slider_23, BothSides=0, CreateSolid=True)
offset_6 = OffsetSurface(Surface=item_27, Distance=Slider(0.1, range=0..0.2), Retrim=True)
offset_7 = OffsetSurface(Surface=offset_6, Distance=Slider(0.1, range=0..0.2), Retrim=True)

entwine_6 = Entwine(
    Branch00=extr_7,
    Branch01=merge_15,
    Branch02=cull_5,
    Branch03=pipe_11,
    Branch04=pipe_12,
    Branch05=boundary_12,
    Branch06=move_21.Geometry,
    Branch07=pipe_10,
    Branch08=offsrf_3,
    FlattenInputs=True)

# ----
# LOWER HALF
panel_18 = Panel("""1
2""")
item_28 = ListItem(List=flatten_4, Index=panel_18, Wrap=True)

move_22 = Move(Geometry=item_28, Motion=Z_17)  # -> Geometry, Transform

ln_11 = Line(StartPoint=move_20.Geometry, EndPoint=move_22.Geometry)
pframe_3 = PerpFrame(Curve=simplify(ln_11), Parameter="0.5")  # -> graft(Frame)
ext_3 = ExtendCurve(Curve=ln_11, Type="0", Start="0", End="1")
pipe_13 = Pipe(Curve=ext_3, Radius="1", Caps=0)
cap_5 = CapHoles(Brep=pipe_13)

bbx_8 = BrepBrep(BrepA=cap_5, BrepB=srf_5)  # -> Curves, Points
pipe_14 = Pipe(Curve=bbx_8.Curves, Radius=Slider(0.05, range=0..0.1), Caps=0)

# ---- group: w frame
brep_11 = Brep(pipe_14)

# ----
# UPPER HALF
panel_19 = Panel("""1
2""")
item_29 = ListItem(List=flatten_2, Index=panel_19, Wrap=True)

move_23 = Move(Geometry=item_29, Motion=amp_5)  # -> Geometry, Transform

ln_12 = Line(StartPoint=move_23.Geometry, EndPoint=move_13.Geometry)
pframe_4 = PerpFrame(Curve=simplify(ln_12), Parameter="0.5")  # -> graft(Frame)
ext_4 = ExtendCurve(Curve=ln_12, Type="0", Start="1", End="0")
pipe_15 = Pipe(Curve=ext_4, Radius="1", Caps=0)
cap_6 = CapHoles(Brep=pipe_15)

bbx_9 = BrepBrep(BrepA=cap_6, BrepB=srf_3)  # -> Curves, Points
pipe_16 = Pipe(Curve=bbx_9.Curves, Radius=Slider(0.05, range=0..0.1), Caps=0)

# ---- group: w frames inner lower
brep_12 = Brep(pipe_16)

# ----
panel_20 = Panel("""0
3""")
item_30 = ListItem(List=flatten_4, Index=panel_20, Wrap=True)

move_24 = Move(Geometry=item_30, Motion=Z_17)  # -> Geometry, Transform

ln_13 = Line(StartPoint=move_24.Geometry, EndPoint=move_20.Geometry)
pframe_5 = PerpFrame(Curve=simplify(ln_13), Parameter="0.5")  # -> graft(Frame)
ext_5 = ExtendCurve(Curve=ln_13, Type="0", Start="1", End="0")
pipe_17 = Pipe(Curve=ext_5, Radius="1", Caps=0)
scale_nu_2 = ScaleNU(Geometry=pipe_17, Plane=pframe_5, ScaleX=Slider(1.1, range=0..1.1), ScaleY=Slider(0.88, range=0..1), ScaleZ=1)  # -> flatten(Geometry), Transform
cap_7 = CapHoles(Brep=scale_nu_2.Geometry)

merge_16 = Merge(Data1=cap_7, Data2=cap_5)  # -> flatten(Result)
bbx_10 = BrepBrep(BrepA=cap_7, BrepB=srf_5)  # -> Curves, Points
splitmul_2 = SplitBrepMultiple(Brep=srf_5, Cutters=merge_16)
area_9 = Area(Geometry=splitmul_2)  # -> Area, Centroid
smaller_4 = SmallerThan(FirstNumber=flatten(area_9.Area), SecondNumber=Slider(6, range=0..10))  # -> SmallerThan, OrEqualTo
cull_6 = CullPattern(List=flatten(splitmul_2), CullPattern=smaller_4.SmallerThan)
item_31 = ListItem(List=splitmul_2, Index=0, Wrap=True)
pipe_18 = Pipe(Curve=bbx_10.Curves, Radius=Slider(0.05, range=0..0.1), Caps=0)
offset_8 = OffsetSurface(Surface=item_31, Distance=Slider(0.1, range=0..0.2), Retrim=True)
# Layers
flip_7 = Flip(Surface=offset_8, Guide=item_31)  # -> Surface, Result
offset_9 = OffsetSurface(Surface=flip_7.Surface, Distance=Slider(0.1, range=0..0.2), Retrim=True)

# ---- group: windows down
brep_13 = Brep(cull_6)

# ---- group: inflatable inner
brep_14 = Brep(offset_9)

# ---- group: inflatable outter
brep_15 = Brep(item_31)

# ---- group: w frame circulation
brep_16 = Brep(pipe_18)

# ---- group: inflatable middle
brep_17 = Brep(offset_8)

# ----
panel_21 = Panel("""0
3""")
item_32 = ListItem(List=flatten_2, Index=panel_21, Wrap=True)

move_25 = Move(Geometry=item_32, Motion=amp_5)  # -> Geometry, Transform

ln_14 = Line(StartPoint=move_25.Geometry, EndPoint=move_13.Geometry)
pframe_6 = PerpFrame(Curve=simplify(ln_14), Parameter="0.5")  # -> graft(Frame)
ext_6 = ExtendCurve(Curve=ln_14, Type="0", Start="1", End="0")
pipe_19 = Pipe(Curve=ext_6, Radius="1", Caps=0)
scale_nu_3 = ScaleNU(Geometry=pipe_19, Plane=pframe_6, ScaleX=Slider(1.1, range=0..1.1), ScaleY=Slider(0.88, range=0..1), ScaleZ=1)  # -> flatten(Geometry), Transform
cap_8 = CapHoles(Brep=scale_nu_3.Geometry)

merge_17 = Merge(Data1=cap_8, Data2=cap_6)  # -> flatten(Result)
bbx_11 = BrepBrep(BrepA=cap_8, BrepB=srf_3)  # -> Curves, Points
splitmul_3 = SplitBrepMultiple(Brep=srf_3, Cutters=merge_17)
area_10 = Area(Geometry=splitmul_3)  # -> Area, Centroid
smaller_5 = SmallerThan(FirstNumber=flatten(area_10.Area), SecondNumber=Slider(6, range=0..10))  # -> SmallerThan, OrEqualTo
cull_7 = CullPattern(List=flatten(splitmul_3), CullPattern=smaller_5.SmallerThan)
item_33 = ListItem(List=splitmul_3, Index=0, Wrap=True)
pipe_20 = Pipe(Curve=bbx_11.Curves, Radius=Slider(0.05, range=0..0.1), Caps=0)
offset_10 = OffsetSurface(Surface=item_33, Distance=Slider(0.1, range=0..0.2), Retrim=True)
offset_11 = OffsetSurface(Surface=offset_10, Distance=Slider(0.1, range=0..0.2), Retrim=True)

# ---- group: inflatable inner
brep_18 = Brep(offset_11)

# ---- group: w frames outer lower
brep_19 = Brep(pipe_20)

# ---- group: windows upper
brep_20 = Brep(cull_7)

# ---- group: inflatable outter
brep_21 = Brep(item_33)

# ---- group: inflatable middle
brep_22 = Brep(offset_10)

# ---- group: windows
entwine_7 = Entwine(Branch00=flatten(brep_20), Branch01=flatten(brep_13), FlattenInputs=True)  # -> flatten(Result)

# ---- group: inflatable inner
entwine_8 = Entwine(Branch00=flatten(brep_18), Branch01=flatten(brep_14), FlattenInputs=True)  # -> flatten(Result)

# ---- group: inflatable middle
entwine_9 = Entwine(Branch00=flatten(brep_22), Branch01=flatten(brep_17), FlattenInputs=True)  # -> flatten(Result)

# ---- group: inflatable outter
entwine_10 = Entwine(Branch00=flatten(brep_21), Branch01=flatten(brep_15), FlattenInputs=True)  # -> flatten(Result)

# ---- group: Window frames
merge_18 = Merge(Data1=flatten(brep_16), Data2=flatten(brep_11), Data3=flatten(brep_19), Data4=flatten(brep_12))

# ----
entwine_11 = Entwine(
    Branch00=brep_15,
    Branch01=brep_17,
    Branch02=brep_14,
    Branch03=brep_18,
    Branch04=brep_22,
    Branch05=brep_21,
    Branch06=brep_13,
    Branch07=brep_20,
    Branch08=brep_16,
    Branch09=brep_11,
    Branch010=brep_19,
    Branch011=brep_12,
    Branch012=brep_6,
    Branch013=brep_7,
    Branch014=extr_3,
    Branch015=extr_2,
    Branch016=brep_4,
    Branch017=brep_5,
    Branch018=brep_8,
    FlattenInputs=True)

brep_23 = Brep(cap)
item_34 = ListItem(List=flatten(brep_23), Index=0, Wrap=True)
volume_6 = Volume(Geometry=item_34)  # -> Volume, Centroid
move2pt_3 = MoveToPoint(Geometry=entwine_11, PointA=area_3.Centroid, PointB=graft(volume_6.Centroid))  # -> simplify(Moved), Vector, Transform
previewmat_3 = CustomPreviewMaterials(DiffuseColor=RGB(255, 255, 255))
previewmat_4 = CustomPreviewMaterials(Geometry=move2pt_3.Moved, DiffuseColor=merge_9)

entwine_12 = Entwine(Branch00=item_27, Branch01=offsrf_3, Branch02=offset_6, Branch03=offset_7, FlattenInputs=True)
merge_19 = Merge(Data1=ColourSwatch(SwatchColor=RGBA(189, 189, 189, 206)), Data2=ColourSwatch(SwatchColor=RGB(255, 255, 255)))  # -> simplify(graft(Result))
python_2 = GhPythonScript(S=entwine_12, D=Slider(0.01, range=0..1))  # -> simplify(a); inputs S: Brep; same code as python
brep_24 = Brep(item_9)
volume_7 = Volume(Geometry=brep_24)  # -> Volume, Centroid
flatten_5 = FlattenTree(Tree=python_2, Path="{0}")
graft_2 = GraftTree(Tree=volume_7.Centroid, IncludeEmptyLists=True, IncludeNullItems=True)  # -> simplify(Tree)

entwine_13 = Entwine(Branch00=flatten_5, Branch01=entwine_6, FlattenInputs=True)
move2pt_4 = MoveToPoint(Geometry=entwine_13, PointA=area.Centroid, PointB=graft(volume_2.Centroid))  # -> simplify(Moved), Vector, Transform

move2pt_5 = MoveToPoint(Geometry=entwine_13, PointA=area.Centroid, PointB=graft(volume_7.Centroid))  # -> simplify(Moved), Vector, Transform
lng_2 = ListLength(List=move2pt_5.Moved)
group_2 = Group(Objects=move2pt_5.Moved)
split_4 = SplitList(List=move2pt_5.Moved, Index=expr("x/2", lng_2))  # -> flatten(ListA), flatten(ListB)
mirror_9 = Mirror(Geometry=group_2, Plane=graft_2)  # -> Geometry, Transform
ungroup_2 = Ungroup(Group=mirror_9.Geometry)
entwine_14 = Entwine(Branch00=split_4.ListA, Branch01=split_4.ListB, FlattenInputs=True)  # -> simplify(Result)
split_5 = SplitList(List=ungroup_2, Index=expr("x/2", lng_2))  # -> flatten(ListA), flatten(ListB)
entwine_15 = Entwine(Branch00=split_5.ListA, Branch01=split_5.ListB, FlattenInputs=True)  # -> simplify(Result)
merge_20 = Merge(Data1=entwine_14, Data2=entwine_15)
previewmat_5 = CustomPreviewMaterials(Geometry=merge_20, DiffuseColor=merge_19)
