# Grasshopper definition units_detail_Paula.gh (Grasshopper 1.0.7)
# plug-ins: Speckle 2, treesloth01, Human, Pufferfish, eleFront

# https://macad.speckle.xyz/streams/4975f9f0a8/commits/9ec35295b2
mesh = Mesh()  # disabled

# ----
# https://macad.speckle.xyz/streams/0f1c84ad9c/commits/c4616ae012
dso = DeconstructSpeckleObject(selectedKitName="Objects")  # -> DisplayStyle, Elements
dso_2 = DeconstructSpeckleObject(SpeckleObject=dso.Elements, selectedKitName="Objects")
dso_3 = DeconstructSpeckleObject(SpeckleObject=dso.DisplayStyle, selectedKitName="Objects")

dso_4 = DeconstructSpeckleObject(selectedKitName="Objects")
reflay = ReferenceByLayer(LayerName="UnitsRawVolumes", lightweight=False)

volume = Volume(Geometry=reflay)  # -> Volume, Centroid
int = Integer(volume.Volume)
cset = CreateSet(List=int)  # -> Set, Map
cset_2 = CreateSet(List=cset.Map)  # -> Set, Map
mindex = MemberIndex(Set=cset.Map, Member=cset_2.Set)  # -> Index, Count
item = ListItem(List=reflay, Index=mindex.Index, Wrap=True)  # -> simplify(Item)
bang = ExplodeTree(Data=item)  # -> Branch0, Branch1

# ----
# HABIT
number_slider = Slider(1.2, range=0..2.02)
number_slider_2 = Slider(1.5, range=1..2)
range = Range(Domain=Slider(1.5, range=0..6.002), Steps=number_slider_2)
range_2 = Range(Domain=Domain(0, 1), Steps=number_slider_2)
pt = ConstructPoint(XCoordinate=0, YCoordinate=0, ZCoordinate=range)
graph = GraphMapper(range_2, x0=0, x1=1, y0=0, y1=1, container_name="Bezier", cpx=[0, 0.5185281634, 1, 1], cpy=[0, 0, 0.1436586976, 1])
dom = ConstructDomain(DomainStart=Slider(3.9, range=1..13), DomainEnd=number_slider)
bnd = Bounds(Numbers=graph)
prot = RotatePlane(Plane=pt, Angle="0.5*pi")
remap = RemapNumbers(Value=graph, Source=bnd, Target=dom)  # -> Mapped, Clipped
number_slider_3 = Slider(0.01, range=0..1)
cir = Circle(Plane=prot, Radius=remap.Mapped)
item_2 = ListItem(List=cir, Index=0, Wrap=True)
area = Area(Geometry=item_2)  # -> Area, Centroid
range_3 = Range(Domain=Domain(0, 1), Steps=Slider(8, range=0..50))
subtraction = Subtraction(A="1", B=number_slider_3)
merge = Merge(Data1="0", Data2=number_slider_3, Data3=subtraction, Data4="1")
shatter = Shatter(Curve=reparameterize(graft(cir)), Parameters=range_3)
consec = ConsecutiveDomains(Numbers=merge, Additive=invert(True))
panel = Panel(merge)
subcrv = SubCurve(BaseCurve=reparameterize(graft(shatter)), Domain=consec)
panel_2 = Panel("""0
2""")
panel_3 = Panel(consec)
cull_i = CullIndex(List=subcrv, Indices=panel_2, Wrap=True)  # -> simplify(List)
item_3 = ListItem(List=subcrv, Index=panel_2, Wrap=True)
pshift = ShiftPaths(Data=cull_i, Offset=-1)
flip = FlipMatrix(Data=pshift)
midpt = CurveMiddle(Curve=flip)
loft = Loft(Curves=cir, Options={Adjust=False, Closed=False, LoftEnds=0, LoftSimp=0, LoftType=0, Rebuild=10, Refit=0.01})
pshift_2 = ShiftPaths(Data=item_3, Offset=-1)
graph_2 = GraphMapper(range_2, x0=0, x1=1, y0=0, y1=1, container_name="Bezier", cpx=[0, 0.25, 0.75, 1], cpy=[0, 0.25, 0.75, 1])
join = JoinCurves(Curves=pshift_2, Preserve=False)
brep_cp = BrepClosestPoint(Point=midpt, Brep=loft)  # -> Point, Normal, Distance
dom_2 = ConstructDomain(DomainStart=Slider(0.1, range=0..10), DomainEnd=Slider(0.11, range=0..1))
flip_2 = FlipMatrix(Data=join)
bnd_2 = Bounds(Numbers=graph_2)
remap_2 = RemapNumbers(Value=graph_2, Source=bnd_2, Target=dom_2)  # -> Mapped, Clipped
amp = Amplitude(Vector=brep_cp.Normal, Amplitude=remap_2.Mapped)
rev = Reverse(Vector=amp)
end = EndPoints(Curve=flip)  # -> Start, End
move = Move(Geometry=midpt, Motion=rev)  # -> Geometry, Transform
arc = Arc3Pt(PointA=end.Start, PointB=move.Geometry, PointC=end.End)  # -> Arc, Plane, Radius
item_4 = ListItem(List=arc.Arc, Index=0, Wrap=True)
project = Project(Geometry=item_4, Plane=PlaneXY(0, 0, 0))  # -> Geometry, Transform
replace = ReplaceItems(List=arc.Arc, Item=project.Geometry, Indices="0", Wrap=False)
loft_opt = LoftOptions(Closed=False, Adjust=False, Rebuild=0, Refit="0.01", Type=0)

area_2 = Area(Geometry=bang.Branch1)  # -> Area, Centroid
prox = Proximity3D(Points=area_2.Centroid, Group="1", MaxRadius="5")  # -> simplify(Links), Topology
clean = CleanTree(RemoveNulls=True, RemoveInvalid=True, RemoveEmpty=True, Tree=prox.Links)
tstat = TreeStatistics(Tree=clean)  # -> Paths, Length, Count
split = SplitTree(Data=simplify(graft(bang.Branch1)), Masks=flatten(tstat.Paths))  # -> flatten(Positive), flatten(Negative)

item_5 = ListItem(List=bang.Branch0, Index=0, Wrap=True)

# ----
# BUFFER
number_slider_4 = Slider(1.2, range=0..2.02)
number_slider_5 = Slider(1.5, range=1..2)
range_4 = Range(Domain=Slider(3.7, range=0..6.002), Steps=number_slider_5)
range_5 = Range(Domain=Domain(0, 1), Steps=number_slider_5)
graph_3 = GraphMapper(range_5, x0=0, x1=1, y0=0, y1=1, container_name="Bezier", cpx=[0, 0.5185281634, 1, 1], cpy=[0, 0, 0.1436586976, 1])
pt_2 = ConstructPoint(XCoordinate=0, YCoordinate=0, ZCoordinate=range_4)
dom_3 = ConstructDomain(DomainStart=Slider(4.2, range=1..13), DomainEnd=number_slider_4)
bnd_3 = Bounds(Numbers=graph_3)
prot_2 = RotatePlane(Plane=pt_2, Angle="0.5*pi")
remap_3 = RemapNumbers(Value=graph_3, Source=bnd_3, Target=dom_3)  # -> Mapped, Clipped
cir_2 = Circle(Plane=prot_2, Radius=remap_3.Mapped)
item_6 = ListItem(List=cir_2, Index=0, Wrap=True)
area_3 = Area(Geometry=item_6)  # -> Area, Centroid
number_slider_6 = Slider(0.01, range=0..1)
range_6 = Range(Domain=Domain(0, 1), Steps=Slider(8, range=0..50))
shatter_2 = Shatter(Curve=reparameterize(graft(cir_2)), Parameters=range_6)
subtraction_2 = Subtraction(A="1", B=number_slider_6)
merge_2 = Merge(Data1="0", Data2=number_slider_6, Data3=subtraction_2, Data4="1")
consec_2 = ConsecutiveDomains(Numbers=merge_2, Additive=invert(True))
panel_4 = Panel(merge_2)
subcrv_2 = SubCurve(BaseCurve=reparameterize(graft(shatter_2)), Domain=consec_2)
panel_5 = Panel("""0
2""")
panel_6 = Panel(consec_2)
cull_i_2 = CullIndex(List=subcrv_2, Indices=panel_5, Wrap=True)  # -> simplify(List)
item_7 = ListItem(List=subcrv_2, Index=panel_5, Wrap=True)
pshift_3 = ShiftPaths(Data=cull_i_2, Offset=-1)
flip_3 = FlipMatrix(Data=pshift_3)
midpt_2 = CurveMiddle(Curve=flip_3)
loft_2 = Loft(Curves=cir_2, Options={Adjust=False, Closed=False, LoftEnds=0, LoftSimp=0, LoftType=0, Rebuild=10, Refit=0.01})
pshift_4 = ShiftPaths(Data=item_7, Offset=-1)
graph_4 = GraphMapper(range_5, x0=0, x1=1, y0=0, y1=1, container_name="Bezier", cpx=[0, 0.25, 0.75, 1], cpy=[0, 0.25, 0.75, 1])
join_2 = JoinCurves(Curves=pshift_4, Preserve=False)
brep_cp_2 = BrepClosestPoint(Point=midpt_2, Brep=loft_2)  # -> Point, Normal, Distance
dom_4 = ConstructDomain(DomainStart=Slider(0.1, range=0..10), DomainEnd=Slider(0.11, range=0..1))
flip_4 = FlipMatrix(Data=join_2)
bnd_4 = Bounds(Numbers=graph_4)
remap_4 = RemapNumbers(Value=graph_4, Source=bnd_4, Target=dom_4)  # -> Mapped, Clipped
amp_2 = Amplitude(Vector=brep_cp_2.Normal, Amplitude=remap_4.Mapped)
rev_2 = Reverse(Vector=amp_2)
end_2 = EndPoints(Curve=flip_3)  # -> Start, End
move_2 = Move(Geometry=midpt_2, Motion=rev_2)  # -> Geometry, Transform
arc_2 = Arc3Pt(PointA=end_2.Start, PointB=move_2.Geometry, PointC=end_2.End)  # -> Arc, Plane, Radius
item_8 = ListItem(List=arc_2.Arc, Index=0, Wrap=True)
project_2 = Project(Geometry=item_8, Plane=PlaneXY(0, 0, 0))  # -> Geometry, Transform
loft_opt_2 = LoftOptions(Closed=False, Adjust=False, Rebuild=0, Refit="0.01", Type=0)
replace_2 = ReplaceItems(List=arc_2.Arc, Item=project_2.Geometry, Indices="0", Wrap=False)
loft_3 = Loft(Curves=flip_4, Options=loft_opt_2)
loft_4 = Loft(Curves=replace_2, Options=loft_opt_2)

item_9 = ListItem(List=split.Negative, Index=0, Wrap=True)
brep = Brep(item_9)

renumber = RenumberPaths(Data=clean)
end_3 = EndPoints(Curve=renumber)  # -> Start, End
pdecon = Deconstruct(Point=[end_3.Start, end_3.End])  # -> XComponent, YComponent, ZComponent
int_2 = Integer(pdecon.ZComponent)
bnd_5 = Bounds(Numbers=int_2)
dedomain = DeconstructDomain(Domain=bnd_5)  # -> Start, End
equals = Equality(FirstNumber=int_2, SecondNumber=dedomain.Start)  # -> Equality, Inequality
subtraction_3 = Subtraction(A=dedomain.Start, B=dedomain.End)
cull = CullPattern(List=[end_3.Start, end_3.End], CullPattern=equals.Equality)
division = Division(A=subtraction_3, B="2")
abs = Absolute(Value=subtraction_3)
Z = UnitZ(Factor=division)
wires = BrepWireframe(Brep=split.Positive, Density=-1)
move_3 = Move(Geometry=cull, Motion=Z)  # -> Geometry, Transform
project_3 = Project(Geometry=wires, Plane=move_3.Geometry)  # -> simplify(Geometry), Transform

panel_7 = Panel("https://macad.speckle.xyz/streams/5e4e4e4563/branches/24.02.27-class")  # disabled

loft_5 = Loft(Curves=replace, Options=loft_opt)
loft_6 = Loft(Curves=flip_2, Options=loft_opt)

end_4 = EndPoints(Curve=project_3.Geometry)  # -> Start, End
multiplication = Multiplication(A=abs, B="2")
cullpt = CullDuplicates(Points=[end_4.Start, end_4.End], Tolerance=0.1, CullMode=3)  # -> Points, Indices, Valence
pline = PolyLine(Vertices=cullpt.Points, Closed=True)  # -> simplify(Polyline)
Z_2 = UnitZ(Factor=multiplication)
extr = Extrude(Base=pline, Direction=Z_2)
cap = CapHoles(Brep=extr)

item_10 = ListItem(List=end.End, Index=0, Wrap=True)  # -> flatten(Item)
item_11 = ListItem(List=cir, Index="-1", Wrap=True)
crv_cp = CurveClosestPoint(Point=item_10, Curve=item_11)  # -> flatten(Point), Parameter, Distance
avr = Average(Input=crv_cp.Point)
vec2pt = Vector2Pt(PointA=avr, PointB=crv_cp.Point, Unitize=False)  # -> Vector, Length
amp_3 = Amplitude(Vector=vec2pt.Vector, Amplitude=Slider(0.1, range=0..0.1))
move_4 = Move(Geometry=crv_cp.Point, Motion=amp_3)  # -> Geometry, Transform
ln = Line(StartPoint=crv_cp.Point, EndPoint=move_4.Geometry)

item_12 = ListItem(List=end_2.End, Index=0, Wrap=True)  # -> flatten(Item)
item_13 = ListItem(List=cir_2, Index="-1", Wrap=True)
crv_cp_2 = CurveClosestPoint(Point=item_12, Curve=item_13)  # -> flatten(Point), Parameter, Distance
avr_2 = Average(Input=crv_cp_2.Point)
vec2pt_2 = Vector2Pt(PointA=avr_2, PointB=crv_cp_2.Point, Unitize=False)  # -> Vector, Length
amp_4 = Amplitude(Vector=vec2pt_2.Vector, Amplitude=Slider(0.1, range=0..0.1))
move_5 = Move(Geometry=crv_cp_2.Point, Motion=amp_4)  # -> Geometry, Transform
ln_2 = Line(StartPoint=crv_cp_2.Point, EndPoint=move_5.Geometry)

debrep = DeconstructBrep(Brep=loft_5)  # -> Faces, Edges, Vertices
midpt_3 = CurveMiddle(Curve=debrep.Edges)
pdecon_2 = Deconstruct(Point=midpt_3)  # -> XComponent, YComponent, ZComponent
smaller = SmallerThan(FirstNumber=pdecon_2.ZComponent, SecondNumber="0.1")  # -> SmallerThan, OrEqualTo
cull_2 = CullPattern(List=midpt_3, CullPattern=smaller.SmallerThan)
flatten = FlattenTree(Tree=cull_2, Path="{0}")

debrep_2 = DeconstructBrep(Brep=loft_4)  # -> Faces, Edges, Vertices
midpt_4 = CurveMiddle(Curve=debrep_2.Edges)
pdecon_3 = Deconstruct(Point=midpt_4)  # -> XComponent, YComponent, ZComponent
smaller_2 = SmallerThan(FirstNumber=pdecon_3.ZComponent, SecondNumber="0.1")  # -> SmallerThan, OrEqualTo
cull_3 = CullPattern(List=midpt_4, CullPattern=smaller_2.SmallerThan)
flatten_2 = FlattenTree(Tree=cull_3, Path="{0}")

srf = Surface(flatten(loft_4))

# ----
# FLOOR DOWN
avr_3 = Average(Input=item_12)
neg = Negative(Value=Slider(2.5, range=0..5))
Z_3 = UnitZ(Factor=neg)
move_6 = Move(Geometry=avr_3, Motion=Z_3)  # -> Geometry, Transform
ln_3 = Line(StartPoint=move_6.Geometry, EndPoint=avr_3)
circle = CircleCNR(Center=move_6.Geometry, Normal=Vector(0, 0, 1), Radius=Slider(5, range=0..10))
boundary = BoundarySurfaces(Edges=circle)
mirror = Mirror(Geometry=srf, Plane=avr_3)  # -> Geometry, Transform
bbx = BrepBrep(BrepA=mirror.Geometry, BrepB=boundary)  # -> Curves, Points
end_5 = EndPoints(Curve=bbx.Curves)  # -> flatten(Start), End
pline_2 = PolyLine(Vertices=end_5.Start, Closed=True)
offset = OffsetCurve(Curve=pline_2, Distance="-0.1", Corners=1)
boundary_2 = BoundarySurfaces(Edges=offset)
Z_4 = UnitZ(Factor=Slider(0.05, range=0.05..0.1))
extr_2 = Extrude(Base=boundary_2, Direction=Z_4)

# ----
# CEILING
number_slider_7 = Slider(0.5, range=0..5)
neg_2 = Negative(Value=number_slider_7)
Z_5 = UnitZ(Factor=neg_2)
move_7 = Move(Geometry=avr_2, Motion=Z_5)  # -> Geometry, Transform
ln_4 = Line(StartPoint=move_7.Geometry, EndPoint=avr_2)
circle_2 = CircleCNR(Center=move_7.Geometry, Normal=Vector(0, 0, 1), Radius=Slider(5, range=0..10))
boundary_3 = BoundarySurfaces(Edges=circle_2)
bbx_2 = BrepBrep(BrepA=srf, BrepB=boundary_3)  # -> Curves, Points
end_6 = EndPoints(Curve=bbx_2.Curves)  # -> flatten(Start), End
number_slider_8 = Slider(0.14, range=0..0.2)
pline_3 = PolyLine(Vertices=end_6.Start, Closed=True)
offset_2 = OffsetCurve(Curve=pline_3, Distance="-0.1", Corners=1)
Y = UnitY(Factor=1)
boundary_4 = BoundarySurfaces(Edges=offset_2)
X = UnitX(Factor=1)
number_slider_9 = Slider(0.02, range=0..0.1)
contour = Contour(Shape=boundary_4, Point=Point(0, 0, 0), Direction=Y, Distance=number_slider_8)
contour_2 = Contour(Shape=boundary_4, Point=Point(0, 0, 0), Direction=X, Distance=number_slider_8)
Z_6 = UnitZ(Factor=number_slider_9)
neg_3 = Negative(Value=Z_6)
move_8 = Move(Geometry=contour, Motion=neg_3)  # -> Geometry, Transform
pipe = Pipe(Curve=contour_2, Radius=number_slider_9, Caps=0)
pipe_2 = Pipe(Curve=move_8.Geometry, Radius=number_slider_9, Caps=0)
merge_3 = Merge(Data1=pipe_2, Data2=pipe)

# ----
# FLOOR UP
number_slider_10 = Slider(0, range=0..5)
neg_4 = Negative(Value=number_slider_10)
Z_7 = UnitZ(Factor=neg_4)
move_9 = Move(Geometry=avr_3, Motion=Z_7)  # -> Geometry, Transform
ln_5 = Line(StartPoint=move_9.Geometry, EndPoint=avr_3)
circle_3 = CircleCNR(Center=move_9.Geometry, Normal=Vector(0, 0, 1), Radius=Slider(5, range=0..10))
boundary_5 = BoundarySurfaces(Edges=circle_3)
mirror_2 = Mirror(Geometry=srf, Plane=avr_3)  # -> Geometry, Transform
bbx_3 = BrepBrep(BrepA=mirror_2.Geometry, BrepB=boundary_5)  # -> Curves, Points
end_7 = EndPoints(Curve=bbx_3.Curves)  # -> flatten(Start), End
pline_4 = PolyLine(Vertices=end_7.Start, Closed=True)
offset_3 = OffsetCurve(Curve=pline_4, Distance="-0.1", Corners=1)
boundary_6 = BoundarySurfaces(Edges=offset_3)
Z_8 = UnitZ(Factor=Slider(0.05, range=0.05..0.1))
area_4 = Area(Geometry=boundary_6)  # -> Area, Centroid
cir_3 = Circle(Plane=area_4.Centroid, Radius=Slider(0.9, range=0..1))
rdiff = RegionDifference(CurvesA=offset_3, CurvesB=cir_3)
boundary_7 = BoundarySurfaces(Edges=rdiff)
extr_3 = Extrude(Base=boundary_7, Direction=Z_8)

avr_4 = Average(Input=flatten(flatten))

offcrv = OffsetCurve(Curve=item_11, Plane=PlaneXY(0, 0, 0), Distance=Slider(0.05, range=0..0.1), BothSides=0, Kinks=0, CapType=1)
merge_4 = Merge(Data1=offcrv, Data2=item_11)  # -> flatten(Result)
loft_7 = Loft(Curves=merge_4, Options={Adjust=False, Closed=False, LoftEnds=0, LoftSimp=0, LoftType=0, Rebuild=10, Refit=0.01})
number_slider_11 = Slider(0.2, range=0..0.2)
Z_9 = UnitZ(Factor=number_slider_11)
multiplication_2 = Multiplication(A=number_slider_11, B="-0.5")
extr_4 = Extrude(Base=loft_7, Direction=Z_9)
Z_10 = UnitZ(Factor=multiplication_2)

panel_8 = Panel("""0
3""")
item_14 = ListItem(List=flatten, Index=panel_8, Wrap=True)
ln_6 = Line(StartPoint=avr_4, EndPoint=item_14)
pframe = PerpFrame(Curve=simplify(ln_6), Parameter="0.5")  # -> graft(Frame)
ext = ExtendCurve(Curve=ln_6, Type="0", Start="0", End="1")
pipe_3 = Pipe(Curve=ext, Radius="1", Caps=0)
scale_nu = ScaleNU(Geometry=pipe_3, Plane=pframe, ScaleX=Slider(1.1, range=0..1.1), ScaleY=Slider(0.88, range=0..1), ScaleZ=1)  # -> flatten(Geometry), Transform
cap_2 = CapHoles(Brep=scale_nu.Geometry)

offcrv_2 = OffsetCurve(Curve=item_13, Plane=PlaneXY(0, 0, 0), Distance=Slider(0.05, range=0..0.1), BothSides=0, Kinks=0, CapType=1)
merge_5 = Merge(Data1=offcrv_2, Data2=item_13)  # -> flatten(Result)
loft_8 = Loft(Curves=merge_5, Options={Adjust=False, Closed=False, LoftEnds=0, LoftSimp=0, LoftType=0, Rebuild=10, Refit=0.01})
number_slider_12 = Slider(0.2, range=0..0.2)
Z_11 = UnitZ(Factor=number_slider_12)
multiplication_3 = Multiplication(A=number_slider_12, B="-0.5")
extr_5 = Extrude(Base=loft_8, Direction=Z_11)
Z_12 = UnitZ(Factor=multiplication_3)

srf_2 = Surface(flatten(loft_5))

# ----
# FLOOR
number_slider_13 = Slider(2.81, range=0..5)
neg_5 = Negative(Value=number_slider_13)
Z_13 = UnitZ(Factor=neg_5)
move_10 = Move(Geometry=avr, Motion=Z_13)  # -> Geometry, Transform
ln_7 = Line(StartPoint=move_10.Geometry, EndPoint=avr)
circle_4 = CircleCNR(Center=move_10.Geometry, Normal=Vector(0, 0, 1), Radius=Slider(5, range=0..10))
avr_5 = Average(Input=item_10)
boundary_8 = BoundarySurfaces(Edges=circle_4)
mirror_3 = Mirror(Geometry=srf_2, Plane=avr_5)  # -> Geometry, Transform
bbx_4 = BrepBrep(BrepA=mirror_3.Geometry, BrepB=boundary_8)  # -> Curves, Points
end_8 = EndPoints(Curve=bbx_4.Curves)  # -> flatten(Start), End
pline_5 = PolyLine(Vertices=end_8.Start, Closed=True)
offset_4 = OffsetCurve(Curve=pline_5, Distance="-0.1", Corners=1)
boundary_9 = BoundarySurfaces(Edges=offset_4)
Z_14 = UnitZ(Factor=Slider(0.05, range=0.05..0.1))
extr_6 = Extrude(Base=boundary_9, Direction=Z_14)

# ----
# CEILING
number_slider_14 = Slider(0.15, range=0..5)
neg_6 = Negative(Value=number_slider_14)
Z_15 = UnitZ(Factor=neg_6)
move_11 = Move(Geometry=avr, Motion=Z_15)  # -> Geometry, Transform
ln_8 = Line(StartPoint=move_11.Geometry, EndPoint=avr)
circle_5 = CircleCNR(Center=move_11.Geometry, Normal=Vector(0, 0, 1), Radius=Slider(5, range=0..10))
boundary_10 = BoundarySurfaces(Edges=circle_5)
bbx_5 = BrepBrep(BrepA=srf_2, BrepB=boundary_10)  # -> Curves, Points
end_9 = EndPoints(Curve=bbx_5.Curves)  # -> flatten(Start), End
number_slider_15 = Slider(0.14, range=0..0.2)
pline_6 = PolyLine(Vertices=end_9.Start, Closed=True)
offset_5 = OffsetCurve(Curve=pline_6, Distance="-0.1", Corners=1)
Y_2 = UnitY(Factor=1)
boundary_11 = BoundarySurfaces(Edges=offset_5)
X_2 = UnitX(Factor=1)
contour_3 = Contour(Shape=boundary_11, Point=Point(0, 0, 0), Direction=Y_2, Distance=number_slider_15)
contour_4 = Contour(Shape=boundary_11, Point=Point(0, 0, 0), Direction=X_2, Distance=number_slider_15)
number_slider_16 = Slider(0.02, range=0..0.1)
Z_16 = UnitZ(Factor=number_slider_16)
neg_7 = Negative(Value=Z_16)
move_12 = Move(Geometry=contour_3, Motion=neg_7)  # -> Geometry, Transform
pipe_4 = Pipe(Curve=move_12.Geometry, Radius=number_slider_16, Caps=0)
pipe_5 = Pipe(Curve=contour_4, Radius=number_slider_16, Caps=0)
merge_6 = Merge(Data1=pipe_4, Data2=pipe_5)

avr_6 = Average(Input=flatten(flatten_2))
srf_3 = Surface(flatten(loft_4))
addition = Addition(A=neg, B="1")
Z_17 = UnitZ(Factor=addition)
neg_8 = Negative(Value=Z_17)
amp_5 = Amplitude(Vector=neg_8, Amplitude=Slider(1.3, range=1..1.5))
move_13 = Move(Geometry=avr_6, Motion=amp_5)  # -> Geometry, Transform
bbx_6 = BrepBrep(BrepA=cap_2, BrepB=srf_2)  # -> Curves, Points

mirror_4 = Mirror(Geometry=bbx_6.Curves, Plane=avr_5)  # -> Geometry, Transform
join_3 = JoinCurves(Curves=flatten([mirror_4.Geometry, bbx_6.Curves]), Preserve=False)  # -> graft(Curves)
bang_2 = ExplodeTree(Data=join_3)  # -> Branch0, Branch1
crv = Curve(bang_2.Branch0)
divide = DivideCurve(Curve=crv, Count=Slider(2, range=0..10), Kinks=False)  # -> Points, Tangents, Parameters
item_15 = ListItem(List=divide.Points, Index=0, Wrap=True)  # -> Item, Item1
Z_18 = UnitZ(Factor="5")
ln_9 = Line(StartPoint=item_15.Item, EndPoint=item_15.Item1)
move_14 = Move(Geometry=ln_9, Motion=Z_18)  # -> Geometry, Transform
midpt_5 = CurveMiddle(Curve=move_14.Geometry)
lnpt = LinePt(Line=ln_9, Point=midpt_5)
pln = Plane(lnpt)
vec = Vector(pln)
rotate = Rotate(Geometry=pln, Angle=degrees(Slider(90, range=0..100)), Plane=PlaneXY(0, 0, 0))  # -> Geometry, Transform
amp_6 = Amplitude(Vector=vec, Amplitude=Slider(3, range=0..10))
mirror_5 = Mirror(Geometry=crv, Plane=pln)  # -> Geometry, Transform
amp_7 = Amplitude(Vector=vec, Amplitude=Slider(3, range=0..10))
move_15 = Move(Geometry=mirror_5.Geometry, Motion=amp_7)  # -> Geometry, Transform
vec_2 = Vector(rotate.Geometry)
neg_9 = Negative(Value=vec_2)
loft_9 = Loft(
    Curves=flatten([move_15.Geometry, crv]),
    Options={Adjust=False, Closed=False, LoftEnds=0, LoftSimp=0, LoftType=0, Rebuild=10, Refit=0.01})
area_5 = Area(Geometry=loft_9)  # -> Area, Centroid
amp_8 = Amplitude(Vector=neg_9, Amplitude=Slider(0.41, range=0..1))
orient = Orient(Geometry=pln, Source=PlaneXY(0, 0, 0), Target=area_5.Centroid)  # -> Geometry, Transform
box = CenterBox(Base=orient.Geometry, X=Slider(1.75, range=0..10), Y=Slider(1.25, range=0..10), Z=Slider(1.25, range=0..10))
area_6 = Area(Geometry=box)  # -> Area, Centroid
orient_2 = Orient(Geometry=box, Source=area_6.Centroid, Target=area_5.Centroid)  # -> Geometry, Transform
move_16 = Move(Geometry=orient_2.Geometry, Motion=amp_8)  # -> Geometry, Transform
contour_5 = Contour(Shape=move_16.Geometry, Point=Point(0, 0, 0), Direction=pln, Distance=Slider(0.2, range=0..1))
panel_9 = Panel("""0
1""")
fillet = Fillet(Curve=contour_5, Radius=Slider(0.8, range=0..1))
pcen = PolygonCenter(Polyline=contour_5)  # -> CenterV, CenterE, CenterA
number_slider_17 = Slider(0.9, range=0.5..1)
dispatch = Dispatch(List=flatten(fillet), DispatchPattern=panel_9)  # -> ListA, ListB
dispatch_2 = Dispatch(List=flatten(pcen.CenterV), DispatchPattern=panel_9)  # -> ListA, ListB
scale = Scale(Geometry=fillet, Center=pcen.CenterV, Factor=number_slider_17)  # -> Geometry, Transform
scale_2 = Scale(Geometry=dispatch.ListA, Center=dispatch_2.ListA, Factor=number_slider_17)  # -> Geometry, Transform
crv_2 = Curve(dispatch.ListB)
weave = Weave(Pattern=[0, 1], Stream0=crv_2, Stream1=scale_2.Geometry, NullGaps=False)
item_16 = ListItem(List=weave, Index=0, Wrap=True)  # -> Item1, Item
crv_3 = Curve(crv)
number_slider_18 = Slider(0.05, range=0..0.1)
crv_4 = Curve(move_15.Geometry)
loft_10 = Loft(
    Curves=flatten(scale.Geometry),
    Options={Adjust=False, Closed=False, LoftEnds=0, LoftSimp=0, LoftType=0, Rebuild=10, Refit=0.01})
merge_7 = Merge(Data1=item_16.Item, Data2=crv_3)
merge_8 = Merge(Data1=crv_4, Data2=item_16.Item1)
offset_6 = OffsetSurface(Surface=loft_10, Distance=".05", Retrim=True)
rebcrv = RebuildCurve(Curve=merge_8, Count="50", EndTangents=False)  # -> flatten(Rebuilt)
rebcrv_2 = RebuildCurve(Curve=merge_7, Count="50", EndTangents=False)  # -> flatten(Rebuilt)
offsrf = OffsetSurface(Surface=offset_6, Distance=Slider(0.05, range=0..0.1), BothSides=0, CreateSolid=True)
loft_11 = Loft(Curves=weave, Options={Adjust=False, Closed=False, LoftEnds=0, LoftSimp=0, LoftType=0, Rebuild=10, Refit=0.01})
loft_12 = Loft(Curves=rebcrv, Options={Adjust=False, Closed=False, LoftEnds=0, LoftSimp=0, LoftType=0, Rebuild=10, Refit=0.01})
loft_13 = Loft(Curves=rebcrv_2, Options={Adjust=False, Closed=False, LoftEnds=0, LoftSimp=0, LoftType=0, Rebuild=10, Refit=0.01})
pipe_6 = Pipe(Curve=crv_4, Radius="0.05", Caps=0)
pipe_7 = Pipe(Curve=crv_3, Radius="0.05", Caps=0)
offset_7 = OffsetSurface(Surface=loft_11, Distance=number_slider_18, Retrim=True)
offset_8 = OffsetSurface(Surface=loft_12, Distance=number_slider_18, Retrim=True)
offset_9 = OffsetSurface(Surface=loft_13, Distance=number_slider_18, Retrim=True)
brep_2 = Brep(offset_8)
brep_3 = Brep(loft_12)
brep_4 = Brep(offset_9)
brep_5 = Brep(loft_13)
brep_6 = Brep(pipe_6)
brep_7 = Brep(pipe_7)

clean_2 = CleanTree(RemoveNulls=True, RemoveInvalid=True, RemoveEmpty=True, Tree=bbx_6.Curves)
number_slider_19 = Slider(0.1, range=0..0.2)
number_slider_20 = Slider(0.1, range=0..0.2)
srf_4 = Surface(loft_6)
avr_7 = Average(Input=item_10)
move_17 = Move(Geometry=extr_4, Motion=Z_10)  # -> Geometry, Transform
pipe_8 = Pipe(Curve=ln, Radius=Slider(0.05, range=0..0.1), Caps=0)
boundary_12 = BoundarySurfaces(Edges=item_11)
pipe_9 = Pipe(Curve=clean_2, Radius=Slider(0.05, range=0..0.1), Caps=0)
offsrf_2 = OffsetSurface(Surface=srf_4, Distance=Slider(0.05, range=0..0.1), BothSides=0, CreateSolid=True)
mirror_6 = Mirror(Geometry=pipe_9, Plane=avr_7)  # -> Geometry, Transform
mirror_7 = Mirror(Geometry=offsrf_2, Plane=avr_7)  # -> Geometry, Transform
srf_5 = Surface(loft_3)
Z_19 = UnitZ(Factor="1.6")

# ---- group: connector frames
merge_9 = Merge(Data1=brep_6, Data2=brep_7)  # -> flatten(Result)

# ---- group: connector inner
merge_10 = Merge(Data1=brep_2, Data2=brep_4)

# ---- group: connector outer
merge_11 = Merge(Data1=brep_3, Data2=brep_5)

# ----
number_slider_21 = Slider(0.05, range=0..0.1)

# ---- group: interior shell
brep_8 = Brep(offsrf)

# ---- group: skin outer
brep_9 = Brep(offset_7)

# ---- group: skin inner
brep_10 = Brep(loft_11)

# ----
brep_11 = Brep(pipe_8)
brep_12 = Brep(move_17.Geometry)
brep_13 = Brep(boundary_12)
brep_14 = Brep(mirror_7.Geometry)
brep_15 = Brep(offsrf_2)
brep_16 = Brep(pipe_9)
brep_17 = Brep(mirror_6.Geometry)
area_7 = Area(Geometry=brep_8)  # -> Area, Centroid
merge_12 = Merge(Data1=flatten(brep_11), Data2=flatten(brep_12))
mirror_8 = Mirror(Geometry=loft_3, Plane=avr_3)  # -> Geometry, Transform
pipe_10 = Pipe(Curve=ln_2, Radius=Slider(0.05, range=0..0.1), Caps=0)
boundary_13 = BoundarySurfaces(Edges=item_13)
move_18 = Move(Geometry=extr_5, Motion=Z_12)  # -> Geometry, Transform
orient_3 = Orient(Geometry=brep_8, Source=area_7.Centroid, Target=PlaneXY(0, 0, 0))  # -> Geometry, Transform
orient_4 = Orient(Geometry=brep_9, Source=area_7.Centroid, Target=PlaneXY(0, 0, 0))  # -> Geometry, Transform
orient_5 = Orient(Geometry=brep_10, Source=area_7.Centroid, Target=PlaneXY(0, 0, 0))  # -> Geometry, Transform
orient_6 = Orient(Geometry=merge_11, Source=area_7.Centroid, Target=PlaneXY(0, 0, 0))  # -> Geometry, Transform
orient_7 = Orient(Geometry=merge_10, Source=area_7.Centroid, Target=PlaneXY(0, 0, 0))  # -> Geometry, Transform
orient_8 = Orient(Geometry=merge_9, Source=area_7.Centroid, Target=PlaneXY(0, 0, 0))  # -> Geometry, Transform

# ---- group: structure
entwine = Entwine(Branch00=flatten(brep_14), Branch01=flatten(brep_15), FlattenInputs=True)  # -> flatten(Result)

# ----
# Layers
offsrf_3 = OffsetSurface(Surface=srf_5, Distance=number_slider_21, BothSides=0, CreateSolid=True)

# ---- group: floor
brep_18 = Brep(flatten(extr_6))

# ---- group: ceiling
brep_19 = Brep(flatten(merge_6))

# ---- group: window up glass
brep_20 = Brep(flatten(brep_13))

# ----
offsrf_4 = OffsetSurface(Surface=mirror_8.Geometry, Distance=number_slider_21, BothSides=0, CreateSolid=True)
Z_20 = UnitZ(Factor="1.6")

# ---- group: upper floor
brep_21 = Brep(extr_3)

# ---- group: Lower floor
brep_22 = Brep(extr_2)

# ----
move_19 = Move(Geometry=orient_3.Geometry, Motion=Z_19)  # -> Geometry, Transform
move_20 = Move(Geometry=orient_4.Geometry, Motion=Z_19)  # -> Geometry, Transform
move_21 = Move(Geometry=orient_5.Geometry, Motion=Z_19)  # -> Geometry, Transform
move_22 = Move(Geometry=orient_6.Geometry, Motion=Z_19)  # -> Geometry, Transform
move_23 = Move(Geometry=orient_7.Geometry, Motion=Z_19)  # -> Geometry, Transform
move_24 = Move(Geometry=orient_8.Geometry, Motion=Z_19)  # -> Geometry, Transform
move_25 = Move(Geometry=brep_18, Motion=Z_20)  # -> Geometry, Transform
move_26 = Move(Geometry=brep_19, Motion=Z_20)  # -> Geometry, Transform
move_27 = Move(Geometry=entwine, Motion=Z_20)  # -> Geometry, Transform
move_28 = Move(Geometry=brep_20, Motion=Z_20)  # -> Geometry, Transform

# ---- group: ceiling structure
brep_23 = Brep(merge_3)

# ---- group: outer ring
brep_24 = Brep(move_18.Geometry)

# ---- group: Structure lower
brep_25 = Brep(offsrf_4)

# ---- group: structure upper
brep_26 = Brep(offsrf_3)

# ---- group: outer ring parts
brep_27 = Brep(pipe_10)

# ----
merge_13 = Merge(Data1=flatten(brep_24), Data2=flatten(brep_27))

# ---- group: Floors
entwine_2 = Entwine(Branch00=flatten(brep_21), Branch01=flatten(brep_22), FlattenInputs=True)  # -> flatten(Result)

# ---- group: structure
entwine_3 = Entwine(Branch00=flatten(brep_25), Branch01=flatten(brep_26), FlattenInputs=True)  # -> flatten(Result)

# ---- group: upperwindow
brep_28 = Brep(flatten(boundary_13))

# ----
Z_21 = UnitZ(Factor="3.2")

# ---- group: ceiling structure
brep_29 = Brep(flatten(brep_23))

# ----
move_29 = Move(Geometry=brep_29, Motion=Z_21)  # -> Geometry, Transform
move_30 = Move(Geometry=entwine_3, Motion=Z_21)  # -> Geometry, Transform
move_31 = Move(Geometry=entwine_2, Motion=Z_21)  # -> Geometry, Transform
move_32 = Move(Geometry=brep_28, Motion=Z_21)  # -> Geometry, Transform

# ---- group: Bake Object to its layers
button = Button()

button_2 = Button()

# ----
# LAYER AND SUBLAYER ACCESS/NAME
panel_10 = Panel("Units_Support::")

# ----
# LAYER AND SUBLAYER ACCESS/NAME
panel_11 = Panel("Units_Habi::")

# ---- group: Bake Object to its layers
button_3 = Button()

# ----
# LAYER AND SUBLAYER ACCESS/NAME
panel_12 = Panel("Units_Buffer::")

layer_name = Panel("InteriorShell")
material_name = Panel("Steel")
number_slider_22 = Slider(148, range=0..400)
rgb = ColourRGB(Alpha=Slider(0.697, range=0..1), Red=number_slider_22, Green=number_slider_22, Blue=number_slider_22)
concat = Concatenate(FragmentC=panel_10, FragmentA="support", FragmentB=layer_name)
lng = ListLength(List=move_19.Geometry)
layer_baking_location = Panel(concat)
dup = DuplicateData(Data=material_name, Number=lng, Order=True)
dup_2 = DuplicateData(Data=concat, Number=lng, Order=True)
dup_3 = DuplicateData(Data=rgb, Number=lng, Order=True)
ef_layer = EleFrontLayer(Layer=dup_2, DisplayColour=dup_3, MaterialName=dup)  # -> Layer, FullPath, Hidden, Locked, DisplayColour, MaterialName, Linetype, PrintColour, PrintWidth
ef_att = EleFrontAttributes(Layer=dup_2, ColourSource=ef_layer.DisplayColour, MaterialName=ef_layer.MaterialName, PrintColour=ef_layer.PrintColour)  # -> Attributes, Keys, Values, Name, Layer, ColourSource, DisplayColour, MaterialSource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
bklay = BakeLayers(Layers=ef_layer.Layer, Bake=button)
bake = BakeObjects(Geometry=move_19.Geometry, Attributes=ef_att.Attributes, Bake=button, createGroups=False)  # -> Message, Ghosts

layer_name_2 = Panel("FabricOuter")
material_name_2 = Panel("inflatable")
number_slider_23 = Slider(148, range=0..400)
rgb_2 = ColourRGB(Alpha=Slider(0.697, range=0..1), Red=number_slider_23, Green=number_slider_23, Blue=number_slider_23)
concat_2 = Concatenate(FragmentC=panel_10, FragmentA="support", FragmentB=layer_name_2)
lng_2 = ListLength(List=move_20.Geometry)
layer_baking_location_2 = Panel(concat_2)
dup_4 = DuplicateData(Data=material_name_2, Number=lng_2, Order=True)
dup_5 = DuplicateData(Data=concat_2, Number=lng_2, Order=True)
dup_6 = DuplicateData(Data=rgb_2, Number=lng_2, Order=True)
ef_layer_2 = EleFrontLayer(Layer=dup_5, DisplayColour=dup_6, MaterialName=dup_4)  # -> Layer, FullPath, Hidden, Locked, DisplayColour, MaterialName, Linetype, PrintColour, PrintWidth
ef_att_2 = EleFrontAttributes(
    Layer=dup_5,
    ColourSource=ef_layer_2.DisplayColour,
    MaterialName=ef_layer_2.MaterialName,
    PrintColour=ef_layer_2.PrintColour)  # -> Attributes, Keys, Values, Name, Layer, ColourSource, DisplayColour, MaterialSource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
bklay_2 = BakeLayers(Layers=ef_layer_2.Layer, Bake=button)
bake_2 = BakeObjects(Geometry=move_20.Geometry, Attributes=ef_att_2.Attributes, Bake=button, createGroups=False)  # -> Message, Ghosts

layer_name_3 = Panel("FabricInner")
material_name_3 = Panel("inflatable")
number_slider_24 = Slider(148, range=0..400)
rgb_3 = ColourRGB(Alpha=Slider(0.697, range=0..1), Red=number_slider_24, Green=number_slider_24, Blue=number_slider_24)
concat_3 = Concatenate(FragmentC=panel_10, FragmentA="support", FragmentB=layer_name_3)
lng_3 = ListLength(List=move_21.Geometry)
layer_baking_location_3 = Panel(concat_3)
dup_7 = DuplicateData(Data=material_name_3, Number=lng_3, Order=True)
dup_8 = DuplicateData(Data=concat_3, Number=lng_3, Order=True)
dup_9 = DuplicateData(Data=rgb_3, Number=lng_3, Order=True)
ef_layer_3 = EleFrontLayer(Layer=dup_8, DisplayColour=dup_9, MaterialName=dup_7)  # -> Layer, FullPath, Hidden, Locked, DisplayColour, MaterialName, Linetype, PrintColour, PrintWidth
ef_att_3 = EleFrontAttributes(
    Layer=dup_8,
    ColourSource=ef_layer_3.DisplayColour,
    MaterialName=ef_layer_3.MaterialName,
    PrintColour=ef_layer_3.PrintColour)  # -> Attributes, Keys, Values, Name, Layer, ColourSource, DisplayColour, MaterialSource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
bklay_3 = BakeLayers(Layers=ef_layer_3.Layer, Bake=button)
bake_3 = BakeObjects(Geometry=move_21.Geometry, Attributes=ef_att_3.Attributes, Bake=button, createGroups=False)  # -> Message, Ghosts

layer_name_4 = Panel("ConnectorOuter")
material_name_4 = Panel("inflatable")
number_slider_25 = Slider(148, range=0..400)
rgb_4 = ColourRGB(Alpha=Slider(0.697, range=0..1), Red=number_slider_25, Green=number_slider_25, Blue=number_slider_25)
concat_4 = Concatenate(FragmentC=panel_10, FragmentA="support", FragmentB=layer_name_4)
lng_4 = ListLength(List=move_22.Geometry)
layer_baking_location_4 = Panel(concat_4)
dup_10 = DuplicateData(Data=material_name_4, Number=lng_4, Order=True)
dup_11 = DuplicateData(Data=concat_4, Number=lng_4, Order=True)
dup_12 = DuplicateData(Data=rgb_4, Number=lng_4, Order=True)
ef_layer_4 = EleFrontLayer(Layer=dup_11, DisplayColour=dup_12, MaterialName=dup_10)  # -> Layer, FullPath, Hidden, Locked, DisplayColour, MaterialName, Linetype, PrintColour, PrintWidth
ef_att_4 = EleFrontAttributes(
    Layer=dup_11,
    ColourSource=ef_layer_4.DisplayColour,
    MaterialName=ef_layer_4.MaterialName,
    PrintColour=ef_layer_4.PrintColour)  # -> Attributes, Keys, Values, Name, Layer, ColourSource, DisplayColour, MaterialSource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
bklay_4 = BakeLayers(Layers=ef_layer_4.Layer, Bake=button)
bake_4 = BakeObjects(Geometry=move_22.Geometry, Attributes=ef_att_4.Attributes, Bake=button, createGroups=False)  # -> Message, Ghosts

material_name_5 = Panel("Steel")
number_slider_26 = Slider(148, range=0..400)
layer_name_5 = Panel("ConnectorFrames")
rgb_5 = ColourRGB(Alpha=Slider(0.697, range=0..1), Red=number_slider_26, Green=number_slider_26, Blue=number_slider_26)
concat_5 = Concatenate(FragmentC=panel_10, FragmentA="support", FragmentB=layer_name_5)
lng_5 = ListLength(List=move_24.Geometry)
layer_baking_location_5 = Panel(concat_5)
dup_13 = DuplicateData(Data=material_name_5, Number=lng_5, Order=True)
dup_14 = DuplicateData(Data=concat_5, Number=lng_5, Order=True)
dup_15 = DuplicateData(Data=rgb_5, Number=lng_5, Order=True)
ef_layer_5 = EleFrontLayer(Layer=dup_14, DisplayColour=dup_15, MaterialName=dup_13)  # -> Layer, FullPath, Hidden, Locked, DisplayColour, MaterialName, Linetype, PrintColour, PrintWidth
ef_att_5 = EleFrontAttributes(
    Layer=dup_14,
    ColourSource=ef_layer_5.DisplayColour,
    MaterialName=ef_layer_5.MaterialName,
    PrintColour=ef_layer_5.PrintColour)  # -> Attributes, Keys, Values, Name, Layer, ColourSource, DisplayColour, MaterialSource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
bklay_5 = BakeLayers(Layers=ef_layer_5.Layer, Bake=button)
bake_5 = BakeObjects(Geometry=move_24.Geometry, Attributes=ef_att_5.Attributes, Bake=button, createGroups=False)  # -> Message, Ghosts

layer_name_6 = Panel("ConnectorInner")
material_name_6 = Panel("inflatable")
number_slider_27 = Slider(148, range=0..400)
rgb_6 = ColourRGB(Alpha=Slider(0.697, range=0..1), Red=number_slider_27, Green=number_slider_27, Blue=number_slider_27)
concat_6 = Concatenate(FragmentC=panel_10, FragmentA="support", FragmentB=layer_name_6)
lng_6 = ListLength(List=move_23.Geometry)
layer_baking_location_6 = Panel(concat_6)
dup_16 = DuplicateData(Data=material_name_6, Number=lng_6, Order=True)
dup_17 = DuplicateData(Data=concat_6, Number=lng_6, Order=True)
dup_18 = DuplicateData(Data=rgb_6, Number=lng_6, Order=True)
ef_layer_6 = EleFrontLayer(Layer=dup_17, DisplayColour=dup_18, MaterialName=dup_16)  # -> Layer, FullPath, Hidden, Locked, DisplayColour, MaterialName, Linetype, PrintColour, PrintWidth
ef_att_6 = EleFrontAttributes(
    Layer=dup_17,
    ColourSource=ef_layer_6.DisplayColour,
    MaterialName=ef_layer_6.MaterialName,
    PrintColour=ef_layer_6.PrintColour)  # -> Attributes, Keys, Values, Name, Layer, ColourSource, DisplayColour, MaterialSource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
bklay_6 = BakeLayers(Layers=ef_layer_6.Layer, Bake=button)
bake_6 = BakeObjects(Geometry=move_23.Geometry, Attributes=ef_att_6.Attributes, Bake=button, createGroups=False)  # -> Message, Ghosts

layer_name_7 = Panel("Floors")
material_name_7 = Panel("Steel")
number_slider_28 = Slider(148, range=0..400)
rgb_7 = ColourRGB(Alpha=Slider(0.697, range=0..1), Red=number_slider_28, Green=number_slider_28, Blue=number_slider_28)
concat_7 = Concatenate(FragmentC=panel_11, FragmentA="habi", FragmentB=layer_name_7)
lng_7 = ListLength(List=move_25.Geometry)
layer_baking_location_7 = Panel(concat_7)
dup_19 = DuplicateData(Data=material_name_7, Number=lng_7, Order=True)
dup_20 = DuplicateData(Data=concat_7, Number=lng_7, Order=True)
dup_21 = DuplicateData(Data=rgb_7, Number=lng_7, Order=True)
ef_layer_7 = EleFrontLayer(Layer=dup_20, DisplayColour=dup_21, MaterialName=dup_19)  # -> Layer, FullPath, Hidden, Locked, DisplayColour, MaterialName, Linetype, PrintColour, PrintWidth
ef_att_7 = EleFrontAttributes(
    Layer=dup_20,
    ColourSource=ef_layer_7.DisplayColour,
    MaterialName=ef_layer_7.MaterialName,
    PrintColour=ef_layer_7.PrintColour)  # -> Attributes, Keys, Values, Name, Layer, ColourSource, DisplayColour, MaterialSource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
bklay_7 = BakeLayers(Layers=ef_layer_7.Layer, Bake=button_2)
bake_7 = BakeObjects(Geometry=move_25.Geometry, Attributes=ef_att_7.Attributes, Bake=button_2, createGroups=False)  # -> Message, Ghosts

layer_name_8 = Panel("CeilingStructure")
material_name_8 = Panel("Steel")
number_slider_29 = Slider(148, range=0..400)
rgb_8 = ColourRGB(Alpha=Slider(0.697, range=0..1), Red=number_slider_29, Green=number_slider_29, Blue=number_slider_29)
concat_8 = Concatenate(FragmentC=panel_11, FragmentA="habi", FragmentB=layer_name_8)
lng_8 = ListLength(List=move_26.Geometry)
layer_baking_location_8 = Panel(concat_8)
dup_22 = DuplicateData(Data=material_name_8, Number=lng_8, Order=True)
dup_23 = DuplicateData(Data=concat_8, Number=lng_8, Order=True)
dup_24 = DuplicateData(Data=rgb_8, Number=lng_8, Order=True)
ef_layer_8 = EleFrontLayer(Layer=dup_23, DisplayColour=dup_24, MaterialName=dup_22)  # -> Layer, FullPath, Hidden, Locked, DisplayColour, MaterialName, Linetype, PrintColour, PrintWidth
ef_att_8 = EleFrontAttributes(
    Layer=dup_23,
    ColourSource=ef_layer_8.DisplayColour,
    MaterialName=ef_layer_8.MaterialName,
    PrintColour=ef_layer_8.PrintColour)  # -> Attributes, Keys, Values, Name, Layer, ColourSource, DisplayColour, MaterialSource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
bklay_8 = BakeLayers(Layers=ef_layer_8.Layer, Bake=button_2)
bake_8 = BakeObjects(Geometry=move_26.Geometry, Attributes=ef_att_8.Attributes, Bake=button_2, createGroups=False)  # -> Message, Ghosts

layer_name_9 = Panel("UpperWindow")
material_name_9 = Panel("Pods-Glass")
number_slider_30 = Slider(148, range=0..400)
rgb_9 = ColourRGB(Alpha=Slider(0.697, range=0..1), Red=number_slider_30, Green=number_slider_30, Blue=number_slider_30)
concat_9 = Concatenate(FragmentC=panel_11, FragmentA="habi", FragmentB=layer_name_9)
lng_9 = ListLength(List=move_28.Geometry)
layer_baking_location_9 = Panel(concat_9)
dup_25 = DuplicateData(Data=material_name_9, Number=lng_9, Order=True)
dup_26 = DuplicateData(Data=concat_9, Number=lng_9, Order=True)
dup_27 = DuplicateData(Data=rgb_9, Number=lng_9, Order=True)
ef_layer_9 = EleFrontLayer(Layer=dup_26, DisplayColour=dup_27, MaterialName=dup_25)  # -> Layer, FullPath, Hidden, Locked, DisplayColour, MaterialName, Linetype, PrintColour, PrintWidth
ef_att_9 = EleFrontAttributes(
    Layer=dup_26,
    ColourSource=ef_layer_9.DisplayColour,
    MaterialName=ef_layer_9.MaterialName,
    PrintColour=ef_layer_9.PrintColour)  # -> Attributes, Keys, Values, Name, Layer, ColourSource, DisplayColour, MaterialSource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
bklay_9 = BakeLayers(Layers=ef_layer_9.Layer, Bake=button_2)
bake_9 = BakeObjects(Geometry=move_28.Geometry, Attributes=ef_att_9.Attributes, Bake=button_2, createGroups=False)  # -> Message, Ghosts

layer_name_10 = Panel("PrimaryStructure")
material_name_10 = Panel("Steel")
number_slider_31 = Slider(148, range=0..400)
rgb_10 = ColourRGB(Alpha=Slider(0.697, range=0..1), Red=number_slider_31, Green=number_slider_31, Blue=number_slider_31)
concat_10 = Concatenate(FragmentC=panel_11, FragmentA="habi", FragmentB=layer_name_10)
lng_10 = ListLength(List=move_27.Geometry)
layer_baking_location_10 = Panel(concat_10)
dup_28 = DuplicateData(Data=material_name_10, Number=lng_10, Order=True)
dup_29 = DuplicateData(Data=concat_10, Number=lng_10, Order=True)
dup_30 = DuplicateData(Data=rgb_10, Number=lng_10, Order=True)
ef_layer_10 = EleFrontLayer(Layer=dup_29, DisplayColour=dup_30, MaterialName=dup_28)  # -> Layer, FullPath, Hidden, Locked, DisplayColour, MaterialName, Linetype, PrintColour, PrintWidth
ef_att_10 = EleFrontAttributes(
    Layer=dup_29,
    ColourSource=ef_layer_10.DisplayColour,
    MaterialName=ef_layer_10.MaterialName,
    PrintColour=ef_layer_10.PrintColour)  # -> Attributes, Keys, Values, Name, Layer, ColourSource, DisplayColour, MaterialSource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
bklay_10 = BakeLayers(Layers=ef_layer_10.Layer, Bake=button_2)
bake_10 = BakeObjects(Geometry=move_27.Geometry, Attributes=ef_att_10.Attributes, Bake=button_2, createGroups=False)  # -> Message, Ghosts

layer_name_11 = Panel("Floors")
material_name_11 = Panel("Steel")
number_slider_32 = Slider(148, range=0..400)
rgb_11 = ColourRGB(Alpha=Slider(0.697, range=0..1), Red=number_slider_32, Green=number_slider_32, Blue=number_slider_32)
concat_11 = Concatenate(FragmentC=panel_12, FragmentA="buffer", FragmentB=layer_name_11)
lng_11 = ListLength(List=move_31.Geometry)
layer_baking_location_11 = Panel(concat_11)
dup_31 = DuplicateData(Data=material_name_11, Number=lng_11, Order=True)
dup_32 = DuplicateData(Data=concat_11, Number=lng_11, Order=True)
dup_33 = DuplicateData(Data=rgb_11, Number=lng_11, Order=True)
ef_layer_11 = EleFrontLayer(Layer=dup_32, DisplayColour=dup_33, MaterialName=dup_31)  # -> Layer, FullPath, Hidden, Locked, DisplayColour, MaterialName, Linetype, PrintColour, PrintWidth
ef_att_11 = EleFrontAttributes(
    Layer=dup_32,
    ColourSource=ef_layer_11.DisplayColour,
    MaterialName=ef_layer_11.MaterialName,
    PrintColour=ef_layer_11.PrintColour)  # -> Attributes, Keys, Values, Name, Layer, ColourSource, DisplayColour, MaterialSource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
bklay_11 = BakeLayers(Layers=ef_layer_11.Layer, Bake=button_3)
bake_11 = BakeObjects(Geometry=move_31.Geometry, Attributes=ef_att_11.Attributes, Bake=button_3, createGroups=False)  # -> Message, Ghosts

layer_name_12 = Panel("CeilingStructure")
material_name_12 = Panel("Steel")
number_slider_33 = Slider(148, range=0..400)
rgb_12 = ColourRGB(Alpha=Slider(0.697, range=0..1), Red=number_slider_33, Green=number_slider_33, Blue=number_slider_33)
concat_12 = Concatenate(FragmentC=panel_12, FragmentA="buffer", FragmentB=layer_name_12)
lng_12 = ListLength(List=move_29.Geometry)
layer_baking_location_12 = Panel(concat_12)
dup_34 = DuplicateData(Data=material_name_12, Number=lng_12, Order=True)
dup_35 = DuplicateData(Data=concat_12, Number=lng_12, Order=True)
dup_36 = DuplicateData(Data=rgb_12, Number=lng_12, Order=True)
ef_layer_12 = EleFrontLayer(Layer=dup_35, DisplayColour=dup_36, MaterialName=dup_34)  # -> Layer, FullPath, Hidden, Locked, DisplayColour, MaterialName, Linetype, PrintColour, PrintWidth
ef_att_12 = EleFrontAttributes(
    Layer=dup_35,
    ColourSource=ef_layer_12.DisplayColour,
    MaterialName=ef_layer_12.MaterialName,
    PrintColour=ef_layer_12.PrintColour)  # -> Attributes, Keys, Values, Name, Layer, ColourSource, DisplayColour, MaterialSource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
bklay_12 = BakeLayers(Layers=ef_layer_12.Layer, Bake=button_3)
bake_12 = BakeObjects(Geometry=move_29.Geometry, Attributes=ef_att_12.Attributes, Bake=button_3, createGroups=False)  # -> Message, Ghosts

number_slider_34 = Slider(148, range=0..400)
layer_name_13 = Panel("PrimaryStructure")
material_name_13 = Panel("Steel")
rgb_13 = ColourRGB(Alpha=Slider(0.697, range=0..1), Red=number_slider_34, Green=number_slider_34, Blue=number_slider_34)
concat_13 = Concatenate(FragmentC=panel_12, FragmentA="buffer", FragmentB=layer_name_13)
lng_13 = ListLength(List=move_30.Geometry)
layer_baking_location_13 = Panel(concat_13)
dup_37 = DuplicateData(Data=material_name_13, Number=lng_13, Order=True)
dup_38 = DuplicateData(Data=concat_13, Number=lng_13, Order=True)
dup_39 = DuplicateData(Data=rgb_13, Number=lng_13, Order=True)
ef_layer_13 = EleFrontLayer(Layer=dup_38, DisplayColour=dup_39, MaterialName=dup_37)  # -> Layer, FullPath, Hidden, Locked, DisplayColour, MaterialName, Linetype, PrintColour, PrintWidth
ef_att_13 = EleFrontAttributes(
    Layer=dup_38,
    ColourSource=ef_layer_13.DisplayColour,
    MaterialName=ef_layer_13.MaterialName,
    PrintColour=ef_layer_13.PrintColour)  # -> Attributes, Keys, Values, Name, Layer, ColourSource, DisplayColour, MaterialSource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
bklay_13 = BakeLayers(Layers=ef_layer_13.Layer, Bake=button_3)
bake_13 = BakeObjects(Geometry=move_30.Geometry, Attributes=ef_att_13.Attributes, Bake=button_3, createGroups=False)  # -> Message, Ghosts

layer_name_14 = Panel("UpperWindow")
material_name_14 = Panel("Pods-Glass")
number_slider_35 = Slider(148, range=0..400)
rgb_14 = ColourRGB(Alpha=Slider(0.697, range=0..1), Red=number_slider_35, Green=number_slider_35, Blue=number_slider_35)
concat_14 = Concatenate(FragmentC=panel_12, FragmentA="buffer", FragmentB=layer_name_14)
lng_14 = ListLength(List=move_32.Geometry)
layer_baking_location_14 = Panel(concat_14)
dup_40 = DuplicateData(Data=material_name_14, Number=lng_14, Order=True)
dup_41 = DuplicateData(Data=concat_14, Number=lng_14, Order=True)
dup_42 = DuplicateData(Data=rgb_14, Number=lng_14, Order=True)
ef_layer_14 = EleFrontLayer(Layer=dup_41, DisplayColour=dup_42, MaterialName=dup_40)  # -> Layer, FullPath, Hidden, Locked, DisplayColour, MaterialName, Linetype, PrintColour, PrintWidth
ef_att_14 = EleFrontAttributes(
    Layer=dup_41,
    ColourSource=ef_layer_14.DisplayColour,
    MaterialName=ef_layer_14.MaterialName,
    PrintColour=ef_layer_14.PrintColour)  # -> Attributes, Keys, Values, Name, Layer, ColourSource, DisplayColour, MaterialSource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
bklay_14 = BakeLayers(Layers=ef_layer_14.Layer, Bake=button_3)
bake_14 = BakeObjects(Geometry=move_32.Geometry, Attributes=ef_att_14.Attributes, Bake=button_3, createGroups=False)  # -> Message, Ghosts

pt_3 = ConstructPoint(XCoordinate=0, YCoordinate=0, ZCoordinate=0)
pt_4 = ConstructPoint(XCoordinate=0, YCoordinate=0, ZCoordinate=0)
merge_14 = Merge(
    Data1=move_19.Geometry,
    Data2=move_20.Geometry,
    Data3=move_21.Geometry,
    Data4=move_22.Geometry,
    Data5=move_23.Geometry,
    Data6=move_24.Geometry)  # -> simplify(flatten(Result))
merge_15 = Merge(
    Data1=ef_att.Attributes,
    Data2=ef_att_2.Attributes,
    Data3=ef_att_3.Attributes,
    Data4=ef_att_4.Attributes,
    Data5=ef_att_6.Attributes,
    Data6=ef_att_5.Attributes)  # -> simplify(flatten(Result))
panel_13 = Panel(ef_att_2.Attributes)
listblockd = ListBlocksInDocument(fullName=True)
defembed = DefineEmbeddedBlock(Geometry=merge_14, BlockName="Units_Support", BasePlane=PlaneXY(0, 0, 0))
insert = InsertBlock(Plane=PlaneXY(0, 0, 0))
filtername = FilterByName(Name="*", invertFilter=False, returnNulls=False)  # -> ExcludedGeometry, IncludedGeometry
panel_14 = Panel(listblockd)
block_info = GetBlockInfo()  # -> Name, Plane, Transform, BlockType, FilePath, Active
panel_15 = Panel("https://macad.speckle.xyz/projects/4975f9f0a8/models/0c407c0907")
send = Send(
    Stream=panel_15,
    Message="Units_Support block sent",
    Data=move_19.Geometry,
    AutoSend=False,
    BaseId="33f0c129d89bde412936a51f2c47ff01",
    CurrentComponentState="expired",
    KitName="Objects",
    OutputWrappers="https://macad.speckle.xyz\t4975f9f0a8\t4801c9bc0b",
    UseDefaultCache=True,
    selectedKitName="Objects")
panel_16 = Panel(send)
# ASSEMBLY PHASE 5
expblock = ExplodeBlock(recursive=False)  # -> Name, Transform, Geometry
detatt = DetachAttributes(Geometry=expblock.Geometry)  # -> Geometry, Attributes
volume_2 = Volume(Geometry=detatt.Geometry)  # -> Volume, Centroid
cset_3 = CreateSet(List=volume_2.Volume)  # -> Set, Map; disabled
cset_4 = CreateSet(List=cset_3.Map)  # -> Set, Map; disabled
mindex_2 = MemberIndex(Set=cset_3.Map, Member=cset_4.Set)  # -> Index, Count; disabled
item_17 = ListItem(List=detatt.Geometry, Index=mindex_2.Index, Wrap=True)  # -> simplify(Item); disabled
bang_3 = ExplodeTree(Data=item_17)  # -> Branch0, Branch1, Branch2; disabled
panel_17 = Panel("Inflatable")  # disabled
panel_18 = Panel("Glass")  # disabled
panel_19 = Panel("Steel")  # disabled

# ---- group: Units_Support
pln_2 = Plane()  # disabled

# ----
sso = BlockDefinition(
    Name=panel_18,
    Geometry=bang_3.Branch0,
    SelectedConstructorName="Objects.Other.BlockDefinition.ctor(System.String,System.Collections.Generic.List`1[Speckle.Core.Models.Base],Objects.Geometry.Point)",
    SelectedTypeName="Objects.Other.BlockDefinition",
    UseSchemaTag=False,
    UserSetSchemaTag=False,
    seed="c3e00cf1e113ee790956")  # disabled
sso_2 = BlockDefinition(
    Name=panel_17,
    Geometry=bang_3.Branch1,
    SelectedConstructorName="Objects.Other.BlockDefinition.ctor(System.String,System.Collections.Generic.List`1[Speckle.Core.Models.Base],Objects.Geometry.Point)",
    SelectedTypeName="Objects.Other.BlockDefinition",
    UseSchemaTag=False,
    UserSetSchemaTag=False,
    seed="a06898b9aae7d5b59163")  # disabled
sso_3 = BlockDefinition(
    Name=panel_19,
    Geometry=bang_3.Branch2,
    SelectedConstructorName="Objects.Other.BlockDefinition.ctor(System.String,System.Collections.Generic.List`1[Speckle.Core.Models.Base],Objects.Geometry.Point)",
    SelectedTypeName="Objects.Other.BlockDefinition",
    UseSchemaTag=False,
    UserSetSchemaTag=False,
    seed="bf22bfac7f0cb1c82614")  # disabled
pt_5 = Point(pln_2)  # disabled
orient_9 = Orient(Source=PlaneXY(0, 0, 0), Target=pt_5)  # -> Geometry, Transform; disabled
sso_4 = BlockInstance(
    BlockDefinition=sso,
    Transform=orient_9.Transform,
    SelectedConstructorName="Objects.Other.BlockInstance.ctor(Objects.Other.BlockDefinition,Objects.Other.Transform)",
    SelectedTypeName="Objects.Other.BlockInstance",
    UseSchemaTag=False,
    UserSetSchemaTag=False,
    seed="b29bcd91531f56f9eb1f")  # disabled
sso_5 = BlockInstance(
    BlockDefinition=sso_2,
    Transform=orient_9.Transform,
    SelectedConstructorName="Objects.Other.BlockInstance.ctor(Objects.Other.BlockDefinition,Objects.Other.Transform)",
    SelectedTypeName="Objects.Other.BlockInstance",
    UseSchemaTag=False,
    UserSetSchemaTag=False,
    seed="6c22e30deca8216941c1")  # disabled
sso_6 = BlockInstance(
    BlockDefinition=sso_3,
    Transform=orient_9.Transform,
    SelectedConstructorName="Objects.Other.BlockInstance.ctor(Objects.Other.BlockDefinition,Objects.Other.Transform)",
    SelectedTypeName="Objects.Other.BlockInstance",
    UseSchemaTag=False,
    UserSetSchemaTag=False,
    seed="f42b875f65374629faa6")  # disabled
phase = Panel("PODS")  # disabled
panel_20 = Panel("INFLATABLES")  # disabled
panel_21 = Panel("STRUCTURE")  # disabled
panel_22 = Panel("STRUCTURE")  # disabled
name = ExtendSpeckleObject(SpeckleObject=sso_4, BIMSCTYPE=panel_21, BIMSCMATERIAL=panel_18, BIMSCPHASE=phase, selectedKitName="Objects")  # disabled
name_2 = ExtendSpeckleObject(SpeckleObject=sso_5, BIMSCTYPE=panel_20, BIMSCMATERIAL=panel_17, BIMSCPHASE=phase, selectedKitName="Objects")  # disabled
name_3 = ExtendSpeckleObject(SpeckleObject=sso_6, BIMSCTYPE=panel_22, BIMSCMATERIAL=panel_19, BIMSCPHASE=phase, selectedKitName="Objects")  # disabled
in = CreateSpeckleObject(Inflatables=name_2, Structure=name_3, Window=name, selectedKitName="Objects")  # disabled
in_2 = CreateSpeckleObject(Units_Buffer=in, selectedKitName="Objects")  # disabled

number_slider_36 = Slider(0.7, range=0..2.02)  # disabled
# SUPPORT
number_slider_37 = Slider(2, range=1..13)  # disabled
number_slider_38 = Slider(1.5, range=0..6.002)  # disabled
number_slider_39 = Slider(1.5, range=1..2)  # disabled
range_7 = Range(Domain=number_slider_38, Steps=number_slider_39)  # disabled
range_8 = Range(Domain=Domain(0, 1), Steps=number_slider_39)  # disabled
graph_5 = GraphMapper(range_8, x0=0, x1=1, y0=0, y1=1, container_name="Bezier", cpx=[0, 0.5185281634, 1, 1], cpy=[0, 0, 0.1436586976, 1])  # disabled
pt_6 = ConstructPoint(XCoordinate=0, YCoordinate=0, ZCoordinate=range_7)  # disabled
panel_23 = Panel("0.5*pi")  # disabled
dom_5 = ConstructDomain(DomainStart=number_slider_37, DomainEnd=number_slider_36)  # disabled
bnd_6 = Bounds(Numbers=graph_5)  # disabled
prot_3 = RotatePlane(Plane=pt_6, Angle=panel_23)  # disabled
remap_5 = RemapNumbers(Value=graph_5, Source=bnd_6, Target=dom_5)  # -> Mapped, Clipped; disabled
cir_4 = Circle(Plane=pt_6, Radius=remap_5.Mapped)  # disabled
item_18 = ListItem(List=cir_4, Index=0, Wrap=True)  # disabled
number_slider_40 = Slider(4, range=0..50)  # disabled
area_8 = Area(Geometry=item_18)  # -> Area, Centroid; disabled
number_slider_41 = Slider(0.01, range=0..1)  # disabled
range_9 = Range(Domain=Domain(0, 1), Steps=number_slider_40)  # disabled
panel_24 = Panel("1")  # disabled
panel_25 = Panel("0")  # disabled
shatter_3 = Shatter(Curve=reparameterize(graft(cir_4)), Parameters=range_9)  # disabled
subtraction_4 = Subtraction(A=panel_24, B=number_slider_41)  # disabled
merge_16 = Merge(Data1=panel_25, Data2=number_slider_41, Data3=subtraction_4, Data4=panel_24)  # disabled
consec_3 = ConsecutiveDomains(Numbers=merge_16, Additive=invert(True))  # disabled
panel_26 = Panel(merge_16)  # disabled
subcrv_3 = SubCurve(BaseCurve=reparameterize(graft(shatter_3)), Domain=consec_3)  # disabled
panel_27 = Panel("""0
2""")  # disabled
panel_28 = Panel(consec_3)  # disabled
cull_i_3 = CullIndex(List=subcrv_3, Indices=panel_27, Wrap=True)  # -> simplify(List); disabled
item_19 = ListItem(List=subcrv_3, Index=panel_27, Wrap=True)  # disabled
pshift_5 = ShiftPaths(Data=cull_i_3, Offset=-1)  # disabled
flip_5 = FlipMatrix(Data=pshift_5)  # disabled
midpt_6 = CurveMiddle(Curve=flip_5)  # disabled
loft_14 = Loft(Curves=cir_4, Options={Adjust=False, Closed=False, LoftEnds=0, LoftSimp=0, LoftType=0, Rebuild=10, Refit=0.01})  # disabled
number_slider_42 = Slider(0.1, range=0..10)  # disabled
number_slider_43 = Slider(0.11, range=0..1)  # disabled
pshift_6 = ShiftPaths(Data=item_19, Offset=-1)  # disabled
graph_6 = GraphMapper(range_8, x0=0, x1=1, y0=0, y1=1, container_name="Bezier", cpx=[0, 0.25, 0.75, 1], cpy=[0, 0.25, 0.75, 1])  # disabled
join_4 = JoinCurves(Curves=pshift_6, Preserve=False)  # disabled
brep_cp_3 = BrepClosestPoint(Point=midpt_6, Brep=loft_14)  # -> Point, Normal, Distance; disabled
dom_6 = ConstructDomain(DomainStart=number_slider_42, DomainEnd=number_slider_43)  # disabled
flip_6 = FlipMatrix(Data=join_4)  # disabled
bnd_7 = Bounds(Numbers=graph_6)  # disabled
remap_6 = RemapNumbers(Value=graph_6, Source=bnd_7, Target=dom_6)  # -> Mapped, Clipped; disabled
amp_9 = Amplitude(Vector=brep_cp_3.Normal, Amplitude=remap_6.Mapped)  # disabled
rev_3 = Reverse(Vector=amp_9)  # disabled
end_10 = EndPoints(Curve=flip_5)  # -> Start, End; disabled
move_33 = Move(Geometry=midpt_6, Motion=rev_3)  # -> Geometry, Transform; disabled
arc_3 = Arc3Pt(PointA=end_10.Start, PointB=move_33.Geometry, PointC=end_10.End)  # -> Arc, Plane, Radius; disabled
item_20 = ListItem(List=arc_3.Arc, Index=0, Wrap=True)  # disabled
project_4 = Project(Geometry=item_20, Plane=PlaneXY(0, 0, 0))  # -> Geometry, Transform; disabled
panel_29 = Panel("0")  # disabled
panel_30 = Panel("0.01")  # disabled
loft_opt_3 = LoftOptions(Closed=False, Adjust=False, Rebuild=0, Refit=panel_30, Type=0)  # disabled
replace_3 = ReplaceItems(List=arc_3.Arc, Item=project_4.Geometry, Indices=panel_29, Wrap=False)  # disabled
loft_15 = Loft(Curves=flip_6, Options=loft_opt_3)  # disabled
loft_16 = Loft(Curves=replace_3, Options=loft_opt_3)  # disabled
entwine_4 = Entwine(Branch00=loft_16, Branch01=loft_15, FlattenInputs=True)  # disabled
number_slider_44 = Slider(0.01, range=0..1)  # disabled
swatch = ColourSwatch(SwatchColor=RGB(255, 255, 255))  # disabled
swatch_2 = ColourSwatch(SwatchColor=RGBA(107, 107, 107, 206))  # disabled
brep_30 = Brep(item_5)  # disabled
merge_17 = Merge(Data1=swatch_2, Data2=swatch)  # -> simplify(graft(Result)); disabled
python = GhPythonScript(S=entwine_4, D=number_slider_44)  # -> simplify(a); inputs S: Brep; disabled
# ---------- python: Python ----------
import rhinoscriptsyntax as rs

a = rs.OffsetSurface(S, D, None, False, True)
# ---------- end python ----------
item_21 = ListItem(List=brep_30, Index=0, Wrap=True)  # disabled
volume_3 = Volume(Geometry=item_21)  # -> Volume, Centroid; disabled
flatten_3 = FlattenTree(Tree=python, Path="{0}")  # disabled
move2pt = MoveToPoint(Geometry=flatten_3, PointA=area_8.Centroid, PointB=graft(volume_3.Centroid))  # -> simplify(Moved), Vector, Transform; disabled
lng_15 = ListLength(List=move2pt.Moved)  # disabled
graft = GraftTree(Tree=volume_3.Centroid, IncludeEmptyLists=True, IncludeNullItems=True)  # -> simplify(Tree); disabled
group = Group(Objects=move2pt.Moved)  # disabled
split_2 = SplitList(List=move2pt.Moved, Index=expr("x/2", lng_15))  # -> flatten(ListA), flatten(ListB); disabled
mirror_9 = Mirror(Geometry=group, Plane=graft)  # -> Geometry, Transform; disabled
ungroup = Ungroup(Group=mirror_9.Geometry)  # disabled
entwine_5 = Entwine(Branch00=split_2.ListA, Branch01=split_2.ListB, FlattenInputs=True)  # -> simplify(Result); disabled
split_3 = SplitList(List=ungroup, Index=expr("x/2", lng_15))  # -> flatten(ListA), flatten(ListB); disabled
entwine_6 = Entwine(Branch00=split_3.ListA, Branch01=split_3.ListB, FlattenInputs=True)  # -> simplify(Result); disabled
merge_18 = Merge(Data1=entwine_5, Data2=entwine_6)  # disabled
previewmat = CustomPreviewMaterials(Geometry=merge_18, DiffuseColor=RGB(255, 255, 255))  # disabled

number_slider_45 = Slider(0.1, range=0..10)  # disabled
panel_31 = Panel("-1")  # disabled
Z_22 = UnitZ(Factor=expr("-x", number_slider_45))  # disabled
item_22 = ListItem(List=cir_4, Index=panel_31, Wrap=True)  # disabled
extr_7 = Extrude(Base=item_22, Direction=Z_22)  # disabled
cap_3 = CapHoles(Brep=extr_7)  # disabled

move2pt_2 = MoveToPoint(Geometry=cap_3, PointA=area_8.Centroid, PointB=graft(volume_3.Centroid))  # -> Moved, Vector, Transform; disabled
previewmat_2 = CustomPreviewMaterials(Geometry=move2pt_2.Moved, DiffuseColor=RGB(255, 255, 255))  # disabled

merge_19 = Merge(Data5=move2pt_2.Moved, Data6=merge_18)  # disabled
send_2 = Send(
    Stream=panel_7,
    Data=merge_19,
    AutoSend=False,
    BaseId="7005cf4f04ba1d7dde6e5ba4a54a8704",
    CurrentComponentState="expired",
    KitName="Objects",
    OutputWrappers="https://macad.speckle.xyz\t5e4e4e4563\t1905a1a1a6",
    UseDefaultCache=True,
    selectedKitName="Objects")  # disabled
panel_32 = Panel(send_2)  # disabled

mirror_10 = Mirror(Geometry=loft_4, Plane=avr_6)  # -> Geometry, Transform
debrep_3 = DeconstructBrep(Brep=mirror_10.Geometry)  # -> Faces, Edges, Vertices
midpt_7 = CurveMiddle(Curve=debrep_3.Edges)
pdecon_4 = Deconstruct(Point=midpt_7)  # -> XComponent, YComponent, ZComponent

larger = LargerThan(FirstNumber=pdecon_4.ZComponent, SecondNumber="-0.1")  # -> LargerThan, OrEqualTo

cull_4 = CullPattern(List=midpt_7, CullPattern=larger.LargerThan)
flatten_4 = FlattenTree(Tree=cull_4, Path="{0}")

avr_8 = Average(Input=flatten(flatten_4))
move_34 = Move(Geometry=avr_8, Motion=Z_17)  # -> Geometry, Transform
srf_6 = Surface(flatten(mirror_10.Geometry))

panel_33 = Panel("""1
2""")

item_23 = ListItem(List=flatten, Index=panel_33, Wrap=True)

ln_10 = Line(StartPoint=avr_4, EndPoint=item_23)
pframe_2 = PerpFrame(Curve=simplify(ln_10), Parameter="0.5")  # -> graft(Frame)
ext_2 = ExtendCurve(Curve=ln_10, Type="0", Start="0", End="1")
pipe_11 = Pipe(Curve=ext_2, Radius="1", Caps=0)
cap_4 = CapHoles(Brep=pipe_11)

merge_20 = Merge(Data1=cap_2, Data2=cap_4)  # -> flatten(Result)
bbx_7 = BrepBrep(BrepA=cap_4, BrepB=srf_2)  # -> Curves, Points
splitmul = SplitBrepMultiple(Brep=srf_2, Cutters=merge_20)
clean_3 = CleanTree(RemoveNulls=True, RemoveInvalid=True, RemoveEmpty=True, Tree=bbx_7.Curves)
area_9 = Area(Geometry=splitmul)  # -> Area, Centroid
smaller_3 = SmallerThan(FirstNumber=flatten(area_9.Area), SecondNumber=Slider(3, range=0..10))  # -> SmallerThan, OrEqualTo
mirror_11 = Mirror(Geometry=splitmul, Plane=avr_7)  # -> Geometry, Transform
item_24 = ListItem(List=mirror_11.Geometry, Index=0, Wrap=True)
offset_10 = OffsetSurface(Surface=item_24, Distance=number_slider_19, Retrim=True)
item_25 = ListItem(List=splitmul, Index=0, Wrap=True)
pipe_12 = Pipe(Curve=clean_3, Radius=Slider(0.05, range=0..0.1), Caps=0)
cull_5 = CullPattern(List=flatten(splitmul), CullPattern=smaller_3.SmallerThan)
offset_11 = OffsetSurface(Surface=item_25, Distance=number_slider_19, Retrim=True)
flip_7 = Flip(Surface=offset_10, Guide=item_24)  # -> Surface, Result
mirror_12 = Mirror(Geometry=cull_5, Plane=avr_7)  # -> Geometry, Transform
mirror_13 = Mirror(Geometry=pipe_12, Plane=avr_7)  # -> Geometry, Transform
offset_12 = OffsetSurface(Surface=flip_7.Surface, Distance=number_slider_20, Retrim=True)
offset_13 = OffsetSurface(Surface=offset_11, Distance=number_slider_20, Retrim=True)
brep_31 = Brep(pipe_12)
brep_32 = Brep(item_24)
brep_33 = Brep(mirror_13.Geometry)
brep_34 = Brep(offset_13)
brep_35 = Brep(offset_12)
brep_36 = Brep(offset_11)
brep_37 = Brep(item_25)
brep_38 = Brep(offset_10)
brep_39 = Brep(cull_5)
brep_40 = Brep(mirror_12.Geometry)

# ---- group: windows
entwine_7 = Entwine(Branch00=flatten(brep_39), Branch01=flatten(brep_40), FlattenInputs=True)  # -> flatten(Result)

# ---- group: skin inner
entwine_8 = Entwine(Branch00=flatten(brep_35), Branch01=flatten(brep_34), FlattenInputs=True)  # -> flatten(Result)

# ---- group: skin middle
entwine_9 = Entwine(Branch00=flatten(brep_38), Branch01=flatten(brep_36), FlattenInputs=True)  # -> flatten(Result)

# ---- group: skin outer
entwine_10 = Entwine(Branch00=flatten(brep_32), Branch01=flatten(brep_37), FlattenInputs=True)  # -> flatten(Result)

# ---- group: window frames
merge_21 = Merge(Data1=flatten(brep_17), Data2=flatten(brep_16), Data3=flatten(brep_33), Data4=flatten(brep_31), Data5=merge_12)  # -> flatten(Result)

# ----
move_35 = Move(Geometry=entwine_7, Motion=Z_20)  # -> Geometry, Transform
move_36 = Move(Geometry=entwine_8, Motion=Z_20)  # -> Geometry, Transform
move_37 = Move(Geometry=entwine_9, Motion=Z_20)  # -> Geometry, Transform
move_38 = Move(Geometry=entwine_10, Motion=Z_20)  # -> Geometry, Transform
move_39 = Move(Geometry=merge_21, Motion=Z_20)  # -> Geometry, Transform

layer_name_15 = Panel("Windows")
material_name_15 = Panel("Pods-Glass")
number_slider_46 = Slider(148, range=0..400)
rgb_15 = ColourRGB(Alpha=Slider(0.697, range=0..1), Red=number_slider_46, Green=number_slider_46, Blue=number_slider_46)
concat_15 = Concatenate(FragmentC=panel_11, FragmentA="habi", FragmentB=layer_name_15)
lng_16 = ListLength(List=move_35.Geometry)
layer_baking_location_15 = Panel(concat_15)
dup_43 = DuplicateData(Data=material_name_15, Number=lng_16, Order=True)
dup_44 = DuplicateData(Data=concat_15, Number=lng_16, Order=True)
dup_45 = DuplicateData(Data=rgb_15, Number=lng_16, Order=True)
ef_layer_15 = EleFrontLayer(Layer=dup_44, DisplayColour=dup_45, MaterialName=dup_43)  # -> Layer, FullPath, Hidden, Locked, DisplayColour, MaterialName, Linetype, PrintColour, PrintWidth
ef_att_15 = EleFrontAttributes(
    Layer=dup_44,
    ColourSource=ef_layer_15.DisplayColour,
    MaterialName=ef_layer_15.MaterialName,
    PrintColour=ef_layer_15.PrintColour)  # -> Attributes, Keys, Values, Name, Layer, ColourSource, DisplayColour, MaterialSource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
bklay_15 = BakeLayers(Layers=ef_layer_15.Layer, Bake=button_2)
bake_15 = BakeObjects(Geometry=move_35.Geometry, Attributes=ef_att_15.Attributes, Bake=button_2, createGroups=False)  # -> Message, Ghosts

number_slider_47 = Slider(148, range=0..400)
layer_name_16 = Panel("FabricInner")
material_name_16 = Panel("inflatable")
rgb_16 = ColourRGB(Alpha=Slider(0.697, range=0..1), Red=number_slider_47, Green=number_slider_47, Blue=number_slider_47)
concat_16 = Concatenate(FragmentC=panel_11, FragmentA="habi", FragmentB=layer_name_16)
lng_17 = ListLength(List=move_36.Geometry)
layer_baking_location_16 = Panel(concat_16)
dup_46 = DuplicateData(Data=material_name_16, Number=lng_17, Order=True)
dup_47 = DuplicateData(Data=concat_16, Number=lng_17, Order=True)
dup_48 = DuplicateData(Data=rgb_16, Number=lng_17, Order=True)
ef_layer_16 = EleFrontLayer(Layer=dup_47, DisplayColour=dup_48, MaterialName=dup_46)  # -> Layer, FullPath, Hidden, Locked, DisplayColour, MaterialName, Linetype, PrintColour, PrintWidth
ef_att_16 = EleFrontAttributes(
    Layer=dup_47,
    ColourSource=ef_layer_16.DisplayColour,
    MaterialName=ef_layer_16.MaterialName,
    PrintColour=ef_layer_16.PrintColour)  # -> Attributes, Keys, Values, Name, Layer, ColourSource, DisplayColour, MaterialSource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
bklay_16 = BakeLayers(Layers=ef_layer_16.Layer, Bake=button_2)
bake_16 = BakeObjects(Geometry=move_36.Geometry, Attributes=ef_att_16.Attributes, Bake=button_2, createGroups=False)  # -> Message, Ghosts

number_slider_48 = Slider(148, range=0..400)
layer_name_17 = Panel("FabricMiddle")
material_name_17 = Panel("inflatable")
rgb_17 = ColourRGB(Alpha=Slider(0.697, range=0..1), Red=number_slider_48, Green=number_slider_48, Blue=number_slider_48)
concat_17 = Concatenate(FragmentC=panel_11, FragmentA="habi", FragmentB=layer_name_17)
lng_18 = ListLength(List=move_37.Geometry)
layer_baking_location_17 = Panel(concat_17)
dup_49 = DuplicateData(Data=material_name_17, Number=lng_18, Order=True)
dup_50 = DuplicateData(Data=concat_17, Number=lng_18, Order=True)
dup_51 = DuplicateData(Data=rgb_17, Number=lng_18, Order=True)
ef_layer_17 = EleFrontLayer(Layer=dup_50, DisplayColour=dup_51, MaterialName=dup_49)  # -> Layer, FullPath, Hidden, Locked, DisplayColour, MaterialName, Linetype, PrintColour, PrintWidth
ef_att_17 = EleFrontAttributes(
    Layer=dup_50,
    ColourSource=ef_layer_17.DisplayColour,
    MaterialName=ef_layer_17.MaterialName,
    PrintColour=ef_layer_17.PrintColour)  # -> Attributes, Keys, Values, Name, Layer, ColourSource, DisplayColour, MaterialSource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
bklay_17 = BakeLayers(Layers=ef_layer_17.Layer, Bake=button_2)
bake_17 = BakeObjects(Geometry=move_37.Geometry, Attributes=ef_att_17.Attributes, Bake=button_2, createGroups=False)  # -> Message, Ghosts

layer_name_18 = Panel("FabricOuter")
material_name_18 = Panel("inflatable")
number_slider_49 = Slider(148, range=0..400)
rgb_18 = ColourRGB(Alpha=Slider(0.697, range=0..1), Red=number_slider_49, Green=number_slider_49, Blue=number_slider_49)
concat_18 = Concatenate(FragmentC=panel_11, FragmentA="habi", FragmentB=layer_name_18)
lng_19 = ListLength(List=move_38.Geometry)
layer_baking_location_18 = Panel(concat_18)
dup_52 = DuplicateData(Data=material_name_18, Number=lng_19, Order=True)
dup_53 = DuplicateData(Data=concat_18, Number=lng_19, Order=True)
dup_54 = DuplicateData(Data=rgb_18, Number=lng_19, Order=True)
ef_layer_18 = EleFrontLayer(Layer=dup_53, DisplayColour=dup_54, MaterialName=dup_52)  # -> Layer, FullPath, Hidden, Locked, DisplayColour, MaterialName, Linetype, PrintColour, PrintWidth
ef_att_18 = EleFrontAttributes(
    Layer=dup_53,
    ColourSource=ef_layer_18.DisplayColour,
    MaterialName=ef_layer_18.MaterialName,
    PrintColour=ef_layer_18.PrintColour)  # -> Attributes, Keys, Values, Name, Layer, ColourSource, DisplayColour, MaterialSource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
bklay_18 = BakeLayers(Layers=ef_layer_18.Layer, Bake=button_2)
bake_18 = BakeObjects(Geometry=move_38.Geometry, Attributes=ef_att_18.Attributes, Bake=button_2, createGroups=False)  # -> Message, Ghosts

layer_name_19 = Panel("WindowFrames")
material_name_19 = Panel("Steel")
number_slider_50 = Slider(148, range=0..400)
rgb_19 = ColourRGB(Alpha=Slider(0.697, range=0..1), Red=number_slider_50, Green=number_slider_50, Blue=number_slider_50)
concat_19 = Concatenate(FragmentC=panel_11, FragmentA="habi", FragmentB=layer_name_19)
lng_20 = ListLength(List=move_39.Geometry)
layer_baking_location_19 = Panel(concat_19)
dup_55 = DuplicateData(Data=material_name_19, Number=lng_20, Order=True)
dup_56 = DuplicateData(Data=concat_19, Number=lng_20, Order=True)
dup_57 = DuplicateData(Data=rgb_19, Number=lng_20, Order=True)
ef_layer_19 = EleFrontLayer(Layer=dup_56, DisplayColour=dup_57, MaterialName=dup_55)  # -> Layer, FullPath, Hidden, Locked, DisplayColour, MaterialName, Linetype, PrintColour, PrintWidth
ef_att_19 = EleFrontAttributes(
    Layer=dup_56,
    ColourSource=ef_layer_19.DisplayColour,
    MaterialName=ef_layer_19.MaterialName,
    PrintColour=ef_layer_19.PrintColour)  # -> Attributes, Keys, Values, Name, Layer, ColourSource, DisplayColour, MaterialSource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
bklay_19 = BakeLayers(Layers=ef_layer_19.Layer, Bake=button_2)
bake_19 = BakeObjects(Geometry=move_39.Geometry, Attributes=ef_att_19.Attributes, Bake=button_2, createGroups=False)  # -> Message, Ghosts

entwine_11 = Entwine(
    Branch00=brep_18,
    Branch01=brep_19,
    Branch02=brep_39,
    Branch03=brep_16,
    Branch04=brep_31,
    Branch05=brep_13,
    Branch06=brep_12,
    Branch07=brep_20,
    Branch08=brep_15,
    FlattenInputs=True)

# ----
# LOWER HALF
panel_34 = Panel("""1
2""")
item_26 = ListItem(List=flatten_4, Index=panel_34, Wrap=True)

move_40 = Move(Geometry=item_26, Motion=Z_17)  # -> Geometry, Transform

ln_11 = Line(StartPoint=move_34.Geometry, EndPoint=move_40.Geometry)
pframe_3 = PerpFrame(Curve=simplify(ln_11), Parameter="0.5")  # -> graft(Frame)
ext_3 = ExtendCurve(Curve=ln_11, Type="0", Start="0", End="1")
pipe_13 = Pipe(Curve=ext_3, Radius="1", Caps=0)
cap_5 = CapHoles(Brep=pipe_13)

bbx_8 = BrepBrep(BrepA=cap_5, BrepB=srf_6)  # -> Curves, Points
pipe_14 = Pipe(Curve=bbx_8.Curves, Radius=Slider(0.05, range=0..0.1), Caps=0)

# ---- group: w frame
brep_41 = Brep(pipe_14)

# ----
panel_35 = Panel("""0
3""")
item_27 = ListItem(List=flatten_4, Index=panel_35, Wrap=True)

move_41 = Move(Geometry=item_27, Motion=Z_17)  # -> Geometry, Transform

ln_12 = Line(StartPoint=move_41.Geometry, EndPoint=move_34.Geometry)
pframe_4 = PerpFrame(Curve=simplify(ln_12), Parameter="0.5")  # -> graft(Frame)
ext_4 = ExtendCurve(Curve=ln_12, Type="0", Start="1", End="0")
pipe_15 = Pipe(Curve=ext_4, Radius="1", Caps=0)
scale_nu_2 = ScaleNU(Geometry=pipe_15, Plane=pframe_4, ScaleX=Slider(1.1, range=0..1.1), ScaleY=Slider(0.88, range=0..1), ScaleZ=1)  # -> flatten(Geometry), Transform
cap_6 = CapHoles(Brep=scale_nu_2.Geometry)

merge_22 = Merge(Data1=cap_6, Data2=cap_5)  # -> flatten(Result)
bbx_9 = BrepBrep(BrepA=cap_6, BrepB=srf_6)  # -> Curves, Points
splitmul_2 = SplitBrepMultiple(Brep=srf_6, Cutters=merge_22)
area_10 = Area(Geometry=splitmul_2)  # -> Area, Centroid
smaller_4 = SmallerThan(FirstNumber=flatten(area_10.Area), SecondNumber=Slider(6, range=0..10))  # -> SmallerThan, OrEqualTo
cull_6 = CullPattern(List=flatten(splitmul_2), CullPattern=smaller_4.SmallerThan)
item_28 = ListItem(List=splitmul_2, Index=0, Wrap=True)
pipe_16 = Pipe(Curve=bbx_9.Curves, Radius=Slider(0.05, range=0..0.1), Caps=0)
offset_14 = OffsetSurface(Surface=item_28, Distance=Slider(0.1, range=0..0.2), Retrim=True)
# Layers
flip_8 = Flip(Surface=offset_14, Guide=item_28)  # -> Surface, Result
offset_15 = OffsetSurface(Surface=flip_8.Surface, Distance=Slider(0.1, range=0..0.2), Retrim=True)

# ---- group: windows down
brep_42 = Brep(cull_6)

# ---- group: inflatable inner
brep_43 = Brep(offset_15)

# ---- group: inflatable outter
brep_44 = Brep(item_28)

# ---- group: w frame circulation
brep_45 = Brep(pipe_16)

# ---- group: inflatable middle
brep_46 = Brep(offset_14)

# ----
# UPPER HALF
panel_36 = Panel("""1
2""")
item_29 = ListItem(List=flatten_2, Index=panel_36, Wrap=True)

move_42 = Move(Geometry=item_29, Motion=amp_5)  # -> Geometry, Transform

ln_13 = Line(StartPoint=move_42.Geometry, EndPoint=move_13.Geometry)
pframe_5 = PerpFrame(Curve=simplify(ln_13), Parameter="0.5")  # -> graft(Frame)
ext_5 = ExtendCurve(Curve=ln_13, Type="0", Start="1", End="0")
pipe_17 = Pipe(Curve=ext_5, Radius="1", Caps=0)
cap_7 = CapHoles(Brep=pipe_17)

bbx_10 = BrepBrep(BrepA=cap_7, BrepB=srf_3)  # -> Curves, Points
pipe_18 = Pipe(Curve=bbx_10.Curves, Radius=Slider(0.05, range=0..0.1), Caps=0)

# ---- group: w frames inner lower
brep_47 = Brep(pipe_18)

# ----
panel_37 = Panel("""0
3""")
item_30 = ListItem(List=flatten_2, Index=panel_37, Wrap=True)

move_43 = Move(Geometry=item_30, Motion=amp_5)  # -> Geometry, Transform

ln_14 = Line(StartPoint=move_43.Geometry, EndPoint=move_13.Geometry)
pframe_6 = PerpFrame(Curve=simplify(ln_14), Parameter="0.5")  # -> graft(Frame)
ext_6 = ExtendCurve(Curve=ln_14, Type="0", Start="1", End="0")
pipe_19 = Pipe(Curve=ext_6, Radius="1", Caps=0)
scale_nu_3 = ScaleNU(Geometry=pipe_19, Plane=pframe_6, ScaleX=Slider(1.1, range=0..1.1), ScaleY=Slider(0.88, range=0..1), ScaleZ=1)  # -> flatten(Geometry), Transform
cap_8 = CapHoles(Brep=scale_nu_3.Geometry)

merge_23 = Merge(Data1=cap_8, Data2=cap_7)  # -> flatten(Result)
bbx_11 = BrepBrep(BrepA=cap_8, BrepB=srf_3)  # -> Curves, Points
splitmul_3 = SplitBrepMultiple(Brep=srf_3, Cutters=merge_23)
area_11 = Area(Geometry=splitmul_3)  # -> Area, Centroid
smaller_5 = SmallerThan(FirstNumber=flatten(area_11.Area), SecondNumber=Slider(6, range=0..10))  # -> SmallerThan, OrEqualTo
cull_7 = CullPattern(List=flatten(splitmul_3), CullPattern=smaller_5.SmallerThan)
item_31 = ListItem(List=splitmul_3, Index=0, Wrap=True)
pipe_20 = Pipe(Curve=bbx_11.Curves, Radius=Slider(0.05, range=0..0.1), Caps=0)
offset_16 = OffsetSurface(Surface=item_31, Distance=Slider(0.1, range=0..0.2), Retrim=True)
offset_17 = OffsetSurface(Surface=offset_16, Distance=Slider(0.1, range=0..0.2), Retrim=True)

# ---- group: w frames outer lower
brep_48 = Brep(pipe_20)

# ---- group: inflatable inner
brep_49 = Brep(offset_17)

# ---- group: windows upper
brep_50 = Brep(cull_7)

# ---- group: inflatable outter
brep_51 = Brep(item_31)

# ---- group: inflatable middle
brep_52 = Brep(offset_16)

# ---- group: windows
entwine_12 = Entwine(Branch00=flatten(brep_50), Branch01=flatten(brep_42), FlattenInputs=True)  # -> flatten(Result)

# ---- group: inflatable inner
entwine_13 = Entwine(Branch00=flatten(brep_49), Branch01=flatten(brep_43), FlattenInputs=True)  # -> flatten(Result)

# ---- group: inflatable middle
entwine_14 = Entwine(Branch00=flatten(brep_52), Branch01=flatten(brep_46), FlattenInputs=True)  # -> flatten(Result)

# ---- group: inflatable outter
entwine_15 = Entwine(Branch00=flatten(brep_51), Branch01=flatten(brep_44), FlattenInputs=True)  # -> flatten(Result)

# ---- group: Window frames
merge_24 = Merge(Data1=flatten(brep_45), Data2=flatten(brep_41), Data3=flatten(brep_48), Data4=flatten(brep_47), Data5=merge_13)

# ----
move_44 = Move(Geometry=entwine_12, Motion=Z_21)  # -> Geometry, Transform
move_45 = Move(Geometry=entwine_13, Motion=Z_21)  # -> Geometry, Transform
move_46 = Move(Geometry=entwine_14, Motion=Z_21)  # -> Geometry, Transform
move_47 = Move(Geometry=entwine_15, Motion=Z_21)  # -> Geometry, Transform
move_48 = Move(Geometry=merge_24, Motion=Z_21)  # -> Geometry, Transform

layer_name_20 = Panel("Windows")
material_name_20 = Panel("Pods-Glass")
number_slider_51 = Slider(148, range=0..400)
rgb_20 = ColourRGB(Alpha=Slider(0.697, range=0..1), Red=number_slider_51, Green=number_slider_51, Blue=number_slider_51)
concat_20 = Concatenate(FragmentC=panel_12, FragmentA="buffer", FragmentB=layer_name_20)
lng_21 = ListLength(List=move_44.Geometry)
layer_baking_location_20 = Panel(concat_20)
dup_58 = DuplicateData(Data=material_name_20, Number=lng_21, Order=True)
dup_59 = DuplicateData(Data=concat_20, Number=lng_21, Order=True)
dup_60 = DuplicateData(Data=rgb_20, Number=lng_21, Order=True)
ef_layer_20 = EleFrontLayer(Layer=dup_59, DisplayColour=dup_60, MaterialName=dup_58)  # -> Layer, FullPath, Hidden, Locked, DisplayColour, MaterialName, Linetype, PrintColour, PrintWidth
ef_att_20 = EleFrontAttributes(
    Layer=dup_59,
    ColourSource=ef_layer_20.DisplayColour,
    MaterialName=ef_layer_20.MaterialName,
    PrintColour=ef_layer_20.PrintColour)  # -> Attributes, Keys, Values, Name, Layer, ColourSource, DisplayColour, MaterialSource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
bklay_20 = BakeLayers(Layers=ef_layer_20.Layer, Bake=button_3)
bake_20 = BakeObjects(Geometry=move_44.Geometry, Attributes=ef_att_20.Attributes, Bake=button_3, createGroups=False)  # -> Message, Ghosts

material_name_21 = Panel("inflatable")
number_slider_52 = Slider(148, range=0..400)
layer_name_21 = Panel("FabricInner")
rgb_21 = ColourRGB(Alpha=Slider(0.697, range=0..1), Red=number_slider_52, Green=number_slider_52, Blue=number_slider_52)
concat_21 = Concatenate(FragmentC=panel_12, FragmentA="buffer", FragmentB=layer_name_21)
lng_22 = ListLength(List=move_45.Geometry)
layer_baking_location_21 = Panel(concat_21)
dup_61 = DuplicateData(Data=material_name_21, Number=lng_22, Order=True)
dup_62 = DuplicateData(Data=concat_21, Number=lng_22, Order=True)
dup_63 = DuplicateData(Data=rgb_21, Number=lng_22, Order=True)
ef_layer_21 = EleFrontLayer(Layer=dup_62, DisplayColour=dup_63, MaterialName=dup_61)  # -> Layer, FullPath, Hidden, Locked, DisplayColour, MaterialName, Linetype, PrintColour, PrintWidth
ef_att_21 = EleFrontAttributes(
    Layer=dup_62,
    ColourSource=ef_layer_21.DisplayColour,
    MaterialName=ef_layer_21.MaterialName,
    PrintColour=ef_layer_21.PrintColour)  # -> Attributes, Keys, Values, Name, Layer, ColourSource, DisplayColour, MaterialSource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
bklay_21 = BakeLayers(Layers=ef_layer_21.Layer, Bake=button_3)
bake_21 = BakeObjects(Geometry=move_45.Geometry, Attributes=ef_att_21.Attributes, Bake=button_3, createGroups=False)  # -> Message, Ghosts

number_slider_53 = Slider(148, range=0..400)
layer_name_22 = Panel("FabricMiddle")
material_name_22 = Panel("inflatable")
rgb_22 = ColourRGB(Alpha=Slider(0.697, range=0..1), Red=number_slider_53, Green=number_slider_53, Blue=number_slider_53)
concat_22 = Concatenate(FragmentC=panel_12, FragmentA="buffer", FragmentB=layer_name_22)
lng_23 = ListLength(List=move_46.Geometry)
layer_baking_location_22 = Panel(concat_22)
dup_64 = DuplicateData(Data=material_name_22, Number=lng_23, Order=True)
dup_65 = DuplicateData(Data=concat_22, Number=lng_23, Order=True)
dup_66 = DuplicateData(Data=rgb_22, Number=lng_23, Order=True)
ef_layer_22 = EleFrontLayer(Layer=dup_65, DisplayColour=dup_66, MaterialName=dup_64)  # -> Layer, FullPath, Hidden, Locked, DisplayColour, MaterialName, Linetype, PrintColour, PrintWidth
ef_att_22 = EleFrontAttributes(
    Layer=dup_65,
    ColourSource=ef_layer_22.DisplayColour,
    MaterialName=ef_layer_22.MaterialName,
    PrintColour=ef_layer_22.PrintColour)  # -> Attributes, Keys, Values, Name, Layer, ColourSource, DisplayColour, MaterialSource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
bklay_22 = BakeLayers(Layers=ef_layer_22.Layer, Bake=button_3)
bake_22 = BakeObjects(Geometry=move_46.Geometry, Attributes=ef_att_22.Attributes, Bake=button_3, createGroups=False)  # -> Message, Ghosts

layer_name_23 = Panel("FabricOuter")
material_name_23 = Panel("inflatable")
number_slider_54 = Slider(148, range=0..400)
rgb_23 = ColourRGB(Alpha=Slider(0.697, range=0..1), Red=number_slider_54, Green=number_slider_54, Blue=number_slider_54)
concat_23 = Concatenate(FragmentC=panel_12, FragmentA="buffer", FragmentB=layer_name_23)
lng_24 = ListLength(List=move_47.Geometry)
layer_baking_location_23 = Panel(concat_23)
dup_67 = DuplicateData(Data=material_name_23, Number=lng_24, Order=True)
dup_68 = DuplicateData(Data=concat_23, Number=lng_24, Order=True)
dup_69 = DuplicateData(Data=rgb_23, Number=lng_24, Order=True)
ef_layer_23 = EleFrontLayer(Layer=dup_68, DisplayColour=dup_69, MaterialName=dup_67)  # -> Layer, FullPath, Hidden, Locked, DisplayColour, MaterialName, Linetype, PrintColour, PrintWidth
ef_att_23 = EleFrontAttributes(
    Layer=dup_68,
    ColourSource=ef_layer_23.DisplayColour,
    MaterialName=ef_layer_23.MaterialName,
    PrintColour=ef_layer_23.PrintColour)  # -> Attributes, Keys, Values, Name, Layer, ColourSource, DisplayColour, MaterialSource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
bklay_23 = BakeLayers(Layers=ef_layer_23.Layer, Bake=button_3)
bake_23 = BakeObjects(Geometry=move_47.Geometry, Attributes=ef_att_23.Attributes, Bake=button_3, createGroups=False)  # -> Message, Ghosts

layer_name_24 = Panel("WindowFrames")
material_name_24 = Panel("Steel")
number_slider_55 = Slider(148, range=0..400)
rgb_24 = ColourRGB(Alpha=Slider(0.697, range=0..1), Red=number_slider_55, Green=number_slider_55, Blue=number_slider_55)
concat_24 = Concatenate(FragmentC=panel_12, FragmentA="buffer", FragmentB=layer_name_24)
lng_25 = ListLength(List=move_48.Geometry)
layer_baking_location_24 = Panel(concat_24)
dup_70 = DuplicateData(Data=material_name_24, Number=lng_25, Order=True)
dup_71 = DuplicateData(Data=concat_24, Number=lng_25, Order=True)
dup_72 = DuplicateData(Data=rgb_24, Number=lng_25, Order=True)
ef_layer_24 = EleFrontLayer(Layer=dup_71, DisplayColour=dup_72, MaterialName=dup_70)  # -> Layer, FullPath, Hidden, Locked, DisplayColour, MaterialName, Linetype, PrintColour, PrintWidth
ef_att_24 = EleFrontAttributes(
    Layer=dup_71,
    ColourSource=ef_layer_24.DisplayColour,
    MaterialName=ef_layer_24.MaterialName,
    PrintColour=ef_layer_24.PrintColour)  # -> Attributes, Keys, Values, Name, Layer, ColourSource, DisplayColour, MaterialSource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
bklay_24 = BakeLayers(Layers=ef_layer_24.Layer, Bake=button_3)
bake_24 = BakeObjects(Geometry=move_48.Geometry, Attributes=ef_att_24.Attributes, Bake=button_3, createGroups=False)  # -> Message, Ghosts

entwine_16 = Entwine(
    Branch00=brep_44,
    Branch01=brep_46,
    Branch02=brep_43,
    Branch03=brep_49,
    Branch04=brep_52,
    Branch05=brep_51,
    Branch06=brep_42,
    Branch07=brep_50,
    Branch08=brep_45,
    Branch09=brep_41,
    Branch010=brep_48,
    Branch011=brep_47,
    Branch012=brep_25,
    Branch013=brep_26,
    Branch014=extr_3,
    Branch015=extr_2,
    Branch016=brep_23,
    Branch017=brep_24,
    Branch018=brep_27,
    FlattenInputs=True)
brep_53 = Brep(cap)
merge_25 = Merge(Data1=ColourSwatch(SwatchColor=RGBA(189, 189, 189, 206)), Data2=ColourSwatch(SwatchColor=RGB(255, 255, 255)))  # -> simplify(graft(Result))
item_32 = ListItem(List=flatten(brep_53), Index=0, Wrap=True)
volume_4 = Volume(Geometry=item_32)  # -> Volume, Centroid
move2pt_3 = MoveToPoint(Geometry=entwine_16, PointA=area_3.Centroid, PointB=graft(volume_4.Centroid))  # -> simplify(Moved), Vector, Transform
previewmat_3 = CustomPreviewMaterials(DiffuseColor=RGB(255, 255, 255))
previewmat_4 = CustomPreviewMaterials(Geometry=move2pt_3.Moved, DiffuseColor=merge_25)

entwine_17 = Entwine(Branch00=brep_37, Branch01=brep_36, Branch02=brep_34, FlattenInputs=True)
merge_26 = Merge(Data1=ColourSwatch(SwatchColor=RGBA(189, 189, 189, 206)), Data2=ColourSwatch(SwatchColor=RGB(255, 255, 255)))  # -> simplify(graft(Result))
python_2 = GhPythonScript(S=entwine_17, D=Slider(0.01, range=0..1))  # -> simplify(a); inputs S: Brep; same code as python
brep_54 = Brep(item_9)
volume_5 = Volume(Geometry=brep_54)  # -> Volume, Centroid
flatten_5 = FlattenTree(Tree=python_2, Path="{0}")
graft_2 = GraftTree(Tree=volume_5.Centroid, IncludeEmptyLists=True, IncludeNullItems=True)  # -> simplify(Tree)

entwine_18 = Entwine(Branch00=flatten_5, Branch01=entwine_11, FlattenInputs=True)

move2pt_4 = MoveToPoint(Geometry=entwine_18, PointA=area.Centroid, PointB=graft(volume_5.Centroid))  # -> simplify(Moved), Vector, Transform
lng_26 = ListLength(List=move2pt_4.Moved)
group_2 = Group(Objects=move2pt_4.Moved)
split_4 = SplitList(List=move2pt_4.Moved, Index=expr("x/2", lng_26))  # -> flatten(ListA), flatten(ListB)
mirror_14 = Mirror(Geometry=group_2, Plane=graft_2)  # -> Geometry, Transform
ungroup_2 = Ungroup(Group=mirror_14.Geometry)
entwine_19 = Entwine(Branch00=split_4.ListA, Branch01=split_4.ListB, FlattenInputs=True)  # -> simplify(Result)
split_5 = SplitList(List=ungroup_2, Index=expr("x/2", lng_26))  # -> flatten(ListA), flatten(ListB)
entwine_20 = Entwine(Branch00=split_5.ListA, Branch01=split_5.ListB, FlattenInputs=True)  # -> simplify(Result)
merge_27 = Merge(Data1=entwine_19, Data2=entwine_20)
previewmat_5 = CustomPreviewMaterials(Geometry=merge_27, DiffuseColor=merge_26)
