# Grasshopper definition inflatables2.gh (Grasshopper 1.0.7)
# plug-ins: Kangaroo2 Components, Weaverbird, Nautilus, Pufferfish, MeshEdit Components, Human, Sasquatch, MetaHopper

# LAST INFLATABLE,
# SUSCRIBED IN COURTYARD GEOMETRY
# got this data from rhino
#  geom see how to make
#  itr parametrical
# got this data from rhino
#  geom see how to make
#  itr parametrical
number_slider = Slider(3, range=0..3)
# BOUNDARY CYARD
crv = Curve(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)
series = Series(Start=0, Step="-2.5", Count=number_slider)
panel = Panel(series)
Z = UnitZ(Factor=series)
move = Move(Geometry=crv, Motion=Z)  # -> Geometry, Transform
item = ListItem(List=move.Geometry, Index=0, Wrap=True)  # -> Item, Item1, Item2
crv_2 = Curve(item.Item1)
crv_3 = Curve(item.Item2)
crv_4 = Curve(item.Item)
crv_5 = Curve(item.Item1)
explode = Explode(Curve=crv_4, Recursive=True)  # -> Segments, Vertices
explode_2 = Explode(Curve=crv_5, Recursive=True)  # -> Segments, Vertices
midpt = CurveMiddle(Curve=explode.Segments)  # -> graft(Midpoint)
midpt_2 = CurveMiddle(Curve=explode_2.Segments)  # -> graft(Midpoint)
merge = Merge(Data1=midpt, Data2=midpt_2)
avr = Average(Input=merge)  # -> flatten(ArithmeticMean)
lng = ListLength(List=avr)

# ----
# NOT SURE HOW TO
# MAKE A RULE TO GRAB
# HE SIDES I WANT
number_slider_2 = Slider(0, range=0..24)

division = Division(A=lng, B="3")
series_2 = Series(Start=0, Step="3", Count=division)
# Maybe make a rule to
# select the faces i wanna
# connect and not all 8
item_2 = ListItem(List=avr, Index=series_2, Wrap=True)

# ----
# not sure this is really parametric
# not sure this is really parametric
# FIND CENTER OF
# ATTACHING SQUARES
# TOP CURVES (0.00 , -2.50)
# TOP CURVES (0.00 , -2.50)
# this is a random rule
# to make it pick whichever
number_slider_3 = Slider(1, range=0..10)
random = Random(Range=" 0 to 1", Number=number_slider_3, Seed=2)
abs = Absolute(Value=random)
round = Round(Number=random)  # -> Nearest, Floor, Ceiling
panel_2 = Panel(round.Nearest)
cull = CullPattern(List=item_2, CullPattern=panel_2)

avr_2 = Average(Input=item_2)
number_slider_4 = Slider(14.57, range=0..100)
number_slider_5 = Slider(1, range=0..1)
# FIND curves and planes for extrusion
ln = Line(StartPoint=avr_2, EndPoint=cull)
number_slider_6 = Slider(2.5, range=0..10)
multiplication = Multiplication(A=number_slider_4, B=Slider(0.5, range=0..1))
pframe = PerpFrame(Curve=reparameterize(ln), Parameter=number_slider_5)
eval = EvaluateCurve(Curve=reparameterize(ln), Parameter=number_slider_5)  # -> Point, Tangent, Angle
num = Number(multiplication)
rectangle = Rectangle(Plane=pframe, XSize=number_slider_6, YSize=number_slider_6, Radius=0)  # -> Rectangle, Length
multiplication_2 = Multiplication(A=num, B=Slider(0.88, range=0..1))
area = Area(Geometry=rectangle.Rectangle)  # -> Area, Centroid
# point for central shape
# sphere for trying
pt = Point(avr_2)
vec2pt = Vector2Pt(PointA=avr_2, PointB=eval.Point, Unitize=False)  # -> Vector, Length
orient = Orient(Geometry=rectangle.Rectangle, Source=area.Centroid, Target=eval.Point)  # -> Geometry, Transform
amp = Amplitude(Vector=vec2pt.Vector, Amplitude=Slider(-4, range=-10..10))
box = Box()

sph = Sphere(Base=pt, Radius=multiplication_2)
extr = Extrude(Base=orient.Geometry, Direction=amp)

# ----
# trim sphere bottom
panel_3 = Panel("0.5")
number_slider_7 = Slider(22, range=0..1000)
multiplication_3 = Multiplication(A=number_slider_6, B=panel_3)
area_2 = Area(Geometry=sph)  # -> Area, Centroid
neg = Negative(Value=multiplication_3)
rectangle_2 = Rectangle(Plane=area_2.Centroid, XSize=number_slider_7, YSize=number_slider_7, Radius=0)  # -> Rectangle, Length
Z_2 = UnitZ(Factor=neg)
area_3 = Area(Geometry=rectangle_2.Rectangle)  # -> Area, Centroid
orient_2 = Orient(Geometry=rectangle_2.Rectangle, Source=area_3.Centroid, Target=area_2.Centroid)  # -> Geometry, Transform
move_2 = Move(Geometry=orient_2.Geometry, Motion=Z_2)  # -> Geometry, Transform
boundary = BoundarySurfaces(Edges=move_2.Geometry)
splitmul = SplitBrepMultiple(Brep=sph, Cutters=boundary)
item_3 = ListItem(List=splitmul, Index=0, Wrap=True)

multiplication_4 = Multiplication(A=number_slider_4, B=Slider(0.35, range=0..1))
box_2 = CenterBox(Base=pt, X=multiplication_4, Y=multiplication_4, Z=multiplication_4)
facet = FacetDome()  # -> Pattern, Dome
srf = Surface(item_3)

# ----
# not sure this is really parametric
splitmul_2 = SplitBrepMultiple(Brep=extr, Cutters=sph)
splitmul_3 = SplitBrepMultiple(Brep=sph, Cutters=extr)
item_4 = ListItem(List=splitmul_2, Index=0, Wrap=True)  # -> flatten(Item)
item_5 = ListItem(List=splitmul_3, Index=0, Wrap=True)

panel_4 = Panel(item_4)

# ----
# meshing for kangaroo
mesh = Mesh(item_5)
mesh_2 = Mesh(item_4)
merge_2 = Merge(Data1=mesh, Data2=mesh_2)  # -> flatten(Result)
mjoin = MeshJoin(Meshes=merge_2)
weldvertices = MeshWeldVertices(Mesh=mjoin, Tolerance=0.01)  # -> RuntimeMessage, Mesh
unifynormals = MeshUnifyNormals(Mesh=weldvertices.Mesh)
mesh_3 = Mesh(unifynormals)

panel_5 = Panel(mjoin)
# chack if welding is ok
nv = NakedVertices(Mesh=mesh_3)  # -> ClothedIndex, NakedIndex, ClothedPts, NakedPts
pt_2 = Point(nv.NakedPts)
refine = Refine(Mesh=mesh_3, Level=1)
mesh_4 = Mesh(refine)
mesh_5 = Mesh(mesh_4)
medges = MeshEdges(Mesh=mesh_5)  # -> NakedEdges, InteriorEdges, NonManifoldEdges
line = Line(medges.NakedEdges)
join = JoinCurves(Curves=line, Preserve=False)
medges_2 = MeshEdges(Mesh=mesh_4)  # -> NakedEdges, InteriorEdges, NonManifoldEdges
line_2 = Line(medges_2.NakedEdges)
# comprueba: es la casa da musica?
join_2 = JoinCurves(Curves=line_2, Preserve=False)
multiplication_5 = Multiplication(A=Slider(4, range=0..10), B="4")
divide = DivideCurve(Curve=join, Count=multiplication_5, Kinks=False)  # -> Points, Tangents, Parameters
duppt = RemoveDuplicatePts(Points=divide.Points, Tolerance=0.01)
plfit = PlaneFit(Points=duppt)  # -> Plane, Deviation
avr_3 = Average(Input=duppt)
pl_origin = PlaneOrigin(Base=plfit.Plane, Origin=avr_3)
multiplication_6 = Multiplication(A=number_slider_6, B="0.5")
cir = Circle(Plane=pl_origin, Radius=multiplication_6)
crv_cp = CurveClosestPoint(Point=duppt, Curve=cir)  # -> Point, Parameter, Distance
pt_3 = Point(simplify(crv_cp.Point))
pt_4 = Point(simplify(duppt))
edgelengths = EdgeLengths(Mesh=mesh_5, LengthFactor=Slider(0.796, range=0..1), Strength=1)
anchor = Anchor(Point=pt_4, Target=pt_3, Strength=Slider(500, range=0..1000))
ln_2 = Line(StartPoint=pt_4, EndPoint=pt_3)
show = Show(G=mesh_5)
merge_3 = Merge(Data1=flatten(show), Data2=flatten(edgelengths), Data3=flatten(anchor))
solidplanecollide = SolidPlaneCollide(CollisionPlane=PlaneXY(0, 0, 0), Strength=1)
# dont enable before
# disabling the following
# part
button = Button()
rigidbodycollide = RigidBodyCollide(Strength=1)
bouncysolver = BouncySolver(
    GoalObjects=merge_3,
    Reset=button,
    Threshold=1e-15,
    Tolerance=0.0001,
    Damping=Slider(0.9, range=0..1),
    Iterations=10,
    On=Toggle(False))  # -> I, V, O
number_slider_8 = Slider(0.5, range=0..1)
geo = Geometry(bouncysolver.O)
previewmat = CustomPreviewMaterials(Geometry=bouncysolver.O, DiffuseColor=RGB(255, 255, 255))
mesh_6 = MeshBrep(
    Brep=boundary,
    Settings={GridMaxCount=0, GridMinCount=16, JaggedSeams=False, MaxEdgeLength=0, MinEdgeLength=0.0001, MinTolerance=0, Refine=True, RefineAngle=0, RelativeTolerance=0.65, SimplePlanes=True, Tolerance=0})
clean = CleanTree(RemoveNulls=True, RemoveInvalid=True, RemoveEmpty=False, Tree=geo)
item_6 = ListItem(List=clean, Index=0, Wrap=True)  # disabled
msplit = MeshSplit(Mesh=item_6, Splitters=mesh_6)  # disabled
brep = Brep(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)  # disabled
mesh_7 = Mesh(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)  # disabled
mesh_8 = MeshBrep(
    Brep=brep,
    Settings={GridMaxCount=0, GridMinCount=16, JaggedSeams=False, MaxEdgeLength=0, MinEdgeLength=0.0001, MinTolerance=0, Refine=True, RefineAngle=0, RelativeTolerance=0.65, SimplePlanes=True, Tolerance=0})  # disabled
item_7 = ListItem(List=msplit, Index=0, Wrap=True)  # -> Item, Item1; disabled
msplit_2 = MeshSplit(Mesh=mesh_7, Splitters=mesh_8)  # disabled
item_8 = ListItem(List=msplit_2, Index=0, Wrap=True)  # disabled
mjoin_2 = MeshJoin(Meshes=item_7.Item)  # disabled
mjoin_3 = MeshJoin(Meshes=item_7.Item1)  # disabled
mesh_9 = Mesh(item_8)  # disabled
mshnakededgs = MeshNakedEdges(Mesh=item_8)  # -> Naked, R; disabled
weldvertices_2 = MeshWeldVertices(Mesh=mjoin_2, Tolerance=0.01)  # -> RuntimeMessage, Mesh; disabled
pcen = PolygonCenter(Polyline=mshnakededgs.Naked)  # -> CenterV, CenterE, CenterA; disabled
weldvertices_3 = MeshWeldVertices(Mesh=mjoin_3, Tolerance=0.01)  # -> RuntimeMessage, Mesh; disabled
unifynormals_2 = MeshUnifyNormals(Mesh=weldvertices_2.Mesh)
unifynormals_3 = MeshUnifyNormals(Mesh=weldvertices_3.Mesh)
weld_mesh = WeldMesh(Mesh=item_6, Angle=3.141592654)  # disabled
# mehsing (NOT IMPORTANT )
triremesh = TriRemesh(Geometry=weld_mesh, Iterations=25)  # -> Triangulation, Dual, Creases
mesh_10 = Mesh(triremesh.Triangulation)
face_boundaries = FaceBoundaries(Mesh=mesh_10)
boundary_surfaces = BoundarySurfaces(Edges=face_boundaries)
mp = MultiPipe(
    Curves=face_boundaries,
    NodeSize=Slider(0.05, range=0..0.1),
    EndOffset=1,
    StrutSize=1,
    Segment=0,
    KinkAngle=0.6,
    CubeFit=0)
brep_join = BrepJoin(Breps=boundary_surfaces)  # -> Breps, Closed
brep_2 = Brep(brep_join.Breps)
dom = ConstructDomain(DomainStart=Slider(0.99, range=0..1), DomainEnd=Slider(0.32, range=0..1))
cleanoverlapcurves = CleanOverlappingCurves(Distance=1, LimitLength=2, OverSampling=5, Method=2)  # -> Curves, Polylines

# ----
# BOTTOM FLOOR
number_slider_9 = Slider(1.25, range=0..2.5)  # disabled
mshnakededgs_2 = MeshNakedEdges(Mesh=mjoin_3)  # -> Naked, R; disabled
crv_6 = Curve(mshnakededgs_2.Naked)  # disabled
neg_2 = Negative(Value=number_slider_9)  # disabled
Z_3 = UnitZ(Factor=neg_2)
move_3 = Move(Geometry=crv_6, Motion=Z_3)  # -> Geometry, Transform
area_4 = Area(Geometry=move_3.Geometry)  # -> Area, Centroid
scale = Scale(Geometry=move_3.Geometry, Center=area_4.Centroid, Factor=0.5)  # -> Geometry, Transform
merge_4 = Merge(Data1=crv_6, Data2=scale.Geometry)
Z_4 = UnitZ(Factor=1)

# ----
# this loft looks terrible HELP
loft = Loft(Curves=merge_4, Options={Adjust=False, Closed=False, LoftEnds=0, LoftSimp=0, LoftType=0, Rebuild=10, Refit=0.01})

cap = CapHoles(Brep=loft)
join_3 = BrepJoin(Breps=[loft, cap])  # -> Breps, Closed
mesh_11 = MeshBrep(
    Brep=join_3.Breps,
    Settings={GridMaxCount=0, GridMinCount=16, JaggedSeams=False, MaxEdgeLength=0, MinEdgeLength=0.0001, MinTolerance=0, Refine=True, RefineAngle=0, RelativeTolerance=0.65, SimplePlanes=True, Tolerance=0})
offsetbrep = OffsetBrep(Brep=join_3.Breps, OffsetDistance=Z_4, Solid=True, SharpEdges=True, Tolerance=0.01)
wbcatmullclark = WeaverbirdsCatmullClarkSubdivision(MeshCurves=mesh_11, Level=1, SmoothNakedEdges=1)

demesh = DeconstructMesh(Mesh=triremesh.Triangulation)  # -> Vertices, Faces, Colours, Normals; disabled
prox = Proximity3D(Points=demesh.Vertices, Group=Slider(2, range=0..10))  # -> flatten(Links), Topology
dupln = RemoveDuplicateLines(Lines=prox.Links, Tolerance=0.01)
len = Length(Curve=dupln)
larger = LargerThan(FirstNumber=len, SecondNumber=Slider(0.5, range=0..1))  # -> LargerThan, OrEqualTo
cull_2 = CullPattern(List=dupln, CullPattern=larger.LargerThan)
explode_3 = Explode(Curve=cull_2, Recursive=True)  # -> flatten(Segments), Vertices
dupln_2 = RemoveDuplicateLines(Lines=explode_3.Segments, Tolerance=0.01)
end = EndPoints(Curve=dupln_2)  # -> Start, End
merge_5 = Merge(Data1=end.Start, Data2=end.End)
pdecon = Deconstruct(Point=merge_5)  # -> XComponent, YComponent, ZComponent
dom_2 = ConstructDomain(DomainStart=Slider(0.3, range=0..25), DomainEnd=Slider(0.1, range=0..25))
bnd = Bounds(Numbers=pdecon.ZComponent)
remap = RemapNumbers(Value=pdecon.ZComponent, Source=bnd, Target=Domain(0, 1))  # -> Mapped, Clipped
graph = GraphMapper(
    remap.Mapped,
    x0=0,
    x1=1,
    y0=0,
    y1=1,
    container_name="Bezier",
    cpx=[0, 0.6996052861, 0.2302564532, 1],
    cpy=[0, 0.1501221657, 0.7780513763, 1])
remap_2 = RemapNumbers(Value=graph, Source=Domain(0, 1), Target=dom_2)  # -> Mapped, Clipped
toggle = GroupToggle(ToggleActive=True, ToggleVisible=False)  # disabled

mp_2 = MultiPipe(
    Curves=dupln_2,
    NodeSize=remap_2.Mapped,
    SizePoints=merge_5,
    EndOffset=1,
    StrutSize=1,
    Segment=0,
    KinkAngle=0.6,
    CubeFit=0)

preview = CustomPreview(Geometry=mp_2, Material=ColourSwatch(SwatchColor=RGB(118, 163, 91)))

popgeo = PopulateGeometry(Geometry=brep_2, Count=Slider(440, range=0..1200), Seed=1000)
bbox = BoundingBox(Content=brep_2, Plane=PlaneXY(0, 0, 0))  # -> Box, Box_2
voronoi³ = Voronoi3D(Points=popgeo, Box=bbox.Box)  # -> Cells, Boundary
bbx = BrepBrep(BrepA=brep_2, BrepB=voronoi³.Cells)  # -> flatten(Curves), Points
leave_true = BooleanToggle(True)
disc = Discontinuity(Curve=bbx.Curves, Level=1)  # -> Points, Parameters
number_slider_10 = Slider(0.58, range=0.01..0.98)
pline = PolyLine(Vertices=disc.Points, Closed=leave_true)  # -> flatten(Polyline)
pcen_2 = PolygonCenter(Polyline=pline)  # -> CenterV, CenterE, CenterA
number_slider_11 = Slider(1, range=0..10)
Y = UnitY(Factor=Slider(120, range=0..1000))
swatch = ColourSwatch(SwatchColor=RGB(205, 69, 255))

pdecon_2 = Deconstruct(Point=popgeo)  # -> XComponent, YComponent, ZComponent
bnd_2 = Bounds(Numbers=flatten(pdecon_2.ZComponent))  # -> flatten(Domain)
remap_3 = RemapNumbers(Value=pdecon_2.ZComponent, Source=bnd_2, Target=dom)  # -> reverse(Mapped), Clipped
panel_6 = Panel(bnd_2)
graph_2 = GraphMapper(
    reverse(remap_3.Mapped),
    x0=0,
    x1=1,
    y0=0,
    y1=1,
    container_name="Bezier",
    cpx=[0, 0.25, 0.8424620628, 1],
    cpy=[0, 0.25, 0.4494681954, 1])

scale_2 = Scale(Geometry=pline, Center=pcen_2.CenterE, Factor=graph_2)  # -> flatten(Geometry), Transform

merge_6 = Merge(Data1=graft(pline), Data2=graft(scale_2.Geometry))
clean_tree = CleanTree(RemoveNulls=True, RemoveInvalid=True, RemoveEmpty=False, Tree=merge_6)

loft_2 = Loft(Curves=clean_tree, Options={Adjust=False, Closed=False, LoftEnds=0, LoftSimp=0, LoftType=3, Rebuild=10, Refit=0.01})
debrep = DeconstructBrep(Brep=loft_2)  # -> Faces, Edges, Vertices
mesh_uv = MeshSurface(Surface=debrep.Faces, UCount=number_slider_11, VCount=number_slider_11, Overhang=True, Equalize=False)
wbjoin = WeaverbirdsJoinMeshesAndWeld(Mesh=flatten(mesh_uv), Weld=invert(False))
wbthicken = WeaverbirdsMeshThicken(MeshCurves=wbjoin, Distance=Slider(0.22, range=0..10), OffsetType=0)
wbloop = WeaverbirdsLoopSubdivision(MeshCurves=wbthicken, Level=1, SmoothNakedEdges=1)
move_4 = Move(Geometry=wbloop, Motion=Y)  # -> Geometry, Transform
preview_2 = CustomPreview(Geometry=wbthicken, Material=swatch)
medges_3 = MeshEdges(Mesh=wbloop)  # -> NakedEdges, InteriorEdges, NonManifoldEdges
preview_3 = CustomPreview(Geometry=move_4.Geometry, Material=swatch)
# not sure this is really parametric
# this is failing
weaverbird_s_catmull_clark_subdivision = WeaverbirdsCatmullClarkSubdivision(MeshCurves=wbthicken, Level=Slider(2, range=0..10), SmoothNakedEdges=1)
