# Grasshopper definition Roof Adaptive Components.gh (Grasshopper 1.0.7)
# plug-ins: Rhino.Inside for Autodesk Revit, MeshEdit Components, MetaHopper

mesh = Mesh(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)
mesh_2 = Mesh(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)  # disabled
mesh_3 = Mesh(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)
facen = FaceNormals(Mesh=mesh_3)  # -> Centers, Normals
xy = XYPlane(Origin=facen.Centers)
explode = MeshExplode(Mesh=mesh_3, Interpolate=False)
project = Project(Geometry=facen.Normals, Plane=xy)  # -> Geometry, Transform
vdis = VectorDisplay(Anchor=facen.Centers, Vector=facen.Normals)  # disabled
vdis_2 = VectorDisplay(Anchor=facen.Centers, Vector=project.Geometry)  # disabled
angle = Angle(VectorA=facen.Normals, VectorB=project.Geometry)  # -> Angle, Reflex
deg = Degrees(Radians=angle.Angle)
area = Area(Geometry=explode)  # -> Area, Centroid
smaller = SmallerThan(FirstNumber=area.Area, SecondNumber=Slider(0, range=0..1))  # -> SmallerThan, OrEqualTo
smaller_2 = SmallerThan(FirstNumber=deg, SecondNumber=Slider(61.1, range=0..90))  # -> SmallerThan, OrEqualTo
dispatch = Dispatch(List=explode, DispatchPattern=smaller.OrEqualTo)  # -> ListA, ListB
dispatch_2 = Dispatch(List=area.Area, DispatchPattern=smaller.OrEqualTo)  # -> ListA, ListB
dispatch_3 = Dispatch(List=explode, DispatchPattern=smaller_2.OrEqualTo)  # -> ListA, ListB
mesh_4 = Mesh(dispatch_3.ListB)
relay = Relay()
demesh = DeconstructMesh(Mesh=explode)  # -> simplify(Vertices), Faces, Colours, Normals
viewer = ParamViewer(demesh.Vertices)
viewer_2 = ParamViewer(area.Area)
component_families = ComponentFamiliesPicker(<component families picker referenced from the Revit model>, SearchPattern="quad")
trigger = Trigger(Interval=-1000, TimerInterval=1000, Target=g_shape)
element_type_picker = ElementTypePicker(
    component_families,
    {"quadMeshPanel : quadMeshPanel": "259cede1-da21-465f-9b38-6fb7cec222e9:767992d0-5ce3-406e-9628-705649cfe053-00058682"}, selected="quadMeshPanel : quadMeshPanel")

# ---- group: Area
parameter = Parameter(<parameter referenced from the Revit model>, SelectedBuiltInCategory="autodesk.revit.category.family:genericModel")

# ----
g_shape = AddDirectShapeGeometry(Category=<geometry referenced from the Revit model>, Geometry=dispatch.ListA, TrackingMode=2)  # disabled
phase = Phase(<phase referenced from the Revit model>)

mesh_5 = Mesh(<mesh referenced from the Rhino model>)
srf = Surface(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)
toggle = GroupToggle(ToggleActive=True, ToggleVisible=False)  # disabled
explode_2 = MeshExplode(Mesh=mesh_5, Interpolate=False)
demesh_2 = DeconstructMesh(Mesh=explode_2)  # -> Vertices, Faces, Colours, Normals
area_2 = Area(Geometry=explode_2)  # -> Area, Centroid
sort = SortList(Keys=demesh_2.Vertices, ValuesA=demesh_2.Vertices)  # -> Keys, ValuesA
meshcp = MeshClosestPoint(Point=area_2.Centroid, Mesh=mesh_5)  # -> Point, Index, Parameter
pdecon = Deconstruct(Point=meshcp.Point)  # -> XComponent, YComponent, ZComponent
component_families_2 = ComponentFamiliesPicker(<component families picker referenced from the Revit model>, SearchPattern="generic")
multiplication = Multiplication(A=pdecon.XComponent, B=pdecon.YComponent)  # -> simplify(Result)
bnd = Bounds(Numbers=flatten(relay))
element_type_picker_2 = ElementTypePicker(component_families_2)
dedomain = DeconstructDomain(Domain=bnd)  # -> Start, End
gradient = Gradient(
    LowerLimit=dedomain.Start,
    UpperLimit=dedomain.End,
    Parameter=relay,
    stops=[0: RGB(0, 128, 0), 0.5: RGB(255, 255, 0), 1: RGB(255, 0, 0)])
active = ActiveDocument()
trigger_2 = Trigger(Interval=-1000, TimerInterval=1000, Target=a_component)
a_component = AddComponentAdaptive(Document=active, Points=demesh_2.Vertices, Type=element_type_picker_2, TrackingMode=2)  # -> simplify(Component)
cset = CreateSet(List=flatten(gradient))  # -> Set, Map
concat = Concatenate(FragmentA="colour ", FragmentB=cset.Set)
inspect = InspectElement(Element=a_component)  # -> simplify(MaterialsAndFinishesPanelMaterial)
material = AddMaterial(Name=concat, TrackingMode=2)
item = ListItem(List=flatten(material), Index=cset.Map, Wrap=True)  # -> simplify(graft(Item))
param = ElementParameter(Element=a_component, Parameter=inspect)  # -> Element, Value
graphics = MaterialGraphics(Material=item, Color=gradient)  # -> simplify(Material), UseRenderAppearance, Color, Transparency, SurfacePatternsForegroundPattern, SurfacePatternsForegroundColor, CutPatternsForegroundPattern, CutPatternsForegroundColor
phasing = ElementPhasing(Element=param.Element, Created=phase)  # -> Element, Created, Demolished

tstat = TreeStatistics(Tree=demesh.Vertices)  # -> Paths, Length, Count
panel = Panel(parameter)
split = SplitList(List=tstat.Paths, Index="10")  # -> ListA, ListB
split_2 = SplitList(List=area.Area, Index="10")  # -> ListA, ListB
split_3 = SplitTree(Data=demesh.Vertices, Masks=flatten(split.ListA))  # -> Positive, Negative
trigger_3 = Trigger(Interval=-1000, TimerInterval=1000, Target=a_component_2)

# ---- group: Angle
parameter_2 = Parameter(<parameter referenced from the Revit model>)

# ----
panel_2 = Panel("Area")
panel_3 = Panel("Inclination")
panel_4 = Panel("angle")
a_component_2 = AddComponentAdaptive(Points=demesh.Vertices, Type=element_type_picker, TrackingMode=2)  # -> simplify(flatten(Component)); disabled
panel_5 = Panel("Panels Area")
elements = QueryElements(Limit=100)  # -> Elements, Count
define_param = DefineParameter(Type="autodesk.spec:spec.string-2.0.0", Group="autodesk.parameter.group:data-1.0.0")
elements_2 = QueryElements(Limit=100)  # -> Elements, Count
parameters = QueryElementParameters(Element=a_component_2, Name="Panel Area")
parameters_2 = QueryElementParameters(Element=elements.Elements)
parameters_3 = QueryElementParameters(Element=a_component_2, Name="Panel Area")  # -> flatten(Parameters)
panel_6 = Panel(parameters)
param_2 = ElementParameter(Element=a_component_2, Parameter=parameters_3, Value=simplify(area.Area))  # -> Element, Value
panel_7 = Panel(parameters_3)
bnd_2 = Bounds(Numbers=panel_6)
panel_8 = Panel(bnd_2)
