# Grasshopper definition Meditation_interior_design_v1.gh (Grasshopper 1.0.7)
# plug-ins: Heteroptera, ClipperComponents, Kangaroo2 Components, Bifocals, treesloth01, ShapeDiverForGrasshopper, Human, Pufferfish, MeshEdit Components, MetaHopper

geo = Geometry([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])  # disabled
geo_2 = Geometry([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])  # disabled
geo_3 = Geometry([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])  # disabled
geo_4 = Geometry([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])  # disabled
entwine = Entwine(Branch00=geo, Branch01=geo_2, Branch02=geo_3, Branch03=geo_4, FlattenInputs=True)  # disabled
panel = Panel("-3.0")  # disabled
Z = UnitZ(Factor=panel)  # disabled
move = Move(Geometry=entwine, Motion=Z)  # -> Geometry, Transform; disabled
debrep = DeconstructBrep(Brep=move.Geometry)  # -> Faces, Edges, Vertices; disabled
pcen = PolygonCenter(Polyline=debrep.Faces)  # -> CenterV, CenterE, CenterA; disabled
pdecon = Deconstruct(Point=pcen.CenterV)  # -> XComponent, YComponent, ZComponent; disabled
bnd = Bounds(Numbers=pdecon.ZComponent)  # disabled
dedomain = DeconstructDomain(Domain=bnd)  # -> Start, End; disabled
smaller = SmallerThan(FirstNumber=pdecon.ZComponent, SecondNumber=dedomain.Start)  # -> SmallerThan, OrEqualTo; disabled
larger = LargerThan(FirstNumber=pdecon.ZComponent, SecondNumber=dedomain.End)  # -> LargerThan, OrEqualTo; disabled
or = GateOr(A=smaller.OrEqualTo, B=larger.OrEqualTo)  # disabled
dispatch = Dispatch(List=debrep.Faces, DispatchPattern=or)  # -> ListA, ListB; disabled
dispatch_2 = Dispatch(List=debrep.Faces, DispatchPattern=smaller.OrEqualTo)  # -> ListA, ListB; disabled
dispatch_3 = Dispatch(List=pcen.CenterV, DispatchPattern=or)  # -> ListA, ListB; disabled
dispatch_4 = Dispatch(List=debrep.Faces, DispatchPattern=larger.OrEqualTo)  # -> ListA, ListB; disabled
pt = Point(dispatch_3.ListB)  # disabled
srf = Surface(dispatch.ListB)  # disabled
srf_2 = Surface(dispatch_2.ListA)  # disabled
srf_3 = Surface(dispatch_4.ListA)  # disabled
shift = ShiftPaths(Data=pt, Offset=-1)  # disabled
shift_2 = ShiftPaths(Data=srf, Offset=-1)  # disabled
number_slider = Slider(12, range=0..100)  # disabled
avr = Average(Input=shift)  # disabled
dist = Distance(PointA=shift, PointB=avr)  # disabled
smaller_2 = SmallerThan(FirstNumber=dist, SecondNumber=number_slider)  # -> SmallerThan, OrEqualTo; disabled
dispatch_5 = Dispatch(List=shift, DispatchPattern=smaller_2.OrEqualTo)  # -> ListA, ListB; disabled
dispatch_6 = Dispatch(List=shift_2, DispatchPattern=smaller_2.OrEqualTo)  # -> ListA, ListB; disabled
srf_4 = Surface(dispatch_6.ListA)  # disabled
crv = Curve(srf_4)  # disabled
number_slider_2 = Slider(4, range=0..10)  # disabled
merge = Merge(Data1=avr, Data2=dispatch_5.ListA)  # disabled
mst = MST(BasePoints=merge)  # -> PointPointTopology, ConnectionPointTopology, Lines; disabled
circle = CircleCNR(Center=avr, Normal=Vector(0, 0, 1), Radius=number_slider_2)  # disabled
circle_2 = CircleCNR(Center=dispatch_5.ListA, Normal=Vector(0, 0, 1), Radius=number_slider_2)  # disabled
join = JoinCurves(Curves=mst.Lines, Preserve=False)  # disabled
runion = RegionUnion(Curves=circle_2)  # disabled
number_slider_3 = Slider(0, range=0..2)  # disabled
number_slider_4 = Slider(0, range=0..2)  # disabled
number_slider_5 = Slider(1.59, range=1..3)  # disabled
polyoffset = PolylineOffset(
    Polylines=join,
    Distance=number_slider_5,
    Plane=Plane(origin=(0, 0, 0), x=(0, 0, 0), y=(0, 0, 0)),
    Tolerance=0.01,
    ClosedFillet=number_slider_3,
    OpenFillet=number_slider_4,
    Miter=2)  # -> Contour, Holes; disabled
srf_5 = Surface(circle)  # disabled
boundary = BoundarySurfaces(Edges=[polyoffset.Contour, polyoffset.Holes])  # disabled
boundary_2 = BoundarySurfaces(Edges=runion)  # disabled
sunion = SolidUnion(Breps=flatten([srf_5, boundary, boundary_2]))  # disabled
fmerge = MergeFaces(Brep=simplify(flatten(sunion)))  # -> Breps, Before, After; disabled
edges = BrepEdges(Brep=fmerge.Breps)  # -> Naked, Interior, NonManifold; disabled
join_2 = JoinCurves(Curves=edges.Naked, Preserve=False)  # disabled
number_slider_6 = Slider(3, range=0..10)  # disabled
reb = RebuildCurve(Curve=join_2, Degree=number_slider_6, Count=10, Tangents=False)  # disabled

# ----
# units contour
# FIRE CYARD
geo_5 = Geometry([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])
# AIR CYARD
# units contour
geo_6 = Geometry([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])
# units contour
# WATER CYARD
geo_7 = Geometry([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])
# EARTH CYARD
sddp = ShapeDiverDocumentPayload({AbsoluteTolerance=0, AngleTolerance=0, DistanceDisplayPrecision=0, GltfVersion="Gltf2", GrasshopperVersion="1.0.0007", InputGroups="{}", OutputGroups="{}", RelativeTolerance=0, RhinoVersion="7.35.23346.11001", UnitSystem=0, VersionCreated="1.16.0.0", VersionSaved="1.16.0.0"})
debrep_2 = DeconstructBrep(Brep=geo_7)  # -> Faces, Edges, Vertices
debrep_3 = DeconstructBrep(Brep=geo_5)  # -> Faces, Edges, Vertices

# ----
# units contour
geo_8 = Geometry([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])

debrep_4 = DeconstructBrep(Brep=geo_6)  # -> Faces, Edges, Vertices
debrep_5 = DeconstructBrep(Brep=geo_8)  # -> Faces, Edges, Vertices
area = Area(Geometry=debrep_2.Faces)  # -> Area, Centroid
area_2 = Area(Geometry=debrep_3.Faces)  # -> Area, Centroid
area_3 = Area(Geometry=debrep_5.Faces)  # -> Area, Centroid
area_4 = Area(Geometry=debrep_4.Faces)  # -> Area, Centroid
pdecon_2 = Deconstruct(Point=area_3.Centroid)  # -> XComponent, YComponent, ZComponent
pdecon_3 = Deconstruct(Point=area.Centroid)  # -> XComponent, YComponent, ZComponent
pdecon_4 = Deconstruct(Point=area_2.Centroid)  # -> XComponent, YComponent, ZComponent
bnd_2 = Bounds(Numbers=pdecon_2.ZComponent)
pdecon_5 = Deconstruct(Point=area_4.Centroid)  # -> XComponent, YComponent, ZComponent
bnd_3 = Bounds(Numbers=pdecon_3.ZComponent)
dedomain_2 = DeconstructDomain(Domain=bnd_2)  # -> Start, End
bnd_4 = Bounds(Numbers=pdecon_4.ZComponent)
dedomain_3 = DeconstructDomain(Domain=bnd_3)  # -> Start, End
bnd_5 = Bounds(Numbers=pdecon_5.ZComponent)
dedomain_4 = DeconstructDomain(Domain=bnd_4)  # -> Start, End
smaller_3 = SmallerThan(FirstNumber=pdecon_2.ZComponent, SecondNumber=dedomain_2.Start)  # -> SmallerThan, OrEqualTo
larger_2 = LargerThan(FirstNumber=pdecon_3.ZComponent, SecondNumber=dedomain_3.End)  # -> LargerThan, OrEqualTo
smaller_4 = SmallerThan(FirstNumber=pdecon_3.ZComponent, SecondNumber=dedomain_3.Start)  # -> SmallerThan, OrEqualTo
dedomain_5 = DeconstructDomain(Domain=bnd_5)  # -> Start, End
larger_3 = LargerThan(FirstNumber=pdecon_4.ZComponent, SecondNumber=dedomain_4.End)  # -> LargerThan, OrEqualTo
smaller_5 = SmallerThan(FirstNumber=pdecon_4.ZComponent, SecondNumber=dedomain_4.Start)  # -> SmallerThan, OrEqualTo
dispatch_7 = Dispatch(List=debrep_5.Faces, DispatchPattern=smaller_3.OrEqualTo)  # -> ListA, ListB
panel_2 = Panel(shift)  # disabled
dispatch_8 = Dispatch(List=debrep_2.Faces, DispatchPattern=smaller_4.OrEqualTo)  # -> ListA, ListB
larger_4 = LargerThan(FirstNumber=pdecon_5.ZComponent, SecondNumber=dedomain_5.End)  # -> LargerThan, OrEqualTo
smaller_6 = SmallerThan(FirstNumber=pdecon_5.ZComponent, SecondNumber=dedomain_5.Start)  # -> SmallerThan, OrEqualTo
dispatch_9 = Dispatch(List=debrep_3.Faces, DispatchPattern=smaller_5.OrEqualTo)  # -> ListA, ListB
srf_6 = Surface(dispatch_7.ListA)
srf_7 = Surface(dispatch_8.ListA)
dispatch_10 = Dispatch(List=debrep_4.Faces, DispatchPattern=smaller_6.OrEqualTo)  # -> ListA, ListB
debrep_6 = DeconstructBrep(Brep=srf_6)  # -> Faces, Edges, Vertices
srf_8 = Surface(dispatch_9.ListA)
srf_9 = Surface(dispatch_10.ListA)
midpt = CurveMiddle(Curve=debrep_6.Edges)
area_5 = Area(Geometry=debrep_6.Faces)  # -> Area, flatten(Centroid)
debrep_7 = DeconstructBrep(Brep=srf_8)  # -> Faces, Edges, Vertices
debrep_8 = DeconstructBrep(Brep=srf_7)  # -> Faces, Edges, Vertices
debrep_9 = DeconstructBrep(Brep=srf_9)  # -> Faces, Edges, Vertices
avr_2 = Average(Input=area_5.Centroid)
area_6 = Area(Geometry=debrep_7.Faces)  # -> Area, flatten(Centroid)
midpt_2 = CurveMiddle(Curve=debrep_7.Edges)
area_7 = Area(Geometry=debrep_8.Faces)  # -> Area, flatten(Centroid)
midpt_3 = CurveMiddle(Curve=debrep_8.Edges)
area_8 = Area(Geometry=debrep_9.Faces)  # -> Area, flatten(Centroid)
midpt_4 = CurveMiddle(Curve=debrep_9.Edges)
ln = Line(StartPoint=avr_2, EndPoint=midpt)
avr_3 = Average(Input=area_6.Centroid)
avr_4 = Average(Input=area_7.Centroid)
avr_5 = Average(Input=area_8.Centroid)
points = PointList(Points=merge)  # disabled
ln_2 = Line(StartPoint=avr_3, EndPoint=midpt_2)
len = Length(Curve=ln)
ln_3 = Line(StartPoint=avr_4, EndPoint=midpt_3)
ln_4 = Line(StartPoint=avr_5, EndPoint=midpt_4)
len_2 = Length(Curve=ln_2)
len_3 = Length(Curve=ln_3)
len_4 = Length(Curve=ln_4)
smaller_7 = SmallerThan(FirstNumber=len_2, SecondNumber=Slider(12.13, range=10..16))  # -> SmallerThan, OrEqualTo
smaller_8 = SmallerThan(FirstNumber=len_3, SecondNumber=Slider(12.13, range=10..16))  # -> SmallerThan, OrEqualTo
smaller_9 = SmallerThan(FirstNumber=len_4, SecondNumber=Slider(12.13, range=10..16))  # -> SmallerThan, OrEqualTo
smaller_10 = SmallerThan(FirstNumber=len, SecondNumber=Slider(12.13, range=10..16))  # -> SmallerThan, OrEqualTo
dispatch_11 = Dispatch(List=debrep_7.Edges, DispatchPattern=smaller_7.SmallerThan)  # -> ListA, ListB
dispatch_12 = Dispatch(List=debrep_8.Edges, DispatchPattern=smaller_8.SmallerThan)  # -> ListA, ListB
dispatch_13 = Dispatch(List=debrep_9.Edges, DispatchPattern=smaller_9.SmallerThan)  # -> ListA, ListB
dispatch_14 = Dispatch(List=debrep_6.Edges, DispatchPattern=smaller_10.SmallerThan)  # -> ListA, ListB

# ----
# curve
crv_2 = Curve(dispatch_11.ListA)

crv_3 = Curve(dispatch_11.ListB)

# ----
# curve
crv_4 = Curve(dispatch_12.ListA)
join_3 = JoinCurves(Curves=flatten(crv_4), Preserve=False)

crv_5 = Curve(dispatch_12.ListB)

# ----
# curve
crv_6 = Curve(dispatch_13.ListA)

crv_7 = Curve(dispatch_13.ListB)

# ----
# curve
crv_8 = Curve(dispatch_14.ListA)
join_4 = JoinCurves(Curves=flatten(crv_8), Preserve=False)

crv_9 = Curve(dispatch_14.ListB)
join_5 = JoinCurves(Curves=flatten(crv_2), Preserve=False)
number_slider_7 = Slider(15, range=0..100)  # disabled
number_slider_8 = Slider(1.7, range=0..10)  # disabled
number_slider_9 = Slider(15, range=0..100)  # disabled
number_slider_10 = Slider(3.4, range=0..10)  # disabled
join_6 = JoinCurves(Curves=flatten(crv_6), Preserve=False)
number_slider_11 = Slider(15, range=0..100)  # disabled
number_slider_12 = Slider(15, range=0..100)  # disabled
number_slider_13 = Slider(300, range=0..1000)  # disabled
number_slider_14 = Slider(10, range=0..10)  # disabled
number_slider_15 = Slider(2.3, range=0..10)  # disabled

# ----
# MANUAL INPUT (FOR NOW)
number_slider_16 = Slider(21, range=0..24)

number_slider_17 = Slider(200, range=0..1000)  # disabled

# ----
# MANUAL INPUT (FOR NOW)
number_slider_18 = Slider(15, range=0..24)

# ----
# FLOOR extrusion
number_slider_19 = Slider(3, range=1..3)

# ----
# MANUAL INPUT (FOR NOW)
number_slider_20 = Slider(3, range=0..24)

debrep_10 = DeconstructBrep(Brep=join_5)  # -> Faces, Edges, Vertices

# ----
# center point
pcen_2 = PolygonCenter(Polyline=join_5)  # -> CenterV, CenterE, CenterA

# ----
# MANUAL INPUT (FOR NOW)
number_slider_21 = Slider(21, range=0..24)

debrep_11 = DeconstructBrep(Brep=join_3)  # -> Faces, Edges, Vertices
xy = XYPlane(Origin=Point(0, 0, 0))  # disabled

# ----
# center point
pcen_3 = PolygonCenter(Polyline=join_3)  # -> CenterV, CenterE, CenterA

debrep_12 = DeconstructBrep(Brep=join_6)  # -> Faces, Edges, Vertices

# ----
# center point
pcen_4 = PolygonCenter(Polyline=join_6)  # -> CenterV, CenterE, CenterA

# ----
# center point
pcen_5 = PolygonCenter(Polyline=join_4)  # -> CenterV, CenterE, CenterA

xy_2 = XYPlane(Origin=Point(0, 0, 0))  # disabled
division = Division(A=number_slider_9, B=number_slider_8)  # disabled
division_2 = Division(A=number_slider_9, B=number_slider_10)  # disabled
division_3 = Division(A=number_slider_17, B=number_slider_14)  # disabled
division_4 = Division(A=number_slider_17, B=number_slider_15)  # disabled
dom = ConstructDomain(DomainStart=division, DomainEnd=division_2)  # disabled
planesrf = PlaneSurface(Plane=xy, XSize=number_slider_7, YSize=number_slider_9)  # disabled
debrep_13 = DeconstructBrep(Brep=join_4)  # -> Faces, Edges, Vertices
number_slider_22 = Slider(4, range=0..10)  # disabled
shift_3 = ShiftList(List=debrep_10.Edges, Shift=number_slider_16, Wrap=True)
dom_2 = ConstructDomain(DomainStart=division_3, DomainEnd=division_4)  # disabled
planesrf_2 = PlaneSurface(Plane=xy_2, XSize=number_slider_13, YSize=number_slider_17)  # disabled
shift_4 = ShiftList(List=debrep_11.Edges, Shift=number_slider_18, Wrap=True)
shift_5 = ShiftList(List=debrep_12.Edges, Shift=number_slider_20, Wrap=True)
number_slider_23 = Slider(5, range=0..10)  # disabled
srf_10 = Surface(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)  # disabled

# ----
# CENTER RADIUS
number_slider_24 = Slider(4, range=0..10)
pt_2 = Point(pcen_2.CenterV)
circle_3 = CircleCNR(Center=pt_2, Normal=Vector(0, 0, 1), Radius=number_slider_24)

# ----
# CENTER RADIUS
number_slider_25 = Slider(4, range=0..10)
pt_3 = Point(pcen_3.CenterV)
circle_4 = CircleCNR(Center=pt_3, Normal=Vector(0, 0, 1), Radius=number_slider_25)

# ----
# CENTER RADIUS
number_slider_26 = Slider(4, range=0..10)
pt_4 = Point(pcen_4.CenterV)
circle_5 = CircleCNR(Center=pt_4, Normal=Vector(0, 0, 1), Radius=number_slider_26)

# ----
# sorted points
midpt_5 = CurveMiddle(Curve=shift_3)

# ----
# FLOOR
Z_2 = UnitZ(Factor=number_slider_19)
boundary_3 = BoundarySurfaces(Edges=join_6)
neg = Negative(Value=Z_2)
extr = Extrude(Base=boundary_3, Direction=neg)

# ----
# sorted points
midpt_6 = CurveMiddle(Curve=shift_4)

# ----
# sorted points
midpt_7 = CurveMiddle(Curve=shift_5)

bnd_6 = Bounds(Numbers=midpt_7)

# ----
# FLOOR
Z_3 = UnitZ(Factor=number_slider_19)
boundary_4 = BoundarySurfaces(Edges=join_3)
neg_2 = Negative(Value=Z_3)
extr_2 = Extrude(Base=boundary_4, Direction=neg_2)

shift_6 = ShiftList(List=debrep_13.Edges, Shift=number_slider_21, Wrap=True)
range = Range(Domain=dom, Steps=number_slider_22)  # disabled

# ----
# FLOOR
Z_4 = UnitZ(Factor=number_slider_19)
boundary_5 = BoundarySurfaces(Edges=join_5)
neg_3 = Negative(Value=Z_4)
extr_3 = Extrude(Base=boundary_5, Direction=neg_3)

pcen_6 = PolygonCenter(Polyline=srf_10)  # -> CenterV, CenterE, CenterA; disabled

# ----
# CENTER RADIUS
number_slider_27 = Slider(4, range=0..10)
pt_5 = Point(pcen_5.CenterV)
circle_6 = CircleCNR(Center=pt_5, Normal=Vector(0, 0, 1), Radius=number_slider_27)

range_2 = Range(Domain=dom_2, Steps=number_slider_23)  # disabled
pcen_7 = PolygonCenter(Polyline=planesrf_2)  # -> CenterV, CenterE, CenterA; disabled
bnd_7 = Bounds(Numbers=midpt_5)
random = Random(Range=bnd_6, Number=Slider(3, range=0..10), Seed=Slider(6, range=0..10))
bnd_8 = Bounds(Numbers=midpt_6)

# ----
# sorted points
midpt_8 = CurveMiddle(Curve=shift_6)

cir = Circle(Plane=pcen_6.CenterV, Radius=range)  # disabled

# ----
# FLOOR
Z_5 = UnitZ(Factor=number_slider_19)
boundary_6 = BoundarySurfaces(Edges=join_4)
# PATH
neg_4 = Negative(Value=Z_5)
extr_4 = Extrude(Base=boundary_6, Direction=neg_4)

item = ListItem(List=midpt_7, Index=random, Wrap=True)
cir_2 = Circle(Plane=pcen_7.CenterV, Radius=range_2)  # disabled
number_slider_28 = Slider(0.4, range=0..10)  # disabled
points_2 = PointList(Points=midpt_5, Size=Slider(1, range=0..1))
bnd_9 = Bounds(Numbers=midpt_8)
random_2 = Random(Range=bnd_7, Number=Slider(2, range=0..10), Seed=Slider(6, range=0..10))
points_3 = PointList(Points=midpt_6, Size=Slider(1, range=0..1))
len_5 = Length(Curve=cir)  # disabled
points_4 = PointList(Points=midpt_7, Size=Slider(1, range=0..1))
number_slider_29 = Slider(2, range=0..10)  # disabled
random_3 = Random(Range=bnd_8, Number=Slider(3, range=0..10), Seed=Slider(9, range=0..10))
len_6 = Length(Curve=cir_2)  # disabled
item_2 = ListItem(List=midpt_5, Index=random_2, Wrap=True)
points_5 = PointList(Points=midpt_8, Size=Slider(1, range=0..1))
merge_2 = Merge(Data1=pt_4, Data2=item)  # -> flatten(Result)
random_4 = Random(Range=bnd_9, Number=Slider(3, range=0..10), Seed=Slider(2, range=0..10))
item_3 = ListItem(List=midpt_6, Index=random_3, Wrap=True)
division_5 = Division(A=len_5, B=number_slider_28)  # disabled
merge_3 = Merge(Data1=boundary_6, Data2=boundary_4, Data3=boundary_5, Data4=boundary_3)
division_6 = Division(A=len_6, B=number_slider_29)  # disabled
divide = DivideCurve(Curve=cir, Count=division_5, Kinks=False)  # -> simplify(Points), Tangents, Parameters; disabled
debrep_14 = DeconstructBrep(Brep=merge_3)  # -> flatten(Faces), Edges, Vertices

merge_4 = Merge(Data1=pt_2, Data2=item_2)  # -> flatten(Result)
mst_2 = MST(BasePoints=merge_4)  # -> PointPointTopology, ConnectionPointTopology, Lines
polyoffset_2 = PolylineOffset(
    Polylines=mst_2.Lines,
    Distance=Slider(1.59, range=1..3),
    Plane=pt_2,
    Tolerance=0.01,
    ClosedFillet=Slider(0, range=0..2),
    OpenFillet=Slider(0, range=0..2),
    Miter=2)  # -> Contour, Holes
project = Project(Geometry=[polyoffset_2.Contour, circle_3], Plane=pt_2)  # -> flatten(Geometry), Transform
runion_2 = RegionUnion(Curves=project.Geometry, Plane=pt_2)
reb_2 = RebuildCurve(Curve=runion_2, Degree=Slider(3, range=0..10), Count=10, Tangents=False)

item_4 = ListItem(List=midpt_8, Index=random_4, Wrap=True)
divide_2 = DivideCurve(Curve=cir_2, Count=division_6, Kinks=False)  # -> simplify(Points), Tangents, Parameters; disabled

mst_3 = MST(BasePoints=merge_2)  # -> PointPointTopology, ConnectionPointTopology, Lines
polyoffset_3 = PolylineOffset(
    Polylines=mst_3.Lines,
    Distance=Slider(1.59, range=1..3),
    Plane=pt_4,
    Tolerance=0.01,
    ClosedFillet=Slider(0, range=0..2),
    OpenFillet=Slider(0, range=0..2),
    Miter=2)  # -> Contour, Holes
project_2 = Project(Geometry=[polyoffset_3.Contour, circle_5], Plane=pt_4)  # -> flatten(Geometry), Transform
runion_3 = RegionUnion(Curves=project_2.Geometry, Plane=pt_4)
reb_3 = RebuildCurve(Curve=runion_3, Degree=Slider(3, range=0..10), Count=10, Tangents=False)

pline = PolyLine(Vertices=divide.Points, Closed=invert(False))  # disabled
item_5 = ListItem(List=debrep_14.Faces, Index=0, Wrap=True)  # -> Item, Item1, Item2, Item3
merge_5 = Merge(Data1=pt_3, Data2=item_3)  # -> flatten(Result)
pline_2 = PolyLine(Vertices=divide_2.Points, Closed=invert(False))  # disabled
merge_6 = Merge(Data1=pt_5, Data2=item_4)  # -> flatten(Result)
item_6 = ListItem(List=debrep_14.Faces, Index=0, Wrap=True)  # -> Item, Item1, Item2, Item3
lng = ListLength(List=divide.Points)  # -> flatten(Length); disabled

mst_4 = MST(BasePoints=merge_6)  # -> PointPointTopology, ConnectionPointTopology, Lines
polyoffset_4 = PolylineOffset(
    Polylines=mst_4.Lines,
    Distance=Slider(1.59, range=1..3),
    Plane=pt_5,
    Tolerance=0.01,
    ClosedFillet=Slider(0, range=0..2),
    OpenFillet=Slider(0, range=0..2),
    Miter=2)  # -> Contour, Holes
project_3 = Project(Geometry=[polyoffset_4.Contour, circle_6], Plane=pt_5)  # -> flatten(Geometry), Transform
runion_4 = RegionUnion(Curves=project_3.Geometry, Plane=pt_5)

mst_5 = MST(BasePoints=merge_5)  # -> PointPointTopology, ConnectionPointTopology, Lines
polyoffset_5 = PolylineOffset(
    Polylines=mst_5.Lines,
    Distance=Slider(1.59, range=1..3),
    Plane=pt_3,
    Tolerance=0.01,
    ClosedFillet=Slider(0, range=0..2),
    OpenFillet=Slider(0, range=0..2),
    Miter=2)  # -> Contour, Holes
project_4 = Project(Geometry=[polyoffset_5.Contour, circle_4], Plane=pt_3)  # -> flatten(Geometry), Transform
runion_5 = RegionUnion(Curves=project_4.Geometry, Plane=pt_3)

lng_2 = ListLength(List=divide_2.Points)  # -> flatten(Length); disabled

area_9 = Area(Geometry=item_5.Item3)  # -> Area, Centroid
cir_3 = Circle(Plane=area_9.Centroid, Radius=Slider(3, range=0..10))
divide_3 = DivideCurve(Curve=cir_3, Count=Slider(4, range=0..10), Kinks=False)  # -> Points, Tangents, Parameters
points_6 = PointList(Points=divide_3.Points, Size=Slider(1.36, range=0..2))

debrep_15 = DeconstructBrep(Brep=item_6.Item3)  # -> Faces, Edges, Vertices
shift_7 = ShiftList(List=debrep_15.Vertices, Shift=Slider(8, range=0..24), Wrap=True)
pline_3 = PolyLine(Vertices=shift_7, Closed=True)
points_7 = PointList(Points=shift_7, Size=Slider(1.39, range=0..10))
debrep_16 = DeconstructBrep(Brep=pline_3)  # -> Faces, Edges, Vertices
midpt_9 = CurveMiddle(Curve=debrep_16.Edges)
item_7 = ListItem(List=midpt_9, Index=0, Wrap=True)
ln_5 = Line(StartPoint=area_9.Centroid, EndPoint=item_7)
ccx = CurveCurve(CurveA=ln_5, CurveB=cir_3)  # -> Points, ParamsA, ParamsB

explode = Explode(Curve=pline, Recursive=True)  # -> Segments, Vertices; disabled

area_10 = Area(Geometry=item_5.Item)  # -> Area, Centroid
cir_4 = Circle(Plane=area_10.Centroid, Radius=Slider(4, range=0..10))
divide_4 = DivideCurve(Curve=cir_4, Count=Slider(4, range=0..10), Kinks=False)  # -> Points, Tangents, Parameters
points_8 = PointList(Points=divide_4.Points, Size=Slider(1.36, range=0..2))

area_11 = Area(Geometry=item_5.Item2)  # -> Area, Centroid
cir_5 = Circle(Plane=area_11.Centroid, Radius=Slider(3, range=0..10))
divide_5 = DivideCurve(Curve=cir_5, Count=Slider(4, range=0..10), Kinks=False)  # -> Points, Tangents, Parameters
points_9 = PointList(Points=divide_5.Points, Size=Slider(1.36, range=0..2))

area_12 = Area(Geometry=item_5.Item1)  # -> Area, Centroid
cir_6 = Circle(Plane=area_12.Centroid, Radius=Slider(4, range=0..10))
divide_6 = DivideCurve(Curve=cir_6, Count=Slider(4, range=0..10), Kinks=False)  # -> Points, Tangents, Parameters
points_10 = PointList(Points=divide_6.Points, Size=Slider(1.36, range=0..2))

series = Series(Start=0, Step=1, Count=lng)  # disabled
explode_2 = Explode(Curve=pline_2, Recursive=True)  # -> Segments, Vertices; disabled
number_slider_30 = Slider(310, range=0..1000)  # disabled
series_2 = Series(Start=0, Step=1, Count=lng_2)  # disabled
pt_6 = Point(flatten(divide.Points))  # disabled
line = Line(flatten(explode.Segments))  # disabled

number_slider_31 = Slider(2, range=0..10)  # disabled
number_slider_32 = Slider(3.474, range=0..10)  # disabled

shift_8 = ShiftList(List=series, Shift=1, Wrap=True)  # disabled
number_slider_33 = Slider(0.18, range=0..5)  # disabled
number_slider_34 = Slider(1000, range=0..1000)  # disabled
number_slider_35 = Slider(1000, range=0..1000)  # disabled
pt_7 = Point(flatten(divide_2.Points))  # disabled
number_slider_36 = Slider(1000, range=0..1000)  # disabled
line_2 = Line(flatten(explode_2.Segments))  # disabled
number_slider_37 = Slider(10, range=0..10)  # disabled
shift_9 = ShiftList(List=explode.Segments, Shift=1, Wrap=True)  # disabled
panel_3 = Panel("0")  # disabled
number_slider_38 = Slider(1000, range=0..1000)  # disabled
shift_10 = ShiftList(List=series_2, Shift=1, Wrap=True)  # disabled
number_slider_39 = Slider(1.59, range=0..5)  # disabled
number_slider_40 = Slider(5.641, range=0..10)  # disabled
number_slider_41 = Slider(1000, range=0..1000)  # disabled
entwine_2 = Entwine(Branch00=line, Branch01=pt_6, FlattenInputs=True)  # disabled
int = Integer(flatten(series))  # disabled
int_2 = Integer(flatten(shift_8))  # disabled
shift_11 = ShiftList(List=explode_2.Segments, Shift=1, Wrap=True)  # disabled
panel_4 = Panel("0")  # disabled
entwine_3 = Entwine(Branch00=line_2, Branch01=pt_7, FlattenInputs=True)  # disabled
int_3 = Integer(flatten(series_2))  # disabled
int_4 = Integer(flatten(shift_10))  # disabled
length_line = LengthLine(Line=flatten(explode.Segments), Length=number_slider_32, Strength=number_slider_31)  # disabled
onmesh = OnMesh(Points=divide.Points, Mesh=srf_10, Strength=number_slider_30)  # disabled
merge_7 = Merge(Data1=pt_5, Data2=pt_3, Data3=pt_2, Data4=pt_4)  # -> flatten(Result)
angle = Angle(LineA=explode.Segments, LineB=shift_9, RestAngle=panel_3, Strength=number_slider_36)  # disabled
collider = Collider(Objects=entwine_2, Radii=number_slider_33, IgnoreA=int, IgnoreB=int_2, Strength=number_slider_35)  # disabled
show = Show(G=pline)  # disabled

debrep_17 = DeconstructBrep(Brep=item_6.Item2)  # -> Faces, Edges, Vertices
shift_12 = ShiftList(List=debrep_17.Vertices, Shift=Slider(20, range=0..24), Wrap=True)
pline_4 = PolyLine(Vertices=shift_12, Closed=True)
points_11 = PointList(Points=shift_12, Size=Slider(1.39, range=0..10))
debrep_18 = DeconstructBrep(Brep=pline_4)  # -> Faces, Edges, Vertices
midpt_10 = CurveMiddle(Curve=debrep_18.Edges)
item_8 = ListItem(List=midpt_10, Index=[Slider(0, range=0..23), Slider(6, range=0..23)], Wrap=True)
ln_6 = Line(StartPoint=area_11.Centroid, EndPoint=item_8)
ccx_2 = CurveCurve(CurveA=ln_6, CurveB=cir_5)  # -> Points, ParamsA, ParamsB

length_line_2 = LengthLine(Line=flatten(explode_2.Segments), Length=number_slider_40, Strength=number_slider_37)  # disabled
onmesh_2 = OnMesh(Points=divide_2.Points, Mesh=planesrf_2, Strength=number_slider_34)  # disabled
angle_2 = Angle(LineA=explode_2.Segments, LineB=shift_11, RestAngle=panel_4, Strength=number_slider_41)  # disabled
collider_2 = Collider(Objects=entwine_3, Radii=number_slider_39, IgnoreA=int_3, IgnoreB=int_4, Strength=number_slider_38)  # disabled

debrep_19 = DeconstructBrep(Brep=item_6.Item)  # -> Faces, Edges, Vertices
shift_13 = ShiftList(List=debrep_19.Vertices, Shift=Slider(2, range=0..24), Wrap=True)
pline_5 = PolyLine(Vertices=shift_13, Closed=True)
points_12 = PointList(Points=shift_13, Size=Slider(1.39, range=0..10))
debrep_20 = DeconstructBrep(Brep=pline_5)  # -> Faces, Edges, Vertices
midpt_11 = CurveMiddle(Curve=debrep_20.Edges)
item_9 = ListItem(List=midpt_11, Index=Slider(0, range=0..23), Wrap=True)
ln_7 = Line(StartPoint=area_10.Centroid, EndPoint=item_9)
ccx_3 = CurveCurve(CurveA=ln_7, CurveB=cir_4)  # -> Points, ParamsA, ParamsB

debrep_21 = DeconstructBrep(Brep=item_6.Item1)  # -> Faces, Edges, Vertices
shift_14 = ShiftList(List=debrep_21.Vertices, Shift=Slider(14, range=0..24), Wrap=True)
pline_6 = PolyLine(Vertices=shift_14, Closed=True)
points_13 = PointList(Points=shift_14, Size=Slider(1.39, range=0..10))
debrep_22 = DeconstructBrep(Brep=pline_6)  # -> Faces, Edges, Vertices
midpt_12 = CurveMiddle(Curve=debrep_22.Edges)
item_10 = ListItem(List=midpt_12, Index=[Slider(0, range=0..23), Slider(18, range=0..23)], Wrap=True)
ln_8 = Line(StartPoint=area_12.Centroid, EndPoint=item_10)
ccx_4 = CurveCurve(CurveA=ln_8, CurveB=cir_6)  # -> Points, ParamsA, ParamsB

show_2 = Show(G=pline_2)  # disabled

number_slider_42 = Slider(113, range=0..1000)
pl_3pt = Plane3Pt(PointA=pt_5, PointB=pt_3, PointC=pt_2)
planesrf_3 = PlaneSurface(Plane=pl_3pt, XSize=number_slider_42, YSize=number_slider_42)
item_11 = ListItem(List=merge_7, Index=0, Wrap=True)  # -> Item, Item1, Item2
area_13 = Area(Geometry=planesrf_3)  # -> Area, Centroid
pt_8 = Point(item_11.Item2)
orient = Orient(Geometry=planesrf_3, Source=area_13.Centroid, Target=pt_8)  # -> Geometry, Transform
Z_6 = UnitZ(Factor=1)
extr_5 = Extrude(Base=orient.Geometry, Direction=Z_6)

reb_4 = RebuildCurve(Curve=runion_5, Degree=Slider(3, range=0..10), Count=10, Tangents=False)
reb_5 = RebuildCurve(Curve=runion_4, Degree=Slider(10, range=0..10), Count=10, Tangents=False)
toggle = BooleanToggle(False)  # disabled
button = Button()  # disabled
entwine_4 = Entwine(Branch00=show, Branch01=[onmesh, length_line, angle, collider], FlattenInputs=True)  # disabled
toggle_2 = BooleanToggle(False)  # disabled
button_2 = Button()  # disabled
entwine_5 = Entwine(Branch00=show_2, Branch01=[onmesh_2, length_line_2, angle_2, collider_2], FlattenInputs=True)  # disabled
solver = Solver(GoalObjects=entwine_4, Reset=button, Threshold=1e-15, Tolerance=0.0001, On=toggle)  # -> I, V, O; disabled
solver_2 = Solver(GoalObjects=entwine_5, Reset=button_2, Threshold=1e-15, Tolerance=0.0001, On=toggle_2)  # -> I, V, O; disabled
pt_9 = Point(item_8)
pt_10 = Point(item_10)
pt_11 = Point(item_9)
pt_12 = Point(ccx_4.Points)
pt_13 = Point(ccx_3.Points)
item_12 = ListItem(List=pt_9, Index=0, Wrap=True)
pt_14 = Point(ccx_2.Points)
pt_15 = Point(ccx.Points)
pt_16 = Point(item_7)
item_13 = ListItem(List=pt_10, Index=0, Wrap=True)

# ----
# METHOD01-Project Curves - Offset - Ruled
panel_5 = Panel("METHOD02-Meshing - Project")
brep = Brep(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)
crv_10 = Curve([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])
brep_2 = Brep(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)
crv_11 = Curve([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])
project_5 = Project(Geometry=crv_10, Plane=PlaneXY(0, 0, 0))  # -> Geometry, Transform
join_7 = JoinCurves(Curves=crv_11, Preserve=False)
mp = MultiPipe(
    Curves=project_5.Geometry,
    NodeSize=Slider(20, range=0..100),
    EndOffset=1,
    StrutSize=Slider(1, range=0..100),
    Segment=0,
    KinkAngle=0.6,
    CubeFit=0,
    Caps=0)
project_6 = Project(Curve=join_7, Brep=brep_2, Direction=Vector(0, 0, 1), UseTasks=False)  # -> flatten(Curve)
curvepoint = PointOnCurve(project_5.Geometry, parameter=0.5)
subdpoly = SubDControlPolygon(SubD=mp)
xy_3 = XYPlane(Origin=Point(0, 0, 0))
faceb = FaceBoundaries(Mesh=subdpoly)
number_slider_43 = Slider(20, range=0..100)
avr_6 = Average(Input=curvepoint)
pcen_8 = PolygonCenter(Polyline=faceb)  # -> CenterV, CenterE, CenterA
pdecon_6 = Deconstruct(Point=pcen_8.CenterV)  # -> XComponent, YComponent, ZComponent
pdecon_7 = Deconstruct(Point=avr_6)  # -> XComponent, YComponent, ZComponent
offset_l = OffsetCurveLoose(Curve=project_6, Distance=expr("-x", number_slider_43), Plane=xy_3)
offset_l_2 = OffsetCurveLoose(Curve=project_6, Distance=number_slider_43, Plane=xy_3)
larger_5 = LargerThan(FirstNumber=pdecon_6.ZComponent, SecondNumber=pdecon_7.ZComponent)  # -> LargerThan, OrEqualTo
cullf = CullFaces(Mesh=subdpoly, Pattern=larger_5.LargerThan)
rulesrf = RuledSurface(CurveA=offset_l_2, CurveB=offset_l)
Z_7 = UnitZ(Factor=1)
demesh = DeconstructMesh(Mesh=cullf)  # -> Vertices, Faces, Colours, Normals
project_7 = ProjectPoint(Point=demesh.Vertices, Direction=Z_7, Geometry=brep)  # -> Point, Index
conmesh = ConstructMesh(Vertices=project_7.Point, Faces=demesh.Faces)

merge_8 = Merge(
    Data1=pt_13,
    Data3=pt_12,
    Data4=item_13,
    Data5=pt_14,
    Data6=item_12,
    Data7=pt_15,
    Data8=area_10.Centroid,
    Data9=area_12.Centroid,
    Data10=area_11.Centroid,
    Data11=area_9.Centroid,
    Data12=pt_16)  # -> flatten(Result)

# ----
# LOCATION OF BUFFER UNITS
panel_6 = Panel("""5
20""")

# ----
# LOCATION OF BUFFER UNITS
panel_7 = Panel("""5
14""")

# ----
# LOCATION OF BUFFER UNITS
panel_8 = Panel("""14
20
11""")

# ----
# LOCATION OF BUFFER UNITS
panel_9 = Panel("""5
14
20
11
8
17""")

panel_10 = Panel("""0
6""")
panel_11 = Panel("""0
18""")
# CENTER PATH
mst_6 = MST(BasePoints=merge_8)  # -> PointPointTopology, ConnectionPointTopology, Lines

# ----
# CIRCULATION EP
item_14 = ListItem(List=shift_13, Index=panel_6, Wrap=True)
item_15 = ListItem(List=midpt_11, Index=0, Wrap=True)
crv_12 = Curve(cir_4)
area_14 = Area(Geometry=crv_12)  # -> Area, Centroid
crv_cp = CurveClosestPoint(Point=item_14, Curve=crv_12)  # -> Point, Parameter, Distance
merge_9 = Merge(Data1=crv_cp.Point, Data2=item_14, Data3=area_14.Centroid)  # -> flatten(Result)
mst_7 = MST(BasePoints=merge_9)  # -> PointPointTopology, ConnectionPointTopology, Lines
ln_9 = Line(StartPoint=crv_cp.Point, EndPoint=item_14)

# ----
# CIRCULATION WP
item_16 = ListItem(List=midpt_12, Index=panel_11, Wrap=True)
item_17 = ListItem(List=shift_14, Index=panel_7, Wrap=True)
crv_13 = Curve(cir_6)
area_15 = Area(Geometry=crv_13)  # -> Area, Centroid
crv_cp_2 = CurveClosestPoint(Point=item_17, Curve=crv_13)  # -> Point, Parameter, Distance
merge_10 = Merge(Data1=crv_cp_2.Point, Data2=item_17, Data3=area_15.Centroid)  # -> flatten(Result)
mst_8 = MST(BasePoints=merge_10)  # -> PointPointTopology, ConnectionPointTopology, Lines
ln_10 = Line(StartPoint=crv_cp_2.Point, EndPoint=item_17)

# ----
# CIRCULATION WP
item_18 = ListItem(List=shift_12, Index=panel_8, Wrap=True)
item_19 = ListItem(List=midpt_10, Index=panel_10, Wrap=True)
crv_14 = Curve(cir_5)
area_16 = Area(Geometry=crv_14)  # -> Area, Centroid
crv_cp_3 = CurveClosestPoint(Point=item_18, Curve=crv_14)  # -> Point, Parameter, Distance
merge_11 = Merge(Data1=crv_cp_3.Point, Data2=item_18, Data3=area_16.Centroid)  # -> flatten(Result)
mst_9 = MST(BasePoints=merge_11)  # -> PointPointTopology, ConnectionPointTopology, Lines
ln_11 = Line(StartPoint=crv_cp_3.Point, EndPoint=item_18)

# ----
# CIRCULATION WP
item_20 = ListItem(List=shift_7, Index=panel_9, Wrap=True)
crv_15 = Curve(cir_3)
item_21 = ListItem(List=midpt_9, Index="0", Wrap=True)
crv_cp_4 = CurveClosestPoint(Point=flatten([item_20, item_21]), Curve=crv_15)  # -> Point, Parameter, Distance
area_17 = Area(Geometry=crv_15)  # -> Area, Centroid
merge_12 = Merge(Data1=crv_cp_4.Point, Data2=item_20, Data3=area_17.Centroid, Data4=item_21)  # -> flatten(Result)
ln_12 = Line(StartPoint=crv_cp_4.Point, EndPoint=item_20)
mst_10 = MST(BasePoints=merge_12)  # -> PointPointTopology, ConnectionPointTopology, Lines

crv_16 = Curve([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])
crv_cp_5 = CurveClosestPoint(Point=item_15, Curve=crv_12)  # -> Point, Parameter, Distance
crv_cp_6 = CurveClosestPoint(Point=item_19, Curve=crv_14)  # -> Point, Parameter, Distance
crv_cp_7 = CurveClosestPoint(Point=item_16, Curve=crv_13)  # -> Point, Parameter, Distance
join_8 = JoinCurves(Curves=mst_6.Lines, Preserve=False)
flip = FlipCurve(Curve=join_8)  # -> Curve, Flag
pframe = PerpFrame(Curve=reparameterize(flip.Curve), Parameter="1")
ln_13 = Line(StartPoint=crv_cp_5.Point, EndPoint=item_15)
ln_14 = Line(StartPoint=crv_cp_6.Point, EndPoint=item_19)
ln_15 = Line(StartPoint=crv_cp_7.Point, EndPoint=item_16)
cir_7 = Circle(Plane=pframe, Radius="1.00")
merge_13 = Merge(Data1=ln_11, Data2=ln_14)
merge_14 = Merge(Data1=ln_9, Data2=ln_13)
merge_15 = Merge(Data1=ln_10, Data2=ln_15)
seam = Seam(Curve=reparameterize(cir_7), Seam=Slider(0.25, range=0..1))
divide_7 = DivideCurve(Curve=seam, Count=Slider(2, range=0..10), Kinks=False)  # -> Points, Tangents, Parameters
number_slider_44 = Slider(1, range=0..10)
polyoffset_6 = PolylineOffset(
    Polylines=merge_14,
    Distance=Slider(0.82, range=0..10),
    Plane=area_14.Centroid,
    Tolerance=0.01,
    ClosedFillet=1,
    OpenFillet=1,
    Miter=2)  # -> Contour, Holes
polyoffset_7 = PolylineOffset(
    Polylines=merge_15,
    Distance=Slider(0.82, range=0..10),
    Plane=area_15.Centroid,
    Tolerance=0.01,
    ClosedFillet=1,
    OpenFillet=1,
    Miter=2)  # -> Contour, Holes
item_22 = ListItem(List=divide_7.Points, Index=0, Wrap=True)  # -> Item, Item1
ln_16 = Line(StartPoint=item_22.Item, EndPoint=item_22.Item1)
polyoffset_8 = PolylineOffset(
    Polylines=mst_10.Lines,
    Distance=number_slider_44,
    Plane=area_17.Centroid,
    Tolerance=0.01,
    ClosedFillet=1,
    OpenFillet=1,
    Miter=2)  # -> Contour, Holes
polyoffset_9 = PolylineOffset(
    Polylines=merge_13,
    Distance=number_slider_44,
    Plane=area_16.Centroid,
    Tolerance=0.01,
    ClosedFillet=1,
    OpenFillet=1,
    Miter=2)  # -> Contour, Holes
Z_8 = UnitZ(Factor=Slider(10, range=0..10))
Z_9 = UnitZ(Factor=Slider(5, range=0..10))
swp1 = Sweep1(Rail=flip.Curve, Sections=ln_16, Miter=1)
neg_5 = Negative(Value=Z_8)
perimetral_walkway = Slider(-1.5, range=-2.5..2.5)
crv_17 = Curve(crv_13)
crv_18 = Curve(polyoffset_7.Contour)
crv_19 = Curve(pline_6)
crv_20 = Curve(crv_14)
crv_21 = Curve(pline_4)
crv_22 = Curve(pline_5)
crv_23 = Curve(crv_12)
crv_24 = Curve(polyoffset_6.Contour)
crv_25 = Curve(polyoffset_9.Contour)
crv_26 = Curve(pline_3)
number_slider_45 = Slider(-0.89, range=-2.5..2.5)
crv_27 = Curve(crv_15)
crv_28 = Curve(polyoffset_8.Contour)
Z_10 = UnitZ(Factor=1)
extr_6 = Extrude(Base=swp1, Direction=neg_5)
neg_6 = Negative(Value=Z_10)
number_slider_46 = Slider(-1.5, range=-2.5..2.5)
number_slider_47 = Slider(-0.89, range=-2.5..2.5)
join_9 = BrepJoin(Breps=merge_3)  # -> Breps, Closed
runion_6 = RegionUnion(Curves=flatten([crv_23, crv_24]), Plane=area_14.Centroid)
runion_7 = RegionUnion(Curves=flatten([crv_17, crv_18]), Plane=area_15.Centroid)
move_2 = Move(Geometry=extr_6, Motion=Z_9)  # -> Geometry, Transform
runion_8 = RegionUnion(Curves=flatten([crv_20, crv_25]), Plane=area_16.Centroid)
offset = OffsetCurve(Curve=crv_26, Distance=perimetral_walkway, Corners=1)
extr_7 = Extrude(Base=join_9.Breps, Direction=neg_6)
# INCLUDE RAMPS HERE!
runion_9 = RegionUnion(Curves=flatten([crv_28, crv_27]), Plane=area_17.Centroid)
offset_2 = OffsetCurve(Curve=crv_22, Distance=perimetral_walkway, Corners=1)
offset_3 = OffsetCurve(Curve=crv_19, Distance=perimetral_walkway, Corners=1)
offset_4 = OffsetCurve(Curve=crv_21, Distance=perimetral_walkway, Corners=1)
number_slider_48 = Slider(1, range=0..1)
sdiff = SolidDifference(BrepsA=extr_7, BrepsB=move_2.Geometry)
rdiff = RegionDifference(CurvesA=offset_2, CurvesB=runion_6, Plane=area_14.Centroid)
rdiff_2 = RegionDifference(CurvesA=offset_3, CurvesB=runion_7, Plane=area_15.Centroid)
rdiff_3 = RegionDifference(CurvesA=offset, CurvesB=runion_9, Plane=area_17.Centroid)
rdiff_4 = RegionDifference(CurvesA=offset_4, CurvesB=runion_8, Plane=area_16.Centroid)
brep_3 = Brep(sdiff)
number_slider_49 = Slider(1, range=0..1)
item_23 = ListItem(List=midpt_6, Index=0, Wrap=True)
item_24 = ListItem(List=midpt_8, Index=0, Wrap=True)
item_25 = ListItem(List=midpt_5, Index=0, Wrap=True)

# ----
# FILLET NOT WORKING
number_slider_50 = Slider(1.28, range=0..10)
number_slider_51 = Slider(1, range=0..1)
crv_29 = Curve(rdiff_4)

# ----
# FLOORS TO OPERATE ON
crv_30 = Curve(rdiff_3)
number_slider_52 = Slider(1, range=0..1)
crv_31 = Curve(rdiff)
crv_32 = Curve(rdiff_2)
fillet = Fillet(Curve=crv_30, Radius=Slider(1.28, range=0..10))
debrep_23 = DeconstructBrep(Brep=brep_3)  # -> Faces, Edges, Vertices
# RAMP POINTS
merge_16 = Merge(Data1=pt_5, Data2=item_24, Data3=pt_3, Data4=item_23, Data5=pt_2, Data6=item_25, Data7=pt_4)  # -> flatten(Result)
merge_17 = Merge(Data1=merge_16, Data2=merge_6, Data3=item_3, Data4=item_2, Data5=item)  # -> flatten(Result)
fillet_2 = Fillet(Curve=crv_31, Radius=Slider(1.28, range=0..10))
# FLOORS TO OPERATE ON
fillet_3 = Fillet(Curve=crv_29, Radius=number_slider_50)
fillet_4 = Fillet(Curve=crv_32, Radius=Slider(1.28, range=0..10))
preview = CustomPreview(Geometry=brep_3, Material=ColourSwatch(SwatchColor=RGB(125, 125, 125)))
preview_2 = CustomPreview(Geometry=swp1, Material=ColourSwatch(SwatchColor=RGB(184, 103, 103)))
area_18 = Area(Geometry=debrep_23.Faces)  # -> Area, Centroid
join_10 = JoinCurves(Curves=fillet, Preserve=False)
duppt = RemoveDuplicatePts(Points=merge_17, Tolerance=0.01)
join_11 = JoinCurves(Curves=fillet_3, Preserve=False)
join_12 = JoinCurves(Curves=fillet_4, Preserve=False)
join_13 = JoinCurves(Curves=fillet_2, Preserve=False)
mst_11 = MST(BasePoints=merge_16)  # -> PointPointTopology, ConnectionPointTopology, Lines
dom_3 = ConstructDomain(DomainStart=Slider(1, range=1..5), DomainEnd=Slider(3.28, range=1..5))
pdecon_8 = Deconstruct(Point=area_18.Centroid)  # -> XComponent, YComponent, ZComponent
area_19 = Area(Geometry=join_10)  # -> Area, Centroid
area_20 = Area(Geometry=join_11)  # -> Area, Centroid
lng_3 = ListLength(List=duppt)
area_21 = Area(Geometry=join_12)  # -> Area, Centroid
smaller_11 = SmallerThan(FirstNumber=area_20.Area, SecondNumber=Slider(2, range=0..10))  # -> SmallerThan, OrEqualTo
range_3 = Range(Domain=dom_3, Steps=lng_3)
mst_12 = MST(BasePoints=flatten(duppt))  # -> PointPointTopology, ConnectionPointTopology, Lines
clean = CleanTree(RemoveNulls=True, RemoveInvalid=True, RemoveEmpty=False, Tree=mst_11.Lines)
bnd_10 = Bounds(Numbers=pdecon_8.ZComponent)
dispatch_15 = Dispatch(List=area_20.Centroid, DispatchPattern=smaller_11.SmallerThan)  # -> ListA, ListB
boundary_7 = BoundarySurfaces(Edges=join_13)
# POINTS FOR STRUCTURE
# TO ANCHOR
pt_17 = Point(area_21.Centroid)
# POINTS FOR STRUCTURE
# TO ANCHOR
pt_18 = Point(area_19.Centroid)
cir_8 = Circle(Plane=merge_17, Radius=range_3)
# POINTS FOR STRUCTURE
# TO ANCHOR
pt_19 = Point(dispatch_15.ListB)
boundary_8 = BoundarySurfaces(Edges=join_12)
dedomain_6 = DeconstructDomain(Domain=bnd_10)  # -> Start, End
polyoffset_10 = PolylineOffset(
    Polylines=mst_12.Lines,
    Distance=Slider(1.59, range=1..3),
    Plane=pl_3pt,
    Tolerance=0.01,
    ClosedFillet=Slider(0, range=0..2),
    OpenFillet=Slider(0, range=0..2),
    Miter=2)  # -> Contour, Holes
larger_6 = LargerThan(FirstNumber=pdecon_8.ZComponent, SecondNumber=dedomain_6.End)  # -> LargerThan, OrEqualTo
smaller_12 = SmallerThan(FirstNumber=pdecon_8.ZComponent, SecondNumber=dedomain_6.Start)  # -> SmallerThan, OrEqualTo
boundary_9 = BoundarySurfaces(Edges=polyoffset_10.Contour)
crv_33 = Curve(clean)
runion_10 = RegionUnion(Curves=[cir_8, polyoffset_10.Contour], Plane=pl_3pt)
dispatch_16 = Dispatch(List=debrep_23.Faces, DispatchPattern=larger_6.OrEqualTo)  # -> ListA, ListB
srf_11 = Surface(dispatch_16.ListA)
number_slider_53 = Slider(0.36, range=0.3..0.5)

series_3 = Series(Start=0, Step="0.6", Count=Slider(3, range=1..10))
series_4 = Series(Start="0.2", Step="0.2", Count=Slider(3, range=1..10))
neg_7 = Negative(Value=series_3)
Z_11 = UnitZ(Factor=series_4)
offset_5 = OffsetCurve(Curve=graft(join_13), Distance=neg_7, Corners=1)
boundary_10 = BoundarySurfaces(Edges=offset_5)
partition = PartitionList(List=flatten(boundary_10), Size="3")

srf_12 = Surface(flatten(srf_11))
merge_18 = Merge(Data1=boundary_7, Data2=boundary_8)  # -> flatten(Result)
rdiff_5 = RegionDifference(CurvesA=srf_12, CurvesB=merge_18)

join_14 = JoinCurves(Curves=crv_33, Preserve=False)
number_slider_54 = Slider(1.5, range=0..10)
pframe_2 = PerpFrame(Curve=reparameterize(join_14), Parameter=Slider(0, range=0..1))
end = EndPoints(Curve=join_14)  # -> Start, End
rectangle = Rectangle(Plane=pframe_2, XSize=Domain(-1, 1), YSize=Slider(10, range=0..10), Radius=0)  # -> Rectangle, Length
area_22 = Area(Geometry=rectangle.Rectangle)  # -> Area, Centroid
orient_2 = Orient(Geometry=rectangle.Rectangle, Source=area_22.Centroid, Target=end.Start)  # -> Geometry, Transform

boundary_11 = BoundarySurfaces(Edges=rdiff_5)
number_slider_55 = Slider(0, range=0..1)  # disabled
number_slider_56 = Slider(0.2, range=0..1)  # disabled
number_slider_57 = Slider(0.2, range=0..1)  # disabled

number_slider_58 = Slider(1, range=0..10)
join_15 = JoinCurves(Curves=crv_33, Preserve=False)
number_slider_59 = Slider(1.5, range=0..10)
pframe_3 = PerpFrame(Curve=reparameterize(join_15), Parameter=Slider(0, range=0..1))
end_2 = EndPoints(Curve=join_15)  # -> Start, End
rectangle_2 = Rectangle(Plane=pframe_3, XSize=Domain(-1, 1), YSize=Slider(0.2, range=0..1), Radius=0)  # -> Rectangle, Length
area_23 = Area(Geometry=rectangle_2.Rectangle)  # -> Area, Centroid
orient_3 = Orient(Geometry=rectangle_2.Rectangle, Source=area_23.Centroid, Target=end_2.Start)  # -> Geometry, Transform

number_slider_60 = Slider(22, range=0..100)  # disabled
join_16 = JoinCurves(Curves=crv_33, Preserve=False)  # disabled
pframe_4 = PerpFrame(Curve=reparameterize(join_16), Parameter=number_slider_55)  # disabled
end_3 = EndPoints(Curve=join_16)  # -> Start, End; disabled
rectangle_3 = Rectangle(Plane=pframe_4, XSize=number_slider_60, YSize=number_slider_56, Radius=0)  # -> Rectangle, Length; disabled

# ----
# CREATE DENDRO VOLUME
extr_8 = Extrude(Base=partition, Direction=Z_11)

area_24 = Area(Geometry=rectangle_3.Rectangle)  # -> Area, Centroid; disabled
orient_4 = Orient(Geometry=rectangle_3.Rectangle, Source=area_24.Centroid, Target=end_3.Start)  # -> Geometry, Transform; disabled

# ---- group: boundary curve
crv_34 = Curve(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)

# ----
crv_35 = Curve(join_12)

# ----
# fix perpendicularity
swp1_2 = Sweep1(Rail=join_14, Sections=orient_2.Geometry, Miter=1)
swp1_3 = Sweep1(Rail=join_15, Sections=orient_3.Geometry, Miter=1)

mesh = Mesh(crv_34)
triremesh = TriRemesh(Geometry=mesh, Length=1, Iterations=25)  # -> Triangulation, Dual, Creases
nv = NakedVertices(Mesh=triremesh.Triangulation)  # -> ClothedIndex, NakedIndex, ClothedPts, NakedPts
edgelengths = EdgeLengths(Mesh=triremesh.Triangulation, LengthFactor=Slider(0.67, range=0..1), Strength=1)
volume = Volume(Mesh=triremesh.Triangulation, Volume=Slider(6052.308, range=0..20101), Strength=1)
show_3 = Show(G=triremesh.Triangulation)
anchor = Anchor(Point=nv.NakedPts, Strength=10000)
entwine_6 = Entwine(Branch00=show_3, Branch01=[anchor, volume, edgelengths], FlattenInputs=True)
solver_3 = Solver(GoalObjects=entwine_6, Reset=Button(), Threshold=1e-15, Tolerance=0.01, On=Toggle(False))  # -> I, V, O
bang = ExplodeTree(Data=solver_3.O)  # -> Branch0, Branch1
mesh_2 = Mesh(bang.Branch0)
preview_3 = CustomPreview(
    Geometry=mesh_2,
    Material={diffuse=RGB(0, 128, 0), emission=RGB(0, 0, 0), shine=0.5, specular=RGB(255, 255, 255), transparency=0.1})

merge_19 = Merge(Data1=extr_4, Data2=extr_2, Data3=extr_3, Data4=extr)
merge_20 = Merge(Data1=boundary_6, Data2=boundary_4, Data3=boundary_5, Data4=boundary_3)
md_slider = MDSlider(SliderMode=0, slider_value=Point(0.5, 0.5, 0.5), x_domain=Domain(0, 1), y_domain=Domain(0, 1), z_domain=Domain(0, 1))
cap = CapHoles(Brep=merge_19)

# ---- group: Cell Outline
crv_36 = Curve(crv_35)

crv_37 = Curve(<curve referenced from the Rhino model>)

# ----
cap_2 = CapHoles(Brep=swp1_2)
sdiff_2 = SolidDifference(BrepsA=cap, BrepsB=cap_2)
swp1_4 = Sweep1(Rail=join_16, Sections=orient_4.Geometry, Miter=1)  # disabled
brep_4 = Brep(sdiff_2)
debrep_24 = DeconstructBrep(Brep=swp1_4)  # -> Faces, Edges, Vertices; disabled
number_slider_61 = Slider(153, range=0..1000)  # disabled
area_25 = Area(Geometry=debrep_24.Faces)  # -> Area, Centroid; disabled
larger_7 = LargerThan(FirstNumber=area_25.Area, SecondNumber=number_slider_61)  # -> LargerThan, OrEqualTo; disabled
dispatch_17 = Dispatch(List=debrep_24.Faces, DispatchPattern=larger_7.OrEqualTo)  # -> ListA, ListB; disabled
item_26 = ListItem(List=dispatch_17.ListA, Index=0, Wrap=True)  # -> Item, Item1, Item2, Item3, Item4, Item5, Item6, Item7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; disabled
srf_13 = Surface([item_26.Item1, item_26.Item3, item_26.Item5, item_26.Item7, item_26.Item9, item_26.Item11])  # disabled
join_17 = BrepJoin(Breps=srf_13)  # -> Breps, Closed
crv_38 = Curve(runion_10)
crv_39 = Curve([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])
brep_5 = Brep(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)
join_18 = JoinCurves(Curves=crv_39, Preserve=False)
project_8 = Project(Curve=crv_38, Brep=join_17.Breps, Direction=Vector(0, 0, 1), UseTasks=False)  # -> flatten(Curve)
number_slider_62 = Slider(2, range=0..100)
xy_4 = XYPlane(Origin=Point(0, 0, 0))
offset_l_3 = OffsetCurveLoose(Curve=project_8, Distance=expr("-x", number_slider_62), Plane=xy_4)
offset_l_4 = OffsetCurveLoose(Curve=project_8, Distance=number_slider_62, Plane=xy_4)
rulesrf_2 = RuledSurface(CurveA=project_8, CurveB=offset_l_3)
rulesrf_3 = RuledSurface(CurveA=offset_l_4, CurveB=offset_l_3)
popgeo = PopulateGeometry(Geometry=boundary_7, Count=Slider(8, range=0..100), Seed=Slider(4, range=0..10))
area_26 = Area(Geometry=boundary_7)  # -> Area, graft(Centroid)
vec2pt = Vector2Pt(PointA=popgeo, PointB=area_26.Centroid, Unitize=False)  # -> Vector, Length

number_slider_63 = Slider(8, range=0..100)
area_27 = Area(Geometry=boundary_7)  # -> Area, graft(Centroid)
popgeo_2 = PopulateGeometry(Geometry=boundary_7, Count=number_slider_63, Seed=Slider(5, range=0..10))
dom_4 = ConstructDomain(DomainStart=Slider(2.1, range=0..25), DomainEnd=Slider(0.3, range=0..25))
vec2pt_2 = Vector2Pt(PointA=popgeo_2, PointB=area_27.Centroid, Unitize=False)  # -> Vector, Length
offset_distance = Slider(10, range=10..200)
amp = Amplitude(Vector=vec2pt_2.Vector, Amplitude=Slider(2.02, range=1..5))
vdis = VectorDisplay(Anchor=popgeo_2, Vector=vec2pt_2.Vector)
distance_to_group = Slider(69, range=20..200)
radius = Panel("2 to 5")
move_3 = Move(Geometry=popgeo_2, Motion=amp)  # -> Geometry, Transform
random_5 = Random(Range=dom_4, Number=number_slider_63, Seed=2)
pgroups = PointGroups(Points=move_3.Geometry, Distance=distance_to_group)  # -> Groups, Indices
item_27 = ListItem(List=random_5, Index=pgroups.Indices, Wrap=True)
number_slider_64 = Slider(0, range=0..2)
circle_7 = CircleCNR(Center=pgroups.Groups, Normal=Vector(0, 0, 1), Radius=item_27)
polyoffset_11 = PolylineOffset(
    Polylines=circle_7,
    Distance=offset_distance,
    Plane=Plane(origin=(0, 0, 0), x=(0, 0, 0), y=(0, 0, 0)),
    Tolerance=0.01,
    ClosedFillet=number_slider_64,
    OpenFillet=number_slider_64,
    Miter=2)  # -> Contour, Holes
polyoffset_12 = PolylineOffset(
    Polylines=polyoffset_11.Contour,
    Distance=offset_distance,
    Plane=Plane(origin=(0, 0, 0), x=(0, 0, 0), y=(0, 0, 0)),
    Tolerance=0.01,
    ClosedFillet=number_slider_64,
    OpenFillet=number_slider_64,
    Miter=2)  # -> Contour, Holes
crv_40 = Curve(polyoffset_12.Holes)
previewlw = CustomPreviewLineweights(Geometry=crv_40, Shader=ColourSwatch(SwatchColor=RGB(252, 0, 0)), Thickness=Slider(3, range=1..5), Absolute=False)

amp_2 = Amplitude(Vector=vec2pt.Vector, Amplitude=Slider(2.02, range=1..5))
vdis_2 = VectorDisplay(Anchor=popgeo, Vector=vec2pt.Vector)

distance_to_group_2 = Slider(20, range=20..200)
number_slider_65 = Slider(0, range=0..2)
number_slider_66 = Slider(0.29, range=0..10)

move_4 = Move(Geometry=popgeo, Motion=amp_2)  # -> Geometry, Transform

merge_21 = Merge()  # -> flatten(Result)
data = Data(popgeo)
pt_20 = Point(move_4.Geometry)
pgroups_2 = PointGroups(Points=pt_20, Distance=distance_to_group_2)  # -> Groups, Indices
item_28 = ListItem(List=move_4.Geometry, Index=pgroups_2.Indices, Wrap=True)
dom_5 = ConstructDomain(DomainStart=Slider(0.5, range=0..25), DomainEnd=Slider(1.5, range=0..25))
bnd_11 = Bounds(Numbers=item_28)
remap = RemapNumbers(Value=item_28, Source=bnd_11, Target=dom_5)  # -> Mapped, Clipped
circle_8 = CircleCNR(Center=pgroups_2.Groups, Normal=Vector(0, 0, 1), Radius=remap.Mapped)
polyoffset_13 = PolylineOffset(
    Polylines=circle_8,
    Distance=number_slider_66,
    Plane=Plane(origin=(0, 0, 0), x=(0, 0, 0), y=(0, 0, 0)),
    Tolerance=0.01,
    ClosedFillet=number_slider_65,
    OpenFillet=number_slider_65,
    Miter=2)  # -> Contour, Holes
polyoffset_14 = PolylineOffset(
    Polylines=polyoffset_13.Contour,
    Distance=number_slider_66,
    Plane=Plane(origin=(0, 0, 0), x=(0, 0, 0), y=(0, 0, 0)),
    Tolerance=0.01,
    ClosedFillet=number_slider_65,
    OpenFillet=number_slider_65,
    Miter=2)  # -> Contour, Holes
crv_41 = Curve(polyoffset_14.Holes)
join_19 = JoinCurves(Curves=crv_41, Preserve=False)
previewlw_2 = CustomPreviewLineweights(Geometry=join_19, Shader=ColourSwatch(SwatchColor=RGB(252, 0, 0)), Thickness=Slider(2, range=1..5), Absolute=False)

runion_11 = RegionUnion(Curves=[circle_8, polyoffset_14.Contour])
runion_12 = RegionUnion(Curves=[polyoffset_14.Contour, polyoffset_13.Contour])

panel_12 = Panel("0.5")
series_5 = Series(Start=0, Step="0.6", Count=Slider(3, range=1..10))
series_6 = Series(Start=number_slider_53, Step=number_slider_53, Count=Slider(3, range=1..10))
neg_8 = Negative(Value=series_5)
Z_12 = UnitZ(Factor=series_6)
offset_6 = OffsetCurve(Curve=graft(join_12), Distance=neg_8, Corners=1)
boundary_12 = BoundarySurfaces(Edges=offset_6)
partition_2 = PartitionList(List=flatten(boundary_12), Size="3")

neg_9 = Negative(Value=Z_12)

extr_9 = Extrude(Base=partition_2, Direction=neg_9)

item_29 = ListItem(List=extr_9, Index=0, Wrap=True)  # -> Item, Item1, Item2
sunion_2 = SolidUnion(Breps=[item_29.Item, item_29.Item1, item_29.Item2])
debrep_25 = DeconstructBrep(Brep=sunion_2)  # -> Faces, Edges, Vertices
evalsrf = EvaluateSurface(Surface=reparameterize(debrep_25.Faces), Point=md_slider)  # -> Point, Normal, UDirection, VDirection, Frame
devec = DeconstructVector(Vector=evalsrf.Normal)  # -> XComponent, YComponent, ZComponent
panel_13 = Panel(devec.ZComponent)
equalst = EqualityWithinTolerance(FirstNumber=devec.ZComponent, SecondNumber="0", Tolerance=0.01)  # -> Equality, Inequality
dispatch_18 = Dispatch(List=debrep_25.Faces, DispatchPattern=equalst.Equality)  # -> ListA, ListB
srf_14 = Surface(dispatch_18.ListB)
item_30 = ListItem(List=srf_14, Index=0, Wrap=True)  # -> Item, Item1, Item2, Item3
srf_15 = Surface(dispatch_18.ListA)
merge_22 = Merge(Data1=item_30.Item, Data2=item_30.Item1, Data3=item_30.Item3, Data4=srf_15)

disc = Discontinuity(Curve=crv_36, Level=1)  # -> Points, Parameters; disabled
# Kangaroo (One Cell)
toggle_3 = GroupToggle(ToggleActive=True, ToggleVisible=False)  # disabled
avr_7 = Average(Input=disc.Points)  # disabled
ln_17 = Line(StartPoint=disc.Points, EndPoint=avr_7)  # disabled
number_slider_67 = Slider(-0.4, range=-1..0)  # disabled
number_slider_68 = Slider(0, range=0..2)  # disabled
ext = ExtendCurve(Curve=ln_17, Type=number_slider_68, Start=number_slider_68, End=number_slider_67)  # disabled
shift_15 = ShiftList(List=ext, Shift=1, Wrap=True)  # disabled
rulesrf_4 = RuledSurface(CurveA=shift_15, CurveB=ext)  # disabled
mesh_uv = MeshSurface(Surface=rulesrf_4, UCount=Slider(15, range=1..30), VCount=Slider(3, range=1..30), Overhang=True, Equalize=False)  # disabled
mjoin = MeshJoin(Meshes=mesh_uv)  # disabled
weldvertices = MeshWeldVertices(Mesh=mjoin, Tolerance=0.01)  # -> RuntimeMessage, Mesh; disabled
nv_2 = NakedVertices(Mesh=weldvertices.Mesh)  # -> ClothedIndex, NakedIndex, ClothedPts, NakedPts; disabled
medges = MeshEdges(Mesh=weldvertices.Mesh)  # -> NakedEdges, InteriorEdges, NonManifoldEdges; disabled
demesh_2 = DeconstructMesh(Mesh=weldvertices.Mesh)  # -> Vertices, Faces, Colours, Normals; disabled
midpt_13 = CurveMiddle(Curve=medges.NakedEdges)  # disabled
number_slider_69 = Slider(3.18, range=0..5)  # disabled
number_slider_70 = Slider(0.1, range=0.1..0.11)  # disabled
avr_8 = Average(Input=midpt_13)  # disabled
pull = PullPoint(Point=nv_2.NakedPts, Geometry=crv_36, ClosestOnly=True)  # -> ClosestPoint, Distance; disabled
dist_2 = Distance(PointA=midpt_13, PointB=avr_8)  # disabled
smaller_13 = SmallerThan(FirstNumber=dist_2, SecondNumber=number_slider_69)  # -> SmallerThan, OrEqualTo; disabled
number_slider_71 = Slider(-3, range=-6..0)  # disabled
smaller_14 = SmallerThan(FirstNumber=pull.Distance, SecondNumber=number_slider_70)  # -> SmallerThan, OrEqualTo; disabled
cull = CullPattern(List=medges.NakedEdges, CullPattern=smaller_13.SmallerThan)  # disabled
len_7 = Length(Curve=medges.InteriorEdges)  # disabled
cull_2 = CullPattern(List=nv_2.NakedPts, CullPattern=invert(smaller_14.SmallerThan))  # disabled
cull_3 = CullPattern(List=nv_2.NakedPts, CullPattern=smaller_14.SmallerThan)  # disabled
Z_13 = UnitZ(Factor=number_slider_71)  # disabled
len_8 = Length(Curve=cull)  # disabled
number_slider_72 = Slider(0, range=-10..10)  # disabled
number_slider_73 = Slider(2.71, range=0..10)  # disabled
move_5 = Move(Geometry=cull_2, Motion=Z_13)  # -> Geometry, Transform; disabled
vec = VectorXYZ(XComponent=number_slider_72, YComponent=0, ZComponent=number_slider_73)  # -> Vector, Length; disabled
anchor_2 = Anchor(Point=cull_3, Strength=10000)  # disabled
anchor_3 = Anchor(Point=cull_2, Target=move_5.Geometry, Strength=10000)  # disabled
load = Load(Point=demesh_2.Vertices, ForceVector=vec.Vector, Weighting=1)  # disabled
show_4 = Show(G=weldvertices.Mesh)  # disabled
button_3 = Button()  # disabled
toggle_4 = BooleanToggle(False)  # disabled
swatch = ColourSwatch(SwatchColor=RGBA(255, 255, 255, 172))  # disabled

# ---- group: All other segments
number_slider_74 = Slider(0, range=0..1)  # disabled
number_slider_75 = Slider(30, range=0..100)  # disabled
multiplication = Multiplication(A=len_7, B=number_slider_74)  # disabled
length_line_3 = LengthLine(Line=medges.InteriorEdges, Length=multiplication, Strength=number_slider_75)  # disabled

# ---- group: Central Ring
number_slider_76 = Slider(0, range=0..1)  # disabled
number_slider_77 = Slider(10000, range=0..10000)  # disabled
multiplication_2 = Multiplication(A=len_8, B=number_slider_76)  # disabled
length_line_4 = LengthLine(Line=cull, Length=multiplication_2, Strength=number_slider_77)  # disabled

# ----
entwine_7 = Entwine(
    Branch00=show_4,
    Branch01=length_line_3,
    Branch02=length_line_4,
    Branch03=load,
    Branch04=anchor_2,
    Branch05=anchor_3,
    FlattenInputs=True)  # disabled
bouncysolver = BouncySolver(GoalObjects=entwine_7, Reset=button_3, Threshold=1e-15, Tolerance=0.0001, Damping=0.99, Iterations=10, On=toggle_4)  # -> I, V, O; disabled
item_31 = ListItem(List=bouncysolver.O, Index=0, Wrap=True)  # disabled

medges_2 = MeshEdges(Mesh=item_31)  # -> NakedEdges, InteriorEdges, NonManifoldEdges; disabled
preview_4 = CustomPreview(Geometry=item_31, Material=swatch)  # disabled
toggle_5 = GroupToggle(ToggleActive=True, ToggleVisible=False)  # disabled

previewlw_3 = CustomPreviewLineweights(Geometry=medges_2.InteriorEdges, Shader=ColourSwatch(SwatchColor=RGB(0, 0, 0)), Absolute=False)
