# Grasshopper definition Walls & Roofs .gh (Grasshopper 1.0.7)
# plug-ins: Pufferfish, Human, MetaHopper, Kangaroo2 Components, MeshEdit Components, DendroGH, Weaverbird, Speckle 2

connections_x_axis = Curve([<curve referenced from the Rhino model> x2])
connections_centers = Point([<point referenced from the Rhino model> x2])

connections_centers_2 = Point([<point referenced from the Rhino model> x2])
connections_x_axis_2 = Curve([<curve referenced from the Rhino model> x2])

connections_centers_3 = Point(<point referenced from the Rhino model>)
connections_x_axis_3 = Curve(<curve referenced from the Rhino model>)

connections_centers_4 = Point(<point referenced from the Rhino model>)
connections_x_axis_4 = Curve(<curve referenced from the Rhino model>)

connections_centers_5 = Point(<point referenced from the Rhino model>)
connections_x_axis_5 = Curve(<curve referenced from the Rhino model>)

connections_centers_6 = Point(<point referenced from the Rhino model>)
connections_x_axis_6 = Curve(<curve referenced from the Rhino model>)

connections_centers_7 = Point([<point referenced from the Rhino model> x2])
connections_x_axis_7 = Curve([<curve referenced from the Rhino model> x2])

connections_centers_8 = Point(<point referenced from the Rhino model>)
connections_x_axis_8 = Curve(<curve referenced from the Rhino model>)

connections_centers_9 = Point(<point referenced from the Rhino model>)
connections_x_axis_9 = Curve(<curve referenced from the Rhino model>)

connections_x_axis_10 = Curve(<curve referenced from the Rhino model>)
connections_centers_10 = Point(<point referenced from the Rhino model>)

# ----
# HUBS
panel = Panel("HUB_SIDE_R")
part_geometry = Brep(<brep referenced from the Rhino model>)
conndir = Wasp_ConnectionFromDirection(GEO=part_geometry, CEN=connections_centers_10, UP=connections_x_axis_10, T="HUB_SIDE_L")  # -> CONN, PLN_OUT; inputs CEN: list of Point3d, UP: list of Curve, T: list; plug-in component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
conndir_2 = Wasp_ConnectionFromDirection(GEO=part_geometry, CEN=connections_centers_7, UP=connections_x_axis_7, T=panel)  # -> CONN, PLN_OUT; inputs CEN: list of Point3d, UP: list of Curve, T: list; plug-in component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
merge = Merge(Data1=conndir.CONN, Data2=conndir_2.CONN)
points = PointList(Points=connections_centers_10, Size=Slider(1, range=0..10))
part_name = Panel("HUB")
part = Wasp_BasicPart(NAME=part_name, GEO=part_geometry, CONN=flatten(merge))  # -> PART; inputs GEO: Mesh, CONN: list, ATTR: list; plug-in component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

connections_x_axis_11 = Curve(<curve referenced from the Rhino model>)
connections_centers_11 = Point(<point referenced from the Rhino model>)

connections_centers_12 = Point(<point referenced from the Rhino model>)
connections_x_axis_12 = Curve(<curve referenced from the Rhino model>)

# ---- group: OCT
subd = SubD(<subd referenced from the Rhino model>)
mesh = Mesh(<mesh referenced from the Rhino model>)

# ----
qrmesh = QuadRemesh(Mesh=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, Settings={aqc=True, as=50, dhe=True, gci=0, null=False, pme=0, sa=0, tqc=2000})  # disabled
medges = MeshEdges(Mesh=qrmesh)  # -> NakedEdges, InteriorEdges, NonManifoldEdges
merge_2 = Merge(Data1=subd, Data2=qrmesh)

# ---- group: OCT
mesh_2 = Mesh(<mesh referenced from the Rhino model>)
subd_2 = SubD(<subd referenced from the Rhino model>)

mesh_3 = Mesh(<mesh referenced from the Rhino model>)
subd_3 = SubD(<subd referenced from the Rhino model>)

# ----
qrmesh_2 = QuadRemesh(Mesh=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, Settings={aqc=True, as=50, dhe=True, gci=0, null=False, pme=0, sa=0, tqc=2000})  # disabled
medges_2 = MeshEdges(Mesh=qrmesh_2)  # -> NakedEdges, InteriorEdges, NonManifoldEdges
merge_3 = Merge(Data1=subd_2, Data2=qrmesh_2)

geo = Geometry([<brep referenced from the Rhino model>, <mesh referenced from the Rhino model>])
attribute = Wasp_Attribute(ID="UNIT_HUB", VAL=part_geometry, TR=Toggle(True))  # -> ATTR; inputs VAL: list, TR: Boolean; plug-in component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

geo_2 = Geometry([<brep referenced from the Rhino model>, <mesh referenced from the Rhino model>])
attribute_2 = Wasp_Attribute(ID="UNITC", VAL=merge_3, TR=Toggle(False))  # -> ATTR; inputs VAL: list, TR: Boolean; plug-in component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

qrmesh_3 = QuadRemesh(Mesh=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, Settings={aqc=True, as=50, dhe=True, gci=0, null=False, pme=0, sa=0, tqc=2000})  # disabled
medges_3 = MeshEdges(Mesh=qrmesh_3)  # -> NakedEdges, InteriorEdges, NonManifoldEdges
merge_4 = Merge(Data1=subd_3, Data2=qrmesh_3)

geo_3 = Geometry([<brep referenced from the Rhino model>, <mesh referenced from the Rhino model>])
attribute_3 = Wasp_Attribute(ID="UNITO", VAL=merge_4, TR=Toggle(False))  # -> ATTR; inputs VAL: list, TR: Boolean; plug-in component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

mesh_4 = Mesh(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)
mesh_5 = Mesh(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)
msplit = MeshSplit(Mesh=mesh_4, Splitters=mesh_5)

item = ListItem(List=msplit, Index="1", Wrap=True)
Z = UnitZ(Factor=1)
move = Move(Geometry=item, Motion=Z)  # -> Geometry, Transform
medges_4 = MeshEdges(Mesh=move.Geometry)  # -> NakedEdges, InteriorEdges, NonManifoldEdges
previewlw = CustomPreviewLineweights(
    Geometry=medges_4.NakedEdges,
    Shader=ColourSwatch(SwatchColor=RGB(0, 0, 0)),
    Thickness=Slider(2, range=0..100),
    Absolute=False)

contour = Contour(Shape=item, Point=Point(0, 0, 0), Direction=Vector(0, 0, 1), Distance=Slider(5, range=0..50))
patch = Patch(Curves=flatten(contour), Spans=20, Flexibility=1, Trim=True)

preview = CustomPreview(Geometry=item, Material=ColourSwatch(SwatchColor=RGB(194, 194, 194)))  # disabled

connections_centers_13 = Point([<point referenced from the Rhino model> x3])
connections_x_axis_13 = Curve([<curve referenced from the Rhino model> x3])

connections_centers_14 = Point(<point referenced from the Rhino model>)
connections_x_axis_14 = Curve(<curve referenced from the Rhino model>)

connections_x_axis_15 = Curve([<curve referenced from the Rhino model> x2])
connections_centers_15 = Point([<point referenced from the Rhino model> x2])

connections_x_axis_16 = Curve(<curve referenced from the Rhino model>)
connections_centers_16 = Point(<point referenced from the Rhino model>)

connections_centers_17 = Point([<point referenced from the Rhino model> x2])
connections_x_axis_17 = Curve([<curve referenced from the Rhino model> x2])

dom = ConstructDomain(DomainStart=Slider(0.3, range=0..1), DomainEnd=Slider(0.46, range=0..1))
dom_2 = ConstructDomain(DomainStart=Slider(0.15, range=0..1), DomainEnd=Slider(0.33, range=0..1))
dom² = ConstructDomain²(DomainU=dom_2, DomainV=dom)

subd_4 = SubD()  # disabled
mesh_6 = Mesh()  # disabled
qrmesh_4 = QuadRemesh(Mesh=mesh_6, Settings={aqc=True, as=50, dhe=True, gci=0, null=False, pme=0, sa=0, tqc=2000})  # disabled
merge_5 = Merge(Data1=subd_4, Data2=qrmesh_4)  # disabled
medges_5 = MeshEdges(Mesh=qrmesh_4)  # -> NakedEdges, InteriorEdges, NonManifoldEdges; disabled

mesh_7 = Mesh()  # disabled
subd_5 = SubD()  # disabled
qrmesh_5 = QuadRemesh(Mesh=mesh_7, Settings={aqc=True, as=50, dhe=True, gci=0, null=False, pme=0, sa=0, tqc=2000})  # disabled
merge_6 = Merge(Data1=subd_5, Data2=qrmesh_5)  # disabled

subsrf = Isotrim(Surface=patch, Domain=dom²)

geo_4 = Geometry([<brep referenced from the Rhino model>, <mesh referenced from the Rhino model>])
attribute_4 = Wasp_Attribute(ID="UNITC", VAL=merge_5, TR=Toggle(True))  # -> ATTR; inputs VAL: list, TR: Boolean; disabled; plug-in component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

# ----
# CUBES
panel_2 = Panel("CUBE_TOP")
# Attributes Geometry
panel_3 = Panel("CUBE_BOTTOM")
part_geometry_2 = Brep(<brep referenced from the Rhino model>)
points_2 = PointList(Points=connections_centers_15, Size=Slider(1, range=0..10))
conndir_3 = Wasp_ConnectionFromDirection(GEO=part_geometry_2, CEN=connections_centers_15, UP=connections_x_axis_15, T="CUBE_SIDE")  # -> CONN, PLN_OUT; inputs CEN: list of Point3d, UP: list of Curve, T: list; plug-in component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
conndir_4 = Wasp_ConnectionFromDirection(GEO=part_geometry_2, CEN=connections_centers_14, UP=connections_x_axis_14, T=panel_2)  # -> CONN, PLN_OUT; inputs CEN: list of Point3d, UP: list of Curve, T: list; plug-in component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
conndir_5 = Wasp_ConnectionFromDirection(GEO=part_geometry_2, CEN=connections_centers_16, UP=connections_x_axis_16, T=panel_3)  # -> CONN, PLN_OUT; inputs CEN: list of Point3d, UP: list of Curve, T: list; plug-in component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
merge_7 = Merge(Data1=conndir_3.CONN, Data2=conndir_4.CONN, Data3=conndir_5.CONN)
part_name_2 = Panel("CUBE")
part_2 = Wasp_BasicPart(NAME=part_name_2, GEO=part_geometry_2, CONN=flatten(merge_7), ATTR=attribute_4)  # -> PART; inputs GEO: Mesh, CONN: list, ATTR: list; plug-in component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

geo_5 = Geometry([<brep referenced from the Rhino model>, <mesh referenced from the Rhino model>])
attribute_5 = Wasp_Attribute(ID="UNITO", VAL=merge_6, TR=Toggle(True))  # -> ATTR; inputs VAL: list, TR: Boolean; disabled; plug-in component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

# ----
# OCTAGONS
panel_4 = Panel("OCT_SIDE")
part_geometry_3 = Brep(<brep referenced from the Rhino model>)
points_3 = PointList(Points=connections_centers_17, Size=Slider(1, range=0..10))
conndir_6 = Wasp_ConnectionFromDirection(GEO=part_geometry_3, CEN=connections_centers_17, UP=connections_x_axis_17, T=panel_4)  # -> CONN, PLN_OUT; inputs CEN: list of Point3d, UP: list of Curve, T: list; plug-in component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
part_name_3 = Panel("OCT")
part_3 = Wasp_BasicPart(NAME=part_name_3, GEO=part_geometry_3, CONN=flatten(conndir_6.CONN), ATTR=attribute_5)  # -> PART; inputs GEO: Mesh, CONN: list, ATTR: list; plug-in component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

offset = OffsetSurface(Surface=subsrf, Distance=Slider(-1, range=-1..1), Retrim=True)

# ---- group: Terrain from Sample
# Terrain
geo_6 = Geometry(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)

# ---- group: Project Terrain
geo_7 = Geometry(subsrf)

# ----
contour_2 = Contour(Shape=geo_7, Point=Point(0, 0, 0), Direction=Vector(0, 0, 1), Distance=Slider(5, range=0..50))
preview_2 = CustomPreview(Geometry=contour_2, Material=ColourSwatch(SwatchColor=RGB(0, 0, 0)))
preview_3 = CustomPreview(Geometry=geo_7, Material=ColourSwatch(SwatchColor=RGB(214, 214, 214)))

Z_2 = UnitZ(Factor=Slider(-14, range=-20..20))
merge_8 = Merge(Data1=part_3, Data2=part_2)

# ---- group: Guide Curve
crv = Curve(<curve referenced from the Rhino model>)

# ---- group: Guide Polyline
crv_2 = Curve(<curve referenced from the Rhino model>)

# ---- group: Guide Line
crv_3 = Curve(<curve referenced from the Rhino model>)

# ---- group: Terrain
geo_8 = Geometry(geo_7)

# ----
dom_3 = ConstructDomain(DomainStart=Slider(1, range=0..3), DomainEnd=Slider(0, range=0..100))
Z_3 = UnitZ(Factor=Slider(3.394, range=0..10))
move_2 = Move(Motion=Z_3)  # -> Geometry, Transform

# ----
# Mesh Constraint
offsrf = OffsetSurface(Surface=subsrf, Distance=Slider(14.9, range=0..20), BothSides=0, CreateSolid=True)

mesh_8 = MeshBrep(
    Brep=offsrf,
    Settings={GridMaxCount=0, GridMinCount=16, JaggedSeams=False, MaxEdgeLength=0, MinEdgeLength=0.0001, MinTolerance=0, Refine=True, RefineAngle=0, RelativeTolerance=0.65, SimplePlanes=True, Tolerance=0})
panel_5 = Panel("""OCT
CUBE""")
meshconst = Wasp_MeshConstraint(GEO=mesh_8, IN=Toggle(True), SOFT=Toggle(True), REQ=Toggle(True), PART=panel_5)  # -> GC; inputs GEO: Mesh, IN: Boolean, SOFT: Boolean, REQ: Boolean, PART: list; plug-in component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

p_p = Panel("""OCT_SIDE_L>CUBE_SIDE_R
CUBE_SIDE_L>OCT_SIDE_R
CUBE_BOTTOM>CUBE_TOP""")
panel_6 = Panel("12 Feb - Main_04")
panel_7 = Panel("12 Feb - Main_03")
panel_8 = Panel("12 Feb - Main_01")
panel_9 = Panel("Closed Loops - 3m")
number_slider = Slider(-46, range=-100..0)
dom_4 = ConstructDomain(DomainStart="-1", DomainEnd=number_slider)
neg = Negative(Value=number_slider)
range = Range(Domain=dom_4, Steps=expr("x-1", neg))
relay = Relay()
Z_4 = UnitZ(Factor=Slider(-1.73, range=-10..0))

lng = ListLength(List=relay)
getattr = Wasp_GetAttributeByName(PART=relay, ID="house")  # -> VAL; plug-in component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
random = Random(Range=Slider(2, range=0..10), Number=lng, Seed=2, Integers=True)
merge_9 = Merge(
    Data1=ColourSwatch(SwatchColor=RGB(42, 181, 14)),
    Data2=ColourSwatch(SwatchColor=RGB(110, 255, 0)),
    Data3=ColourSwatch(SwatchColor=RGB(207, 255, 77)))
item_2 = ListItem(List=merge_9, Index=random, Wrap=True)
preview_4 = CustomPreview(Geometry=flatten(getattr), Material=item_2)

number_slider_2 = Slider(39, range=0..100)

# ---- group: Terrain
# Terrain
geo_9 = Geometry(geo_7)

# ---- group: 5 Roofs
crv_4 = Curve([<curve referenced from the Rhino model> x5])

# ----
move_3 = Move(Motion=Z_4)  # -> Geometry, Transform
# 3D Printed Wall
crv_5 = Curve(<curve referenced from the Rhino model>)
mesh_uv = MeshSurface(Surface=geo_9, UCount=number_slider_2, VCount=number_slider_2, Overhang=True, Equalize=False)
panel_10 = Panel("""0
0
1""")
offmsh = OffsetMesh(Mesh=mesh_uv, Distance=Slider(-17, range=-20..0), BothSides=0, CreateSolid=True)
vsettings = CreateSettings(VoxelSize=Slider(0.08, range=0..1), Bandwidth=1, Isovalue=0, Adaptivity=0.1)
number_slider_3 = Slider(0.2, range=0..1)
vsettings_2 = VolumeSettings(vsettings)
mesh_9 = Mesh(offmsh)
vsettings_3 = VolumeSettings(vsettings_2)
vsettings_4 = VolumeSettings(vsettings_2)
medges_6 = MeshEdges(Mesh=offmsh)  # -> NakedEdges, InteriorEdges, NonManifoldEdges
preview_5 = CustomPreview(Geometry=offmsh, Material=ColourSwatch(SwatchColor=RGB(222, 115, 0)))  # disabled
vmesh = MeshToVolume(Mesh=mesh_9, Settings=vsettings_3)  # disabled
panel_11 = Panel("""-1.25
-3.75""")
Z_5 = UnitZ(Factor=panel_11)
swatch = ColourSwatch(SwatchColor=RGB(107, 107, 107))
dom_5 = ConstructDomain(DomainStart=Slider(0.35, range=0..1), DomainEnd=Slider(0.69, range=0..1))
number_slider_4 = Slider(1, range=0..10)
Z_6 = UnitZ(Factor=Slider(-6.5, range=-20..0))
neg_2 = Negative(Value=number_slider_4)
Z_7 = UnitZ(Factor=Slider(-0.6, range=-20..0))
vsettings_5 = CreateSettings(VoxelSize=Slider(0.08, range=0..1), Bandwidth=1, Isovalue=0, Adaptivity=0.1)
offsrf_2 = OffsetSurface(Surface=geo_9, Distance=Slider(-17, range=-20..0), BothSides=0, CreateSolid=True)
vsettings_6 = VolumeSettings(vsettings_5)
Z_8 = UnitZ(Factor=1)
qrmesh_6 = QuadRemesh(Settings={aqc=True, as=50, dhe=True, gci=0, null=False, pme=0, sa=0, tqc=2000})
pt = Point([<point referenced from the Rhino model> x4])

# ---- group: 4
brep = Brep([<brep referenced from the Rhino model> x17])

# ---- group: 3
brep_2 = Brep([<brep referenced from the Rhino model> x17])

# ---- group: 2
brep_3 = Brep([<brep referenced from the Rhino model> x22])

# ---- group: 1
brep_4 = Brep([<brep referenced from the Rhino model> x15])

# ---- group: New Site Mesh
mesh_10 = Mesh(<mesh referenced from the Rhino model>)

# ----
entwine = Entwine(Branch00=brep_4, Branch01=brep_3, Branch02=brep_2, Branch03=brep, FlattenInputs=True)

# ---- group: UNITS (LATEST LOCATION)
# Points and Obsticles
brep_5 = Brep([<brep referenced from the Rhino model> x71])

# ---- group: Cell Outline
crv_6 = Curve(<curve referenced from the Rhino model>)

crv_7 = Curve(<curve referenced from the Rhino model>)

# ----
pt_2 = Point(<point referenced from the Rhino model>)

# ----
# Wall Attempts
toggle = GroupToggle(ToggleActive=True, ToggleVisible=False)  # disabled
crv_8 = Curve(<curve referenced from the Rhino model>)  # disabled
flip = FlipCurve(Curve=crv_8)  # -> Curve, Flag; disabled
crv_9 = Curve(<curve referenced from the Rhino model>)  # disabled
number_slider_5 = Slider(8, range=0..30)  # disabled
number_slider_6 = Slider(-1, range=-1..0)  # disabled
disc = Discontinuity(Curve=flip.Curve, Level=1)  # -> Points, Parameters; disabled
disc_2 = Discontinuity(Curve=crv_9, Level=1)  # -> Points, Parameters; disabled
number_slider_7 = Slider(0.08, range=0..3)  # disabled
shift = ShiftList(List=disc.Points, Shift=number_slider_5, Wrap=True)  # disabled
shift_2 = ShiftList(List=disc_2.Points, Shift=number_slider_6, Wrap=True)  # disabled
nurbs = NurbsCurve(Vertices=shift_2, Degree=3, Periodic=True)  # -> Curve, Length, Domain; disabled
Z_9 = UnitZ(Factor=number_slider_7)  # disabled
nurbs_2 = NurbsCurve(Vertices=shift, Degree=3, Periodic=True)  # -> Curve, Length, Domain; disabled
move_4 = Move(Geometry=nurbs.Curve, Motion=Z_9)  # -> Geometry, Transform; disabled
merge_10 = Merge(Data1=nurbs.Curve, Data3=nurbs_2.Curve)  # disabled
loft = Loft(Curves=merge_10, Options={Adjust=False, Closed=False, LoftEnds=0, LoftSimp=0, LoftType=0, Rebuild=10, Refit=0.01})  # disabled
swatch_2 = ColourSwatch(SwatchColor=RGB(133, 0, 0))  # disabled
preview_6 = CustomPreview(Geometry=loft, Material=swatch_2)  # disabled

# ----
# Contour Lines (Projected on plane above)
xy = XYPlane(Origin=pt_2)
project = Project(Geometry=flatten(entwine), Plane=xy)  # -> Geometry, Transform
debrep = DeconstructBrep(Brep=project.Geometry)  # -> Faces, flatten(Edges), Vertices
len = Length(Curve=debrep.Edges)
larger = LargerThan(FirstNumber=len, SecondNumber="0.001")  # -> LargerThan, OrEqualTo
cull = CullPattern(List=debrep.Edges, CullPattern=larger.LargerThan)
panel_12 = Panel("""0
1""")
cull_2 = CullPattern(List=cull, CullPattern=panel_12)
join = JoinCurves(Curves=cull_2, Preserve=False)
runion = RegionUnion(Curves=flatten(join))
item_3 = ListItem(List=runion, Index=0, Wrap=True)  # -> Item, Item1
number_slider_8 = Slider(0.49, range=0..20)
disc_3 = Discontinuity(Curve=item_3.Item, Level=1)  # -> Points, Parameters
nurbs_3 = NurbsCurve(Vertices=disc_3.Points, Degree=3, Periodic=True)  # -> Curve, Length, Domain
neg_3 = Negative(Value=number_slider_8)
xy_2 = XYPlane(Origin=Point(0, 0, 0))
offset_2 = OffsetCurve(Curve=nurbs_3.Curve, Distance=number_slider_8, Corners=3)
offset_3 = OffsetCurve(Curve=offset_2, Distance=neg_3, Plane=xy_2, Corners=1)
offset_4 = OffsetCurve(Curve=offset_3, Distance=neg_3, Plane=xy_2, Corners=1)
series = Series(Start=Slider(0.06, range=-2..5), Step=Slider(2.03, range=-2..5), Count=Slider(7, range=0..10))
offset_5 = OffsetCurve(Curve=nurbs_3.Curve, Distance=series, Corners=1)  # -> flatten(Curve)

number_slider_9 = Slider(137, range=0..144)
# Units (Midterm Location)
panel_13 = Panel("0")
dom_6 = ConstructDomain(DomainStart=panel_13, DomainEnd=number_slider_9)
range_2 = Range(Domain=dom_6, Steps=number_slider_9)
item_4 = ListItem(List=[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], Index=range_2, Wrap=True)
lng_2 = ListLength(List=item_4)
angsplitmsh = AngleSplitMesh(Mesh=item_4, Angle=0, Opposite=False)  # -> Split, R
series_2 = Series(Start=0, Step=1, Count=lng_2)
medges_7 = MeshEdges(Mesh=angsplitmsh.Split)  # -> NakedEdges, InteriorEdges, NonManifoldEdges
gradient = Gradient(LowerLimit=0, UpperLimit=lng_2, Parameter=series_2, stops=[0: RGB(255, 255, 255), 1: RGB(135, 0, 0)])
geo_10 = Geometry(medges_7.NakedEdges)
preview_7 = CustomPreview(Geometry=item_4, Material=gradient)
previewlw_2 = CustomPreviewLineweights(Geometry=geo_10, Shader=ColourSwatch(SwatchColor=RGB(0, 0, 0)), Thickness=Slider(1, range=0..100), Absolute=False)

panel_14 = Panel()
panel_15 = Panel()
panel_16 = Panel("https://macad.speckle.xyz/streams/4975f9f0a8/commits/8fbb543497")
brep_6 = Brep([<brep referenced from the Rhino model> x71])

# ---- group: Obsticles
mesh_11 = Mesh(item_4)

brep_7 = Brep([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])

# ----
geo_11 = Geometry(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)
esokv = ExtendSpeckleObjectByKeyValue(Keys=panel_14, Values=panel_15, selectedKitName="Objects")
receive = Receive(
    Stream=panel_16,
    AutoReceive=False,
    CurrentComponentState="expired",
    ExpandOutput=True,
    ReceiveOnOpen=False,
    ReceivedCommitId="8fbb543497",
    StreamWrapper="https://macad.speckle.xyz/streams/4975f9f0a8/commits/8fbb543497",
    selectedKitName="Objects")  # -> Info, CONTOURS, SOIL
preview_8 = CustomPreview(Geometry=geo_11, Material=ColourSwatch(SwatchColor=RGB(161, 161, 161)))  # disabled
panel_17 = Panel("https://macad.speckle.xyz/streams/4975f9f0a8/branches/site%2F04-community-site")

# ---- group: Community Site Stream (Last Commit at the time)
panel_18 = Panel("https://macad.speckle.xyz/streams/4975f9f0a8/commits/8fbb543497")

# ----
bbox = BoundingBox(Content=brep_6, Plane=PlaneXY(0, 0, 0), UnionBox=True)  # -> Box, Box_2
volume = Volume(Geometry=bbox.Box_2)  # -> Volume, Centroid
receive_2 = Receive(
    Stream=panel_18,
    AutoReceive=False,
    CurrentComponentState="expired",
    ExpandOutput=True,
    LastInfoMessage="German German @ 02/20/2024 02:21:33: Adjusted site (id:8fbb543497)",
    ReceiveOnOpen=False,
    ReceivedCommitId="8fbb543497",
    StreamWrapper="https://macad.speckle.xyz/streams/4975f9f0a8/commits/8fbb543497",
    selectedKitName="Objects")  # -> Info, CONTOURS, SOIL

crv_10 = Curve(item_3.Item1)
disc_4 = Discontinuity(Curve=crv_10, Level=1)  # -> Points, Parameters
nurbs_4 = NurbsCurve(Vertices=disc_4.Points, Degree=3, Periodic=True)  # -> Curve, Length, Domain

send = Send(
    Stream=panel_17,
    Message="First one here :)",
    Brep=brep_6,
    AutoSend=False,
    BaseId="4211a9499277c30a864f8af716dcf53c",
    CurrentComponentState="expired",
    KitName="Objects",
    OutputWrappers="https://macad.speckle.xyz\t4975f9f0a8\t25e44ca5db",
    UseDefaultCache=True,
    selectedKitName="Objects")
sph = Sphere(Base=volume.Centroid, Radius=Slider(100, range=0..1000))
panel_19 = Panel("""ELEMENTAL MARS
G06
VOLUME
MULTIPLE
SITE-PLACE HOLDER
NO MATERIAL""")
panel_20 = Panel("""BIMSC-PROJECT
BIMSC-ORIGINATOR
BIMSC-VOLUME
BIMSC-LEVEL
BIMSC-TYPE
BIMSC-MATERIAL""")

# ---- group: Materials Stream
panel_21 = Panel("https://macad.speckle.xyz/streams/4975f9f0a8/commits/d13e3ec6c6")

# ----
dso = DeconstructSpeckleObject(SpeckleObject=receive_2.SOIL, selectedKitName="Objects")  # -> A, B

# ---- group: G06 Stream
panel_22 = Panel("https://macad.speckle.xyz/streams/4975f9f0a8/branches/students%2Fg06-site_locations")

# ----
mesh_12 = Mesh(dso.A)
receive_3 = Receive(
    Stream=panel_21,
    AutoReceive=False,
    CurrentComponentState="expired",
    ExpandOutput=True,
    LastInfoMessage="James McBennett @ 02/21/2024 20:21:08: Materials 21-02-2024 (id:d13e3ec6c6)",
    ReceiveOnOpen=False,
    ReceivedCommitId="d13e3ec6c6",
    StreamWrapper="https://macad.speckle.xyz/streams/4975f9f0a8/commits/d13e3ec6c6",
    selectedKitName="Objects")  # -> Info, Materials
esokv_2 = ExtendSpeckleObjectByKeyValue(SpeckleObject=brep_5, Keys=panel_20, Values=panel_19, selectedKitName="Objects")
sovk = SpeckleObjectValueByKey(Object=receive_2.SOIL, Key="A4", selectedKitName="Objects")
dso_2 = DeconstructSpeckleObject(SpeckleObject=receive_3.Materials, selectedKitName="Objects")  # -> Glass, Insulation, Regolith, Soil, Steel
item_5 = ListItem(List=flatten(mesh_12), Index=Slider(3, range=0..20), Wrap=True)
send_2 = Send(
    Stream=panel_22,
    Message="Footprint",
    Data=esokv_2,
    AutoSend=False,
    BaseId="5c085f5baf2f57c841840d9e65b2c551",
    CurrentComponentState="up_to_date",
    KitName="Objects",
    OutputWrappers="https://macad.speckle.xyz\t4975f9f0a8\t123ad7dd3c",
    UseDefaultCache=True,
    selectedKitName="Objects")
# Speckle
panel_23 = Panel(dso_2.Steel)
brep_8 = Brep(entwine)
volume_2 = Volume(Geometry=brep_8)  # -> Volume, Centroid
plfit = PlaneFit(Points=flatten(volume_2.Centroid))  # -> Plane, Deviation
offset_6 = OffsetCurve(Curve=nurbs_4.Curve, Distance=Slider(-0.4, range=-2..2), Corners=1)
Z_10 = UnitZ(Factor=Slider(1.4, range=-5..5))
Z_11 = UnitZ(Factor=Slider(-1.2, range=-5..0))
move_5 = Move(Geometry=plfit.Plane, Motion=Z_10)  # -> Geometry, Transform
move_6 = Move(Geometry=plfit.Plane, Motion=Z_11)  # -> Geometry, Transform
Z_12 = UnitZ(Factor=1)
projecta = ProjectAlong(Geometry=offset_6, Plane=move_5.Geometry, Direction=Z_12)  # -> Geometry, Transform

# ----
# Terrain & Contours
Z_13 = UnitZ(Factor=1)
number_slider_10 = Slider(-0.37, range=-2..0)
projecta_2 = ProjectAlong(Geometry=offset_5, Plane=move_6.Geometry, Direction=Z_13)  # -> Geometry, Transform
series_3 = Series(Start=0, Step=number_slider_10, Count=Slider(5, range=0..10))
Z_14 = UnitZ(Factor=series_3)
move_7 = Move(Geometry=reverse(projecta_2.Geometry), Motion=Z_14)  # -> Geometry, Transform
Z_15 = UnitZ(Factor=Slider(1.5, range=0..20))
addition = Addition(A=number_slider_10, B=Slider(0, range=-1..1))
move_8 = Move(Geometry=move_7.Geometry, Motion=Z_15)  # -> Geometry, Transform
Z_16 = UnitZ(Factor=addition)
extr = Extrude(Base=move_8.Geometry, Direction=Z_16)
cap = CapHoles(Brep=extr)
sunion = SolidUnion(Breps=cap)

boundary = BoundarySurfaces(Edges=offset_4)  # disabled
number_slider_11 = Slider(1, range=0..10)  # disabled
toggle_2 = GroupToggle(ToggleActive=True, ToggleVisible=False)  # disabled
mesh_13 = MeshBrep(
    Brep=boundary,
    Settings={GridMaxCount=0, GridMinCount=16, JaggedSeams=False, MaxEdgeLength=0, MinEdgeLength=0.0001, MinTolerance=0, Refine=True, RefineAngle=0, RelativeTolerance=0.65, SimplePlanes=True, Tolerance=0})  # disabled
triremesh = TriRemesh(Geometry=mesh_13, Length=number_slider_11, Iterations=25)  # -> Triangulation, Dual, Creases; disabled
nv = NakedVertices(Mesh=triremesh.Triangulation)  # -> ClothedIndex, NakedIndex, ClothedPts, NakedPts; disabled
medges_8 = MeshEdges(Mesh=triremesh.Triangulation)  # -> NakedEdges, InteriorEdges, NonManifoldEdges; disabled
demesh = DeconstructMesh(Mesh=triremesh.Triangulation)  # -> Vertices, Faces, Colours, Normals; disabled
len_2 = Length(Curve=medges_8.InteriorEdges)  # disabled
number_slider_12 = Slider(0, range=-10..10)  # disabled
number_slider_13 = Slider(2.71, range=0..10)  # disabled
number_slider_14 = Slider(0.25, range=0..1)  # disabled
number_slider_15 = Slider(63, range=0..100)  # disabled
vec = VectorXYZ(XComponent=number_slider_12, YComponent=0, ZComponent=number_slider_13)  # -> Vector, Length; disabled
edgelengths = EdgeLengths(Mesh=triremesh.Triangulation, LengthFactor=number_slider_14, Strength=number_slider_15)  # disabled
anchor = Anchor(Point=nv.NakedPts, Strength=10000)  # disabled
load = Load(Point=demesh.Vertices, ForceVector=vec.Vector, Weighting=1)  # disabled
show = Show(G=triremesh.Triangulation)  # disabled
entwine_2 = Entwine(Branch00=show, Branch01=edgelengths, Branch02=load, Branch03=anchor, FlattenInputs=True)  # disabled
toggle_3 = BooleanToggle(False)  # disabled
button = Button()  # disabled
bouncysolver = BouncySolver(GoalObjects=entwine_2, Reset=button, Threshold=1e-15, Tolerance=0.0001, Damping=0.99, Iterations=10, On=toggle_3)  # -> I, V, O; disabled
item_6 = ListItem(List=bouncysolver.O, Index=0, Wrap=True)  # disabled
medges_9 = MeshEdges(Mesh=item_6)  # -> NakedEdges, InteriorEdges, NonManifoldEdges; disabled

# ----
# Wall
number_slider_16 = Slider(-5.4, range=-10..10)
Z_17 = UnitZ(Factor=number_slider_16)
extr_2 = Extrude(Base=projecta.Geometry, Direction=Z_17)
offsrf_3 = OffsetSurface(Surface=extr_2, Distance=Slider(-0.3, range=-1..1), BothSides=0, CreateSolid=True)
preview_9 = CustomPreview(Geometry=offsrf_3, Material=ColourSwatch(SwatchColor=RGB(135, 0, 0)))

# ----
# Units (Pebbles)
brep_9 = Brep(entwine)
mesh_14 = MeshBrep(
    Brep=brep_9,
    Settings={GridMaxCount=0, GridMinCount=16, JaggedSeams=False, MaxEdgeLength=0, MinEdgeLength=0.0001, MinTolerance=0, Refine=True, RefineAngle=0, RelativeTolerance=0.65, SimplePlanes=True, Tolerance=0})
wbcatmullclark = WeaverbirdsCatmullClarkSubdivision(MeshCurves=mesh_14, Level=Slider(2, range=0..2), SmoothNakedEdges=Slider(0, range=0..2))
preview_10 = CustomPreview(Geometry=brep_9, Material=ColourSwatch(SwatchColor=RGBA(92, 92, 92, 102)))
preview_11 = CustomPreview(Geometry=wbcatmullclark, Material=ColourSwatch(SwatchColor=RGB(145, 142, 132)))

pt_3 = Point([<point referenced from the Rhino model> x7])
projecta_3 = ProjectAlong(Geometry=crv_10, Plane=move_6.Geometry, Direction=Z_13)  # -> Geometry, Transform
projecta_4 = ProjectAlong(Geometry=item_3.Item, Plane=move_6.Geometry, Direction=Z_13)  # -> Geometry, Transform; disabled
item_7 = ListItem(List=move_7.Geometry, Index=0, Wrap=True)  # disabled

number_slider_17 = Slider(5, range=0..10)  # disabled
panel_24 = Panel("1")  # disabled
addition_2 = Addition(A=number_slider_17, B=panel_24)  # disabled
division = Division(A=panel_24, B=addition_2)  # disabled
series_4 = Series(Start=division, Step=division, Count=number_slider_17)  # disabled
tweencrv = TweenCurve(CurveA=projecta_4.Geometry, CurveB=item_7, Factor=series_4, BlendType=0)  # disabled

boundary_2 = BoundarySurfaces(Edges=projecta_3.Geometry)
preview_12 = CustomPreview(Geometry=boundary_2, Material=ColourSwatch(SwatchColor=RGB(78, 87, 62)))

# ---- group: All other segments
number_slider_18 = Slider(0.08, range=0..1)  # disabled
number_slider_19 = Slider(55, range=0..100)  # disabled
multiplication = Multiplication(A=len_2, B=number_slider_18)  # disabled
length_line = LengthLine(Line=medges_8.InteriorEdges, Length=multiplication, Strength=number_slider_19)  # disabled

# ----
# OCTAGONS
panel_25 = Panel("OCT_SIDE_R")
part_geometry_4 = Brep(<brep referenced from the Rhino model>)
conndir_7 = Wasp_ConnectionFromDirection(GEO=part_geometry_4, CEN=connections_centers_6, UP=connections_x_axis_6, T="OCT_SIDE2_L")  # -> CONN, PLN_OUT; inputs CEN: list of Point3d, UP: list of Curve, T: list; plug-in component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
conndir_8 = Wasp_ConnectionFromDirection(GEO=part_geometry_4, CEN=connections_centers_5, UP=connections_x_axis_5, T="OCT_SIDE2_R")  # -> CONN, PLN_OUT; inputs CEN: list of Point3d, UP: list of Curve, T: list; plug-in component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
conndir_9 = Wasp_ConnectionFromDirection(GEO=part_geometry_4, CEN=connections_centers_3, UP=connections_x_axis_3, T="OCT_SIDE_L")  # -> CONN, PLN_OUT; inputs CEN: list of Point3d, UP: list of Curve, T: list; plug-in component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
conndir_10 = Wasp_ConnectionFromDirection(GEO=part_geometry_4, CEN=connections_centers_4, UP=connections_x_axis_4, T=panel_25)  # -> CONN, PLN_OUT; inputs CEN: list of Point3d, UP: list of Curve, T: list; plug-in component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
points_4 = PointList(Points=connections_centers_4, Size=Slider(1, range=0..10))
merge_11 = Merge(Data1=conndir_10.CONN, Data2=conndir_9.CONN, Data3=conndir_8.CONN, Data4=conndir_7.CONN)
part_name_4 = Panel("OCT")

geo_12 = Geometry(part_geometry_4)
attribute_6 = Wasp_Attribute(ID="BREP_O", VAL=geo_12, TR=Toggle(True))  # -> ATTR; inputs VAL: list, TR: Boolean; plug-in component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

part_4 = Wasp_BasicPart(NAME=part_name_4, GEO=part_geometry_4, CONN=flatten(merge_11), ATTR=attribute_6)  # -> PART; inputs GEO: Mesh, CONN: list, ATTR: list; plug-in component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

# ----
# CUBES Original
panel_26 = Panel("CUBE_SIDE")
panel_27 = Panel("CUBE_SIDE_R")  # disabled
part_geometry_5 = Brep(<brep referenced from the Rhino model>)
conndir_11 = Wasp_ConnectionFromDirection(GEO=part_geometry_5, CEN=connections_centers_9, UP=connections_x_axis_9, T=panel_27)  # -> CONN, PLN_OUT; inputs CEN: list of Point3d, UP: list of Curve, T: list; disabled; plug-in component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
conndir_12 = Wasp_ConnectionFromDirection(GEO=part_geometry_5, CEN=connections_centers_12, UP=connections_x_axis_12, T="CUBE_BOTTOM")  # -> CONN, PLN_OUT; inputs CEN: list of Point3d, UP: list of Curve, T: list; plug-in component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
conndir_13 = Wasp_ConnectionFromDirection(GEO=part_geometry_5, CEN=connections_centers_8, UP=connections_x_axis_8, T="CUBE_TOP")  # -> CONN, PLN_OUT; inputs CEN: list of Point3d, UP: list of Curve, T: list; plug-in component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
conndir_14 = Wasp_ConnectionFromDirection(
    GEO=part_geometry_5,
    CEN=[connections_centers_11, connections_centers_9],
    UP=[connections_x_axis_11, connections_x_axis_9],
    T=panel_26)  # -> CONN, PLN_OUT; inputs CEN: list of Point3d, UP: list of Curve, T: list; plug-in component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
points_5 = PointList(Points=connections_centers_11, Size=Slider(1, range=0..10))
part_name_5 = Panel("CUBE")
merge_12 = Merge(Data1=conndir_14.CONN, Data2=conndir_13.CONN, Data3=conndir_12.CONN)

geo_13 = Geometry(part_geometry_5)
attribute_7 = Wasp_Attribute(ID="BREP_C", VAL=geo_13, TR=Toggle(True))  # -> ATTR; inputs VAL: list, TR: Boolean; plug-in component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

part_5 = Wasp_BasicPart(NAME=part_name_5, GEO=part_geometry_5, CONN=flatten(merge_12), ATTR=attribute_7)  # -> PART; inputs GEO: Mesh, CONN: list, ATTR: list; plug-in component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

merge_13 = Merge(Data1=part_4, Data2=part_5)

number_slider_20 = Slider(10, range=0..10)
merge_14 = Merge(Data1=Slider(8, range=0..10), Data2=Slider(10, range=0..10))
partcat = Wasp_PartsCatalog(PART=flatten(merge_13), NUM=merge_14, LIM=Toggle(False), AD=Toggle(True))  # -> CAT; inputs PART: list, NUM: list, LIM: Boolean, AD: Boolean; plug-in component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
panel_28 = Panel(partcat)

rulegen = Wasp_RulesGenerator(PART=merge_13, GR=p_p)  # -> R; inputs PART: list, SELF_P: Boolean, SELF_C: Boolean, TYP: Boolean, GR: list; plug-in component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
panel_29 = Panel(rulegen)

# ----
# HEXAGONS
panel_30 = Panel("HEX_SIDE")
part_geometry_6 = Brep(<brep referenced from the Rhino model>)
conndir_15 = Wasp_ConnectionFromDirection(GEO=part_geometry_6, CEN=connections_centers_13, UP=connections_x_axis_13, T=panel_30)  # -> CONN, PLN_OUT; inputs CEN: list of Point3d, UP: list of Curve, T: list; plug-in component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
points_6 = PointList(Points=connections_centers_13, Size=Slider(1, range=0..10))
part_name_6 = Panel("HEX")

geo_14 = Geometry(part_geometry_6)
attribute_8 = Wasp_Attribute(ID="HEX", VAL=geo_14, TR=Toggle(True))  # -> ATTR; inputs VAL: list, TR: Boolean; plug-in component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

part_6 = Wasp_BasicPart(NAME=part_name_6, GEO=part_geometry_6, CONN=flatten(conndir_15.CONN), ATTR=attribute_8)  # -> PART; inputs GEO: Mesh, CONN: list, ATTR: list; plug-in component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

merge_15 = Merge(Data1=part_6, Data2=part_2)

panel_31 = Panel("Field01")

area = Area(Geometry=geo_7)  # -> Area, Centroid
xy_3 = XYPlane(Origin=area.Centroid)
Y = UnitY(Factor=1)
rot3d = Rotate3D(Geometry=xy_3, Angle=degrees(Slider(12, range=0..90)), Center=area.Centroid, Axis=Y)  # -> Geometry, Transform
deplane = DeconstructPlane(Plane=rot3d.Geometry)  # -> Origin, XAxis, YAxis, ZAxis
amp = Amplitude(Vector=deplane.ZAxis, Amplitude=Slider(3, range=0..100))

bbox_2 = BoundingBox(Content=geo_7, Plane=rot3d.Geometry)  # -> Box, Box_2
volume_3 = Volume(Geometry=bbox_2.Box)  # -> Volume, Centroid

move_9 = Move(Geometry=volume_3.Centroid, Motion=Z_2)  # -> Geometry, Transform

scale_nu = ScaleNU(
    Geometry=bbox_2.Box,
    Plane=move_9.Geometry,
    ScaleX=Slider(1, range=0..10),
    ScaleY=Slider(1, range=0..10),
    ScaleZ=Slider(1.5, range=0..10))  # -> Geometry, Transform
# Fields
fieldpts = Wasp_FieldPoints(BOU=scale_nu.Geometry, RES=Slider(3, range=0..50))  # -> E_FIELD, PTS; inputs BOU: list of Mesh, PLN: Plane; plug-in component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

move_10 = Move(Geometry=scale_nu.Geometry, Motion=amp)  # -> Geometry, Transform

# ----
# Surface Field Values (Terrain)
geo_15 = Geometry(geo_7)
pull = PullPoint(Point=fieldpts.PTS, Geometry=geo_15, ClosestOnly=True)  # -> ClosestPoint, Distance
pdecon = Deconstruct(Point=pull.ClosestPoint)  # -> XComponent, YComponent, ZComponent
pdecon_2 = Deconstruct(Point=fieldpts.PTS)  # -> XComponent, YComponent, ZComponent
smaller = SmallerThan(FirstNumber=pdecon_2.ZComponent, SecondNumber=pdecon.ZComponent)  # -> SmallerThan, OrEqualTo
dispatch = Dispatch(List=pull.Distance, DispatchPattern=smaller.SmallerThan)  # -> ListA, ListB
dom_7 = ConstructDomain(DomainStart=Slider(1, range=0..1), DomainEnd=Slider(0, range=0..100))
bnd = Bounds(Numbers=dispatch.ListB)
lng_3 = ListLength(List=dispatch.ListA)
remap = RemapNumbers(Value=dispatch.ListB, Source=bnd, Target=dom_7)  # -> Mapped, Clipped
repeat = RepeatData(Data=Slider(0, range=0..100), Length=lng_3)
graph = GraphMapper(remap.Mapped, x0=0, x1=1, y0=0, y1=1, container_name="Bezier", cpx=[0, 1, 1, 1], cpy=[0, 0, 0.07525634766, 1])
weave = Weave(Pattern=smaller.SmallerThan, Stream0=graph, Stream1=repeat, NullGaps=False)

# ----
# Height Field Values
pt_4 = Point(fieldpts.PTS)
pdecon_3 = Deconstruct(Point=pt_4)  # -> XComponent, YComponent, ZComponent
bnd_2 = Bounds(Numbers=pdecon_3.ZComponent)
dom_8 = ConstructDomain(DomainStart=Slider(1, range=0..2), DomainEnd=Slider(0, range=0..2))
remap_2 = RemapNumbers(Value=pdecon_3.ZComponent, Source=bnd_2, Target=dom_8)  # -> Mapped, Clipped
graph_2 = GraphMapper(
    remap_2.Mapped,
    x0=0,
    x1=1,
    y0=0,
    y1=1,
    container_name="Bezier",
    cpx=[0, 0.7958096862, 0.2282104492, 1],
    cpy=[0, 0.1180641651, 1, 1])

# ----
# Surface Slope Field Values (Not used here)
geo_16 = Geometry(geo_7)  # disabled
pt_5 = Point(fieldpts.PTS)  # disabled
# Any Additional Fields
toggle_4 = GroupToggle(ToggleActive=True, ToggleVisible=False)  # disabled
srf_cp = SurfaceClosestPoint(Point=pt_5, Surface=geo_16)  # -> Point, UVPoint, Distance; disabled
evalsrf = EvaluateSurface(Surface=geo_16, Point=srf_cp.UVPoint)  # -> Point, Normal, UDirection, VDirection, Frame; disabled
Z_18 = UnitZ(Factor=1)  # disabled
angle = Angle(VectorA=Z_18, VectorB=evalsrf.Normal)  # -> Angle, Reflex; disabled
bnd_3 = Bounds(Numbers=angle.Angle)  # disabled
panel_32 = Panel("1 To 0")  # disabled
remap_3 = RemapNumbers(Value=angle.Angle, Source=bnd_3, Target=panel_32)  # -> Mapped, Clipped; disabled
graph_3 = GraphMapper(remap_3.Mapped, x0=0, x1=1, y0=0, y1=1, container_name="Bezier", cpx=[0, 0.25, 0.75, 1], cpy=[0, 0.25, 0.75, 1])  # disabled

# ----
# Curve Field Values
project_2 = Project(Curve=crv, Brep=geo_8, Direction=Vector(0, 0, 1))
pt_6 = Point(fieldpts.PTS)
pull_2 = PullPoint(Point=pt_6, Geometry=flatten(project_2), ClosestOnly=True)  # -> ClosestPoint, Distance
bnd_4 = Bounds(Numbers=dispatch.ListB)
dom_9 = ConstructDomain(DomainStart=Slider(2, range=0..5), DomainEnd=Slider(0, range=0..100))
remap_4 = RemapNumbers(Value=pull_2.Distance, Source=bnd_4, Target=dom_9)  # -> Mapped, Clipped
graph_4 = GraphMapper(
    remap_4.Mapped,
    x0=0,
    x1=1,
    y0=0,
    y1=1,
    container_name="Bezier",
    cpx=[0, 0, 1, 1],
    cpy=[0, 0.9295432568, 0, 0.7858442664])

# ----
# Second Phase Aggregation Field
curvepoint = PointOnCurve(project_2, parameter=0)
pull_3 = PullPoint(Point=pt_6, Geometry=flatten(curvepoint), ClosestOnly=True)  # -> ClosestPoint, Distance
bnd_5 = Bounds(Numbers=pull_3.Distance)

lng_4 = ListLength(List=dispatch.ListB)
repeat_2 = RepeatData(Data=Slider(1, range=0..1), Length=lng_4)

remap_5 = RemapNumbers(Value=pull_3.Distance, Source=bnd_5, Target=dom_3)  # -> Mapped, Clipped
multiplication_2 = Multiplication(A=weave, B=Slider(1.5, range=0..10))
gradient_2 = Gradient(
    LowerLimit=0,
    UpperLimit=1,
    Parameter=graph_3,
    stops=[0: RGB(184, 184, 184), 0.307: RGB(255, 153, 0), 0.824: RGB(153, 0, 0)])

# ---- group: Preview Field Points
gradient_3 = Gradient(LowerLimit=0, UpperLimit=1, Parameter=graph_3, stops=[0: RGB(255, 0, 0), 0.5: RGB(255, 255, 0), 1: RGB(0, 128, 0)])
preview_13 = CustomPreview(Geometry=evalsrf.Point, Material=gradient_2)  # disabled

# ----
multiplication_3 = Multiplication(A=graph_2, B=Slider(0.75, range=0..10))
multiplication_4 = Multiplication(A=graph_4, B=Slider(1, range=0..10))

pull_4 = PullPoint(Point=fieldpts.PTS, Geometry=project_2, ClosestOnly=True)  # -> ClosestPoint, Distance
dom_10 = ConstructDomain(DomainStart=Slider(0, range=0..1), DomainEnd=Slider(3, range=0..100))
bnd_6 = Bounds(Numbers=pull_4.Distance)
remap_6 = RemapNumbers(Value=pull_4.Distance, Source=bnd_6, Target=dom_10)  # -> Mapped, Clipped
graph_5 = GraphMapper(remap_6.Mapped, x0=0, x1=1, y0=0, y1=1, container_name="Bezier", cpx=[0, 0.3561567962, 1, 1], cpy=[0, 0.287869513, 0, 1])

gradient_4 = Gradient(
    LowerLimit=0,
    UpperLimit=1,
    Parameter=multiplication_2,
    stops=[0: RGB(69, 69, 69), 0.307: RGB(255, 153, 0), 0.824: RGB(153, 0, 0)])

# ---- group: Preview Field Points
gradient_5 = Gradient(
    LowerLimit=0,
    UpperLimit=1,
    Parameter=multiplication_2,
    stops=[0: RGB(0, 128, 0), 0.5: RGB(255, 255, 0), 1: RGB(255, 0, 0)])
preview_14 = CustomPreview(Geometry=fieldpts.PTS, Material=gradient_4)

# ----
gradient_6 = Gradient(
    LowerLimit=0,
    UpperLimit=1,
    Parameter=multiplication_4,
    stops=[0: RGB(69, 69, 69), 0.307: RGB(255, 153, 0), 0.824: RGB(153, 0, 0)])

# ---- group: Preview Field Points
gradient_7 = Gradient(
    LowerLimit=0,
    UpperLimit=1,
    Parameter=multiplication_4,
    stops=[0: RGB(0, 128, 0), 0.5: RGB(255, 255, 0), 1: RGB(255, 0, 0)])
preview_15 = CustomPreview(Geometry=pt_6, Material=gradient_6)

# ----
gradient_8 = Gradient(
    LowerLimit=0,
    UpperLimit=1,
    Parameter=multiplication_3,
    stops=[0: RGB(69, 69, 69), 0.307: RGB(255, 153, 0), 0.824: RGB(153, 0, 0)])

# ---- group: Preview Field Points
gradient_9 = Gradient(
    LowerLimit=0,
    UpperLimit=1,
    Parameter=multiplication_3,
    stops=[0: RGB(0, 128, 0), 0.5: RGB(255, 255, 0), 1: RGB(255, 0, 0)])
preview_16 = CustomPreview(Geometry=pt_4, Material=gradient_8)

# ---- group: Combining Fields Inputs
multiplication_5 = Multiplication(A=multiplication_2, B=multiplication_4, C=multiplication_3)

# ---- group: Preview Field Points
gradient_10 = Gradient(LowerLimit=0, UpperLimit=1, Parameter=graph_5, stops=[0: RGB(0, 128, 0), 0.5: RGB(255, 255, 0), 1: RGB(255, 0, 0)])
preview_17 = CustomPreview(Geometry=fieldpts.PTS, Material=gradient_10)  # disabled

# ----
multiplication_6 = Multiplication(A=multiplication_5, B=Slider(2.03, range=0..10))
multiplication_7 = Multiplication(A=graph_5)

# ---- group: Preview Field Points
# Combined
# Fields
gradient_11 = Gradient(
    LowerLimit=0,
    UpperLimit=1,
    Parameter=multiplication_6,
    stops=[0: RGB(0, 128, 0), 0.5: RGB(255, 255, 0), 1: RGB(255, 0, 0)])
preview_18 = CustomPreview(Geometry=fieldpts.PTS, Material=gradient_11)

# ----
gradient_12 = Gradient(
    LowerLimit=0,
    UpperLimit=1,
    Parameter=multiplication_6,
    stops=[0: RGB(69, 69, 69), 0.307: RGB(255, 153, 0), 0.824: RGB(153, 0, 0)])

# ---- group: Preview Field Points
gradient_13 = Gradient(
    LowerLimit=0,
    UpperLimit=1,
    Parameter=multiplication_7,
    stops=[0: RGB(0, 128, 0), 0.5: RGB(255, 255, 0), 1: RGB(255, 0, 0)])
preview_19 = CustomPreview(Geometry=fieldpts.PTS, Material=gradient_13)  # disabled

# ----
field = Wasp_Field(E_FIELD=fieldpts.E_FIELD, VAL=multiplication_5)  # -> FIELD; inputs VAL: list; plug-in component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

field_2 = Wasp_Field(NAME="Field02", E_FIELD=fieldpts.E_FIELD, VAL=multiplication_7)  # -> FIELD; inputs VAL: list; plug-in component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
crv_11 = Curve(project_2)

# ----
# Aggregation Starting Point
curvepoint_2 = PointOnCurve(crv_11, parameter=0.976)
volume_4 = Volume(Geometry=part_geometry_4)  # -> Volume, Centroid
vec2pt = Vector2Pt(PointA=volume_4.Centroid, PointB=curvepoint_2, Unitize=False)  # -> Vector, Length
move_11 = Move(Motion=vec2pt.Vector)  # -> Geometry, Transform

rotate = Rotate(Angle=degrees(Slider(225, range=0..360)), Plane=volume_4.Centroid)  # -> Geometry, Transform
parttr = Wasp_TransformPart(PART=part_4, TR=rotate.Transform)  # -> PART_OUT; inputs TR: Transform; plug-in component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

parttr_2 = Wasp_TransformPart(PART=parttr, TR=move_11.Transform)  # -> PART_OUT; inputs TR: Transform; plug-in component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
parttr_3 = Wasp_TransformPart(PART=parttr_2, TR=move_2.Transform)  # -> PART_OUT; inputs TR: Transform; plug-in component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

partgeo = Wasp_GetPartGeometry(PART=parttr_3)  # -> GEO; plug-in component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

# ----
# Aggregation and Rules (Grammar)
p_p_2 = Panel("""OCT_SIDE_L>CUBE_SIDE
CUBE_SIDE>OCT_SIDE_R
CUBE_BOTTOM>CUBE_TOP""")
rulegen_2 = Wasp_RulesGenerator(PART=merge_13, GR=p_p_2)  # -> R; inputs PART: list, SELF_P: Boolean, SELF_C: Boolean, TYP: Boolean, GR: list; plug-in component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
fieldaggregation = Wasp_FieldDrivenAggregation(
    PART=flatten(merge_13),
    PREV=parttr_3,
    N=Slider(144, range=0..1200),
    RULES=rulegen_2,
    FIELD=field,
    MODE=Slider(2, range=0..3),
    GC=meshconst,
    RESET=Button())  # -> AGGR, PART_OUT; inputs PART: list, PREV: list, N: Int32, RULES: list, FIELD: list, MODE: Int32, GC: list, RESET: Boolean; plug-in component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

# ----
# Saved Aggregations
toggle_5 = GroupToggle(ToggleActive=True, ToggleVisible=False)  # disabled
panel_33 = Panel("D:\FAD\MaCAD\Studio 2\Models\Wasp Exploration\Saved Aggregations")
path = FilePath(panel_33)
saveaggr = Wasp_SaveAggregationToFile(AGGR=fieldaggregation.AGGR, PATH=path, NAME="12 Feb - Main_Midterm", SAVE=Button())  # -> TXT, FILE; inputs SAVE: Boolean; plug-in component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
loadaggr = Wasp_LoadAggregationFromFile(PART=merge_13, FILE=saveaggr.FILE)  # -> PART_OUT; inputs PART: list, RENUM: Boolean; plug-in component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
partgeo_2 = Wasp_GetPartGeometry(PART=loadaggr)  # -> GEO; plug-in component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

cull_i = CullIndex(List=partgeo_2, Indices=range, Wrap=True)

# ----
# Output Preview
number_slider_21 = Slider(-1.73, range=-10..0)
Z_19 = UnitZ(Factor=number_slider_21)
move_12 = Move(Motion=Z_19)  # -> Geometry, Transform
parttr_4 = Wasp_TransformPart(PART=loadaggr, TR=move_12.Transform)  # -> PART_OUT; inputs TR: Transform; plug-in component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
partgeo_3 = Wasp_GetPartGeometry(PART=parttr_4)  # -> GEO; plug-in component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
lng_5 = ListLength(List=partgeo_3)
series_5 = Series(Start=0, Step=1, Count=lng_5)
gradient_14 = Gradient(LowerLimit=0, UpperLimit=lng_5, Parameter=series_5, stops=[0: RGB(255, 255, 255), 1: RGB(135, 0, 0)])
swatch_3 = ColourSwatch(SwatchColor=RGB(255, 255, 255))
preview_20 = CustomPreview(Geometry=partgeo_3, Material=gradient_14)  # disabled

move_13 = Move(Motion=Z_19)  # -> Geometry, Transform
parttr_5 = Wasp_TransformPart(PART=fieldaggregation.PART_OUT, TR=move_13.Transform)  # -> PART_OUT; inputs TR: Transform; plug-in component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
partgeo_4 = Wasp_GetPartGeometry(PART=parttr_5)  # -> GEO; plug-in component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

# ----
# Handle with Care!
# 
# - Turn off before modifying the aggregation.
# - Turn off before modifying Kangaroo.
# Attributes  (Detailed Units)
toggle_6 = GroupToggle(ToggleActive=True, ToggleVisible=False)  # disabled
panel_34 = Panel("UNITC")  # disabled
panel_35 = Panel("UNITO")  # disabled
getattr_2 = Wasp_GetAttributeByName(PART=loadaggr, ID=panel_34)  # -> VAL; disabled; plug-in component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
getattr_3 = Wasp_GetAttributeByName(PART=loadaggr, ID=panel_35)  # -> VAL; disabled; plug-in component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
move_14 = Move(Geometry=getattr_2, Motion=Z_19)  # -> Geometry, Transform; disabled
swatch_4 = ColourSwatch(SwatchColor=RGB(166, 166, 166))  # disabled
swatch_5 = ColourSwatch(SwatchColor=RGB(163, 163, 163))  # disabled
move_15 = Move(Geometry=getattr_3, Motion=Z_19)  # -> Geometry, Transform; disabled

move_16 = Move(Geometry=crv_4, Motion=Z_19)  # -> Geometry, Transform

# ---- group: Units
geo_17 = Geometry(partgeo_4)

# ----
getattr_4 = Wasp_GetAttributeByName(PART=loadaggr, ID="BREP_O")  # -> VAL; plug-in component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
getattr_5 = Wasp_GetAttributeByName(PART=loadaggr, ID="BREP_C")  # -> VAL; plug-in component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
parttr_6 = Wasp_TransformPart(PART=loadaggr, TR=move_3.Transform)  # -> PART_OUT; inputs TR: Transform; plug-in component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
disc_5 = Discontinuity(Curve=move_16.Geometry, Level=1)  # -> Points, Parameters
partgeo_5 = Wasp_GetPartGeometry(PART=parttr_6)  # -> GEO; plug-in component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
dispatch_2 = Dispatch(List=disc_5.Points, DispatchPattern=panel_10)  # -> ListA, ListB
mjoin = MeshJoin(Meshes=geo_17)
avr = Average(Input=disc_5.Points)
index = ItemIndex(List=disc_5.Points, Item=dispatch_2.ListA)
move_17 = Move(Geometry=getattr_4, Motion=Z_19)  # -> Geometry, Transform
move_18 = Move(Geometry=getattr_5, Motion=Z_19)  # -> Geometry, Transform
mesh_15 = Mesh(mjoin)
preview_21 = CustomPreview(Geometry=move_14.Geometry, Material=swatch_4)
preview_22 = CustomPreview(Geometry=move_15.Geometry, Material=swatch_5)
explode = Explode(Curve=move_16.Geometry, Recursive=True)  # -> Segments, Vertices
angsplitmsh_2 = AngleSplitMesh(Mesh=partgeo_3, Angle=0, Opposite=False)  # -> Split, R
midpt = CurveMiddle(Curve=explode.Segments)
scale = Scale(Geometry=dispatch_2.ListA, Center=avr, Factor=Slider(0.31, range=0.01..1))  # -> Geometry, Transform
scale_2 = Scale(Geometry=disc_5.Points, Center=avr, Factor=Slider(0.41, range=0..1))  # -> Geometry, Transform
medges_10 = MeshEdges(Mesh=angsplitmsh_2.Split)  # -> NakedEdges, InteriorEdges, NonManifoldEdges
vmesh_2 = MeshToVolume(Mesh=mesh_15, Settings=vsettings_4)  # disabled
path_mapper = PathMapper(midpt, source="{A;B}(i)", target="{A;B;i}")
geo_18 = Geometry(medges_10.NakedEdges)
replace = ReplaceItems(List=scale_2.Geometry, Item=scale.Geometry, Indices=index, Wrap=False)
vdiff = VolumeDifference(VolumeA=vmesh, VolumesB=vmesh_2)  # disabled
merge_16 = Merge(Data1=move_17.Geometry, Data2=move_18.Geometry)
volume_5 = Volume(vdiff)
nurbs_5 = NurbsCurve(Vertices=replace, Degree=3, Periodic=True)  # -> Curve, Length, Domain
move_19 = Move(Geometry=path_mapper, Motion=Z_5)  # -> Geometry, Transform
mesh_16 = Mesh(volume_5)
null = NullItem(Item=merge_16)  # -> NullFlags, InvalidFlags, Description
path_mapper_2 = PathMapper(move_19.Geometry, source="{A;B;C}(i)", target="{A;B;i}(C)")
preview_23 = CustomPreview(Geometry=mesh_16, Material=ColourSwatch(SwatchColor=RGB(222, 115, 0)))  # disabled
cull_3 = CullPattern(List=merge_16, CullPattern=invert(null.NullFlags))  # -> flatten(List)
previewlw_3 = CustomPreviewLineweights(Geometry=geo_18, Shader=ColourSwatch(SwatchColor=RGB(0, 0, 0)), Thickness=Slider(1, range=0..100), Absolute=False)

scale_3 = Scale(Geometry=dispatch_2.ListA, Center=avr, Factor=Slider(0.77, range=0.01..1))  # -> Geometry, Transform
scale_4 = Scale(Geometry=disc_5.Points, Center=avr, Factor=Slider(1, range=0..1))  # -> Geometry, Transform
replace_2 = ReplaceItems(List=scale_4.Geometry, Item=scale_3.Geometry, Indices=index, Wrap=False)
Z_20 = UnitZ(Factor=Slider(-4, range=-20..0))
nurbs_6 = NurbsCurve(Vertices=replace_2, Degree=3, Periodic=True)  # -> Curve, Length, Domain
move_20 = Move(Geometry=nurbs_6.Curve, Motion=Z_20)  # -> simplify(Geometry), Transform

avr_2 = Average(Input=path_mapper_2)
lng_6 = ListLength(List=path_mapper_2)
random_2 = Random(Range=dom_5, Number=lng_6, Seed=2)
vec2pt_2 = Vector2Pt(PointA=path_mapper_2, PointB=avr_2, Unitize=False)  # -> Vector, Length
nurbs_7 = NurbsCurve(Vertices=disc_5.Points, Degree=3, Periodic=True)  # -> simplify(Curve), Length, Domain
circle = CircleCNR(Center=path_mapper_2, Normal=vec2pt_2.Vector, Radius=random_2)

number_slider_22 = Slider(3.25, range=0..10)  # disabled
area_2 = Area(Geometry=circle)  # -> Area, Centroid; disabled
scale_nu_2 = ScaleNU(Geometry=circle, Plane=area_2.Centroid, ScaleX=1, ScaleY=1, ScaleZ=number_slider_22)  # -> Geometry, Transform; disabled

amp_2 = Amplitude(Vector=vec2pt_2.Vector, Amplitude=expr("x*3", number_slider_4))
amp_3 = Amplitude(Vector=vec2pt_2.Vector, Amplitude=neg_2)
offset_7 = OffsetCurve(Curve=nurbs_7.Curve, Distance=Slider(0.23, range=0..1), Corners=1)  # -> simplify(Curve)
move_21 = Move(Geometry=nurbs_7.Curve, Motion=Z_7)  # -> simplify(Geometry), Transform
move_22 = Move(Geometry=nurbs_5.Curve, Motion=Z_6)  # -> simplify(Geometry), Transform
move_23 = Move(Geometry=circle, Motion=amp_3)  # -> Geometry, Transform
move_24 = Move(Geometry=offset_7, Motion=Z_6)  # -> Geometry, Transform
merge_17 = Merge(Data1=nurbs_7.Curve, Data2=move_21.Geometry, Data3=move_20.Geometry, Data4=move_22.Geometry)
merge_18 = Merge(Data1=offset_7, Data2=move_24.Geometry)
extr_3 = Extrude(Base=move_23.Geometry, Direction=amp_2)
loft_2 = Loft(
    Curves=[move_22.Geometry, move_24.Geometry],
    Options={Adjust=False, Closed=False, LoftEnds=0, LoftSimp=1, LoftType=2, Rebuild=100, Refit=0.01})
loft_3 = Loft(Curves=merge_18, Options={Adjust=False, Closed=False, LoftEnds=0, LoftSimp=1, LoftType=2, Rebuild=100, Refit=0.01})
loft_4 = Loft(Curves=merge_17, Options={Adjust=False, Closed=False, LoftEnds=0, LoftSimp=1, LoftType=2, Rebuild=100, Refit=0.01})
loft_5 = Loft(
    Curves=[nurbs_7.Curve, offset_7],
    Options={Adjust=False, Closed=False, LoftEnds=0, LoftSimp=1, LoftType=2, Rebuild=100, Refit=0.01})
cap_2 = CapHoles(Brep=extr_3)  # -> flatten(Brep)
cap_3 = CapHoles(Brep=loft_3)  # -> flatten(Brep); disabled
merge_19 = Merge(Data1=loft_4, Data2=loft_5, Data3=loft_2, Data4=loft_3)
join_2 = BrepJoin(Breps=merge_19)  # -> Breps, Closed
mesh_17 = MeshBrep(
    Brep=cap_3,
    Settings={GridMaxCount=0, GridMinCount=16, JaggedSeams=False, MaxEdgeLength=0, MinEdgeLength=0.0001, MinTolerance=0, Refine=True, RefineAngle=0, RelativeTolerance=0.65, SimplePlanes=True, Tolerance=0})
brep_10 = Brep(cull_3)  # disabled
sdiff = SolidDifference(BrepsA=offsrf_2, BrepsB=cap_3)
vmesh_3 = MeshToVolume(Mesh=mesh_17, Settings=vsettings_6)
edges = BrepEdges(Brep=brep_10)  # -> Naked, Interior, NonManifold
vdiff_2 = VolumeDifference(VolumeA=volume_5, VolumesB=vmesh_3)

sdiff_2 = SolidDifference(BrepsA=sdiff, BrepsB=brep_10)
preview_24 = CustomPreview(Geometry=sdiff_2, Material=ColourSwatch(SwatchColor=RGB(212, 212, 212)))

sdiff_3 = SolidDifference(BrepsA=join_2.Breps, BrepsB=cap_2)  # disabled
crv_12 = Curve(edges.Interior)
volume_6 = Volume(vdiff_2)
mesh_18 = Mesh(volume_6)
contour_3 = Contour(Shape=loft_4, Point=Point(0, 0, 0), Direction=Z_8, Distance=Slider(0.14, range=0.05..0.2))  # disabled
preview_25 = CustomPreview(Geometry=join_2.Breps, Material=ColourSwatch(SwatchColor=RGB(181, 136, 101)))
preview_26 = CustomPreview(Geometry=mesh_18, Material=ColourSwatch(SwatchColor=RGB(222, 115, 0)))

triremesh_2 = TriRemesh(Geometry=mesh_10, Iterations=25)  # -> Triangulation, Dual, Creases
# Terrain
medges_11 = MeshEdges(Mesh=triremesh_2.Triangulation)  # -> NakedEdges, InteriorEdges, NonManifoldEdges
dom_11 = ConstructDomain(DomainStart=Slider(0.34, range=0..1), DomainEnd=Slider(0.84, range=0..1))
dom_12 = ConstructDomain(DomainStart=Slider(0.32, range=0..1), DomainEnd=Slider(0.71, range=0..1))
dom²_2 = ConstructDomain²(DomainU=dom_11, DomainV=dom_12)

item_8 = ListItem(List=triremesh_2.Triangulation, Index="1", Wrap=True)
Z_21 = UnitZ(Factor=1)
move_25 = Move(Geometry=item_8, Motion=Z_21)  # -> Geometry, Transform
medges_12 = MeshEdges(Mesh=move_25.Geometry)  # -> NakedEdges, InteriorEdges, NonManifoldEdges
previewlw_4 = CustomPreviewLineweights(
    Geometry=medges_12.NakedEdges,
    Shader=ColourSwatch(SwatchColor=RGB(0, 0, 0)),
    Thickness=Slider(2, range=0..100),
    Absolute=False)

contour_4 = Contour(Shape=item_8, Point=Point(0, 0, 0), Direction=Vector(0, 0, 1), Distance=Slider(1, range=0..50))
patch_2 = Patch(Curves=flatten(contour_4), Spans=20, Flexibility=1, Trim=True)

preview_27 = CustomPreview(Geometry=item_8, Material=ColourSwatch(SwatchColor=RGB(194, 194, 194)))  # disabled
subsrf_2 = Isotrim(Surface=patch_2, Domain=dom²_2)

offsrf_4 = OffsetSurface(Surface=subsrf_2, Distance=Slider(-25, range=-100..0), BothSides=0, CreateSolid=True)
contour_5 = Contour(Shape=subsrf_2, Point=Point(0, 0, 0), Direction=Vector(0, 0, 1), Distance=Slider(1, range=0..50))

brep_11 = Brep(offsrf_4)
sdiff_4 = SolidDifference(BrepsA=brep_11, BrepsB=sunion)
preview_28 = CustomPreview(Geometry=sdiff_4, Material=ColourSwatch(SwatchColor=RGB(255, 255, 255)))

sunion_2 = SolidUnion(Breps=flatten(entwine))
xy_4 = XYPlane(Origin=pt)
sec = BrepPlane(Brep=sunion_2, Plane=xy_4)  # -> Curves, Points
number_slider_23 = Slider(1, range=0..300)

# ---- group: View Lines
project_3 = Project(Geometry=pt, Plane=PlaneXY(0, 0, 0))  # -> Geometry, Transform
ivist = IsoVist(Plane=pt, Count=Slider(24, range=0..300), Radius=Slider(13.5, range=0.1..30), Obstacles=flatten(sec.Curves))  # -> Points, Distance, Index
pline = PolyLine(Vertices=ivist.Points, Closed=True)
simplify = SimplifyCurve(Curve=pline, Tolerance=Slider(0.5, range=0..10), AngleTolerance=Slider(25, range=0..100))  # -> Curve, Simplified
explode_2 = Explode(Curve=simplify.Curve, Recursive=True)  # -> Segments, Vertices
curvepoint_3 = PointOnCurve(explode_2.Segments, parameter=0.498)

# ----
boundary_3 = BoundarySurfaces(Edges=pline)
ln = Line(StartPoint=graft(pt), EndPoint=curvepoint_3)
previewlw_5 = CustomPreviewLineweights(Geometry=pline, Shader=ColourSwatch(SwatchColor=RGB(186, 0, 0)), Thickness=Slider(11, range=0..100), Absolute=False)
preview_29 = CustomPreview(Geometry=boundary_3, Material=ColourSwatch(SwatchColor=RGB(150, 92, 92)))  # disabled

disc_6 = Discontinuity(Curve=crv_6, Level=1)  # -> Points, Parameters
# Kangaroo (One Cell)
toggle_7 = GroupToggle(ToggleActive=True, ToggleVisible=False)  # disabled
avr_3 = Average(Input=disc_6.Points)
ln_2 = Line(StartPoint=disc_6.Points, EndPoint=avr_3)
number_slider_24 = Slider(0, range=0..2)
ext = ExtendCurve(Curve=ln_2, Type=number_slider_24, Start=number_slider_24, End=Slider(-0.4, range=-1..0))
shift_3 = ShiftList(List=ext, Shift=1, Wrap=True)
rulesrf = RuledSurface(CurveA=shift_3, CurveB=ext)
mesh_uv_2 = MeshSurface(Surface=rulesrf, UCount=Slider(15, range=1..30), VCount=Slider(3, range=1..30), Overhang=True, Equalize=False)
mjoin_2 = MeshJoin(Meshes=mesh_uv_2)
weldvertices = MeshWeldVertices(Mesh=mjoin_2, Tolerance=0.01)  # -> RuntimeMessage, Mesh
nv_2 = NakedVertices(Mesh=weldvertices.Mesh)  # -> ClothedIndex, NakedIndex, ClothedPts, NakedPts
medges_13 = MeshEdges(Mesh=weldvertices.Mesh)  # -> NakedEdges, InteriorEdges, NonManifoldEdges
demesh_2 = DeconstructMesh(Mesh=weldvertices.Mesh)  # -> Vertices, Faces, Colours, Normals
midpt_2 = CurveMiddle(Curve=medges_13.NakedEdges)
avr_4 = Average(Input=midpt_2)
pull_5 = PullPoint(Point=nv_2.NakedPts, Geometry=crv_6, ClosestOnly=True)  # -> ClosestPoint, Distance
dist = Distance(PointA=midpt_2, PointB=avr_4)
smaller_2 = SmallerThan(FirstNumber=dist, SecondNumber=Slider(3.18, range=0..5))  # -> SmallerThan, OrEqualTo
smaller_3 = SmallerThan(FirstNumber=pull_5.Distance, SecondNumber=Slider(0.1, range=0.1..0.11))  # -> SmallerThan, OrEqualTo
cull_4 = CullPattern(List=medges_13.NakedEdges, CullPattern=smaller_2.SmallerThan)
len_3 = Length(Curve=medges_13.InteriorEdges)
cull_5 = CullPattern(List=nv_2.NakedPts, CullPattern=invert(smaller_3.SmallerThan))
cull_6 = CullPattern(List=nv_2.NakedPts, CullPattern=smaller_3.SmallerThan)
Z_22 = UnitZ(Factor=Slider(-3, range=-6..0))
len_4 = Length(Curve=cull_4)
move_26 = Move(Geometry=cull_5, Motion=Z_22)  # -> Geometry, Transform
vec_2 = VectorXYZ(XComponent=Slider(0, range=-10..10), YComponent=0, ZComponent=Slider(2.71, range=0..10))  # -> Vector, Length
anchor_2 = Anchor(Point=cull_6, Strength=10000)
anchor_3 = Anchor(Point=cull_5, Target=move_26.Geometry, Strength=10000)
load_2 = Load(Point=demesh_2.Vertices, ForceVector=vec_2.Vector, Weighting=1)
show_2 = Show(G=weldvertices.Mesh)

# ---- group: All other segments
multiplication_8 = Multiplication(A=len_3, B=Slider(0, range=0..1))
length_line_2 = LengthLine(Line=medges_13.InteriorEdges, Length=multiplication_8, Strength=Slider(30, range=0..100))

# ---- group: Central Ring
multiplication_9 = Multiplication(A=len_4, B=Slider(0, range=0..1))
length_line_3 = LengthLine(Line=cull_4, Length=multiplication_9, Strength=Slider(10000, range=0..10000))

# ----
entwine_3 = Entwine(
    Branch00=show_2,
    Branch01=length_line_2,
    Branch02=length_line_3,
    Branch03=load_2,
    Branch04=anchor_2,
    Branch05=anchor_3,
    FlattenInputs=True)
bouncysolver_2 = BouncySolver(GoalObjects=entwine_3, Reset=Button(), Threshold=1e-15, Tolerance=0.0001, Damping=0.99, Iterations=10, On=Toggle(False))  # -> I, V, O
item_9 = ListItem(List=bouncysolver_2.O, Index=0, Wrap=True)

medges_14 = MeshEdges(Mesh=item_9)  # -> NakedEdges, InteriorEdges, NonManifoldEdges
preview_30 = CustomPreview(Geometry=item_9, Material=ColourSwatch(SwatchColor=RGBA(255, 255, 255, 172)))
toggle_8 = GroupToggle(ToggleActive=True, ToggleVisible=False)  # disabled

previewlw_6 = CustomPreviewLineweights(Geometry=medges_14.InteriorEdges, Shader=ColourSwatch(SwatchColor=RGB(0, 0, 0)), Absolute=False)

# ----
# Roofs Attempts
boundary_4 = BoundarySurfaces(Edges=item_3.Item1)  # disabled
disc_7 = Discontinuity(Curve=item_3.Item1, Level=1)  # -> Points, Parameters; disabled
number_slider_25 = Slider(1, range=0..10)  # disabled
toggle_9 = GroupToggle(ToggleActive=True, ToggleVisible=False)  # disabled
mesh_19 = MeshBrep(
    Brep=boundary_4,
    Settings={GridMaxCount=0, GridMinCount=16, JaggedSeams=False, MaxEdgeLength=0, MinEdgeLength=0.0001, MinTolerance=0, Refine=True, RefineAngle=0, RelativeTolerance=0.65, SimplePlanes=True, Tolerance=0})  # disabled
triremesh_3 = TriRemesh(Geometry=mesh_19, Length=number_slider_25, Iterations=25)  # -> Triangulation, Dual, Creases; disabled
nv_3 = NakedVertices(Mesh=triremesh_3.Triangulation)  # -> ClothedIndex, NakedIndex, ClothedPts, NakedPts; disabled
medges_15 = MeshEdges(Mesh=triremesh_3.Triangulation)  # -> NakedEdges, InteriorEdges, NonManifoldEdges; disabled
demesh_3 = DeconstructMesh(Mesh=triremesh_3.Triangulation)  # -> Vertices, Faces, Colours, Normals; disabled
len_5 = Length(Curve=medges_15.InteriorEdges)  # disabled
number_slider_26 = Slider(0, range=-10..10)  # disabled
number_slider_27 = Slider(2.71, range=0..10)  # disabled
vec_3 = VectorXYZ(XComponent=number_slider_26, YComponent=0, ZComponent=number_slider_27)  # -> Vector, Length; disabled
anchor_4 = Anchor(Point=nv_3.NakedPts, Strength=10000)  # disabled
load_3 = Load(Point=demesh_3.Vertices, ForceVector=vec_3.Vector, Weighting=1)  # disabled
show_3 = Show(G=triremesh_3.Triangulation)  # disabled
toggle_10 = BooleanToggle(False)  # disabled
button_2 = Button()  # disabled

# ---- group: All other segments
number_slider_28 = Slider(0, range=0..1)  # disabled
number_slider_29 = Slider(18, range=0..100)  # disabled
multiplication_10 = Multiplication(A=len_5, B=number_slider_28)  # disabled
length_line_4 = LengthLine(Line=medges_15.InteriorEdges, Length=multiplication_10, Strength=number_slider_29)  # disabled

# ----
entwine_4 = Entwine(Branch00=show_3, Branch01=length_line_4, Branch02=load_3, Branch03=anchor_4, FlattenInputs=True)  # disabled
bouncysolver_3 = BouncySolver(GoalObjects=entwine_4, Reset=button_2, Threshold=1e-15, Tolerance=0.0001, Damping=0.99, Iterations=10, On=toggle_10)  # -> I, V, O; disabled
item_10 = ListItem(List=bouncysolver_3.O, Index=0, Wrap=True)  # disabled
medges_16 = MeshEdges(Mesh=item_10)  # -> NakedEdges, InteriorEdges, NonManifoldEdges; disabled

preview_31 = CustomPreview(Geometry=[item_6, item_10], Material=ColourSwatch(SwatchColor=RGB(255, 194, 194)))  # disabled

# ----
# Roof (All Pavilions)
boundary_5 = BoundarySurfaces(Edges=projecta.Geometry)
mesh_20 = MeshBrep(
    Brep=boundary_5,
    Settings={GridMaxCount=0, GridMinCount=16, JaggedSeams=False, MaxEdgeLength=0, MinEdgeLength=0.0001, MinTolerance=0, Refine=True, RefineAngle=0, RelativeTolerance=0.65, SimplePlanes=True, Tolerance=0})
triremesh_4 = TriRemesh(Geometry=mesh_20, Length=Slider(1, range=0..1), Iterations=25)  # -> Triangulation, Dual, Creases
genes = GenePool(Decimals=2, Maximum=10, Minimum=-15, Value=[-9.7, -7.85, -6.41, -3.5, -4.41, -5.8, -9.65])
number_slider_30 = Slider(-9.895, range=-20..10)
nv_4 = NakedVertices(Mesh=triremesh_4.Triangulation)  # -> ClothedIndex, NakedIndex, ClothedPts, NakedPts
Z_23 = UnitZ(Factor=genes)
vec_4 = VectorXYZ(XComponent=Slider(0, range=-10..10), YComponent=0, ZComponent=Slider(7.79, range=0..10))  # -> Vector, Length
edgelengths_2 = EdgeLengths(Mesh=triremesh_4.Triangulation, LengthFactor=Slider(0, range=0..1), Strength=Slider(14, range=0..100))
anchor_5 = Anchor(Point=nv_4.NakedPts, Strength=10000)
show_4 = Show(G=triremesh_4.Triangulation)
load_4 = Load(Point=nv_4.ClothedPts, ForceVector=vec_4.Vector, Weighting=1)

cp = ClosestPoint(Point=pt_3, Cloud=nv_4.ClothedPts)  # -> ClosestPoint, CPIndex, Distance

move_27 = Move(Geometry=cp.ClosestPoint, Motion=Z_23)  # -> Geometry, Transform
anchor_6 = Anchor(Point=cp.ClosestPoint, Target=move_27.Geometry, Strength=10000)
entwine_5 = Entwine(Branch00=show_4, Branch01=edgelengths_2, Branch02=load_4, Branch03=anchor_5, Branch04=anchor_6, FlattenInputs=True)
bouncysolver_4 = BouncySolver(GoalObjects=entwine_5, Reset=Button(), Threshold=1e-15, Tolerance=0.0001, Damping=0.99, Iterations=10, On=Toggle(False))  # -> I, V, O
item_11 = ListItem(List=bouncysolver_4.O, Index=0, Wrap=True)
medges_17 = MeshEdges(Mesh=item_11)  # -> NakedEdges, InteriorEdges, NonManifoldEdges
preview_32 = CustomPreview(Geometry=item_11, Material=ColourSwatch(SwatchColor=RGB(103, 117, 88)))  # disabled

previewlw_7 = CustomPreviewLineweights(
    Geometry=medges_17.InteriorEdges,
    Shader=ColourSwatch(SwatchColor=RGB(0, 0, 0)),
    Thickness=Slider(0.03, range=0..1),
    Absolute=True)
