# Grasshopper definition klein_1.gh (Grasshopper 1.0.7)
# plug-ins: Parakeet

crv = Curve([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])
line = Line(crv)
num = Number(line)
midpt = CurveMiddle(Curve=line)
end = EndPoints(Curve=line)  # -> Start, End
expression = Expression(m=num, Expression="(2/(-1+Sqrt(5)))*m")
vec2pt = Vector2Pt(PointA=end.Start, PointB=end.End, Unitize=False)  # -> Vector, Length
xy = XYPlane(Origin=midpt)
align = AlignPlane(Plane=xy, Direction=vec2pt.Vector)  # -> Plane, Angle
division = Division(A=expression, B=Slider(2, range=1..10))
neg = Negative(Value=division)
dom = ConstructDomain(DomainStart=neg, DomainEnd=division)
planesrf = PlaneSurface(Plane=align.Plane, XSize=dom, YSize=dom)

boxrec = BoxRectangle(Rectangle=planesrf, Height=expression)
tiling_f_sr = TruncatedTrihexagonal(Plane=PlaneXY(0, 0, 0), Size=1, ExtendX=<missing>, ExtendY=<missing>)
klein_surface = KleinSurface(UDivision=100, Radius1=<missing>, Radius2=<missing>)  # -> KleinSurface, KleinSurfacePoints, KleinSurfaceMesh
tiling_f_sr_2 = TruncatedTrihexagonal(Plane=PlaneXY(0, 0, 0), Size=1, ExtendX=<missing>, ExtendY=<missing>)
klein_surface_2 = KleinSurface(UDivision=100, Radius1=<missing>, Radius2=<missing>)  # -> KleinSurface, KleinSurfacePoints, KleinSurfaceMesh
_2tilinga = _2UniformTilingA(Plane=PlaneXY(0, 0, 0), Size=1, ExtendX=<missing>, ExtendY=<missing>)
starpatterni = StarPatternI(BaseGrid=tiling_f_sr, Angle=<missing>, Distance=<missing>, ShiftSize=0, BulgeFactor=0)
patterngenl_pt = PatternGenotypeLPT(BasePolylines=tiling_f_sr_2, RotationFactor=<missing>, ScaleFactor=<missing>)
quadsubm = MirroredSubdivideQuad(BasePolylineS=<missing>, Mirror=True)
starpatterni_2 = StarPatternI(BaseGrid=_2tilinga, Angle=<missing>, Distance=<missing>, ShiftSize=0, BulgeFactor=0)
patterngene = PatternGenotypeE(BasePolylines=quadsubm, Factor=<missing>)
