# Grasshopper definition units-forfinal before taking them out of the script assembled.gh (Grasshopper 1.0.7)
# plug-ins: Pufferfish

brep = Brep()
volume = Volume(Geometry=brep)  # -> Volume, Centroid
cull_i = CullIndex(List=volume.Centroid, Wrap=True)

# ---- group: units centroids
pt = Point(volume.Centroid)

# ----
volume_2 = Volume()  # -> Volume, Centroid; disabled
group = Group()  # disabled
group_2 = Group()  # disabled
group_3 = Group()  # disabled
group_4 = Group(Objects=flatten([group, group_2]))  # disabled

# ---- group: units centroids
pt_2 = Point(volume_2.Centroid)  # disabled

# ----
group_5 = Group()  # disabled
group_6 = Group()  # disabled

number_slider = Slider(0.7, range=0..2.02)  # disabled
number_slider_2 = Slider(2, range=1..13)  # disabled
number_slider_3 = Slider(1.5, range=0..6.002)  # disabled
number_slider_4 = Slider(1.5, range=1..2)  # disabled
range = Range(Domain=number_slider_3, Steps=number_slider_4)  # disabled
range_2 = Range(Domain=Domain(0, 1), Steps=number_slider_4)  # disabled
graph = GraphMapper(range_2, x0=0, x1=1, y0=0, y1=1, container_name="Bezier", cpx=[0, 0.5185281634, 1, 1], cpy=[0, 0, 0.1436586976, 1])  # disabled
pt_3 = ConstructPoint(XCoordinate=0, YCoordinate=0, ZCoordinate=range)  # disabled
panel = Panel("0.5*pi")  # disabled
dom = ConstructDomain(DomainStart=number_slider_2, DomainEnd=number_slider)  # disabled
bnd = Bounds(Numbers=graph)  # disabled
prot = RotatePlane(Plane=pt_3, Angle=panel)  # disabled
remap = RemapNumbers(Value=graph, Source=bnd, Target=dom)  # -> Mapped, Clipped; disabled
cir = Circle(Plane=pt_3, Radius=remap.Mapped)  # disabled
item = ListItem(List=cir, Index=0, Wrap=True)  # disabled
number_slider_5 = Slider(4, range=0..50)  # disabled
area = Area(Geometry=item)  # -> Area, Centroid; disabled
number_slider_6 = Slider(0.01, range=0..1)  # disabled
range_3 = Range(Domain=Domain(0, 1), Steps=number_slider_5)  # disabled
panel_2 = Panel("1")  # disabled
panel_3 = Panel("0")  # disabled
shatter = Shatter(Curve=reparameterize(graft(cir)), Parameters=range_3)  # disabled
subtraction = Subtraction(A=panel_2, B=number_slider_6)  # disabled
merge = Merge(Data1=panel_3, Data2=number_slider_6, Data3=subtraction, Data4=panel_2)  # disabled
consec = ConsecutiveDomains(Numbers=merge, Additive=invert(True))  # disabled
panel_4 = Panel(merge)  # disabled
subcrv = SubCurve(BaseCurve=reparameterize(graft(shatter)), Domain=consec)  # disabled
panel_5 = Panel("""0
2""")  # disabled
panel_6 = Panel(consec)  # disabled
cull_i_2 = CullIndex(List=subcrv, Indices=panel_5, Wrap=True)  # -> simplify(List); disabled
item_2 = ListItem(List=subcrv, Index=panel_5, Wrap=True)  # disabled
pshift = ShiftPaths(Data=cull_i_2, Offset=-1)  # disabled
flip = FlipMatrix(Data=pshift)  # disabled
midpt = CurveMiddle(Curve=flip)  # disabled
loft = Loft(Curves=cir, Options={Adjust=False, Closed=False, LoftEnds=0, LoftSimp=0, LoftType=0, Rebuild=10, Refit=0.01})  # disabled
number_slider_7 = Slider(0.1, range=0..10)  # disabled
number_slider_8 = Slider(0.11, range=0..1)  # disabled
pshift_2 = ShiftPaths(Data=item_2, Offset=-1)  # disabled
graph_2 = GraphMapper(range_2, x0=0, x1=1, y0=0, y1=1, container_name="Bezier", cpx=[0, 0.25, 0.75, 1], cpy=[0, 0.25, 0.75, 1])  # disabled
join = JoinCurves(Curves=pshift_2, Preserve=False)  # disabled
brep_cp = BrepClosestPoint(Point=midpt, Brep=loft)  # -> Point, Normal, Distance; disabled
dom_2 = ConstructDomain(DomainStart=number_slider_7, DomainEnd=number_slider_8)  # disabled
flip_2 = FlipMatrix(Data=join)  # disabled
bnd_2 = Bounds(Numbers=graph_2)  # disabled
remap_2 = RemapNumbers(Value=graph_2, Source=bnd_2, Target=dom_2)  # -> Mapped, Clipped; disabled
amp = Amplitude(Vector=brep_cp.Normal, Amplitude=remap_2.Mapped)  # disabled
rev = Reverse(Vector=amp)  # disabled
end = EndPoints(Curve=flip)  # -> Start, End; disabled
move = Move(Geometry=midpt, Motion=rev)  # -> Geometry, Transform; disabled
arc = Arc3Pt(PointA=end.Start, PointB=move.Geometry, PointC=end.End)  # -> Arc, Plane, Radius; disabled
item_3 = ListItem(List=arc.Arc, Index=0, Wrap=True)  # disabled
project = Project(Geometry=item_3, Plane=PlaneXY(0, 0, 0))  # -> Geometry, Transform; disabled
panel_7 = Panel("0")  # disabled
panel_8 = Panel("0.01")  # disabled
loft_opt = LoftOptions(Closed=False, Adjust=False, Rebuild=0, Refit=panel_8, Type=0)  # disabled
replace = ReplaceItems(List=arc.Arc, Item=project.Geometry, Indices=panel_7, Wrap=False)  # disabled
loft_2 = Loft(Curves=flip_2, Options=loft_opt)  # disabled
loft_3 = Loft(Curves=replace, Options=loft_opt)  # disabled
entwine = Entwine(Branch00=loft_3, Branch01=loft_2, FlattenInputs=True)  # disabled
number_slider_9 = Slider(0.01, range=0..1)  # disabled
swatch = ColourSwatch(SwatchColor=RGB(255, 255, 255))  # disabled
swatch_2 = ColourSwatch(SwatchColor=RGBA(107, 107, 107, 206))  # disabled
brep_2 = Brep()  # disabled
merge_2 = Merge(Data1=swatch_2, Data2=swatch)  # -> simplify(graft(Result)); disabled
python = GhPythonScript(S=entwine, D=number_slider_9)  # -> simplify(a); inputs S: Brep; disabled
# ---------- python: Python ----------
import rhinoscriptsyntax as rs

a = rs.OffsetSurface(S, D, None, False, True)
# ---------- end python ----------
flatten = FlattenTree(Tree=python, Path="{0}")  # disabled

number_slider_10 = Slider(0.1, range=0..10)  # disabled
panel_9 = Panel("-1")  # disabled
Z = UnitZ(Factor=expr("-x", number_slider_10))  # disabled
item_4 = ListItem(List=cir, Index=panel_9, Wrap=True)  # disabled
extr = Extrude(Base=item_4, Direction=Z)  # disabled
cap = CapHoles(Brep=extr)  # disabled

item_5 = ListItem(List=brep_2, Index=0, Wrap=True)  # disabled

volume_3 = Volume(Geometry=item_5)  # -> Volume, Centroid; disabled
move2pt = MoveToPoint(Geometry=flatten, PointA=area.Centroid, PointB=graft(volume_3.Centroid))  # -> simplify(Moved), Vector, Transform; disabled
lng = ListLength(List=move2pt.Moved)  # disabled
graft = GraftTree(Tree=volume_3.Centroid, IncludeEmptyLists=True, IncludeNullItems=True)  # -> simplify(Tree); disabled
group_7 = Group(Objects=move2pt.Moved)  # disabled
split = SplitList(List=move2pt.Moved, Index=expr("x/2", lng))  # -> flatten(ListA), flatten(ListB); disabled
mirror = Mirror(Geometry=group_7, Plane=graft)  # -> Geometry, Transform; disabled
ungroup = Ungroup(Group=mirror.Geometry)  # disabled
move2pt_2 = MoveToPoint(Geometry=cap, PointA=area.Centroid, PointB=graft(volume_3.Centroid))  # -> Moved, Vector, Transform; disabled
split_2 = SplitList(List=ungroup, Index=expr("x/2", lng))  # -> flatten(ListA), flatten(ListB); disabled
entwine_2 = Entwine(Branch00=split.ListA, Branch01=split.ListB, FlattenInputs=True)  # -> simplify(Result); disabled
entwine_3 = Entwine(Branch00=split_2.ListA, Branch01=split_2.ListB, FlattenInputs=True)  # -> simplify(Result); disabled
merge_3 = Merge(Data1=entwine_2, Data2=entwine_3)  # disabled

data = Data([split.ListB, split_2.ListB])  # disabled
data_2 = Data([split.ListA, split_2.ListA])  # disabled
qrmesh = QuadRemesh(Mesh=data_2, Settings={aqc=True, as=50, dhe=True, gci=0, null=False, pme=0, sa=0, tqc=2000})  # -> graft(QuadResult); disabled
qrmesh_2 = QuadRemesh(Mesh=data, Settings={aqc=True, as=50, dhe=True, gci=0, null=False, pme=0, sa=0, tqc=2000})  # disabled

# ---- group: unit centroid
pt_4 = Point(volume_3.Centroid)  # disabled

# ----
group_8 = Group(Objects=qrmesh)  # disabled
group_9 = Group(Objects=qrmesh_2)  # disabled
group_10 = Group(Objects=flatten([group_9, group_5]))  # disabled
move2pt_3 = MoveToPoint(Geometry=move2pt_2.Moved, PointA=pt_4, PointB=pt_2)  # -> flatten(Moved), Vector, Transform; disabled
move2pt_4 = MoveToPoint(Geometry=qrmesh_2, PointA=pt_4, PointB=graft(pt_2))  # -> flatten(Moved), Vector, Transform; disabled
move2pt_5 = MoveToPoint(Geometry=qrmesh, PointA=pt_4, PointB=pt_2)  # -> flatten(Moved), Vector, Transform; disabled
merge_4 = Merge(Data1=move2pt_3.Moved, Data2=move2pt_4.Moved)  # disabled

number_slider_11 = Slider(1.2, range=0..2.02)  # disabled
number_slider_12 = Slider(3.9, range=1..13)  # disabled
number_slider_13 = Slider(1.5, range=1..2)  # disabled
number_slider_14 = Slider(1.5, range=0..6.002)  # disabled
range_4 = Range(Domain=number_slider_14, Steps=number_slider_13)  # disabled
range_5 = Range(Domain=Domain(0, 1), Steps=number_slider_13)  # disabled
graph_3 = GraphMapper(range_5, x0=0, x1=1, y0=0, y1=1, container_name="Bezier", cpx=[0, 0.5185281634, 1, 1], cpy=[0, 0, 0.1436586976, 1])  # disabled
pt_5 = ConstructPoint(XCoordinate=0, YCoordinate=0, ZCoordinate=range_4)  # disabled
panel_10 = Panel("0.5*pi")  # disabled
dom_3 = ConstructDomain(DomainStart=number_slider_12, DomainEnd=number_slider_11)  # disabled
bnd_3 = Bounds(Numbers=graph_3)  # disabled
prot_2 = RotatePlane(Plane=pt_5, Angle=panel_10)  # disabled
remap_3 = RemapNumbers(Value=graph_3, Source=bnd_3, Target=dom_3)  # -> Mapped, Clipped; disabled
number_slider_15 = Slider(0.01, range=0..1)  # disabled
cir_2 = Circle(Plane=prot_2, Radius=remap_3.Mapped)  # disabled
item_6 = ListItem(List=cir_2, Index=0, Wrap=True)  # disabled
number_slider_16 = Slider(8, range=0..50)  # disabled
panel_11 = Panel("1")  # disabled
area_2 = Area(Geometry=item_6)  # -> Area, Centroid; disabled
panel_12 = Panel("0")  # disabled
subtraction_2 = Subtraction(A=panel_11, B=number_slider_15)  # disabled
range_6 = Range(Domain=Domain(0, 1), Steps=number_slider_16)  # disabled
merge_5 = Merge(Data1=panel_12, Data2=number_slider_15, Data3=subtraction_2, Data4=panel_11)  # disabled
shatter_2 = Shatter(Curve=reparameterize(graft(cir_2)), Parameters=range_6)  # disabled
consec_2 = ConsecutiveDomains(Numbers=merge_5, Additive=invert(True))  # disabled
panel_13 = Panel(merge_5)  # disabled
subcrv_2 = SubCurve(BaseCurve=reparameterize(graft(shatter_2)), Domain=consec_2)  # disabled
panel_14 = Panel("""0
2""")  # disabled
panel_15 = Panel(consec_2)  # disabled
cull_i_3 = CullIndex(List=subcrv_2, Indices=panel_14, Wrap=True)  # -> simplify(List); disabled
item_7 = ListItem(List=subcrv_2, Index=panel_14, Wrap=True)  # disabled
pshift_3 = ShiftPaths(Data=cull_i_3, Offset=-1)  # disabled
flip_3 = FlipMatrix(Data=pshift_3)  # disabled
midpt_2 = CurveMiddle(Curve=flip_3)  # disabled
loft_4 = Loft(Curves=cir_2, Options={Adjust=False, Closed=False, LoftEnds=0, LoftSimp=0, LoftType=0, Rebuild=10, Refit=0.01})  # disabled
number_slider_17 = Slider(0.1, range=0..10)  # disabled
number_slider_18 = Slider(0.11, range=0..1)  # disabled
pshift_4 = ShiftPaths(Data=item_7, Offset=-1)  # disabled
graph_4 = GraphMapper(range_5, x0=0, x1=1, y0=0, y1=1, container_name="Bezier", cpx=[0, 0.25, 0.75, 1], cpy=[0, 0.25, 0.75, 1])  # disabled
join_2 = JoinCurves(Curves=pshift_4, Preserve=False)  # disabled
brep_cp_2 = BrepClosestPoint(Point=midpt_2, Brep=loft_4)  # -> Point, Normal, Distance; disabled
dom_4 = ConstructDomain(DomainStart=number_slider_17, DomainEnd=number_slider_18)  # disabled
flip_4 = FlipMatrix(Data=join_2)  # disabled
bnd_4 = Bounds(Numbers=graph_4)  # disabled
remap_4 = RemapNumbers(Value=graph_4, Source=bnd_4, Target=dom_4)  # -> Mapped, Clipped; disabled
amp_2 = Amplitude(Vector=brep_cp_2.Normal, Amplitude=remap_4.Mapped)  # disabled
rev_2 = Reverse(Vector=amp_2)  # disabled
end_2 = EndPoints(Curve=flip_3)  # -> Start, End; disabled
move_2 = Move(Geometry=midpt_2, Motion=rev_2)  # -> Geometry, Transform; disabled
arc_2 = Arc3Pt(PointA=end_2.Start, PointB=move_2.Geometry, PointC=end_2.End)  # -> Arc, Plane, Radius; disabled
item_8 = ListItem(List=arc_2.Arc, Index=0, Wrap=True)  # disabled
project_2 = Project(Geometry=item_8, Plane=PlaneXY(0, 0, 0))  # -> Geometry, Transform; disabled
panel_16 = Panel("0")  # disabled
panel_17 = Panel("0.01")  # disabled
loft_opt_2 = LoftOptions(Closed=False, Adjust=False, Rebuild=0, Refit=panel_17, Type=0)  # disabled
replace_2 = ReplaceItems(List=arc_2.Arc, Item=project_2.Geometry, Indices=panel_16, Wrap=False)  # disabled
loft_5 = Loft(Curves=flip_4, Options=loft_opt_2)  # disabled
loft_6 = Loft(Curves=replace_2, Options=loft_opt_2)  # disabled
entwine_4 = Entwine(Branch00=loft_6, Branch01=loft_5, FlattenInputs=True)  # disabled
number_slider_19 = Slider(0.01, range=0..1)  # disabled
swatch_3 = ColourSwatch(SwatchColor=RGB(255, 255, 255))  # disabled
swatch_4 = ColourSwatch(SwatchColor=RGBA(189, 189, 189, 206))  # disabled
merge_6 = Merge(Data1=swatch_4, Data2=swatch_3)  # -> simplify(graft(Result)); disabled
python_2 = GhPythonScript(S=entwine_4, D=number_slider_19)  # -> simplify(a); inputs S: Brep; disabled; same code as python
brep_3 = Brep()  # disabled
volume_4 = Volume(Geometry=brep_3)  # -> Volume, Centroid; disabled
flatten_2 = FlattenTree(Tree=python_2, Path="{0}")  # disabled
move2pt_6 = MoveToPoint(Geometry=flatten_2, PointA=area_2.Centroid, PointB=graft(volume_4.Centroid))  # -> simplify(Moved), Vector, Transform; disabled
lng_2 = ListLength(List=move2pt_6.Moved)  # disabled
graft_2 = GraftTree(Tree=volume_4.Centroid, IncludeEmptyLists=True, IncludeNullItems=True)  # -> simplify(Tree); disabled
group_11 = Group(Objects=move2pt_6.Moved)  # disabled
split_3 = SplitList(List=move2pt_6.Moved, Index=expr("x/2", lng_2))  # -> flatten(ListA), flatten(ListB); disabled
mirror_2 = Mirror(Geometry=group_11, Plane=graft_2)  # -> Geometry, Transform; disabled
ungroup_2 = Ungroup(Group=mirror_2.Geometry)  # disabled
entwine_5 = Entwine(Branch00=split_3.ListA, Branch01=split_3.ListB, FlattenInputs=True)  # -> simplify(Result); disabled
split_4 = SplitList(List=ungroup_2, Index=expr("x/2", lng_2))  # -> flatten(ListA), flatten(ListB); disabled
entwine_6 = Entwine(Branch00=split_4.ListA, Branch01=split_4.ListB, FlattenInputs=True)  # -> simplify(Result); disabled
merge_7 = Merge(Data1=entwine_5, Data2=entwine_6)  # disabled

number_slider_20 = Slider(0.1, range=0..10)  # disabled
panel_18 = Panel("-1")  # disabled
Z_2 = UnitZ(Factor=expr("-x", number_slider_20))  # disabled
item_9 = ListItem(List=cir_2, Index=panel_18, Wrap=True)  # disabled
extr_2 = Extrude(Base=item_9, Direction=Z_2)  # disabled
cap_2 = CapHoles(Brep=extr_2)  # disabled

move2pt_7 = MoveToPoint(Geometry=cap_2, PointA=area_2.Centroid, PointB=graft(volume_4.Centroid))  # -> Moved, Vector, Transform; disabled

data_3 = Data([split_3.ListB, split_4.ListB])  # disabled
data_4 = Data([split_3.ListA, split_4.ListA])  # disabled

# ---- group: unit centroid
pt_6 = Point(volume_4.Centroid)  # disabled

# ----
debrep = DeconstructBrep(Brep=brep_3)  # -> Faces, Edges, Vertices; disabled
area_3 = Area(Geometry=debrep.Faces)  # -> Area, Centroid; disabled
panel_19 = Panel("""0
3""")  # disabled
item_10 = ListItem(List=flatten(area_3.Centroid), Index=panel_19, Wrap=True)  # disabled
panel_20 = Panel("22.5")  # disabled
rotate = Rotate(Geometry=item_10, Angle=degrees(panel_20), Plane=pt_6)  # -> Geometry, Transform; disabled
number_slider_21 = Slider(2, range=0..10)  # disabled
number_slider_22 = Slider(0, range=0..10)  # disabled
ln = Line(StartPoint=rotate.Geometry, EndPoint=pt_6)  # disabled
ext = ExtendCurve(Curve=ln, Type=0, Start=number_slider_21, End=number_slider_22)  # disabled
panel_21 = Panel("0.5")  # disabled
number_slider_23 = Slider(0.7, range=0..1)  # disabled
pframe = PerpFrame(Curve=reparameterize(ext), Parameter=panel_21)  # -> graft(Frame); disabled
pipe = Pipe(Curve=ext, Radius=1, Caps=0)  # disabled
scale_nu = ScaleNU(Geometry=pipe, Plane=pframe, ScaleX=1, ScaleY=number_slider_23, ScaleZ=1)  # -> Geometry, Transform; disabled
panel_22 = Panel(pframe)  # disabled
cap_3 = CapHoles(Brep=scale_nu.Geometry)  # disabled
mesh = Mesh(cap_3)  # disabled
number_slider_24 = Slider(0, range=0..100)  # disabled
msplit = MeshSplit(Splitters=flatten(mesh))  # disabled
item_11 = ListItem(List=msplit, Index=number_slider_24, Wrap=True)  # disabled

move2pt_8 = MoveToPoint(Geometry=data_3, PointA=pt_6, PointB=graft(pt))  # -> flatten(Moved), Vector, Transform; disabled
move2pt_9 = MoveToPoint(Geometry=data_4, PointA=pt_6, PointB=pt)  # -> flatten(Moved), Vector, Transform; disabled
move2pt_10 = MoveToPoint(PointA=pt_6, PointB=pt)  # -> flatten(Moved), Vector, Transform; disabled
merge_8 = Merge(Data1=move2pt_9.Moved, Data2=move2pt_8.Moved)  # disabled

number_slider_25 = Slider(1.2, range=0..2.02)  # disabled
number_slider_26 = Slider(4.2, range=1..13)  # disabled
number_slider_27 = Slider(3.7, range=0..6.002)  # disabled
number_slider_28 = Slider(1.5, range=1..2)  # disabled
range_7 = Range(Domain=number_slider_27, Steps=number_slider_28)  # disabled
range_8 = Range(Domain=Domain(0, 1), Steps=number_slider_28)  # disabled
graph_5 = GraphMapper(range_8, x0=0, x1=1, y0=0, y1=1, container_name="Bezier", cpx=[0, 0.5185281634, 1, 1], cpy=[0, 0, 0.1436586976, 1])  # disabled
pt_7 = ConstructPoint(XCoordinate=0, YCoordinate=0, ZCoordinate=range_7)  # disabled
panel_23 = Panel("0.5*pi")  # disabled
dom_5 = ConstructDomain(DomainStart=number_slider_26, DomainEnd=number_slider_25)  # disabled
bnd_5 = Bounds(Numbers=graph_5)  # disabled
prot_3 = RotatePlane(Plane=pt_7, Angle=panel_23)  # disabled
remap_5 = RemapNumbers(Value=graph_5, Source=bnd_5, Target=dom_5)  # -> Mapped, Clipped; disabled
cir_3 = Circle(Plane=prot_3, Radius=remap_5.Mapped)  # disabled
item_12 = ListItem(List=cir_3, Index=0, Wrap=True)  # disabled
number_slider_29 = Slider(8, range=0..50)  # disabled
area_4 = Area(Geometry=item_12)  # -> Area, Centroid; disabled
number_slider_30 = Slider(0.01, range=0..1)  # disabled
range_9 = Range(Domain=Domain(0, 1), Steps=number_slider_29)  # disabled
panel_24 = Panel("1")  # disabled
panel_25 = Panel("0")  # disabled
shatter_3 = Shatter(Curve=reparameterize(graft(cir_3)), Parameters=range_9)  # disabled
subtraction_3 = Subtraction(A=panel_24, B=number_slider_30)  # disabled
merge_9 = Merge(Data1=panel_25, Data2=number_slider_30, Data3=subtraction_3, Data4=panel_24)  # disabled
consec_3 = ConsecutiveDomains(Numbers=merge_9, Additive=invert(True))  # disabled
panel_26 = Panel(merge_9)  # disabled
subcrv_3 = SubCurve(BaseCurve=reparameterize(graft(shatter_3)), Domain=consec_3)  # disabled
panel_27 = Panel("""0
2""")  # disabled
panel_28 = Panel(consec_3)  # disabled
cull_i_4 = CullIndex(List=subcrv_3, Indices=panel_27, Wrap=True)  # -> simplify(List); disabled
item_13 = ListItem(List=subcrv_3, Index=panel_27, Wrap=True)  # disabled
pshift_5 = ShiftPaths(Data=cull_i_4, Offset=-1)  # disabled
flip_5 = FlipMatrix(Data=pshift_5)  # disabled
midpt_3 = CurveMiddle(Curve=flip_5)  # disabled
loft_7 = Loft(Curves=cir_3, Options={Adjust=False, Closed=False, LoftEnds=0, LoftSimp=0, LoftType=0, Rebuild=10, Refit=0.01})  # disabled
number_slider_31 = Slider(0.1, range=0..10)  # disabled
number_slider_32 = Slider(0.11, range=0..1)  # disabled
pshift_6 = ShiftPaths(Data=item_13, Offset=-1)  # disabled
graph_6 = GraphMapper(range_8, x0=0, x1=1, y0=0, y1=1, container_name="Bezier", cpx=[0, 0.25, 0.75, 1], cpy=[0, 0.25, 0.75, 1])  # disabled
join_3 = JoinCurves(Curves=pshift_6, Preserve=False)  # disabled
brep_cp_3 = BrepClosestPoint(Point=midpt_3, Brep=loft_7)  # -> Point, Normal, Distance; disabled
dom_6 = ConstructDomain(DomainStart=number_slider_31, DomainEnd=number_slider_32)  # disabled
flip_6 = FlipMatrix(Data=join_3)  # disabled
bnd_6 = Bounds(Numbers=graph_6)  # disabled
remap_6 = RemapNumbers(Value=graph_6, Source=bnd_6, Target=dom_6)  # -> Mapped, Clipped; disabled
amp_3 = Amplitude(Vector=brep_cp_3.Normal, Amplitude=remap_6.Mapped)  # disabled
rev_3 = Reverse(Vector=amp_3)  # disabled
end_3 = EndPoints(Curve=flip_5)  # -> Start, End; disabled
move_3 = Move(Geometry=midpt_3, Motion=rev_3)  # -> Geometry, Transform; disabled
arc_3 = Arc3Pt(PointA=end_3.Start, PointB=move_3.Geometry, PointC=end_3.End)  # -> Arc, Plane, Radius; disabled
item_14 = ListItem(List=arc_3.Arc, Index=0, Wrap=True)  # disabled
project_3 = Project(Geometry=item_14, Plane=PlaneXY(0, 0, 0))  # -> Geometry, Transform; disabled
panel_29 = Panel("0")  # disabled
panel_30 = Panel("0.01")  # disabled
loft_opt_3 = LoftOptions(Closed=False, Adjust=False, Rebuild=0, Refit=panel_30, Type=0)  # disabled
replace_3 = ReplaceItems(List=arc_3.Arc, Item=project_3.Geometry, Indices=panel_29, Wrap=False)  # disabled
loft_8 = Loft(Curves=flip_6, Options=loft_opt_3)  # disabled
loft_9 = Loft(Curves=replace_3, Options=loft_opt_3)  # disabled
entwine_7 = Entwine(Branch00=loft_9, Branch01=loft_8, FlattenInputs=True)  # disabled
number_slider_33 = Slider(0.01, range=0..1)  # disabled
swatch_5 = ColourSwatch(SwatchColor=RGB(255, 255, 255))  # disabled
swatch_6 = ColourSwatch(SwatchColor=RGBA(107, 107, 107, 206))  # disabled
merge_10 = Merge(Data1=swatch_6, Data2=swatch_5)  # -> simplify(graft(Result)); disabled
python_3 = GhPythonScript(S=entwine_7, D=number_slider_33)  # -> simplify(a); inputs S: Brep; disabled; same code as python
brep_4 = Brep()  # disabled
flatten_3 = FlattenTree(Tree=python_3, Path="{0}")  # disabled

number_slider_34 = Slider(0.1, range=0..10)  # disabled
panel_31 = Panel("-1")  # disabled
Z_3 = UnitZ(Factor=expr("-x", number_slider_34))  # disabled
item_15 = ListItem(List=cir_3, Index=panel_31, Wrap=True)  # disabled
extr_3 = Extrude(Base=item_15, Direction=Z_3)  # disabled
cap_4 = CapHoles(Brep=extr_3)  # disabled

item_16 = ListItem(List=flatten(brep_4), Index=0, Wrap=True)  # disabled

volume_5 = Volume(Geometry=item_16)  # -> Volume, Centroid; disabled
move2pt_11 = MoveToPoint(Geometry=flatten_3, PointA=area_4.Centroid, PointB=graft(volume_5.Centroid))  # -> simplify(Moved), Vector, Transform; disabled
lng_3 = ListLength(List=move2pt_11.Moved)  # disabled
graft_3 = GraftTree(Tree=volume_5.Centroid, IncludeEmptyLists=True, IncludeNullItems=True)  # -> simplify(Tree); disabled
group_12 = Group(Objects=move2pt_11.Moved)  # disabled
split_5 = SplitList(List=move2pt_11.Moved, Index=expr("x/2", lng_3))  # -> flatten(ListA), flatten(ListB); disabled
mirror_3 = Mirror(Geometry=group_12, Plane=graft_3)  # -> Geometry, Transform; disabled
ungroup_3 = Ungroup(Group=mirror_3.Geometry)  # disabled
move2pt_12 = MoveToPoint(Geometry=cap_4, PointA=area_4.Centroid, PointB=graft(volume_5.Centroid))  # -> Moved, Vector, Transform; disabled
entwine_8 = Entwine(Branch00=split_5.ListA, Branch01=split_5.ListB, FlattenInputs=True)  # -> simplify(Result); disabled
split_6 = SplitList(List=ungroup_3, Index=expr("x/2", lng_3))  # -> flatten(ListA), flatten(ListB); disabled
entwine_9 = Entwine(Branch00=split_6.ListA, Branch01=split_6.ListB, FlattenInputs=True)  # -> simplify(Result); disabled
merge_11 = Merge(Data1=entwine_8, Data2=entwine_9)  # disabled

volume_6 = Volume(Geometry=brep_4)  # -> Volume, Centroid; disabled
data_5 = Data([split_5.ListB, split_6.ListB])  # disabled
data_6 = Data([split_5.ListA, split_6.ListA])  # disabled
qrmesh_3 = QuadRemesh(Mesh=data_6, Settings={aqc=True, as=50, dhe=True, gci=0, null=False, pme=0, sa=0, tqc=2000})  # -> graft(QuadResult); disabled
qrmesh_4 = QuadRemesh(Mesh=data_5, Settings={aqc=True, as=50, dhe=True, gci=0, null=False, pme=0, sa=0, tqc=2000})  # disabled

# ---- group: units centroids
pt_8 = Point(flatten(volume_6.Centroid))  # disabled

# ---- group: unit centroid
pt_9 = Point(volume_5.Centroid)  # disabled

# ----
group_13 = Group(Objects=qrmesh_4)  # disabled
group_14 = Group(Objects=qrmesh_3)  # disabled
group_15 = Group(Objects=flatten([group_13, group_6]))  # disabled
move2pt_13 = MoveToPoint(Geometry=qrmesh_4, PointA=pt_9, PointB=graft(pt_8))  # -> flatten(Moved), Vector, Transform; disabled
move2pt_14 = MoveToPoint(Geometry=qrmesh_3, PointA=pt_9, PointB=pt_8)  # -> flatten(Moved), Vector, Transform; disabled
move2pt_15 = MoveToPoint(Geometry=[move2pt_12.Moved, qrmesh_4], PointA=pt_9, PointB=pt_8)  # -> flatten(Moved), Vector, Transform; disabled
merge_12 = Merge(Data1=move2pt_13.Moved, Data2=move2pt_15.Moved)  # disabled
