# Grasshopper definition BIMSC-24-RIR-Tutorial.gh (Grasshopper 1.0.7)
# plug-ins: Rhino.Inside for Autodesk Revit, eleFront, treesloth01, Bifocals

# //Send topo meshes to Revit
number_slider = Slider(9, range=0..10)
# //Send block instances to Revit
listblockd = ListBlocksInDocument(fullName=True)
panel = Panel(listblockd)
mesh = Mesh(<mesh referenced from the Rhino model>)
Y = UnitY(Factor=250)
refblock = ReferenceBlockByName(BlockName=listblockd, getNestedBlocks=False, lightweight=False)
categories = DirectShapeCategories("autodesk.revit.category.local:topography-1.0.0", SearchPattern="topo")
unweld = UnweldMesh(Mesh=mesh, Angle=degrees(number_slider))
move = Move(Geometry=mesh, Motion=Y)  # -> Geometry, Transform
item = ListItem(List=refblock, Index=0, Wrap=True)
block_info = GetBlockInfo(Block=item)  # -> Name, Plane, Transform, BlockType, FilePath, Active
topography = AddTopographyMesh(Mesh=unweld, TrackingMode=2)
g_shape = AddDirectShapeGeometry(Category=categories, Geometry=move.Geometry, TrackingMode=2)
orient = Orient(Geometry=item, Source=block_info.Plane, Target=PlaneXY(0, 0, 0))  # -> Geometry, Transform
expblock = ExplodeBlock(Block=orient.Geometry, recursive=False)  # -> Name, Transform, Geometry

# ----
# //Query materials' names using Elefront
geo = Geometry(expblock.Geometry)
ef_att = EleFrontAttributes(Attributes=geo)
ef_layer = EleFrontLayer(Layer=ef_att)
ef_layer_2 = EleFrontLayer(Layer=ef_layer)

materials = QueryMaterials(Name=ef_layer_2)

# ----
# 02// Create new component family
panel_2 = Panel("C:\Users\hesham.shawqy\OneDrive - Grimshaw Architects\HS\00_Transfer\BIMSC-RIR-Tutorial\FTemplate_GEN_.rft")
famform = ComponentFamilyForm(Brep=graft(geo), Material=materials)  # disabled
shift = ShiftPaths(Data=famform, Offset=-1)
new = NewComponentFamily(Template=panel_2, Overwrite=Toggle(True), Name=expblock.Name, Geometry=shift)  # disabled

# ----
# 03//Add components to RH Planes
types = QueryTypes(Kind=3, FamilyName=expblock.Name)  # disabled
block_info_2 = GetBlockInfo(Block=refblock)  # -> Name, Plane, Transform, BlockType, FilePath, Active
l_component = AddComponentLocation(Location=block_info_2.Plane, Type=types, TrackingMode=2)  # disabled

# ----
# 01 //Create Revit materials from Rhino M Properties
cset = CreateSet(List=flatten(ef_layer_2))  # -> Set, Map
material = AddMaterial(Name=cset.Set, TrackingMode=2)  # disabled

# ---- group: MaterialProperties
python = GhPythonScript(Mname=cset.Set)  # -> out, Pvalue, Pname
# ---------- python: Python ----------
__author__ = "hesham.shawqy"
__version__ = "2024.02.25"

import rhinoscriptsyntax as rs
import Rhino.DocObjects as rd
import Rhino as rh

def get_material_properties(Mname):
    # Get the active Rhino document
    doc = rh.RhinoDoc.ActiveDoc
    
    # Search for the material by name
    material_index = doc.Materials.Find(Mname, True)
    if material_index < 0:
        print("Material not found.")
        return None
    
    # Retrieve the material object
    material = doc.Materials[material_index]
    
    # Extract material properties
    properties = {
        "DiffuseColor": material.DiffuseColor,
        "Transparency": material.Transparency,
        # Add more properties as needed
    }
    
    return properties

Pname = []
Pvalue = []
material_properties = get_material_properties(Mname)
if material_properties:
    for prop, value in material_properties.items():
        Pvalue.append(value)
        Pname.append(prop)
# ---------- end python ----------

# ----
item_2 = ListItem(List=python.Pvalue, Index=0, Wrap=True)  # -> Item, Item1
graphics = MaterialGraphics(
    Material=graft(material),
    Color=item_2.Item,
    Transparency=item_2.Item1,
    ForegroundPatternCutPatterns=<geometry referenced from the Revit model>)  # -> Material, UseRenderAppearance, Color, Transparency, SurfacePatternsForegroundPattern, SurfacePatternsForegroundColor, CutPatternsForegroundPattern, CutPatternsForegroundColor; disabled
