# Grasshopper definition BIMSC-24-RIR-Tutorial_AR.gh (Grasshopper 1.0.7)
# plug-ins: Rhino.Inside for Autodesk Revit, eleFront, treesloth01

# ----
# 01 //Create Revit Materials from Rhino M Properties
trigger = Trigger(Interval=-1000, TimerInterval=1000, Target=[material, graphics])

# ----
# 02// Create New Unit Revit Family
trigger_2 = Trigger(Interval=-1000, TimerInterval=1000, Target=[famform, new, materials])

# ----
# The figures in the circles from the trigger component
# for the revit families to work have to be from left to right:
# a triangle (play), a pointer (mouse), and a key.
# //Send Topo Meshes to Revit
trigger_3 = Trigger(Interval=-1000, TimerInterval=1000, Target=topography)

# ----
# 03//Add Units to Revit
trigger_4 = Trigger(Interval=-1000, TimerInterval=1000, Target=[types, block_info_2, l_component])

# ----
# //Send topo meshes to Revit
number_slider = Slider(9, range=0..10)
mesh = Mesh(<mesh referenced from the Rhino model>)
unweld = UnweldMesh(Mesh=mesh, Angle=degrees(number_slider))
topography = AddTopographyMesh(Mesh=unweld, TrackingMode=2)

# ----
# //Send block instances to Revit
listblockd = ListBlocksInDocument(fullName=True)
refblock = ReferenceBlockByName(BlockName=listblockd, getNestedBlocks=False, lightweight=False, DisableAutoUpdate=False)
item = ListItem(List=refblock, Index=0, Wrap=True)
block_info = GetBlockInfo(Block=item)  # -> Name, Plane, Transform, BlockType, FilePath, Active
orient = Orient(Geometry=item, Source=block_info.Plane, Target=PlaneXY(0, 0, 0))  # -> Geometry, Transform
expblock = ExplodeBlock(Block=orient.Geometry, recursive=False)  # -> Name, Transform, Geometry

# ----
# //Query materials' names using Elefront
geo = Geometry(expblock.Geometry)
ef_att = EleFrontAttributes(Attributes=geo)
ef_layer = EleFrontLayer(Layer=ef_att)
ef_layer_2 = EleFrontLayer(Layer=ef_layer)

split = TextSplit(Text=ef_layer, Separators="::")
item_2 = ListItem(List=split, Index=-1, Wrap=True)
concat = Concatenate(FragmentA="M-", FragmentB=item_2)  # -> simplify(Result)
pshift = ShiftPaths(Data=concat, Offset=-1)

# ----
# 02// Create new component family
materials = QueryMaterials(Name=pshift)
panel = Panel("C:\Users\hesham.shawqy\OneDrive - Grimshaw Architects\HS\00_Transfer\BIMSC-RIR-Tutorial\FTemplate_GEN_.rft")
famform = ComponentFamilyForm(Brep=graft(geo), Material=materials)
shift = ShiftPaths(Data=famform, Offset=-1)
new = NewComponentFamily(Template=panel, Overwrite=Toggle(True), Name=simplify(expblock.Name), Geometry=simplify(shift))

# ----
# 03//Add components to RH Planes
types = QueryTypes(Kind=3, FamilyName=expblock.Name)
block_info_2 = GetBlockInfo(Block=refblock)  # -> Name, Plane, Transform, BlockType, FilePath, Active
l_component = AddComponentLocation(Location=simplify(block_info_2.Plane), Type=simplify(types), TrackingMode=2)

# ----
# 01 //Create Revit materials from Rhino M Properties
cset = CreateSet(List=flatten(pshift))  # -> Set, Map
material = AddMaterial(Name=cset.Set, TrackingMode=2)

# ---- group: MaterialProperties
python = GhPythonScript(Mname=cset.Set)  # -> out, Pvalue, Pname
# ---------- python: Python ----------
__author__ = "hesham.shawqy"
__version__ = "2024.02.25"

import rhinoscriptsyntax as rs
import Rhino.DocObjects as rd
import Rhino as rh

def get_material_properties(Mname):
    # Get the active Rhino document
    doc = rh.RhinoDoc.ActiveDoc
    
    # Search for the material by name
    material_index = doc.Materials.Find(Mname, True)
    if material_index < 0:
        print("Material not found.")
        return None
    
    # Retrieve the material object
    material = doc.Materials[material_index]
    
    # Extract material properties
    properties = {
        "DiffuseColor": material.DiffuseColor,
        "Transparency": material.Transparency,
        # Add more properties as needed
    }
    
    return properties

Pname = []
Pvalue = []
material_properties = get_material_properties(Mname)
if material_properties:
    for prop, value in material_properties.items():
        Pvalue.append(value)
        Pname.append(prop)
# ---------- end python ----------

# ----
item_3 = ListItem(List=simplify(python.Pvalue), Index=0, Wrap=True)  # -> Item, Item1
graphics = MaterialGraphics(
    Material=simplify(graft(material)),
    Color=item_3.Item,
    Transparency=item_3.Item1,
    ForegroundPatternCutPatterns=<geometry referenced from the Revit model>)  # -> Material, UseRenderAppearance, Color, Transparency, SurfacePatternsForegroundPattern, SurfacePatternsForegroundColor, CutPatternsForegroundPattern, CutPatternsForegroundColor
